# Grasshopper definition Chair.ghx (Grasshopper 0.9.76)

number_slider = Slider(330, range=100..1000)
number_slider_2 = Slider(564, range=0..1000)
number_slider_3 = Slider(30, range=10..40)
int = Integer(2)
subtraction = Subtraction(A=number_slider, B=number_slider_3)
subtraction_2 = Subtraction(A=number_slider_2, B=number_slider_3)
multiplication = Multiplication(A=number_slider_3, B=int)
rectangle = Rectangle(Plane=PlaneXY(0, 0, 0), XSize=number_slider, YSize=number_slider_2, Radius=0)  # -> Rectangle, Length
pt = ConstructPoint(XCoordinate=subtraction, YCoordinate=number_slider_3, ZCoordinate=0)
pt_2 = ConstructPoint(XCoordinate=subtraction, YCoordinate=subtraction_2, ZCoordinate=0)
neg = Negative(Value=number_slider_3)
boundary = BoundarySurfaces(Edges=rectangle.Rectangle)
dom = ConstructDomain(DomainStart=neg, DomainEnd=number_slider_3)
rectangle_2 = Rectangle(Plane=pt, XSize=dom, YSize=dom, Radius=0)  # -> Rectangle, Length
rectangle_3 = Rectangle(Plane=pt_2, XSize=dom, YSize=dom, Radius=0)  # -> Rectangle, Length
rectangle_4 = Rectangle(Plane=PlaneXY(0, 0, 0), XSize=number_slider, YSize=multiplication, Radius=0)  # -> Rectangle, Length
split = SplitBrep(Brep=boundary, Cutter=rectangle_2.Rectangle)
boundary_2 = BoundarySurfaces(Edges=rectangle_4.Rectangle)
dispatch = Dispatch(List=split, DispatchPattern=[True, False])  # -> ListA, ListB
split_2 = SplitBrep(Brep=dispatch.ListB, Cutter=rectangle_3.Rectangle)
Z = UnitZ(Factor=Slider(400, range=40..800))
Z_2 = UnitZ(Factor=Slider(400, range=40..800))
dispatch_2 = Dispatch(List=split_2, DispatchPattern=[True, False])  # -> ListA, ListB
Z_3 = UnitZ(Factor=Slider(35, range=10..80))
neg_2 = Negative(Value=Z_2)
neg_3 = Negative(Value=Z_3)
srf = Surface(dispatch.ListA)
srf_2 = Surface(dispatch_2.ListA)
srf_3 = Surface(dispatch_2.ListB)
split_3 = SplitBrep(Brep=boundary_2, Cutter=srf)
extr = Extrude(Base=[srf_2, srf], Direction=neg_2)
flatten = FlattenTree(Tree=extr, Path="{0}")
dispatch_3 = Dispatch(List=split_3, DispatchPattern=[True, False])  # -> ListA, ListB
dispatch_4 = Dispatch(List=flatten, DispatchPattern=[True, False])  # -> ListA, ListB
extr_2 = Extrude(Base=srf, Direction=Z)
srf_4 = Surface(dispatch_3.ListB)
brep = Brep(dispatch_4.ListA)
move = Move(Geometry=srf_4, Motion=Z)  # -> Geometry, Transform
Z_4 = UnitZ(Factor=Slider(73, range=10..200))
merge = Merge(Data1=extr_2, Data2=brep)
neg_4 = Negative(Value=Z_4)
sunion = SolidUnion(Breps=merge)
extr_3 = Extrude(Base=srf_3, Direction=neg_3)
extr_4 = Extrude(Base=move.Geometry, Direction=neg_4)
flatten_2 = FlattenTree(Tree=sunion, Path="{0}")
brep_2 = Brep(dispatch_4.ListB)
merge_2 = Merge(Data1=flatten_2, Data2=brep_2, Data3=extr_3, Data4=extr_4)
flatten_3 = FlattenTree(Tree=merge_2, Path="{0}")
mirror = Mirror(Geometry=flatten_3, Plane=PlaneYZ(0, 0, 0))  # -> Geometry, Transform
flatten_4 = FlattenTree(Tree=mirror.Geometry, Path="{0}")
merge_3 = Merge(Data1=flatten_3, Data2=flatten_4)
sunion_2 = SolidUnion(Breps=merge_3)
