# Grasshopper definition Cocoon-MetaBall.ghx (Grasshopper 0.9.76)
# plug-ins: MarchingCubes

panel = Panel("""3.5
6
4
4""")
pt = Point([Point(-5.226937371, 10.06211028, 8.141024126), Point(-2.919487942, 9.194295767, 2.500495747), Point(-7.69741049, 4.257591367, 0.2883095413), Point(1.012579976, 6.746542357, 5.967097054)])
num = Number(panel)
sph = Sphere(Base=pt, Radius=num)
pt_2 = Point(pt)
num_2 = Number(Slider(5, range=0..10))
num_3 = Number(num)
point_charge = PointCharge(Point=pt_2, Radius=num_3, ChargeStrength=num_2)
cocoon = Cocoon(
    Charges=point_charge,
    Iso=Slider(0.28, range=0..1),
    CellSize=Slider(2.4, range=0..10),
    Execute=Toggle(True),
    Simple=False)  # -> Mesh, RefinementData
mesh = Mesh(cocoon.Mesh)
data = Data(cocoon.RefinementData)
medges = MeshEdges(Mesh=mesh)  # -> NakedEdges, InteriorEdges, NonManifoldEdges
refine = Refine(
    RefinementData=data,
    Samples=Slider(3, range=0..10),
    SampleSize=Slider(1, range=0..1),
    SampleTolerance=Slider(0.01, range=0..0.01),
    LaplacianSmoothing=Slider(5, range=0..10),
    ValencePasses=Slider(3, range=0..10),
    SubD=Slider(2, range=0..10),
    Execute=Toggle(True))
panel_2 = Panel(refine)
preview = CustomPreview(Geometry=refine, Shader=ColourSwatch(SwatchColor=RGB(61, 142, 255)))
