# Grasshopper definition FabCafe-classA-1.ghx (Grasshopper 0.9.76)
# plug-ins: Python Interpreter

number_slider = Slider(153, range=1..250)
python = PythonScript(n=number_slider, h=Slider(45, range=1..45), r=Slider(9.95, range=1..15))  # -> out, a; inputs n: Int32
# ---------- python: Python ----------
import rhinoscriptsyntax as rs
import math

a=[]
for i in range(n):
    x=math.cos(i*0.1)*i*r
    y=math.sin(i*0.1)*i*r
    z=i*h
    
    p=rs.AddPoint(x,y,z)
    a.append(p)
# ---------- end python ----------
panel = Panel(python.a)
intcrv = Interpolate(Vertices=python.a, Degree=3, Periodic=False, KnotStyle=1)  # -> Curve, Length, Domain
number_slider_2 = Slider(198, range=100..300)
divlength = DivideLength(Curve=intcrv.Curve, Length=number_slider_2)  # -> Points, Tangents, Parameters
devec = DeconstructVector(Vector=divlength.Tangents)  # -> XComponent, YComponent, ZComponent
vec = VectorXYZ(XComponent=devec.XComponent, YComponent=devec.YComponent, ZComponent=0)  # -> Vector, Length
vdis = VectorDisplay(Anchor=divlength.Points, Vector=vec.Vector)
pl = ConstructPlane(Origin=divlength.Points, XAxis=vec.Vector, YAxis=Vector(0, 1, 0))

# ---- group: 2
int = Integer(2)

int_2 = Integer(2)

# ----
division = Division(A=number_slider_2, B=int_2)
division_2 = Division(A=Slider(434, range=0..1000), B=int)
neg = Negative(Value=division_2)
neg_2 = Negative(Value=division)
dom = ConstructDomain(DomainStart=neg, DomainEnd=division_2)
dom_2 = ConstructDomain(DomainStart=neg_2, DomainEnd=division)
panel_2 = Panel(dom_2)
rectangle = Rectangle(Plane=pl, XSize=dom_2, YSize=dom, Radius=0)  # -> Rectangle, Length
boundary = BoundarySurfaces(Edges=rectangle.Rectangle)
subtraction = Subtraction(A=division_2, B=Slider(20, range=0..20))
number_slider_3 = Slider(700, range=0..1000)
neg_3 = Negative(Value=subtraction)
offset = Offset(Curve=intcrv.Curve, Distance=subtraction, Plane=PlaneXY(0, 0, 0), Corners=1)
offset_2 = Offset(Curve=intcrv.Curve, Distance=neg_3, Plane=PlaneXY(0, 0, 0), Corners=1)
Z = UnitZ(Factor=number_slider_3)
pt = ConstructPoint(XCoordinate=0, YCoordinate=0, ZCoordinate=0)
move = Move(Geometry=offset, Motion=Z)  # -> Geometry, Transform
move_2 = Move(Geometry=offset_2, Motion=Z)  # -> Geometry, Transform
merge = Merge(Data1=move.Geometry, Data2=move_2.Geometry)
vec2pt = Vector2Pt(PointA=pt, PointB=pl, Unitize=False)  # -> Vector, Length
pt_2 = Point(pl)
number_slider_4 = Slider(20, range=0..100)
number_slider_5 = Slider(20, range=0..100)
devec_2 = DeconstructVector(Vector=vec2pt.Vector)  # -> XComponent, YComponent, ZComponent
vec_2 = VectorXYZ(XComponent=devec_2.XComponent, YComponent=devec_2.YComponent, ZComponent=0)  # -> Vector, Length
neg_4 = Negative(Value=number_slider_4)
neg_5 = Negative(Value=number_slider_5)
unit = UnitVector(Vector=vec_2.Vector)
dom_3 = ConstructDomain(DomainStart=number_slider_5, DomainEnd=neg_5)
dom_4 = ConstructDomain(DomainStart=number_slider_4, DomainEnd=neg_4)
amp = Amplitude(Vector=unit, Amplitude=subtraction)
neg_6 = Negative(Value=amp)
pframes = PerpFrames(Curve=merge, Count=number_slider, Align=True)  # -> Frames, Parameters
move_3 = Move(Geometry=pt_2, Motion=amp)  # -> Geometry, Transform
move_4 = Move(Geometry=pt_2, Motion=neg_6)  # -> Geometry, Transform
rectangle_2 = Rectangle(Plane=pframes.Frames, XSize=dom_3, YSize=dom_4, Radius=0)  # -> Rectangle, Length
lng = ListLength(List=rectangle_2.Rectangle)
merge_2 = Merge(Data1=move_3.Geometry, Data2=move_4.Geometry)
Z_2 = UnitZ(Factor=1)
line = LineSDL(Start=merge_2, Direction=Z_2, Length=number_slider_3)

# ---- group: Step
Z_3 = UnitZ(Factor=Slider(25, range=1..50))
extr = Extrude(Base=boundary, Direction=Z_3)

# ---- group: Side Column
pipe = Pipe(Curve=line, Radius=Slider(10, range=0..30), Caps=0)

# ---- group: Rails Pipe
number_slider_6 = Slider(20, range=0..30)  # disabled
pipe_2 = Pipe(Curve=[move.Geometry, move_2.Geometry], Radius=number_slider_6, Caps=0)  # disabled

# ---- group: Rails Loft
number_slider_7 = Slider(90, range=0..90)

# ----
series = Series(Start=0, Step=number_slider_7, Count=lng)
rad = Radians(Degrees=series)
rotate = Rotate(Geometry=rectangle_2.Rectangle, Angle=rad, Plane=pframes.Frames)  # -> Geometry, Transform

# ---- group: Rails Loft (continued)
loft = Loft(Curves=rotate.Geometry, Options={Adjust=False, Closed=False, LoftEnds=0, LoftSimp=0, LoftType=0, Rebuild=10, Refit=0.01})
