# Grasshopper definition FabCafe-classA-Homework-example.ghx (Grasshopper 0.9.76)

number_slider = Slider(47, range=0..100)
pt = ConstructPoint(XCoordinate=0, YCoordinate=0, ZCoordinate=0)
number_slider_2 = Slider(3, range=0..10)
number_slider_3 = Slider(360, range=0..1000)
num = Number(2)
Y = UnitY(Factor=-1)
multiplication = Multiplication(A=number_slider, B=num)
cir = Circle(Plane=PlaneXY(0, 0, 0), Radius=number_slider)
division = Division(A=number_slider_3, B=number_slider_2)
range = Range(Domain=number_slider_3, Steps=number_slider_2)
line = LineSDL(Start=pt, Direction=Y, Length=multiplication)
rev = ReverseList(List=range)
division_2 = Division(A=division, B=num)
cull_i = CullIndex(List=rev, Indices=0, Wrap=True)  # -> reverse(List)
rad = Radians(Degrees=cull_i)
rotate = Rotate(Geometry=line, Angle=rad, Plane=PlaneXY(0, 0, 0))  # -> Geometry, Transform
ccx = CurveCurve(CurveA=cir, CurveB=rotate.Geometry)  # -> Points, ParamsA, ParamsB
vec2pt = Vector2Pt(PointA=pt, PointB=simplify(ccx.Points), Unitize=False)  # -> Vector, Length
multiplication_2 = Multiplication(A=vec2pt.Vector, B=Slider(1.4, range=1..2))
move = Move(Geometry=cir, Motion=multiplication_2)  # -> Geometry, Transform
ccx_2 = CurveCurve(CurveA=move.Geometry, CurveB=cir)  # -> simplify(Points), ParamsA, ParamsB
pline = PolyLine(Vertices=ccx_2.Points, Closed=False)
centerpoint = CenterPoint(B=pline)
flatten = FlattenTree(Tree=move.Geometry, Path="{0}")
Z = UnitZ(Factor=1)
vec = Vector(pline)
trim = TrimWithRegion(Curve=flatten, Region=cir)  # -> Inside, Outside
pl = ConstructPlane(Origin=centerpoint, XAxis=vec, YAxis=Z)
rad_2 = Radians(Degrees=division_2)
boundary = BoundarySurfaces(Edges=cir)
crv = Curve(simplify(trim.Inside))
flatten_2 = FlattenTree(Tree=crv, Path="{0}")
mirror = Mirror(Geometry=crv, Plane=pl)  # -> Geometry, Transform
srfsplit = SurfaceSplit(Surface=boundary, Curves=flatten_2)
rotate_2 = Rotate(Geometry=crv, Angle=rad_2, Plane=pt)  # -> Geometry, Transform
rotate_3 = Rotate(Geometry=mirror.Geometry, Angle=rad_2, Plane=pt)  # -> Geometry, Transform
bang = ExplodeTree(Data=multiplication_2)  # -> Branch0, Branch1, Branch2
area = Area(Geometry=srfsplit)  # -> Area, Centroid
flatten_3 = FlattenTree(Tree=rotate_2.Geometry, Path="{0}")
merge = Merge()
sort = SortList(Keys=area.Area, ValuesA=srfsplit)  # -> Keys, reverse(ValuesA)
devec = DeconstructVector(Vector=bang.Branch0)  # -> XComponent, YComponent, ZComponent
devec_2 = DeconstructVector(Vector=bang.Branch1)  # -> XComponent, YComponent, ZComponent
neg = Negative(Value=devec.YComponent)
num_2 = Number(2)
item = ListItem(List=sort.ValuesA, Index=0, Wrap=True)
multiplication_3 = Multiplication(A=devec_2.XComponent, B=num_2)
crv_2 = Curve(item)
trim_2 = TrimWithRegion(Curve=flatten_3, Region=crv_2)  # -> Inside, Outside
crv_3 = Curve(trim_2.Outside)
flatten_4 = FlattenTree(Tree=crv, Path="{0}")
flatten_5 = FlattenTree(Tree=crv_3, Path="{0}")
series = Series(Start=0, Step=multiplication_3, Count=Slider(13, range=0..100))
series_2 = Series(Start=0, Step=neg, Count=Slider(20, range=0..100))
merge_2 = Merge(Data1=flatten_4, Data2=flatten_5)
X = UnitX(Factor=series)
Y_2 = UnitY(Factor=series_2)
group = Group(Objects=merge_2)
move_2 = Move(Geometry=group, Motion=bang.Branch1)  # -> Geometry, Transform
move_3 = Move(Geometry=move_2.Geometry, Motion=X)  # -> Geometry, Transform
move_4 = Move(Geometry=group, Motion=X)  # -> Geometry, Transform
merge_3 = Merge(Data1=move_3.Geometry, Data2=move_4.Geometry)
group_2 = Group(Objects=merge_3)
move_5 = Move(Geometry=group_2, Motion=Y_2)  # -> Geometry, Transform

# ==== cluster CenterPoint
B = ClusterInput()
box_corners = BoxCorners(Box=B)  # -> CornerA, CornerB, CornerC, CornerD, CornerE, CornerF, CornerG, CornerH
ln = Line(PointA=box_corners.CornerA, PointB=box_corners.CornerG)
eval = EvaluateCurve(Curve=ln, Parameter=0.5)  # -> Point, Tangent, Angle
P = ClusterOutput(eval.Point)
