# Grasshopper definition FabCafe-classC-2.ghx (Grasshopper 0.9.76)

number_slider = Slider(10, range=5..30)
crv = Curve(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)
number_slider_2 = Slider(2, range=0..10)
divlength = DivideLength(Curve=crv, Length=number_slider)  # -> Points, Tangents, Parameters
pl = ConstructPlane(Origin=divlength.Points, XAxis=divlength.Tangents, YAxis=Vector(0, 1, 0))
neg = Negative(Value=number_slider_2)
neg_2 = Negative(Value=number_slider)
dom = ConstructDomain(DomainStart=neg, DomainEnd=number_slider_2)
dom_2 = ConstructDomain(DomainStart=neg_2, DomainEnd=number_slider)
rectangle = Rectangle(Plane=pl, XSize=dom_2, YSize=dom, Radius=0)  # -> Rectangle, Length
dispatch = Dispatch(List=rectangle.Rectangle, DispatchPattern=[True, False])  # -> ListA, ListB
int = Integer(2)
number_slider_3 = Slider(4.7, range=0..10)
number_slider_4 = Slider(20, range=0..100)
multiplication = Multiplication(A=number_slider_3, B=int)
series = Series(Start=0, Step=multiplication, Count=number_slider_4)
series_2 = Series(Start=number_slider_3, Step=multiplication, Count=number_slider_4)
Z = UnitZ(Factor=series)
Z_2 = UnitZ(Factor=series_2)
graft = GraftTree(Tree=Z, IncludeEmptyLists=True, IncludeNullItems=True)
graft_2 = GraftTree(Tree=Z_2, IncludeEmptyLists=True, IncludeNullItems=True)
Z_3 = UnitZ(Factor=number_slider_3)
move = Move(Geometry=dispatch.ListA, Motion=graft)  # -> Geometry, Transform
move_2 = Move(Geometry=dispatch.ListB, Motion=graft_2)  # -> Geometry, Transform
merge = Merge(Data1=move.Geometry, Data2=move_2.Geometry)
boundary = BoundarySurfaces(Edges=merge)
extr = Extrude(Base=boundary, Direction=Z_3)
flatten = FlattenTree(Tree=extr, Path="{0}")
bbox = BoundingBox(Content=flatten, Plane=PlaneXY(0, 0, 0), UnionBox=True)  # -> Box, Box_2
int_2 = Integer(8)
debrep = DeconstructBrep(Brep=bbox.Box)  # -> Faces, Edges, Vertices
item = ListItem(List=debrep.Edges, Index=int_2, Wrap=True)
Z_4 = UnitZ(Factor=item)
area = Area(Geometry=extr)  # -> Area, Centroid
extr_2 = Extrude(Base=crv, Direction=Z_4)
srf_cp = SurfaceClosestPoint(Point=area.Centroid, Surface=reparameterize(extr_2))  # -> Point, UVPoint, Distance
pdecon = Deconstruct(Point=srf_cp.UVPoint)  # -> XComponent, YComponent, ZComponent
panel = Panel(srf_cp.UVPoint)
pt = ConstructPoint(XCoordinate=pdecon.YComponent, YCoordinate=pdecon.XComponent, ZCoordinate=0)
flatten_2 = FlattenTree(Tree=<missing>, Path="{0}")
dom_3 = ConstructDomain(DomainStart=Slider(30, range=0..100), DomainEnd=Slider(1, range=0..1))
bnd = Bounds(Numbers=flatten_2)
remap = RemapNumbers(Value=<missing>, Source=bnd, Target=dom_3)  # -> Mapped, Clipped
rad = Radians(Degrees=remap.Mapped)
rotate = Rotate(Geometry=extr, Angle=rad, Plane=area.Centroid)  # -> Geometry, Transform
