# Grasshopper definition FabCafe-classE-2.ghx (Grasshopper 0.9.76)
# plug-ins: Python Interpreter

panel = Panel("AddSphere")
panel_2 = Panel("Pattern")
panel_3 = Panel("Function")
panel_4 = Panel("""Class

function1 + function2""")
pt = ConstructPoint(XCoordinate=0, YCoordinate=0, ZCoordinate=0)
pt_2 = ConstructPoint(XCoordinate=0, YCoordinate=0, ZCoordinate=0)
pt_3 = ConstructPoint(XCoordinate=0, YCoordinate=0, ZCoordinate=0)
python = PythonScript(
    obj=pt_2,
    x=Slider(10, range=1..20),
    y=Slider(10, range=1..20),
    z=Slider(10, range=1..20),
    width=Slider(7.6, range=0..10))  # -> out, a; inputs x: Int32, y: Int32, z: Int32
# ---------- python: Python ----------
import rhinoscriptsyntax as rs

List=[]

for i in range(x):
    for n in range(y):
        for u in range(z):
            tempObj=rs.CopyObject(obj)
            rs.MoveObject(tempObj,[i*width,n*width,u*width])
            List.append(tempObj)
a=List
# ---------- end python ----------
python_2 = PythonScript(pos=pt_3, rad=Slider(100, range=0..100))  # -> out, a, b, c
# ---------- python_2: Python ----------
import rhinoscriptsyntax as rs

## Class Template
class Ball:
    ## Must Function (Initialize)
    def __init__(self,_position,_radius):  
        self.pos= _position
        self.radius= _radius
        self.object= rs.AddSphere(self.pos,self.radius)
        
    def Display(self):
        return rs.AddSphere(self.pos,self.radius)

ball1 = Ball(pos,rad)

## Use Objict
## a = ball1.object

## Use Display
a = ball1.Display()

b = ball1.radius
c = ball1.pos
# ---------- end python_2 ----------
python_3 = PythonScript(x=pt, y=Slider(100, range=0..100))  # -> out, a; inputs y: Int32
# ---------- python_3: Python ----------
import rhinoscriptsyntax as rs

a=rs.AddSphere(x,y)
# ---------- end python_3 ----------
python_4 = PythonScript(x=Slider(8, range=1..10))  # -> out, a; inputs x: Int32
# ---------- python_4: Python ----------
import rhinoscriptsyntax as rs

List = []

## Function
## Make Original Functoin

def MakeGrid(pos):
    for i in range(x):
        for j in range(x):
            pt = rs.VectorAdd(pos,[10*i,10*j,0])
            pt2 = rs.AddPoint(pt)
            ## Same Name OK
            List.append(pt2)

MakeGrid([4,4,4])
MakeGrid([60,-30,30])
MakeGrid([-50,0,-30])

a=List
# ---------- end python_4 ----------
panel_5 = Panel(python_3.out)
panel_6 = Panel(python_3.a)
panel_7 = Panel(python_2.out)
panel_8 = Panel(python.out)
panel_9 = Panel(python.a)
panel_10 = Panel(python_2.a)
panel_11 = Panel(python_2.b)
panel_12 = Panel(python_2.c)
