# Grasshopper definition FabCafe-classE-3.ghx (Grasshopper 0.9.76)
# plug-ins: Python Interpreter

panel = Panel("Animation")
panel_2 = Panel("""インスタンス

不明な形式""")
pt = ConstructPoint(XCoordinate=0, YCoordinate=0, ZCoordinate=0)
panel_3 = Panel("1:30:00~")
pt_2 = ConstructPoint(XCoordinate=Slider(10, range=0..10), YCoordinate=Slider(10, range=0..10), ZCoordinate=Slider(10, range=0..10))
python = PythonScript(pos=pt, rad=Slider(100, range=0..100))  # -> out, a
# ---------- python: Python ----------
import rhinoscriptsyntax as rs

## Class Template
class Ball:
    ## Must Function (Initialize)
    def __init__(self,_position,_radius):  
        self.pos= _position
        self.radius= _radius
        self.object= rs.AddSphere(self.pos,self.radius)
        
    def Display(self):
        return rs.AddSphere(self.pos,self.radius)

ball1 = Ball(pos,rad)

a = ball1
# ---------- end python ----------
panel_4 = Panel(python.a)
python_2 = PythonScript(pos=pt_2, rad=Slider(31, range=0..100))  # -> out, a; inputs pos: Point3d
# ---------- python_2: Python ----------
import rhinoscriptsyntax as rs

## Class Template
class Ball:
    ## Must Function (Initialize)
    def __init__(self,_position,_radius):  
        self.pos= _position
        self.radius= _radius
        self.object= rs.AddSphere(self.pos,self.radius)

    def follow(self,target,speed):
        vec2pt = target-self.pos
        vec2pt = rs.VectorUnitize(vec2pt)
        vec2pt = vec2pt*speed
        self.pos = self.pos + vec2pt
        self.object = rs.AddSphere(self.pos,self.radius)

ball = Ball(pos,rad)

a = ball
# ---------- end python_2 ----------
panel_5 = Panel(python_2.out)
panel_6 = Panel("クラスの引継ぎができる")
python_3 = PythonScript(ball=python.a)  # -> out, a
# ---------- python_3: Python ----------
import rhinoscriptsyntax as rs

a = ball.radius
# ---------- end python_3 ----------
panel_7 = Panel(python_2.a)
pt_3 = Point(Point(165.3823518, -38.09091614, 230.3422922))
panel_8 = Panel(python_3.out)
timer = Timer(TimerInterval=20, Target=python_4)  # disabled
python_4 = PythonScript(ball=python_2.a, target=pt_3, speed=Slider(3.3, range=0..10))  # -> out, a; inputs target: Point3d
# ---------- python_4: Python ----------
import rhinoscriptsyntax as rs

ball.follow(target,speed)

a = ball.object
# ---------- end python_4 ----------
panel_9 = Panel(python_3.a)
