# Grasshopper definition GrasshopperBake-with-ghPython.ghx (Grasshopper 0.9.76)
# plug-ins: Python Interpreter

box = CenterBox(Base=PlaneXY(0, 0, 0), X=1, Y=1, Z=1)
cyl = Cylinder(Base=PlaneXY(0, 0, 0), Radius=0.5, Length=1)
sph = Sphere(Base=PlaneXY(0, 0, 0), Radius=1)
cone = Cone(Base=PlaneXY(0, 0, 0), Radius=0.5, Length=1)  # -> Cone, Tip
ellipse = Ellipse(Plane=PlaneXY(0, 0, 0), Radius1=1, Radius2=1)  # -> Ellipse, Focus1, Focus2
brep = Brep(sph)
python = PythonScript(brep=brep, bake=Toggle(False))  # -> out; inputs brep: Brep
# ---------- python: Python ----------
# bake surfaces with simple materials
# input type - bool (Toggle)
import Rhino
import scriptcontext as sc

sc.doc = Rhino.RhinoDoc.ActiveDoc

out = bake

if bake:
    Br = brep
    sc.doc.Objects.AddBrep(Br)
    print "Baked!!"
# ---------- end python ----------
panel = Panel(python)
