# Grasshopper definition Group-01.ghx (Grasshopper 0.9.76)

series = Series(Start=0, Step=1, Count=10)
construct_point = ConstructPoint(XCoordinate=series, YCoordinate=0, ZCoordinate=0)
unit_y = UnitY(Factor=series)
group = Group(Objects=construct_point)
move = Move(Geometry=group, Motion=unit_y)  # -> Geometry, Transform
unit_z = UnitZ(Factor=series)
group_2 = Group(Objects=move.Geometry)
param_viewer = ParamViewer(move.Geometry)
move_2 = Move(Geometry=group_2, Motion=unit_z)  # -> Geometry, Transform
param_viewer_2 = ParamViewer(group_2)
ungroup = Ungroup(Group=move_2.Geometry)
ungroup_2 = Ungroup(Group=ungroup)
ungroup_3 = Ungroup(Group=ungroup_2)
param_viewer_3 = ParamViewer(move_2.Geometry)
param_viewer_4 = ParamViewer(ungroup)
param_viewer_5 = ParamViewer(ungroup_2)
param_viewer_6 = ParamViewer(ungroup_3)
flatten_tree = FlattenTree(Tree=ungroup_3, Path="{0}")
list_length = ListLength(List=flatten_tree)
panel = Panel(list_length)
