# Grasshopper definition ImageSampler-01.ghx (Grasshopper 0.9.76)

number_slider = Slider(50, range=10..50)
rec_2pt = Rectangle2Pt(Plane=PlaneXY(0, 0, 0), PointA="0, 0, 0", PointB="1, 1, 0", Radius=0)  # -> Rectangle, Length
ln = Line(StartPoint="0, 0, 0", EndPoint="1, 1, 0")
curvepoint = PointOnCurve(ln, parameter=0.5)
boundary = BoundarySurfaces(Edges=rec_2pt.Rectangle)
arrrec = RectangularArray(Geometry=boundary, Cell=rec_2pt.Rectangle, XCount=number_slider, YCount=number_slider)  # -> Geometry, Transform
arrrec_2 = RectangularArray(Geometry=curvepoint, Cell=rec_2pt.Rectangle, XCount=number_slider, YCount=number_slider)  # -> Geometry, Transform
pdecon = Deconstruct(Point=arrrec_2.Geometry)  # -> XComponent, YComponent, ZComponent
bnd = Bounds(Numbers=pdecon.XComponent)
bnd_2 = Bounds(Numbers=pdecon.YComponent)
remap = RemapNumbers(Value=pdecon.XComponent, Source=bnd, Target=" 0 to 1")  # -> Mapped, Clipped
remap_2 = RemapNumbers(Value=pdecon.YComponent, Source=bnd_2, Target=" 0 to 1")  # -> Mapped, Clipped
pt = ConstructPoint(XCoordinate=remap.Mapped, YCoordinate=remap_2.Mapped, ZCoordinate=0)
image = ImageSampler(
    pt,
    FilePath="C:\Users\yoshioca\Documents\image-sampler\Image-Sample.jpg",
    Filter="Colour",
    Interpolate=False,
    Umax=1,
    Umin=0,
    Vmax=1,
    Vmin=0,
    Wrap=1)
pdecon_2 = Deconstruct(Point=image)  # -> XComponent, YComponent, ZComponent
bnd_3 = Bounds(Numbers=pdecon_2.ZComponent)
remap_3 = RemapNumbers(Value=pdecon_2.ZComponent, Source=bnd_3, Target="0 to 1")  # -> Mapped, Clipped
larger = LargerThan(FirstNumber=remap_3.Mapped, SecondNumber=Slider(0.66, range=0..1))  # -> LargerThan, OrEqualTo
frgb = ColourRGBF(Alpha=1, Red=pdecon_2.XComponent, Green=pdecon_2.YComponent, Blue=pdecon_2.ZComponent)
dispatch = Dispatch(List=arrrec.Geometry, DispatchPattern=larger.LargerThan)  # -> ListA, ListB
preview = CustomPreview(Geometry=arrrec.Geometry, Shader=frgb)
brep = Brep(dispatch.ListA)
