# Grasshopper definition ImageSampler-02.ghx (Grasshopper 0.9.76)

number_slider = Slider(2.3, range=0.1..10)
_2 = Integer(2)
multiplication = Multiplication(A=number_slider, B=_2)
series = Series(Start=0, Step=multiplication, Count=Slider(36, range=10..50))
pt = ConstructPoint(XCoordinate=0, YCoordinate=0, ZCoordinate=0)
X = UnitX(Factor=series)
Y = UnitY(Factor=series)
move = Move(Geometry=pt, Motion=X)  # -> Geometry, Transform
graft = GraftTree(Tree=Y, IncludeEmptyLists=True, IncludeNullItems=True)
move_2 = Move(Geometry=move.Geometry, Motion=graft)  # -> Geometry, Transform
flatten = FlattenTree(Tree=move_2.Geometry, Path="{0}")
pdecon = Deconstruct(Point=flatten)  # -> XComponent, YComponent, ZComponent
dom = ConstructDomain(DomainStart=0, DomainEnd=1)
bnd = Bounds(Numbers=pdecon.XComponent)
bnd_2 = Bounds(Numbers=pdecon.YComponent)
remap = RemapNumbers(Value=pdecon.XComponent, Source=bnd, Target=dom)  # -> Mapped, Clipped
remap_2 = RemapNumbers(Value=pdecon.YComponent, Source=bnd_2, Target=dom)  # -> Mapped, Clipped
pt_2 = ConstructPoint(XCoordinate=remap.Mapped, YCoordinate=remap_2.Mapped, ZCoordinate=0)
panel = Panel(pt_2)
image = ImageSampler(
    pt_2,
    FilePath="C:\Users\yoshioca\Documents\image-sampler\Image_Sample_Gradation2.jpg",
    Filter="Colour",
    Interpolate=False,
    Umax=1,
    Umin=0,
    Vmax=1,
    Vmin=0,
    Wrap=1)
panel_2 = Panel(image)
pdecon_2 = Deconstruct(Point=image)  # -> XComponent, YComponent, ZComponent
num = Number(pdecon_2.ZComponent)
dom_2 = ConstructDomain(DomainStart=0, DomainEnd=number_slider)
bnd_3 = Bounds(Numbers=num)
remap_3 = RemapNumbers(Value=num, Source=bnd_3, Target=dom_2)  # -> Mapped, Clipped
cir = Circle(Plane=flatten, Radius=remap_3.Mapped)
