# Grasshopper definition Make-Script-RhinoPy-iGeo-p5.ghx (Grasshopper 0.9.76)

crv = Curve([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])
end = EndPoints(Curve=crv)  # -> Start, End
pdecon = Deconstruct(Point=end.End)  # -> XComponent, YComponent, ZComponent
pdecon_2 = Deconstruct(Point=end.Start)  # -> XComponent, YComponent, ZComponent
int = Integer(graft(pdecon_2.XComponent))
int_2 = Integer(graft(pdecon.XComponent))
int_3 = Integer(graft(pdecon.YComponent))
int_4 = Integer(graft(pdecon_2.YComponent))
int_5 = Integer(graft(pdecon_2.ZComponent))
int_6 = Integer(graft(pdecon.ZComponent))
panel = Panel("""Add3DPt({0},{1},{2});
EndPoly3D;""")
panel_2 = Panel("""BeginPoly3D;
Add3DPt({0},{1},{2});""")
txt = Text(panel_2)
txt_2 = Text(panel)
txt_3 = Text("[{0},{1},{2}]")
lng = ListLength(List=pdecon.XComponent)
format = Format(Format=txt, Culture=127, Data0=int, Data1=int_4, Data2=int_5)
format_2 = Format(Format=txt_2, Culture=127, Data0=int_2, Data1=int_3, Data2=int_6)
txt_4 = Text("({0},{1},{2})")
series = Series(Start=0, Step=1, Count=lng)
viewer = ParamViewer(format)
format_3 = Format(Format=txt_3, Culture=127, Data0=int, Data1=int_4, Data2=int_5)
panel_3 = Panel(end.Start)
merge = Merge(Data1=format, Data2=format_2)
format_4 = Format(Format=txt_3, Culture=127, Data0=int_2, Data1=int_3, Data2=int_6)
int_7 = Integer(graft(series))
format_5 = Format(Format=txt_4, Culture=127, Data0=int, Data1=int_4, Data2=int_5)
txt_5 = Text(graft(format_3))
format_6 = Format(Format=txt_4, Culture=127, Data0=int_2, Data1=int_3, Data2=int_6)
txt_6 = Text(graft(format_4))
flatten = FlattenTree(Tree=merge, Path="{0}")
txt_7 = Text(graft(format_5))
viewer_2 = ParamViewer(merge)
panel_4 = Panel(txt_5)
txt_8 = Text(graft(format_6))
panel_5 = Panel(flatten)
format_7 = Format(Format="rs.AddPipe(line{0},0,75,2,2)", Culture=127, Data0=int_7)
format_8 = Format(Format="line{0} = rs.AddLine({1},{2})", Culture=127, Data0=int_7, Data1=txt_5, Data2=txt_6)
flatten_2 = FlattenTree(Tree=format_8, Path="{0}")
flatten_3 = FlattenTree(Tree=format_7, Path="{0}")
format_9 = Format(Format="IG.pipe(curve{0},75);", Culture=127, Data0=int_7)
viewer_3 = ParamViewer(flatten_2)
panel_6 = Panel(flatten_2)
viewer_4 = ParamViewer(flatten_3)
panel_7 = Panel(flatten_3)
format_10 = Format(Format="ICurve curve{0} = new ICurve(new IVec{1},new IVec{2});", Culture=127, Data0=int_7, Data1=txt_7, Data2=txt_8)
panel_8 = Panel(format_10)
flatten_4 = FlattenTree(Tree=format_9, Path="{0}")
viewer_5 = ParamViewer(flatten_4)
flatten_5 = FlattenTree(Tree=format_10, Path="{0}")
panel_9 = Panel(flatten_4)

# ---- group: Make RhinoPython
merge_2 = Merge(Data1="import rhinoscriptsyntax as rs", Data2=flatten_2, Data3=flatten_3)

# ----
viewer_6 = ParamViewer(flatten_5)
panel_10 = Panel(flatten_5)
panel_11 = Panel("""import processing.opengl.*;
import igeo.*;

size(960,720,IG.GL);""")

# ---- group: copy all contents
panel_12 = Panel(merge_2)

# ---- group: Make processing with igeo
merge_3 = Merge(Data1=panel_11, Data2=flatten_5, Data3="// IG.pipe(profile, Radius);", Data4=flatten_4)

# ----
panel_13 = Panel(""".py

command editPythonScript""")

# ---- group: copy all contents
panel_14 = Panel(merge_3)

# ----
panel_15 = Panel(""".pde

processing IDE""")
