# Grasshopper definition UDP-Receiver.gh (Grasshopper 0.9.76)
# plug-ins: gHowl

udp = UDPReceiver(Address="127.0.0.1", Port=Slider(1192, range=0..10000), Pattern="999")  # -> Info, Data
panel = Panel(udp.Data)
