# Grasshopper definition UDP-Sender.gh (Grasshopper 0.9.76)
# plug-ins: Python Interpreter, Firefly.X

panel = Panel("Slider/")
number_slider = Slider(9998, range=0..10000)
series = Series(Start=0, Step=1, Count=10)
lng = ListLength(List=series)
panel_2 = Panel(series)
python = PythonScript(x=series, y=lng)  # -> out, a; inputs x: tree, y: Int32
# ---------- python: Python ----------
a = []

for i in range(y):
    a.append(i)
# ---------- end python ----------
python_2 = PythonScript(x=Slider(60, range=0..100), y=Slider(61, range=0..100))  # -> out, a
# ---------- python_2: Python ----------
a = str(x) + ", " + str(y)
# ---------- end python_2 ----------
txt = Text(Slider(49, range=0..100))
txt_2 = Text(python_2.a)
filter = StreamFilter(Gate=Slider(2, range=0..2), Stream0="Hello OSC", Stream1=txt, Stream2=txt_2)
panel_3 = Panel(python.a)
txt_3 = Text(Slider(652, range=0..1000))
txt_4 = Text(filter)
osc_sender = OSCSender(Data=txt_4, IPAddressOfUDPServer="127.0.0.1", UDPPort=number_slider)
osc_sender_2 = OSCSender(Data=txt_3, IPAddressOfUDPServer="127.0.0.1", UDPPort=number_slider)
