# Grasshopper definition Pattern-Circle-01.ghx (Grasshopper 0.9.76)

number_slider = Slider(10, range=1..100)
multiplication = Multiplication(A=number_slider, B=Slider(2, range=0..10))
pt = ConstructPoint(XCoordinate=multiplication, YCoordinate=multiplication, ZCoordinate=0)
pt_2 = ConstructPoint(XCoordinate=0, YCoordinate=0, ZCoordinate=0)
cir = Circle(Plane=PlaneXY(0, 0, 0), Radius=number_slider)
rec_2pt = Rectangle2Pt(Plane=PlaneXY(0, 0, 0), PointA=pt_2, PointB=pt, Radius=0)  # -> Rectangle, Length
number_slider_2 = Slider(10, range=0..10)
vec = VectorXYZ(XComponent=number_slider, YComponent=number_slider, ZComponent=0)  # -> Vector, Length
arrrec = RectangularArray(Geometry=cir, Cell=rec_2pt.Rectangle, XCount=number_slider_2, YCount=number_slider_2)  # -> Geometry, Transform
move = Move(Geometry=arrrec.Geometry, Motion=vec.Vector)  # -> Geometry, Transform
merge = Merge(Data1=arrrec.Geometry, Data2=move.Geometry)
