# Grasshopper definition Pattern-Pen-Saki-01.ghx (Grasshopper 0.9.76)

number_slider = Slider(15, range=0..100)
X = UnitX(Factor=number_slider)
Y = UnitY(Factor=Slider(45, range=0..100))
neg = Negative(Value=Y)
pt = ConstructPoint(XCoordinate=0, YCoordinate=0, ZCoordinate=0)
move = Move(Geometry=pt, Motion=X)  # -> Geometry, Transform
move_2 = Move(Geometry=move.Geometry, Motion=Y)  # -> Geometry, Transform
move_3 = Move(Geometry=move_2.Geometry, Motion=X)  # -> Geometry, Transform
move_4 = Move(Geometry=move_3.Geometry, Motion=Y)  # -> Geometry, Transform
move_5 = Move(Geometry=move_4.Geometry, Motion=X)  # -> Geometry, Transform
move_6 = Move(Geometry=move_5.Geometry, Motion=neg)  # -> Geometry, Transform
move_7 = Move(Geometry=move_6.Geometry, Motion=X)  # -> Geometry, Transform
move_8 = Move(Geometry=move_7.Geometry, Motion=neg)  # -> Geometry, Transform
number_slider_2 = Slider(1, range=0..100)
pline = PolyLine(
    Vertices=[pt, move.Geometry, move_2.Geometry, move_3.Geometry, move_4.Geometry, move_5.Geometry, move_6.Geometry, move_7.Geometry, move_8.Geometry],
    Closed=False)
vec2pt = Vector2Pt(PointA=pt, PointB=move_8.Geometry, Unitize=False)  # -> Vector, Length
devec = DeconstructVector(Vector=vec2pt.Vector)  # -> XComponent, YComponent, ZComponent
series = Series(Start=0, Step=devec.XComponent, Count=Slider(23, range=0..100))
X_2 = UnitX(Factor=series)
multiplication = Multiplication(A=Y, B=Slider(3, range=0..10))
multiplication_2 = Multiplication(A=number_slider, B=Slider(2, range=0..10))
multiplication_3 = Multiplication(A=Y, B=Slider(6, range=0..10))
move_9 = Move(Geometry=pline, Motion=X_2)  # -> Geometry, Transform
vec = VectorXYZ(XComponent=multiplication_2, YComponent=multiplication, ZComponent=0)  # -> Vector, Length
series_2 = Series(Start=multiplication_3, Step=multiplication_3, Count=Slider(5, range=0..10))  # -> graft(Series)
move_10 = Move(Geometry=move_9.Geometry, Motion=vec.Vector)  # -> Geometry, Transform
vec_2 = VectorXYZ(XComponent=0, YComponent=series_2, ZComponent=0)  # -> Vector, Length
merge = Merge(Data1=move_9.Geometry, Data2=move_10.Geometry)
join = JoinCurves(Curves=merge, Preserve=False)
move_11 = Move(Geometry=join, Motion=vec_2.Vector)  # -> Geometry, Transform
merge_2 = Merge(Data1=join, Data2=move_11.Geometry)
