# Grasshopper definition Pattern-T-01.ghx (Grasshopper 0.9.76)

y = Slider(206, range=1..300)
x = Slider(279, range=1..300)
panel = Panel("x>y")
addition = Addition(A=x, B=y)
multiplication = Multiplication(A=x, B=Slider(4, range=0..10))
multiplication_2 = Multiplication(A=x, B=Slider(2, range=0..10))
vec = VectorXYZ(XComponent=x, YComponent=0, ZComponent=0)  # -> Vector, Length
vec_2 = VectorXYZ(XComponent=0, YComponent=y, ZComponent=0)  # -> Vector, Length
vec_3 = VectorXYZ(XComponent=y, YComponent=y, ZComponent=0)  # -> Vector, Length
vec_4 = VectorXYZ(XComponent=0, YComponent=x, ZComponent=0)  # -> Vector, Length
vec_5 = VectorXYZ(XComponent=0, YComponent=addition, ZComponent=0)  # -> Vector, Length
pt = ConstructPoint(XCoordinate=0, YCoordinate=0, ZCoordinate=0)
move = Move(Geometry=pt, Motion=vec.Vector)  # -> Geometry, Transform
move_2 = Move(Geometry=pt, Motion=vec_2.Vector)  # -> Geometry, Transform
move_3 = Move(Geometry=pt, Motion=vec_3.Vector)  # -> Geometry, Transform
move_4 = Move(Geometry=move_3.Geometry, Motion=vec_4.Vector)  # -> Geometry, Transform
move_5 = Move(Geometry=move.Geometry, Motion=vec_5.Vector)  # -> Geometry, Transform
subtraction = Subtraction(A=x, B=y)
multiplication_3 = Multiplication(A=x, B=Slider(4, range=0..10))
multiplication_4 = Multiplication(A=addition, B=Slider(2, range=0..10))
multiplication_5 = Multiplication(A=x, B=Slider(2, range=0..10))
multiplication_6 = Multiplication(A=subtraction, B=Slider(2, range=0..10))
vec_6 = VectorXYZ(XComponent=multiplication_3, YComponent=y, ZComponent=0)  # -> Vector, Length
pline = PolyLine(Vertices=[move.Geometry, pt, move_2.Geometry, move_3.Geometry, move_4.Geometry, move_5.Geometry], Closed=False)
panel_2 = Panel(multiplication_5)
ln = Line(StartPoint=move.Geometry, EndPoint=move_5.Geometry)
addition_2 = Addition(A=multiplication_4, B=multiplication_6)
move_6 = Move(Geometry=pt, Motion=vec_6.Vector)  # -> Geometry, Transform
mirror = MirrorCurve(Geometry=pline, Curve=ln, Tangent=True)
vec_7 = VectorXYZ(XComponent=0, YComponent=0, ZComponent=0)  # -> Vector, Length
pt_2 = ConstructPoint(XCoordinate=multiplication_5, YCoordinate=multiplication_2, ZCoordinate=0)
vec_8 = VectorXYZ(XComponent=multiplication_5, YComponent=addition_2, ZComponent=0)  # -> Vector, Length
merge = Merge(Data1=pline, Data2=mirror)
ln_2 = Line(StartPoint=move_4.Geometry, EndPoint=move_5.Geometry)
move_7 = Move(Geometry=pt, Motion=vec_8.Vector)  # -> Geometry, Transform
mirror_2 = MirrorCurve(Geometry=merge, Curve=ln_2, Tangent=True)
rotate = Rotate(Geometry=merge, Angle=1.570796327, Plane=PlaneXY(0, 0, 0))  # -> Geometry, Transform
rec_2pt = Rectangle2Pt(Plane=PlaneXY(0, 0, 0), PointA=pt, PointB=move_7.Geometry, Radius=0)  # -> Rectangle, Length
merge_2 = Merge(Data1=merge, Data2=mirror_2)
vec2pt = Vector2Pt(PointA=pt, PointB=pt_2, Unitize=False)  # -> Vector, Length
arrrec = RectangularArray(Geometry=merge_2, Cell=rec_2pt.Rectangle, XCount=Slider(1, range=0..1), YCount=Slider(10, range=0..10))  # -> Geometry, Transform
move_8 = Move(Geometry=arrrec.Geometry, Motion=vec2pt.Vector)  # -> Geometry, Transform
series = Series(Start=multiplication, Step=multiplication, Count=10)
merge_3 = Merge(Data1=arrrec.Geometry, Data2=move_8.Geometry)  # -> graft(Result)
move_9 = Move(Geometry=rotate.Geometry, Motion=vec_3.Vector)  # -> Geometry, Transform
mirror_3 = MirrorCurve(Geometry=move_9.Geometry, Curve=ln, Tangent=True)
X = UnitX(Factor=series)
rec_2pt_2 = Rectangle2Pt(Plane=PlaneXY(0, 0, 0), PointA=pt, PointB=move_6.Geometry, Radius=0)  # -> Rectangle, Length
move_10 = Move(Geometry=merge_3, Motion=X)  # -> Geometry, Transform
merge_4 = Merge(Data1=move_9.Geometry, Data2=mirror_3)
join = JoinCurves(Curves=merge_4, Preserve=False)
arrrec_2 = RectangularArray(Geometry=join, Cell=rec_2pt_2.Rectangle, XCount=6, YCount=Slider(1, range=0..1))  # -> graft(Geometry), Transform
move_11 = Move(Geometry=arrrec_2.Geometry, Motion=Vector(0, 0, 10))  # -> Geometry, Transform
panel_3 = Panel(move_11.Geometry)
boundary = BoundarySurfaces(Edges=move_11.Geometry)
