# Grasshopper definition Thonet-Chair.ghx (Grasshopper 0.9.76)

pt = Point(graft([Point(10222.3, 425.52673, 700), Point(10222.3, 174.47327, 700)]))
pt_2 = Point(graft([Point(10199, 456.17, 300), Point(10199, 143.83, 300)]))
pt_3 = Point([Point(10545, 122.1699, 300), Point(10489, 154.5, 570), Point(10475, 154.5, 729), Point(10525, 115.285325, 1047), Point(10566, 212.5793206, 1144), Point(10566, 387.4206794, 1144), Point(10525, 484.714675, 1047), Point(10475, 445.5, 729), Point(10489, 445.5, 570), Point(10545, 477.8301, 300)])
pt_4 = Point([Point(10480, 159.156, 827), Point(10501, 146, 961), Point(10529, 244.1536512, 1056), Point(10529, 355.8463488, 1056), Point(10501, 454, 961), Point(10480, 440.844, 827)])
crv = Curve(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)
ln = Line(StartPoint=pt_2, EndPoint=pt)
intcrv = Interpolate(Vertices=pt_3, Degree=3, Periodic=False, KnotStyle=1)  # -> Curve, Length, Domain
intcrv_2 = Interpolate(Vertices=pt_4, Degree=3, Periodic=False, KnotStyle=1)  # -> Curve, Length, Domain
number_slider = Slider(15, range=0..100)
pipe = Pipe(Curve=crv, Radius=Slider(10, range=0..100), Caps="1")

# ---- group: Seat
brep = Brep(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)

# ----
pipe_2 = Pipe(Curve=intcrv_2.Curve, Radius=number_slider, Caps="1")
pipe_3 = Pipe(Curve=ln, Radius=number_slider, Caps="1")
pipe_4 = Pipe(Curve=intcrv.Curve, Radius=number_slider, Caps="1")
merge = Merge(Data1=pipe_3, Data2=pipe_4, Data3=pipe_2, Data4=pipe, Data5=brep)  # -> flatten(Result)
panel = Panel(merge)
sunion = SolidUnion(Breps=merge)
bbox = BoundingBox(Content=sunion, Plane=PlaneXY(0, 0, 0))  # -> Box, Box_2
panel_2 = Panel(sunion)
debox = DeconstructBox(Box=bbox.Box)  # -> Plane, X, Y, Z
area = Area(Geometry=bbox.Box)  # -> Area, Centroid
dedomain = DeconstructDomain(Domain=debox.Z)  # -> Start, End
subtraction = Subtraction(A=dedomain.Start, B=dedomain.End)
pdecon = Deconstruct(Point=area.Centroid)  # -> XComponent, YComponent, ZComponent
abs = Absolute(Value=subtraction)
division = Division(A=abs, B="2")
panel_3 = Panel(debox.Z)
pt_5 = ConstructPoint(XCoordinate=pdecon.XComponent, YCoordinate=pdecon.YComponent, ZCoordinate=division)
vec2pt = Vector2Pt(PointA=pt_5, PointB="0,0,0", Unitize=False)  # -> Vector, Length
move = Move(Geometry=sunion, Motion=vec2pt.Vector)  # -> Geometry, Transform
