# Grasshopper definition Twisted-Column.ghx (Grasshopper 0.9.76)

range = Range(Domain=Domain(0, 1), Steps=Slider(10, range=0..10))
panel = Panel(range)
range_2 = Range(Domain=Domain(0, 1), Steps=Slider(10, range=0..10))
graph = GraphMapper(
    range,
    x0=0,
    x1=1,
    y0=0,
    y1=1,
    container_name="Bezier",
    cpx=[0, 0, 0.7391304374, 1],
    cpy=[0.5710344315, 0, 0, 0.8303447962])
graph_2 = GraphMapper(
    range_2,
    x0=0,
    x1=1,
    y0=0,
    y1=1,
    container_name="Sine Summation",
    Equation0_px=[0.2, 0.3],
    Equation0_py=[0.2, 0.3],
    Equation1_px=[0.6, 0.9],
    Equation1_py=[0.3, 0.5])
bnd = Bounds(Numbers=graph_2)
dom = ConstructDomain(DomainStart=Slider(146, range=0..250), DomainEnd=Slider(600, range=0..1000))
bnd_2 = Bounds(Numbers=graph)
dom_2 = ConstructDomain(DomainStart=Slider(199, range=0..250), DomainEnd=Slider(761, range=0..1000))
remap = RemapNumbers(Value=graph_2, Source=bnd, Target=dom)  # -> Mapped, Clipped
remap_2 = RemapNumbers(Value=graph, Source=bnd_2, Target=dom_2)  # -> Mapped, Clipped
neg = Negative(Value=remap_2.Mapped)
neg_2 = Negative(Value=remap.Mapped)
dom_3 = ConstructDomain(DomainStart=remap_2.Mapped, DomainEnd=neg)
dom_4 = ConstructDomain(DomainStart=remap.Mapped, DomainEnd=neg_2)
rectangle = Rectangle(Plane=PlaneXY(0, 0, 0), XSize=dom_3, YSize=dom_3, Radius=0)  # -> Rectangle, Length
polygon = Polygon(Plane=PlaneXY(0, 0, 0), Radius=dom_4, Segments=Slider(5, range=3..20), FilletRadius=0)  # -> Polygon, Length
lng = ListLength(List=rectangle.Rectangle)
lng_2 = ListLength(List=polygon.Polygon)
panel_2 = Panel(lng)
series = Series(Start=0, Step=Slider(461, range=0..1000), Count=lng)
panel_3 = Panel(lng_2)
Z = UnitZ(Factor=series)
series_2 = Series(Start=0, Step=Slider(532, range=0..1000), Count=lng_2)
series_3 = Series(Start=0, Step=Slider(-33, range=-90..90), Count=lng)
move = Move(Geometry=rectangle.Rectangle, Motion=Z)  # -> Geometry, Transform
Z_2 = UnitZ(Factor=series_2)
rad = Radians(Degrees=series_3)
move_2 = Move(Geometry=polygon.Polygon, Motion=Z_2)  # -> Geometry, Transform
series_4 = Series(Start=0, Step=Slider(12, range=-90..90), Count=lng_2)
rotate = Rotate(Geometry=move.Geometry, Angle=rad, Plane=PlaneXY(0, 0, 0))  # -> Geometry, Transform
rad_2 = Radians(Degrees=series_4)
loft = Loft(Curves=rotate.Geometry, Options={Adjust=False, Closed=False, LoftEnds=0, LoftSimp=0, LoftType=0, Rebuild=10, Refit=0.01})
rotate_2 = Rotate(Geometry=move_2.Geometry, Angle=rad_2, Plane=PlaneXY(0, 0, 0))  # -> Geometry, Transform
cap = CapHoles(Brep=loft)
loft_2 = Loft(
    Curves=rotate_2.Geometry,
    Options={Adjust=False, Closed=False, LoftEnds=0, LoftSimp=0, LoftType=0, Rebuild=10, Refit=0.01})
cap_2 = CapHoles(Brep=loft_2)
