# Grasshopper definition Voronoi-Sphere.ghx (Grasshopper 0.9.76)
# plug-ins: Weaverbird

sph = Sphere(Base=PlaneXY(0, 0, 0), Radius=Slider(74, range=0..100))
popgeo = PopulateGeometry(Geometry=sph, Count=Slider(50, range=0..100), Seed=1)
facet = FacetDome(Points=popgeo)  # -> Pattern, Dome
neg = Negative(Value=Slider(16, range=1..30))
wbframe = WeaverbirdsPictureFrame(MeshPolylines=facet.Pattern, Distance=Slider(34, range=1..50), InsetType=0)
wbthicken = WeaverbirdsMeshThicken(MeshCurves=wbframe, Distance=neg, OffsetType=0)
wbcatmullclark = WeaverbirdsCatmullClarkSubdivision(MeshCurves=wbthicken, Level=Slider(2, range=1..3), SmoothNakedEdges=1)
tri = Triangulate(Mesh=wbcatmullclark)  # -> Mesh, Count
mesh = Mesh(tri.Mesh)
medges = MeshEdges(Mesh=mesh)  # -> NakedEdges, InteriorEdges, NonManifoldEdges
