# Grasshopper definition Paneling-UV-Curve-02.gh (Grasshopper 0.9.76)
# plug-ins: Python Interpreter

pi = Pi(Factor=Slider(0.5, range=0..1))
xz = XZPlane(Origin=Point(0, 0, 0))
neg = Negative(Value=pi)
dom = ConstructDomain(DomainStart=neg, DomainEnd=pi)
arc = Arc(Plane=xz, Radius=Slider(100, range=0..100), Angle=dom)  # -> Arc, Length

# ---- group: toggle
timer = Timer(TimerInterval=50, Target=rec)  # disabled

# ----
scale_nu = ScaleNU(Geometry=arc.Arc, Plane=PlaneXY(0, 0, 0), ScaleX=1, ScaleY=1, ScaleZ=Slider(1, range=0..1))  # -> Geometry, Transform
rec = DataRecorder("0", DataLimit=-10, RecordData=True)
lng = ListLength(List=rec)
arrpolar = PolarArray(Geometry=scale_nu.Geometry, Plane=PlaneXY(0, 0, 0), Count=Slider(8, range=0..10), Angle=6.283185307)  # -> Geometry, Transform
panel = Panel(lng)
divide = DivideCurve(Curve=arrpolar.Geometry, Count=Slider(10, range=8..12), Kinks=False)  # -> Points, Tangents, Parameters
int = Integer(Slider(1, range=0..1))
split = SplitList(List=divide.Points, Index="1")  # -> ListA, ListB
pt = Point(split.ListB)
rev = ReverseList(List=pt)
split_2 = SplitList(List=rev, Index="1")  # -> ListA, ListB
pt_2 = Point(Point(0, 0, 0))
vec2pt = Vector2Pt(PointA=pt_2, PointB=split_2.ListB, Unitize=False)  # -> Vector, Length
unit = UnitVector(Vector=vec2pt.Vector)
amp = Amplitude(Vector=unit, Amplitude=1)
random = Random(Range=Domain(0, 1), Number=1, Seed=2)
move = Move(Geometry=vec2pt.Vector, Motion=amp)  # -> Geometry, Transform
pt_3 = Point(split_2.ListA)
pt_4 = Point(split.ListA)
ins = InsertItems(List=move.Geometry, Item=pt_3, Indices=0, Wrap=True)  # -> reverse(List)
ins_2 = InsertItems(List=ins, Item=pt_4, Indices=0, Wrap=True)
intcrv = Interpolate(Vertices=ins_2, Degree=3, Periodic=False, KnotStyle=1)  # -> Curve, Length, Domain
loft_opt = LoftOptions(Closed=Toggle(True), Adjust=False, Rebuild=0, Refit=0, Type=0)
flatten = FlattenTree(Tree=intcrv.Curve, Path="{0}")
loft = Loft(Curves=flatten, Options=loft_opt)
number_slider = Slider(0.8, range=0..1)
brep = Brep(loft)
scale = Scale(Geometry=brep, Center=Point(0, 0, 0), Factor=number_slider)  # -> Geometry, Transform
scale_2 = Scale(Geometry=scale.Geometry, Center=Point(0, 0, 0), Factor=number_slider)  # -> Geometry, Transform
srf = Surface(reparameterize(brep))
number_slider_2 = Slider(20, range=0..100)
srf_2 = Surface(reparameterize(scale.Geometry))
srf_3 = Surface(reparameterize(scale_2.Geometry))
panel_2 = Panel(srf)
python = PythonScript(surf0=srf, surf1=srf_2, surf2=srf_3, unum=number_slider_2, vnum=number_slider_2)  # -> out, a, b, c, d; inputs surf0: Surface, surf1: Surface, surf2: Surface, unum: Int32, vnum: Int32
# ---------- python: Python ----------
import Rhino.Geometry as rg

a = []
b = []
c = []
d = []

for i in range(unum):
    for j in range(vnum):
        
        pt11 = surf0.PointAt(i/unum, j/vnum)
        pt12 = surf0.PointAt((i+1)/unum, j/vnum)
        pt22 = surf0.PointAt((i+1)/unum, (j+1)/vnum)
        pt21 = surf0.PointAt(i/unum, (j+1)/vnum)
        
        
        nt11 = surf1.PointAt(i/unum, j/vnum)
        nt12 = surf1.PointAt((i+1)/unum, j/vnum)
        nt22 = surf1.PointAt((i+1)/unum, (j+1)/vnum)
        nt21 = surf1.PointAt(i/unum, (j+1)/vnum)
        
        mt11 = surf2.PointAt(i/unum, j/vnum)
        mt12 = surf2.PointAt((i+1)/unum, j/vnum)
        mt22 = surf2.PointAt((i+1)/unum, (j+1)/vnum)
        mt21 = surf2.PointAt(i/unum, (j+1)/vnum)
        
        #line1 = rs.AddLine(pt11,pt22)
        #line2 = rs.AddLine(pt12,pt21)
        line1 = rg.Line(pt11,pt22)
        line2 = rg.Line(nt12,nt21)
        line3 = rg.Line(pt11,nt12)
        
        a.append(line1)
        b.append(line2)
        c.append(line3)
# ---------- end python ----------
crv = Curve(python.a)
crv_2 = Curve(python.b)
crv_3 = Curve(python.c)
number_slider_3 = Slider(2, range=0..10)
number_slider_4 = Slider(2.3, range=0..10)
pipe = Pipe(Curve=crv, Radius=number_slider_4, Caps=number_slider_3)  # -> flatten(Pipe)
pipe_2 = Pipe(Curve=crv_3, Radius=number_slider_4, Caps=number_slider_3)  # -> flatten(Pipe)
pipe_3 = Pipe(Curve=crv_2, Radius=number_slider_4, Caps=number_slider_3)  # -> flatten(Pipe)
mesh = Mesh(pipe)
mesh_2 = Mesh(pipe_3)
mesh_3 = Mesh(pipe_2)
mjoin = MeshJoin(Meshes=mesh)
mjoin_2 = MeshJoin(Meshes=mesh_3)
mjoin_3 = MeshJoin(Meshes=mesh_2)
viewer = ParamViewer()
viewer_2 = ParamViewer()
mjoin_4 = MeshJoin(Meshes=[mjoin, mjoin_3, mjoin_2])
