# Grasshopper definition Paneling-UV-Curve-03.gh (Grasshopper 0.9.76)
# plug-ins: Python Interpreter

pi = Pi(Factor=Slider(0.5, range=0..1))
xz = XZPlane(Origin=Point(0, 0, 0))
neg = Negative(Value=pi)
dom = ConstructDomain(DomainStart=neg, DomainEnd=pi)
arc = Arc(Plane=xz, Radius=Slider(100, range=0..100), Angle=dom)  # -> Arc, Length

# ---- group: toggle
timer = Timer(TimerInterval=50, Target=rec)  # disabled

# ----
scale_nu = ScaleNU(Geometry=arc.Arc, Plane=PlaneXY(0, 0, 0), ScaleX=1, ScaleY=1, ScaleZ=Slider(1, range=0..1))  # -> Geometry, Transform
rec = DataRecorder("0", DataLimit=-10, RecordData=True)
number_slider = Slider(10, range=8..12)
lng = ListLength(List=rec)
arrpolar = PolarArray(Geometry=scale_nu.Geometry, Plane=PlaneXY(0, 0, 0), Count=Slider(10, range=0..10), Angle=6.283185307)  # -> Geometry, Transform
panel = Panel(lng)
divide = DivideCurve(Curve=arrpolar.Geometry, Count=number_slider, Kinks=False)  # -> Points, Tangents, Parameters
int = Integer(Slider(1, range=0..1))
subtraction = Subtraction(A=number_slider, B=1)
split = SplitList(List=divide.Points, Index="1")  # -> ListA, ListB
pt = Point(split.ListB)
rev = ReverseList(List=pt)
split_2 = SplitList(List=rev, Index="1")  # -> ListA, ListB
pt_2 = Point(split_2.ListB)
pt_3 = Point(split_2.ListA)
pt_4 = Point(split.ListA)
ins = InsertItems(List=pt_2, Item=pt_3, Indices=0, Wrap=True)  # -> reverse(List)
ins_2 = InsertItems(List=ins, Item=pt_4, Indices=0, Wrap=True)
intcrv = Interpolate(Vertices=ins_2, Degree=3, Periodic=False, KnotStyle=1)  # -> Curve, Length, Domain
loft_opt = LoftOptions(Closed=Toggle(True), Adjust=False, Rebuild=0, Refit=0, Type=0)
flatten = FlattenTree(Tree=intcrv.Curve, Path="{0}")
loft = Loft(Curves=flatten, Options=loft_opt)
brep = Brep(loft)
srf = Surface(reparameterize(brep))
panel_2 = Panel(srf)
python = PythonScript(surf=srf, unum=Slider(30, range=0..30), vnum=Slider(21, range=0..30))  # -> out, pt, a, b, c, d; inputs surf: Surface, unum: Int32, vnum: Int32
# ---------- python: Python ----------
import Rhino.Geometry as rg

pt = []
a = []
b = []
c = []

for i in range(unum):
    for j in range(vnum):
        
        pt11 = surf.PointAt(i/unum, (j)/vnum)
        pt12 = surf.PointAt((i+1)/unum, (j)/vnum)
        pt22 = surf.PointAt((i+1)/unum, (j+1)/vnum)
        pt21 = surf.PointAt(i/unum, (j+1)/vnum)
        
        #line1 = rs.AddLine(pt11,pt22)
        #line2 = rs.AddLine(pt12,pt21)
        line1 = rg.Line(pt11,pt22)
        line2 = rg.Line(pt12,pt21)
        
        
        
        a.append(line1)
        b.append(line2)
        
        c.append(pt11)
# ---------- end python ----------
pt_5 = Point(python.c)
image = ImageSampler(
    pt_5,
    FilePath="C:\Users\yoshioca\Desktop\image-sampler\PerlinNoise.jpg",
    Filter="Colour",
    Interpolate=True,
    Umax=1,
    Umin=0,
    Vmax=1,
    Vmin=0,
    Wrap=1)
panel_3 = Panel(pt_5)
pt_6 = Point(python.pt)
crv = Curve(python.a)
crv_2 = Curve(python.b)
bnd = Bounds(Numbers=image)
dom_2 = ConstructDomain(DomainStart=Slider(0, range=0..100), DomainEnd=Slider(20, range=0..100))
remap = RemapNumbers(Value=image, Source=bnd, Target=dom_2)  # -> Mapped, Clipped
python_2 = PythonScript()  # -> Out, A
merge = Merge(Data1=crv, Data2=crv_2)
number_slider_2 = Slider(2.2, range=0..10)  # disabled
number_slider_3 = Slider(2, range=0..10)  # disabled
pipe = Pipe(Curve=merge, Radius=number_slider_2, Caps=number_slider_3)  # -> flatten(Pipe); disabled
brep_2 = Brep(srf)  # disabled
custom_mesh_settings = SettingsCustom(
    StitchSeams=True,
    SimplePlanes=False,
    Refine=True,
    MinCount=16,
    MaxCount=400,
    AspectRatio=20,
    MaxDistance=0,
    MaxAngle=20,
    MinEdge=0,
    MaxEdge=0)
mesh = MeshBrep(Brep=pipe, Settings=custom_mesh_settings)  # disabled
mesh_2 = Mesh(brep_2)
mesh_3 = Mesh(mesh)
viewer = ParamViewer(mesh_2)
viewer_2 = ParamViewer(mesh_3)
mjoin = MeshJoin(Meshes=[mesh_3, mesh_2])
panel_4 = Panel(mjoin)
