# Grasshopper definition Paneling-UV-Curve.gh (Grasshopper 0.9.76)
# plug-ins: Python Interpreter

pi = Pi(Factor=Slider(0.5, range=0..1))
xz = XZPlane(Origin=Point(0, 0, 0))
neg = Negative(Value=pi)
dom = ConstructDomain(DomainStart=neg, DomainEnd=pi)
arc = Arc(Plane=xz, Radius=Slider(100, range=0..100), Angle=dom)  # -> Arc, Length

# ---- group: toggle
timer = Timer(TimerInterval=50, Target=rec)  # disabled

# ----
scale_nu = ScaleNU(Geometry=arc.Arc, Plane=PlaneXY(0, 0, 0), ScaleX=1, ScaleY=1, ScaleZ=Slider(1, range=0..1))  # -> Geometry, Transform
number_slider = Slider(10, range=0..10)
rec = DataRecorder("0", DataLimit=-10, RecordData=True)
number_slider_2 = Slider(10, range=8..12)
lng = ListLength(List=rec)
arrpolar = PolarArray(Geometry=scale_nu.Geometry, Plane=PlaneXY(0, 0, 0), Count=number_slider, Angle=6.283185307)  # -> Geometry, Transform
panel = Panel(lng)
divide = DivideCurve(Curve=arrpolar.Geometry, Count=number_slider_2, Kinks=False)  # -> Points, Tangents, Parameters
int = Integer(Slider(1, range=0..1))
subtraction = Subtraction(A=number_slider_2, B=1)
pi_2 = Pi(Factor=Slider(0.05, range=0..0.1))
random = Random(Range=Domain(0, 100), Number=number_slider, Seed=2)
split = SplitList(List=divide.Points, Index="1")  # -> ListA, ListB
neg_2 = Negative(Value=pi_2)
pt = Point(split.ListB)
rev = ReverseList(List=pt)
dom_2 = ConstructDomain(DomainStart=neg_2, DomainEnd=pi_2)
split_2 = SplitList(List=rev, Index="1")  # -> ListA, ListB
random_2 = Random(Range=dom_2, Number=1, Seed=random)
pt_2 = Point(split_2.ListB)
random_3 = Random(Range=dom_2, Number=subtraction, Seed=random)
xy = XYPlane(Origin=Point(0, 0, 0))
rotate = Rotate(Geometry=pt_2, Angle=random_3, Plane=xy)  # -> Geometry, Transform
pt_3 = Point(split_2.ListA)
pt_4 = Point(rotate.Geometry)
pt_5 = Point(split.ListA)
ins = InsertItems(List=pt_2, Item=pt_3, Indices=0, Wrap=True)  # -> reverse(List)
ins_2 = InsertItems(List=ins, Item=pt_5, Indices=0, Wrap=True)
intcrv = Interpolate(Vertices=ins_2, Degree=3, Periodic=False, KnotStyle=1)  # -> Curve, Length, Domain
loft_opt = LoftOptions(Closed=Toggle(True), Adjust=False, Rebuild=0, Refit=0, Type=0)
flatten = FlattenTree(Tree=intcrv.Curve, Path="{0}")
loft = Loft(Curves=flatten, Options=loft_opt)
brep = Brep(loft)
srf = Surface(reparameterize(brep))
panel_2 = Panel(srf)
python = PythonScript(surf=srf, unum=Slider(20, range=0..100), vnum=Slider(20, range=0..100))  # -> out, a, b; inputs surf: Surface, unum: Int32, vnum: Int32
# ---------- python: Python ----------
import Rhino.Geometry as rg

a = []
b = []

for i in range(unum):
    for j in range(vnum):
        
        pt11 = surf.PointAt(i/unum, j/vnum)
        pt12 = surf.PointAt((i+1)/unum, j/vnum)
        pt22 = surf.PointAt((i+1)/unum, (j+1)/vnum)
        pt21 = surf.PointAt(i/unum, (j+1)/vnum)
        
        #line1 = rs.AddLine(pt11,pt22)
        #line2 = rs.AddLine(pt12,pt21)
        line1 = rg.Line(pt11,pt22)
        line2 = rg.Line(pt12,pt21)
        
        a.append(line1)
        b.append(line2)
# ---------- end python ----------
crv = Curve(python.a)
viewer = ParamViewer(crv)
crv_2 = Curve(python.b)
merge = Merge(Data1=crv, Data2=crv_2)
number_slider_3 = Slider(2.2, range=0..10)  # disabled
number_slider_4 = Slider(2, range=0..10)  # disabled
pipe = Pipe(Curve=merge, Radius=number_slider_3, Caps=number_slider_4)  # -> flatten(Pipe); disabled
brep_2 = Brep(srf)  # disabled
custom_mesh_settings = SettingsCustom(
    StitchSeams=True,
    SimplePlanes=False,
    Refine=True,
    MinCount=16,
    MaxCount=400,
    AspectRatio=20,
    MaxDistance=0,
    MaxAngle=20,
    MinEdge=0,
    MaxEdge=0)
mesh = MeshBrep(Brep=pipe, Settings=custom_mesh_settings)  # disabled
mesh_2 = Mesh(brep_2)
mesh_3 = Mesh(mesh)
viewer_2 = ParamViewer(mesh_2)
viewer_3 = ParamViewer(mesh_3)
mjoin = MeshJoin(Meshes=[mesh_3, mesh_2])
panel_3 = Panel(mjoin)
