# Grasshopper definition PythonSpiral.gh (Grasshopper 0.9.76)
# plug-ins: Python Interpreter

python = PythonScript(x=Slider(100, range=0..100), y=Slider(0.1, range=0..1))  # -> out, a; inputs x: Int32
# ---------- python: Python ----------
import rhinoscriptsyntax as rs
import math

a = []

for i in range(x):
    pt = rs.AddPoint(math.sin(i),math.cos(i),i*y)
    a.append(pt)
# ---------- end python ----------
intcrv = Interpolate(Vertices=python.a, Degree=3, Periodic=False, KnotStyle=1)  # -> Curve, Length, Domain
panel = Panel(python.a)
pipe = Pipe(Curve=intcrv.Curve, Radius=Slider(0.1, range=0..0.1), Caps=0)
