# Grasshopper definition ss-02-01_InputType.gh (Grasshopper 0.9.76)
# plug-ins: Python Interpreter

panel = Panel("""<int>
噛ませる必要はあるのか

↓

Type Hintで
intに。""")
python = PythonScript(x=Slider(100, range=1..100), y=Slider(100, range=1..100), z=Slider(1.5, range=0..10), u=Slider(1.5, range=0..10))  # -> out, a; inputs x: Int32, y: Int32
# ---------- python: Python ----------
## Buliding A Point Grid Out Of Input Parameters
## Input Type - x:int , y:int , z:float , u:float

import rhinoscriptsyntax as rs
import math

a=[]
for i in range(x):
    for j in range(y):
        p=rs.AddPoint(i,j,math.sin(i*u)*math.sin(j*u)*z)
        a.append(p)
# ---------- end python ----------
del = DelaunayMesh(Points=python.a, Plane=PlaneXY(0, 0, 0))
panel_2 = Panel(python.out)
