# Grasshopper definition ss-01-01_helloworld.gh (Grasshopper 0.9.76)
# plug-ins: Python Interpreter

python = PythonScript()  # -> out, a
# ---------- python: Python ----------
import rhinoscriptsyntax as rs

text = "hello world"
print text
# ---------- end python ----------
panel = Panel(python.out)
panel_2 = Panel(python.a)
