# Grasshopper definition ss-01-02_For.ghx (Grasshopper 0.9.76)
# plug-ins: Python Interpreter

python = PythonScript(x=Slider(9, range=1..20))  # -> out, a; inputs x: Int32
# ---------- python: Python ----------
import rhinoscriptsyntax as rs

num = x

for i in range(num):
    print(i)
# ---------- end python ----------
panel = Panel(python.a)
panel_2 = Panel(python.out)
