# Grasshopper definition ss-01-03_for.ghx (Grasshopper 0.9.76)
# plug-ins: Python Interpreter

python = PythonScript(x=Slider(8, range=1..20))  # -> out, a; inputs x: Int32
# ---------- python: Python ----------
import rhinoscriptsyntax as rs

a = []

for i in range(x):
    
    p = rs.AddPoint(i,0,0)
    a.append(p)
# ---------- end python ----------
panel = Panel(python.out)
panel_2 = Panel(python.a)
