# Grasshopper definition ss-01-04_If.ghx (Grasshopper 0.9.76)
# plug-ins: Python Interpreter

python = PythonScript(x=Slider(11, range=1..20))  # -> out, a; inputs x: Int32
# ---------- python: Python ----------
import rhinoscriptsyntax as rs

a = []

for i in range(x):
    if(i%2 == 0):
        p=rs.AddPoint(i,0,0)
    else:
        p=rs.AddPoint(i,0,5)
    a.append(p)
# ---------- end python ----------
pline = PolyLine(Vertices=python.a, Closed=False)
