# Grasshopper definition ss-01-05_If_Elif.ghx (Grasshopper 0.9.76)
# plug-ins: Python Interpreter

python = PythonScript(x=Slider(11, range=1..20))  # -> out, a; inputs x: Int32
# ---------- python: Python ----------
import rhinoscriptsyntax as rs

a=[]

for i in range(x):
    if(i<5):
        p=rs.AddPoint(i,0,0)
    elif(i<8):
        p=rs.AddPoint(i,0,6)
    else:
        p=rs.AddPoint(i,0,2)
    a.append(p)
# ---------- end python ----------
pline = PolyLine(Vertices=python.a, Closed=False)
