# Grasshopper definition ss-01-06_MathSpiral.ghx (Grasshopper 0.9.76)
# plug-ins: Python Interpreter

python = PythonScript(n=Slider(365, range=0..1000), h=Slider(0.05, range=0.01..0.2))  # -> out, a; inputs n: Int32
# ---------- python: Python ----------
import rhinoscriptsyntax as rs
import math

a=[]

for i in range(n):
    x = math.cos(i*0.1)*i*0.1
    y = math.sin(i*0.1)*i*0.1
    
    if (i < 200):
        z = i*h
    else:
        z = 20-i*h
    
    p=rs.AddPoint(x,y,z)
    a.append(p)
# ---------- end python ----------
intcrv = Interpolate(Vertices=python.a, Degree=3, Periodic=False, KnotStyle=1)  # -> Curve, Length, Domain
