# Grasshopper definition ss-01-07_Random.ghx (Grasshopper 0.9.76)
# plug-ins: Python Interpreter

python = PythonScript(n=Slider(800, range=1..800), m=Slider(261, range=1..800))  # -> out, a; inputs n: Int32, m: Int32
# ---------- python: Python ----------
import rhinoscriptsyntax as rs
import math
import random

a=[]

for i in range(n):
    x = math.cos(i*0.2)*i*0.2
    y = math.sin(i*0.2)*i*0.2
    
    if (i<m):
        z = 0
    else:
        z = random.random()*(i-200)*0.05
        
    p = rs.AddPoint(x,y,z)
    a.append(p)
# ---------- end python ----------
del = DelaunayMesh(Points=python.a, Plane=PlaneXY(0, 0, 0))
