# Grasshopper definition ss-01-08_NestedForLoop.ghx (Grasshopper 0.9.76)
# plug-ins: Python Interpreter

panel = Panel("""z = math.sin(i*0.1)*1;

     if(j%20 < 10):   z *= (j%20)*0.2;

else:    z *= (20 - j%20)*0.2;


；　　　これは必要？？""")

# ---- group: Downloaded
python = PythonScript()  # -> out, a
# ---------- python: Python ----------
import rhinoscriptsyntax as rs
import math

a = []
for i in range(100):
    for j in range(50):
        x = i*0.5
        y = j*0.5
        z = math.sin(i*0.1)*1;
        if(j%20 < 10):
            z *= (j%20)*0.2;
        else:
            z *= (20 - j%20)*0.2;
        p = rs.AddPoint(x,y,z)
        a.append(p)
# ---------- end python ----------
del = DelaunayMesh(Points=python.a, Plane=PlaneXY(0, 0, 0))

# ----
python_2 = PythonScript(n=Slider(100, range=2..100), m=Slider(100, range=2..100))  # -> out, a; inputs n: Int32, m: Int32
# ---------- python_2: Python ----------
import rhinoscriptsyntax as rs
import math

a=[]

for i in range(n):
    for j in range(m):
        
        x = i*0.5
        y = j*0.5
        z = math.sin(i*0.1)
        
        if(j%20 < 10):
            z *= (j%20)*0.2
        else:
            z *= (20 - j%20)*0.2
        p = rs.AddPoint(x,y,z)
        a.append(p)
# ---------- end python_2 ----------
del_2 = DelaunayMesh(Points=python_2.a, Plane=PlaneXY(0, 0, 0))
