# Grasshopper definition ss-01-09_AndOr.ghx (Grasshopper 0.9.76)
# plug-ins: Python Interpreter

python = PythonScript()  # -> out, a
# ---------- python: Python ----------
import rhinoscriptsyntax as rs
import math

a =[]
for i in range(100):
    for j in range(100):
        x=i*0.5
        y=j*0.5
        if(i<20 and j<20):
            z=2
        elif(i>=20 and i<40 and j>=60 and j<80):
            z=1
        elif(i==50 or j==50):
            z=3
        elif(i>=60 and i<80 and j>=20 and j<80):
            z=math.cos(j*0.2)+2
        elif(not i>60 and j>=25 and j<35):
            z=8-i*0.1
        elif(not (i<90 and j<90)):
            z=math.sin(i*0.2)*math.cos(j*0.2)+2
        else:
            z=math.sin(i*0.2)*math.sin(j*0.1)
        
        p=rs.AddPoint(x,y,z)
        a.append(p)
# ---------- end python ----------
python_2 = PythonScript()  # -> out, a
# ---------- python_2: Python ----------
import rhinoscriptsyntax as rs
import math

a =[]
for i in range(100):
    for j in range(100):
        x=i*0.5
        y=j*0.5
        if(i==50 or j==50):
            z=3
        else:
            z=1
        p=rs.AddPoint(x,y,z)
        a.append(p)
# ---------- end python_2 ----------
del = DelaunayMesh(Points=python.a, Plane=PlaneXY(0, 0, 0))
del_2 = DelaunayMesh(Points=python_2.a, Plane=PlaneXY(0, 0, 0))
panel = Panel(python.a)
panel_2 = Panel(python.out)
