# Grasshopper definition ss-01-10_Patterning.ghx (Grasshopper 0.9.76)
# plug-ins: Python Interpreter

python = PythonScript()  # -> out, a
# ---------- python: Python ----------
import rhinoscriptsyntax as rs
import math

a=[]
for i in range(100):
    for j in range(100):
        x =i*0.5
        y =j*0.5
        
        if(i%20<4 or j%20<4):
            z=0
        elif(i%20+j%20>20):
            z=((20-i%20)*(j%20))*0.03
            z+=math.cos(i*0.1)*math.sin(j*0.1)*2+2
        elif(i%20>=5 and j%20<10):
            z=((i%20)*(i%20)/20+(j%20)/2*0.3)
        else:
            z=((i%20)*0.2+(j%20)*0.3)
            
        p=rs.AddPoint(x,y,z)
        a.append(p)
# ---------- end python ----------
del = DelaunayMesh(Points=python.a, Plane=PlaneXY(0, 0, 0))
panel = Panel(python.out)
panel_2 = Panel(python.a)
