# Grasshopper definition ss-02-02_PointInput.gh (Grasshopper 0.9.76)
# plug-ins: Python Interpreter

panel = Panel("""ｘの入力形式変更

List Access


type hintより
Point3d""")
pop2d = Populate2D(Region={Plane=PlaneXY(0, 0, 0), Size=Domain2(u=0..20, v=0..10)}, Count=Slider(1000, range=0..1000), Seed=1)
python = PythonScript(x=pop2d)  # -> out, a, b, c; inputs x: list of Point3d
# ---------- python: Python ----------
## Separate Input Point Into 3 Output Groups

## Change Input Type
## type hint x:Point3D 
## (List Access)

import rhinoscriptsyntax as rs
import math

import rhinoscriptsyntax as rs
import math

a = []
b = []
c = []
for pt in x:
    if(pt.X % 3 < 0.5):
        a.append(pt)
    elif( math.sqrt(pt.Y) %0.6< 0.3):
        b.append(pt)
    else:
        c.append(pt)
# ---------- end python ----------
panel_2 = Panel(python.out)
number_slider = Slider(0.674, range=0..1)
number_slider_2 = Slider(0.1, range=0..1)
neg = Negative(Value=number_slider)
neg_2 = Negative(Value=number_slider_2)
dom = ConstructDomain(DomainStart=number_slider, DomainEnd=neg)
dom_2 = ConstructDomain(DomainStart=number_slider_2, DomainEnd=neg_2)
rectangle = Rectangle(Plane=python.b, XSize=dom_2, YSize=dom, Radius=0)  # -> Rectangle, Length
rectangle_2 = Rectangle(Plane=python.a, XSize=dom, YSize=dom_2, Radius=0)  # -> Rectangle, Length
cir = Circle(Plane=python.c, Radius=number_slider_2)
