# Grasshopper definition ss-02-03_PointInputAttr.ghx (Grasshopper 0.9.76)
# plug-ins: Python Interpreter

hexgrid = Hexagonal(Plane=PlaneXY(0, 0, 0), Size=1, ExtentX=Slider(20, range=0..100), ExtentY=Slider(25, range=0..100))  # -> Cells, flatten(Points)
pt = Point(Point(13.5436769, 18.43885153, 0))
pt_2 = Point(hexgrid.Points)
python = PythonScript(pts=hexgrid.Points, attr=pt, height=Slider(0.75, range=0.01..3), width=Slider(2, range=0.01..3))  # -> out, a, b; inputs pts: list of Point3d, attr: Point3d
# ---------- python: Python ----------
## This Separates Points 
## And Creates Attractor Controlled Circles Or Rectngles
##
## Input Type
## pts  : Point3d(List Access)
## attr : Point3d(Item Access)

import rhinoscriptsyntax as rs
import Rhino.Geometry as rg
import math

h=height
w=width

a=[]
b=[]


for pt in pts:

    if(pt.Y % 10>0 and pt.Y% 10<2):
        rect=rs.AddRectangle(rg.Plane.WorldXY,w,h)
        rs.MoveObject(rect,pt)
        rs.MoveObject(rect,rg.Vector3d(-(w*0.5),-(h*0.5),0))
        a.append(rect)
        
    else:
        dist = rs.Distance(pt,attr)
        circle=rs.AddCircle(pt,0.02*dist)
        b.append(circle)
# ---------- end python ----------
panel = Panel(python.out)
