# Grasshopper definition ss-02-04_PointsCluster.ghx (Grasshopper 0.9.76)
# plug-ins: Python Interpreter

pop2d = Populate2D(Region={Plane=PlaneXY(0, 0, 0), Size=Domain2(u=0..20, v=0..10)}, Count=100, Seed=Slider(44, range=1..100))
python = PythonScript(pts=pop2d, threshold=Slider(1.7886, range=0..10))  # -> out, a, pt2, line; inputs pts: list of Point3d
# ---------- python: Python ----------
## This Connects Points Within The Input Distance Only
## If Numbers Of Connection Is More Than A Certain Number
## Input Type
## pts : Point3d(List Access)
## threshold : float

import rhinoscriptsyntax as rs
a=[]

for pt in pts:
    
    closePts=[]
    for pt2 in pts:
        dist=rs.Distance(pt,pt2)
        if(dist>0 and dist<threshold):
            closePts.append(pt2)
            
    count = len(closePts)
    if(count>=3):
        for cpt in closePts:
            zpt =rs.AddPoint(pt.X,pt.Y,0.5*(count-2))
            line =rs.AddLine(zpt,cpt)
            a.append(line)
# ---------- end python ----------
panel = Panel(python.out)
panel_2 = Panel(python.pt2)
