# Grasshopper definition ss-02-05_InputCurveClosest.ghx (Grasshopper 0.9.76)
# plug-ins: Python Interpreter

crv = Curve(reparameterize([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]))

# ---- group: Download
crv_2 = Curve(reparameterize([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]))
python = PythonScript(curves=crv_2, div=Slider(50, range=0..100))  # -> out, a, b; inputs curves: list of Curve, div: Int32
# ---------- python: Python ----------
# draw lines between closest points on the input curves
# input type: curves - Curve (List Access), div - int
import rhinoscriptsyntax as rs

a = []
b = []
for crv1 in curves:
    for i in range(div+1):
        pt1 = crv1.PointAt(i/div)
        a.append(pt1)
        
        minDist = -1 #initialize 
        for crv2 in curves:
            if(crv1 != crv2):
                for j in range(div+1):
                    pt2 = crv2.PointAt(j/div)
                    dist = rs.Distance(pt1, pt2)
                    if(minDist < 0): # first time to check
                        closest = pt2
                        minDist = dist
                    elif(dist < minDist):
                        closest = pt2
                        minDist = dist
                        
        line = rs.AddLine(pt1, closest)
        b.append(line)
# ---------- end python ----------

# ----
python_2 = PythonScript(curves=crv, div=Slider(53, range=1..100))  # -> out, a, b; inputs curves: list of Curve, div: Int32
# ---------- python_2: Python ----------
## Draw Lines Between Closest Points On The Input Curves
## Input type
## curves : Curve(List Access)
## div : int

import rhinoscriptsyntax as rs

a=[]
b=[]

for crv1 in curves:
    for i in range(div+1):
        pt1=crv1.PointAt(i/div)
        
        a.append(pt1)
        
        minDist = -1
        
        for crv2 in curves:
            if(crv1 != crv2):
                for j in range(div+1):
                    
                    pt2 = crv2.PointAt(j/div)
                    dist = rs.Distance(pt1, pt2)
                    
                    if (minDist < 0):
                        closest = pt2
                        minDist = dist
                        
                    elif (dist < minDist):
                        closest = pt2
                        minDist = dist
                        
        line = rs.AddLine(pt1, closest)
        
        b.append(line)
# ---------- end python_2 ----------
panel = Panel(python_2.out)
panel_2 = Panel(python_2.b)
