# Grasshopper definition ss-02-06_InputCurveInterSection.ghx (Grasshopper 0.9.76)
# plug-ins: Python Interpreter

crv = Curve([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])

# ---- group: Download
crv_2 = Curve([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])
python = PythonScript(curves=crv_2)  # -> out, a, b; inputs curves: list of Curve
# ---------- python: Python ----------
# this takes intersection of all curves and build geometry around the intersection
# input type: curves - Curve (List Access)
import rhinoscriptsyntax as rs
import Rhino.Geometry as rg

a = []
b = []
for curve1 in curves:
    for curve2 in curves:
        if( curve1 != curve2):
            itxn = rg.Intersect.Intersection.CurveCurve(curve1, curve2, 0.0001, 0.0001)
            for item in itxn.Item:
                # intersection point
                ipt = item.PointA
                a.append(ipt)
                
                # build geometry at intersection
                [success, t] = curve1.ClosestPoint(ipt) # get t parameter
                if(success):
                    tan = curve1.TangentAt(t) # get tangent vector
                    tan *= 2
                    pt1 = rg.Point3d(ipt) # copy a new point
                    pt1 += tan
                    pt2 = rg.Point3d(ipt)
                    pt2 -= tan
                    pt3 = rg.Point3d(ipt)
                    pt3 += rg.Vector3d(0,0,10)
                    surf = rs.AddSrfPt([pt1, pt2, pt3])
                    b.append(surf)
# ---------- end python ----------
pt = Point(python.a)
srf = Surface(python.b)

# ----
python_2 = PythonScript(curves=crv, h=Slider(5.53, range=0.01..10))  # -> out, a, b; inputs curves: list of Curve
# ---------- python_2: Python ----------
## This Takes Intersect of all Curves
## And Build Geometry Around The Intersection
## Input Type
## Curves : Curve (List Access)

import rhinoscriptsyntax as rs
import Rhino.Geometry as rg

a=[]
b=[]

for curve1 in curves:
    for curve2 in curves:
        if( curve1 != curve2):
            itxn =rg.Intersect.Intersection.CurveCurve(curve1,curve2,0.0001,0.0001)
            for item in itxn.Item:
                
                ## Intersection Point
                ipt=item.PointA
                a.append(ipt)
                
                ## Build Geometry At Intersection
                ## Get t Parameter
                [success,t]=curve1.ClosestPoint(ipt)
                if(success):
                    tan=curve1.TangentAt(t)
                    tan*=2
                    pt1 = rg.Point3d(ipt)
                    pt1 += tan
                    pt2 = rg.Point3d(ipt)
                    pt2 -= tan
                    pt3 = rg.Point3d(ipt)
                    pt3 += rg.Vector3d(0,0,h)
                    surf = rs.AddSrfPt([pt1,pt2,pt3])
                    b.append(surf)
# ---------- end python_2 ----------
pt_2 = Point(python_2.a)
srf_2 = Surface(python_2.b)
