# Grasshopper definition ss-02-07_Panelization_1.ghx (Grasshopper 0.9.76)
# plug-ins: Python Interpreter

srf = Surface(reparameterize(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))

# ---- group: Download
srf_2 = Surface(reparameterize(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))
python = PythonScript(surf=srf_2, unum=Slider(8, range=0..50), vnum=Slider(16, range=0..50))  # -> out, panels; inputs surf: Surface, unum: Int32, vnum: Int32
# ---------- python: Python ----------
# This makes surface panels by 4 points on an input surface
# input type: surf - Surface, unum - int, vnum - int

import Rhino.Geometry as rg

panels = []
for i in range(unum):
    for j in range(vnum):
        pt11 = surf.PointAt(i/unum, j/vnum)
        pt12 = surf.PointAt((i+1)/unum, j/vnum)
        pt21 = surf.PointAt(i/unum, (j+1)/vnum)
        pt22 = surf.PointAt((i+1)/unum, (j+1)/vnum)
        panel = rg.NurbsSurface.CreateFromCorners(pt11, pt12, pt22, pt21)
        panels.append(panel)
# ---------- end python ----------

# ----
python_2 = PythonScript(surf=srf, uNum=Slider(13, range=0..50), vNum=Slider(18, range=0..50))  # -> out, panels; inputs surf: Surface, uNum: Int32, vNum: Int32
# ---------- python_2: Python ----------
## This makes surface panels by 4 point on an input surface
## Input type - srf:Surface , uNum:int , vNum:int

import Rhino.Geometry as rg

panels =[]
for i in range(uNum):
    for j in range(vNum):
        pt11 = surf.PointAt(i/uNum , j/vNum)
        pt12 = surf.PointAt((i+1)/uNum , j/vNum)
        pt21 = surf.PointAt(i/uNum , (j+1)/vNum)
        pt22 = surf.PointAt((i+1)/uNum , (j+1)/vNum)
        panel = rg.NurbsSurface.CreateFromCorners(pt11,pt12,pt22,pt21)
        panels.append(panel)
# ---------- end python_2 ----------
item = ListItem(List=python_2.panels, Index=Slider(43, range=0..100), Wrap=True)
panel = Panel(python_2.panels)
dispatch = Dispatch(List=python_2.panels, DispatchPattern=[True, False])  # -> ListA, ListB
srf_3 = Surface(dispatch.ListA)
srf_4 = Surface(dispatch.ListB)
dispatch_2 = Dispatch(List=srf_3, DispatchPattern=[True, False])  # -> ListA, ListB
dispatch_3 = Dispatch(List=srf_4, DispatchPattern=[True, False])  # -> ListA, ListB
srf_5 = Surface(dispatch_2.ListA)
srf_6 = Surface(dispatch_3.ListB)
