# Grasshopper definition ss-02-08_Panelization_2.ghx (Grasshopper 0.9.76)
# plug-ins: Python Interpreter

srf = Surface(reparameterize(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))

srf_2 = Surface(reparameterize(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))
python = PythonScript(surf=srf_2, unum=Slider(12, range=0..50), vnum=Slider(16, range=0..50))  # -> out, panels; inputs surf: Surface, unum: Int32, vnum: Int32
# ---------- python: Python ----------
# This makes surface panels by 3 points on an input surface
# input type: surf - Surface, unum - int, vnum - int
import Rhino.Geometry as rg

panels = []
for i in range(unum):
    for j in range(vnum):
        pt1 = surf.PointAt(i/unum, j/vnum)
        pt2 = surf.PointAt((i+0.9)/unum, (j+0.1)/vnum)
        pt3 = surf.PointAt((i+1.2)/unum, (j+1.0)/vnum)
        pt4 = surf.PointAt((i+0.3)/unum, (j+1)/vnum)
        pt5 = surf.PointAt((i+0.6)/unum, (j+0.3)/vnum)
        n1 = surf.NormalAt(i/unum, j/vnum)
        n2 = surf.NormalAt((i+0.9)/unum, (j+0.1)/vnum)
        n3 = surf.NormalAt((i+1.2)/unum, (j+1.0)/vnum)
        n4 = surf.NormalAt((i+0.3)/unum, (j+1)/vnum)
        n5 = surf.NormalAt((i+0.6)/unum, (j+0.3)/vnum)
        
        pt1 += n1*0.2
        pt2 += n2*0.2
        pt3 += n3*-0.1
        pt4 += n4*1.3
        pt5 += n5*1.5
        
        panel = rg.NurbsSurface.CreateFromCorners(pt2, pt3, pt5)
        panels.append(panel)
        panel = rg.NurbsSurface.CreateFromCorners(pt3, pt4, pt5)
        panels.append(panel)
        panel = rg.NurbsSurface.CreateFromCorners(pt4, pt1, pt5)
        panels.append(panel)
# ---------- end python ----------

python_2 = PythonScript(surf=srf, unum=Slider(12, range=0..50), vnum=Slider(16, range=0..50))  # -> out, panels; inputs surf: Surface, unum: Int32, vnum: Int32
# ---------- python_2: Python ----------
import Rhino.Geometry as rg

panels = []
for i in range(unum):
    for j in range(vnum):
        pt1 = surf.PointAt(i/unum,j/vnum)
        pt2 = surf.PointAt((i+0.9)/unum,(j+0.1)/vnum)
        pt3 = surf.PointAt((i+1.2)/unum,(j+1.0)/vnum)
        pt4 = surf.PointAt((i+0.3)/unum,(j+1.0)/vnum)
        pt5 = surf.PointAt((i+0.6)/unum,(j+0.3)/vnum)
        
        n1 = surf.NormalAt(i/unum,j/vnum)
        n2 = surf.NormalAt((i+0.9)/unum,(j+0.1)/vnum)
        n3 = surf.NormalAt((i+1.2)/unum,(j+1.0)/vnum)
        n4 = surf.NormalAt((i+0.3)/unum,(j+1.0)/vnum)
        n5 = surf.NormalAt((i+0.6)/unum,(j+0.3)/vnum)
        
        pt1 += n1*0.2
        pt2 += n2*0.2
        pt3 += n3*-0.1
        pt4 += n4*1.3
        pt5 += n5*1.5
        
        panel = rg.NurbsSurface.CreateFromCorners(pt2,pt3,pt5)
        panels.append(panel)
        
        panel = rg.NurbsSurface.CreateFromCorners(pt3,pt4,pt5)
        panels.append(panel)
        
        panel = rg.NurbsSurface.CreateFromCorners(pt4,pt1,pt5)
        panels.append(panel)
# ---------- end python_2 ----------
