# Grasshopper definition ss-02-09_Panelization_3.ghx (Grasshopper 0.9.76)
# plug-ins: Python Interpreter

srf = Surface(reparameterize(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))
number_slider = Slider(19, range=0..50)
number_slider_2 = Slider(10, range=0..50)
number_slider_3 = Slider(0.219, range=0..1)
number_slider_4 = Slider(1, range=0..1)
python = PythonScript(surf=srf, unum=number_slider, vnum=number_slider_2, panelWidth=number_slider_3, panelDepth=number_slider_4)  # -> out, panels; inputs surf: Surface, unum: Int32, vnum: Int32
# ---------- python: Python ----------
import Rhino.Geometry as rg

panels = []
for i in range(unum):
    for j in range(vnum):
        pt11 = surf.PointAt(i/unum,j/vnum)
        pt12 = surf.PointAt((i+panelWidth)/unum,j/vnum)
        
        pt21 = surf.PointAt((i+0.5)/unum,(j+0.75)/vnum)
        pt22 = surf.PointAt((i+0.5+panelWidth)/unum,(j+0.7)/vnum)
        
        pt31 = surf.PointAt((i+1)/unum,(j+1.5)/vnum)
        pt32 = surf.PointAt((i+1+panelWidth)/unum,(j+0.5)/vnum)
        
        n21 = surf.NormalAt((i+0.25)/unum,(j+0.5)/vnum)
        n22 = surf.NormalAt((i+0.25+panelWidth)/unum,(j+0.5)/vnum)
        
        pt21 += n21*panelDepth
        pt22 += n22*panelDepth
        
        line1 = rg.LineCurve(pt11,pt12)
        line2 = rg.LineCurve(pt21,pt22)
        line3 = rg.LineCurve(pt31,pt32)
        
        panelSurf = rg.Brep.CreateFromLoft([line1,line2,line3],rg.Point3d.Unset,rg.Point3d.Unset,rg.LoftType.Straight,False)
        panels.extend(panelSurf)
# ---------- end python ----------

# ---- group: Downlaod
python_2 = PythonScript(surf=srf, unum=number_slider, vnum=number_slider_2, panelWidth=number_slider_3, panelDepth=number_slider_4)  # -> out, panels; inputs surf: Surface, unum: Int32, vnum: Int32
# ---------- python_2: Python ----------
# This makes surface panels by lofting on an input surface
# input type: surf - Surface, unum - int, vnum - int, panelWdith - float, panelDepth - float

import Rhino.Geometry as rg

panels = []
for i in range(unum):
    for j in range(vnum):
        pt11 = surf.PointAt(i/unum, j/vnum)
        pt12 = surf.PointAt((i+panelWidth)/unum, j/vnum)
        pt21 = surf.PointAt((i+0.5)/unum, (j+0.75)/vnum)
        pt22 = surf.PointAt((i+0.5+panelWidth)/unum, (j+0.75)/vnum)
        pt31 = surf.PointAt((i+1)/unum, (j+1.5)/vnum)
        pt32 = surf.PointAt((i+1+panelWidth)/unum, (j+1.5)/vnum)
        
        n21 = surf.NormalAt((i+0.25)/unum, (j+0.5)/vnum)
        n22 = surf.NormalAt((i+0.25+panelWidth)/unum, (j+0.5)/vnum)
        pt21 += n21*panelDepth
        pt22 += n22*panelDepth
        
        line1 = rg.LineCurve(pt11, pt12)
        line2 = rg.LineCurve(pt21, pt22)
        line3 = rg.LineCurve(pt31, pt32)
        panelSurf = rg.Brep.CreateFromLoft([line1, line2, line3], rg.Point3d.Unset, rg.Point3d.Unset, rg.LoftType.Straight, False)
        panels.extend(panelSurf)
# ---------- end python_2 ----------
