# Grasshopper definition ss-02-10_Panelization_4.ghx (Grasshopper 0.9.76)
# plug-ins: Python Interpreter

srf = Surface(reparameterize(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))
number_slider = Slider(19, range=0..50)
number_slider_2 = Slider(10, range=0..50)
number_slider_3 = Slider(1, range=0..1)
python = PythonScript(surf=srf, unum=number_slider, vnum=number_slider_2, panelDepth=number_slider_3)  # -> out, panels, a, b, c, d, e, f; inputs surf: Surface, unum: Int32, vnum: Int32
# ---------- python: Python ----------
import Rhino.Geometry as rg
import math

panels = []

a = []
b = []
c = []
d = []
e = []
f = []

for i in range(unum):
    for j in range(vnum):
        
        if j%4 == 0:
            
            pt11 = surf.PointAt((i+1)/unum, j/vnum)
            pt21 = surf.PointAt((i+1.5+math.sin((i+1)*0.5)*0.5)/unum, j/vnum)
            pt31 = surf.PointAt((i+2)/unum, j/vnum)
            
            pt12 = surf.PointAt(i/unum, (j+1)/vnum)
            pt22 = surf.PointAt((i+0.5+math.sin(i*0.5)*0.5)/unum, (j+1)/vnum)
            pt32 = surf.PointAt((i+1)/unum, (j+1)/vnum)
            
            n21 = surf.NormalAt((i+1.5+math.sin((i+1)*0.5)*0.5)/unum, j/vnum)
            n22 = surf.NormalAt((i+0.5+math.sin(i*0.5)*0.5)/unum, (j+1)/vnum)
            
            pt21 += n21*panelDepth*math.sin(j*0.4)
            pt22 += n22*panelDepth*math.sin((j+1)*0.4)
            
            panel1 = rg.NurbsSurface.CreateFromCorners(pt11, pt21, pt22, pt12)
            panels.append(panel1)
            panel2 = rg.NurbsSurface.CreateFromCorners(pt21, pt31, pt32, pt22)
            panels.append(panel2)
            
            # a.append(pt11)
            # b.append(pt21)
            # c.append(pt31)
            # d.append(pt12)
            # e.append(pt22)
            # f.append(pt32)
            
            
            
        else:
            
            pt11 = surf.PointAt(i/unum, j/vnum)
            pt21 = surf.PointAt((i+0.5+math.sin(i*0.5)*0.5)/unum, j/vnum)
            pt31 = surf.PointAt((i+1)/unum, j/vnum)
            
            pt12 = surf.PointAt((i+1)/unum, (j+1)/vnum)
            pt22 = surf.PointAt((i+1.5+math.sin((i+1)*0.5)*0.5)/unum, (j+1)/vnum)
            pt32 = surf.PointAt((i+2)/unum, (j+1)/vnum)
            
            n21 = surf.NormalAt((i+0.5+math.sin(i*0.5)*0.5)/unum, j/vnum)
            n22 = surf.NormalAt((i+1.5+math.sin((i+1)*0.5)*0.5)/unum, (j+1)/vnum)
            
            pt21 += n21*panelDepth*math.sin(j*0.4)
            pt22 += n22*panelDepth*math.sin((j+1)*0.4)
            
            panel1 = rg.NurbsSurface.CreateFromCorners(pt11, pt21, pt22, pt12)
            panels.append(panel1)
            
            panel2 = rg.NurbsSurface.CreateFromCorners(pt21, pt31, pt32, pt22)
            panels.append(panel2)
            
            
            
            # a.append(pt11)
            # b.append(pt21)
            # c.append(pt31)
            # d.append(pt12)
            # e.append(pt22)
            # f.append(pt32)
            
            
            pass # debug
# ---------- end python ----------

# ---- group: Downlaod
python_2 = PythonScript(surf=srf, unum=number_slider, vnum=number_slider_2, panelDepth=number_slider_3)  # -> out, panels; inputs surf: Surface, unum: Int32, vnum: Int32
# ---------- python_2: Python ----------
# This makes surface panels by 6 points on an input surface
# input type: surf - Surface, unum - int, vnum - int, panelDepth - float

import Rhino.Geometry as rg
import math

panels = []
for i in range(unum):
    for j in range(vnum):
        if j % 4 == 0:
            pt11 = surf.PointAt((i+1)/unum, j/vnum)
            pt21 = surf.PointAt((i+1.5+math.sin((i+1)*0.5)*0.5)/unum, j/vnum)
            pt31 = surf.PointAt((i+2)/unum, j/vnum)
            pt12 = surf.PointAt(i/unum, (j+1)/vnum)
            pt22 = surf.PointAt((i+0.5+math.sin(i*0.5)*0.5)/unum, (j+1)/vnum)
            pt32 = surf.PointAt((i+1)/unum, (j+1)/vnum)
            
            n21 = surf.NormalAt((i+1.5+math.sin((i+1)*0.5)*0.5)/unum, j/vnum)
            n22 = surf.NormalAt((i+0.5+math.sin(i*0.5)*0.5)/unum, (j+1)/vnum)
            pt21 += n21*panelDepth * math.sin(j*0.4)
            pt22 += n22*panelDepth * math.sin((j+1)*0.4)
            
            panel = rg.NurbsSurface.CreateFromCorners(pt11,pt21,pt22,pt12)
            panels.append(panel)
            panel = rg.NurbsSurface.CreateFromCorners(pt21,pt31,pt32,pt22)
            panels.append(panel)
        else:
            pt11 = surf.PointAt(i/unum, j/vnum)
            pt21 = surf.PointAt((i+0.5+math.sin(i*0.5)*0.5)/unum, j/vnum)
            pt31 = surf.PointAt((i+1)/unum, j/vnum)
            pt12 = surf.PointAt((i+1)/unum, (j+1)/vnum)
            pt22 = surf.PointAt((i+1.5+math.sin((i+1)*0.5)*0.5)/unum, (j+1)/vnum)
            pt32 = surf.PointAt((i+2)/unum, (j+1)/vnum)
            
            n21 = surf.NormalAt((i+0.5+math.sin(i*0.5)*0.5)/unum, j/vnum)
            n22 = surf.NormalAt((i+1.5+math.sin((i+1)*0.5)*0.5)/unum, (j+1)/vnum)
            pt21 += n21*panelDepth * math.sin(j*0.4)
            pt22 += n22*panelDepth * math.sin((j+1)*0.4)
            
            panel = rg.NurbsSurface.CreateFromCorners(pt11,pt21,pt22,pt12)
            panels.append(panel)
            panel = rg.NurbsSurface.CreateFromCorners(pt21,pt31,pt32,pt22)
            panels.append(panel)
# ---------- end python_2 ----------
