# Grasshopper definition ss-02-12_Panelization_6.ghx (Grasshopper 0.9.76)
# plug-ins: Python Interpreter

number_slider = Slider(0.7, range=0..1)
srf = Surface(reparameterize(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))
number_slider_2 = Slider(19, range=0..50)
number_slider_3 = Slider(10, range=0..50)
number_slider_4 = Slider(1, range=0..1)
python = PythonScript(surf=srf, unum=number_slider_2, vnum=number_slider_3, panelDepth=number_slider_4, x=number_slider)  # -> out, panels, a, b, c, d, e, f; inputs surf: Surface, unum: Int32, vnum: Int32
# ---------- python: Python ----------
import Rhino.Geometry as rg
import random


panels = []


for i in range(unum):
    for j in range(vnum):
        
        pt1 = surf.PointAt(i/unum, j/vnum)
        pt2 = surf.PointAt((i+1)/unum, j/vnum)
        pt3 = surf.PointAt((i+1)/unum, (j+1)/vnum)
        pt4 = surf.PointAt(i/unum, (j+1)/vnum)
        
        
        if random.random() < x:
            n1 = surf.NormalAt(i/unum, j/vnum)
            n2 = surf.NormalAt((i+1)/unum, j/vnum)
            n3 = surf.NormalAt((i+1)/unum, (j+1)/vnum)
            n4 = surf.NormalAt(i/unum, (j+1)/vnum)
            
            uvRatio = random.random()*0.3
            depthRatio = random.random()
            
            pt5 = surf.PointAt((i+0.5-uvRatio)/unum, (j+0.5-uvRatio)/vnum)
            pt6 = pt2
            pt7 = surf.PointAt((i+0.5+uvRatio)/unum, (j+0.5+uvRatio)/vnum)
            pt8 = pt4
            
            pt5 += n1 * panelDepth * depthRatio
            pt6 += n2 * panelDepth * depthRatio * 0.5
            pt7 += n3 * panelDepth * depthRatio
            pt8 += n4 * panelDepth * depthRatio * 0.5
            
            polyline1 = rg.PolylineCurve([pt1, pt2, pt3, pt4, pt1])
            polyline2 = rg.PolylineCurve([pt5, pt6, pt7, pt8, pt5])
            
            panelSurf = rg.Brep.CreateFromLoft([polyline1, polyline2], rg.Point3d.Unset, rg.Point3d.Unset, rg.LoftType.Straight, False)
            panels.extend(panelSurf)
            
        else:
            panel = rg.NurbsSurface.CreateFromCorners(pt1, pt2, pt3, pt4)
            panels.append(panel)
# ---------- end python ----------

# ---- group: Downlaod
python_2 = PythonScript(surf=srf, unum=number_slider_2, vnum=number_slider_3, panelDepth=number_slider_4, x=number_slider)  # -> out, panels; inputs surf: Surface, unum: Int32, vnum: Int32
# ---------- python_2: Python ----------
# This makes surface panels by lofting on an input surface
# input type: surf - Surface, unum - int, vnum - int, panelDepth - float

import Rhino.Geometry as rg
import random

panels = []
for i in range(unum):
    for j in range(vnum):
        pt1 = surf.PointAt(i/unum, j/vnum)
        pt2 = surf.PointAt((i+1)/unum, j/vnum)
        pt3 = surf.PointAt((i+1)/unum, (j+1)/vnum)
        pt4 = surf.PointAt(i/unum, (j+1)/vnum)
        
        if random.random() < x:
            n1 = surf.NormalAt(i/unum, j/vnum)
            n2 = surf.NormalAt((i+1)/unum, j/vnum)
            n3 = surf.NormalAt((i+1)/unum, (j+1)/vnum)
            n4 = surf.NormalAt(i/unum, (j+1)/vnum)
            
            uvRatio = random.random()*0.3
            depthRatio = random.random()
            pt5 = surf.PointAt((i+0.5-uvRatio)/unum, (j+0.5-uvRatio)/vnum)
            pt6 = pt2 
            pt7 = surf.PointAt((i+0.5+uvRatio)/unum, (j+0.5+uvRatio)/vnum)
            pt8 = pt4 
            pt5 += n1 * panelDepth * depthRatio 
            pt6 += n2 * panelDepth * depthRatio * 0.5
            pt7 += n3 * panelDepth * depthRatio 
            pt8 += n4 * panelDepth * depthRatio * 0.5
            
            polyline1 = rg.PolylineCurve([pt1,pt2,pt3,pt4,pt1])
            polyline2 = rg.PolylineCurve([pt5,pt6,pt7,pt8,pt5])
            
            panelSurf = rg.Brep.CreateFromLoft([polyline1, polyline2], rg.Point3d.Unset, rg.Point3d.Unset, rg.LoftType.Straight, False)
            panels.extend(panelSurf)
        else:
            panel = rg.NurbsSurface.CreateFromCorners(pt1, pt2, pt3, pt4)
            panels.append(panel)
# ---------- end python_2 ----------
