# Grasshopper definition ss-02-13_InputTree_1.ghx (Grasshopper 0.9.76)
# plug-ins: Python Interpreter

sqgrid = Square(Plane=PlaneXY(0, 0, 0), Size=1, ExtentX=Slider(40, range=0..100), ExtentY=Slider(30, range=0..100))  # -> Cells, Points
python = PythonScript(ptTree=sqgrid.Points)  # -> out, a; inputs ptTree: tree of Point3d
# ---------- python: Python ----------
import rhinoscriptsyntax as rs

a=[]

for ptList in ptTree.Branches:
    for pt in ptList:
        
        circle = rs.AddCircle(pt,0.4)
        a.append(circle)
# ---------- end python ----------

# ---- group: Download
python_2 = PythonScript(ptTree=sqgrid.Points)  # -> out, a; inputs ptTree: tree of Point3d
# ---------- python_2: Python ----------
# this iterates a tree of points and put circles
# input type: ptTree : Point3d (Tree Access)
import rhinoscriptsyntax as rs

a = []
for ptList in ptTree.Branches:
    for pt in ptList:
        circle = rs.AddCircle(pt, 0.4)
        a.append(circle)
# ---------- end python_2 ----------
