# Grasshopper definition ss-02-14_InputTree_2.ghx (Grasshopper 0.9.76)
# plug-ins: Python Interpreter

sqgrid = Square(Plane=PlaneXY(0, 0, 0), Size=1, ExtentX=Slider(60, range=0..100), ExtentY=Slider(30, range=0..100))  # -> Cells, Points
flatten = FlattenTree(Tree=sqgrid.Points, Path="{0}")
python = PythonScript(ptTree=sqgrid.Points)  # -> out, a; inputs ptTree: tree of Point3d
# ---------- python: Python ----------
import rhinoscriptsyntax as rs

a =[]

for i in range(ptTree.BranchCount):
    ptList = ptTree.Branch(i)
    ptNum = len(ptList)
    for j in range(ptNum):
        if (i==10 and j==23 or i==20 and j==2 or i==30 and j==12):
            circle = rs.AddCircle(ptList[j],1)
        else:
            circle = rs.AddCircle(ptList[j],0.2)
        a.append(circle)
# ---------- end python ----------

# ---- group: Download
python_2 = PythonScript(ptTree=sqgrid.Points)  # -> out, a; inputs ptTree: tree of Point3d
# ---------- python_2: Python ----------
# this iterates a tree of points and put circles
# input type: ptTree : Point3d (Tree Access)
import rhinoscriptsyntax as rs

a = []
for i in range(ptTree.BranchCount):
    
    ptList = ptTree.Branch(i)
    ptNum = len(ptList)
    
    for j in range(ptNum):
        
        if (i==10 and j==23 or i==20 and j==2 or i==32 and j==18):
            circle = rs.AddCircle(ptList[j], 5)
            
        else:
            circle = rs.AddCircle(ptList[j], 0.5)
            
        a.append(circle)
# ---------- end python_2 ----------

# ----
python_3 = PythonScript(ptTree=flatten)  # -> out, a; inputs ptTree: list of Point3d
# ---------- python_3: Python ----------
# this iterates a tree of points and put circles
# input type: ptTree : Point3d (Tree Access)
import rhinoscriptsyntax as rs

a = []
for i in range(len(ptTree)):
    for j in range(ptNum):
        if( i==10 and j==23 or i==20 and j==2 or i==32 and j==18):
            circle = rs.AddCircle(ptList[j], 1)
        else:
            circle = rs.AddCircle(ptList[j], 0.2)
        a.append(circle)
# ---------- end python_3 ----------
