# Grasshopper definition ss-02-15_InputTree_3.ghx (Grasshopper 0.9.76)
# plug-ins: Python Interpreter

crv = Curve([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])
divlength = DivideLength(Curve=crv, Length=Slider(4, range=2..5))  # -> Points, Tangents, Parameters
panel = Panel(divlength.Points)
pt = Point(divlength.Points)

# ---- group: Download
python = PythonScript(ptTree=divlength.Points)  # -> out, a; inputs ptTree: tree; disabled
# ---------- python: Python ----------
# this connects closest points between branches in a tree
# input type: ptTree - Curve (Tree Access)
import rhinoscriptsyntax as rs

a = []
for ptList in ptTree.Branches:
    for pt in ptList:
        minDist = -1 # initialize
        for ptList2 in ptTree.Branches:
            if(ptList!=ptList2):
                print len(ptList2)
                for pt2 in ptList2:
                    dist = rs.Distance(pt, pt2)
                    if(minDist < 0): # first time
                        minDist = dist
                        closest = pt2
                    elif(dist < minDist):
                        minDist = dist
                        closest = pt2
        line = rs.AddLine(pt, closest)
        a.append(line)
# ---------- end python ----------

# ----
python_2 = PythonScript(ptTree=divlength.Points)  # -> out, a; inputs ptTree: tree
# ---------- python_2: Python ----------
import rhinoscriptsyntax as rs

a = []

for ptList in ptTree.Branches:
    for pt in ptList:
        minDist = -1 ##Initialize
        
        for ptList2 in ptTree.Branches:
            if (ptList != ptList2):
                
                for pt2 in ptList2:
                    dist = rs.Distance(pt,pt2)
                    
                    if(minDist<0):
                        minDist = dist
                        closest = pt2
                    elif(dist<minDist):
                        minDist = dist
                        closest = pt2
        line = rs.AddLine(pt,closest)
        a.append(line)
# ---------- end python_2 ----------
viewer = ParamViewer(pt)
viewer_2 = ParamViewer(python_2.a)
