# Grasshopper definition ss-03-01_Fun.gh (Grasshopper 0.9.76)
# plug-ins: Python Interpreter

pop2d = Populate2D(Region={Plane=PlaneXY(0, 0, 0), Size=Domain2(u=0..20, v=0..10)}, Count=Slider(100, range=10..100), Seed=1)
python = PythonScript(pts=pop2d)  # -> out, a; inputs pts: list of Point3d
# ---------- python: Python ----------
import rhinoscriptsyntax as rs
import Rhino.Geometry as rg
import math


## Function Definition
def drawWhorl(pt):
    r1 = 0.3
    r2 = 1
    num = 30
    
    lines=[]
    for i in range(num):
        vec1 = rg.Vector3d(r1,0,0)
        vec1.Rotate(math.pi*2*i/num + math.pi/3, rg.Vector3d.ZAxis)
        
        vec2 = rg.Vector3d(r2,0,0)
        vec2.Rotate(math.pi*2*i/num, rg.Vector3d.ZAxis)
        
        vec1 += pt
        vec2 += pt
        
        line = rs.AddLine(vec1,vec2)
        lines.append(line)
    return lines

## Main

a = []
for pt in pts:
    lines = drawWhorl(pt)
    a.extend(lines)
# ---------- end python ----------

# ---- group: Download
python_2 = PythonScript(pts=pop2d)  # -> out, a; inputs pts: list of Point3d
# ---------- python_2: Python ----------
# This draws a line pattern at each input point
# input type : pts - Point3d (List Access)
import rhinoscriptsyntax as rs
import Rhino.Geometry as rg
import math

# function definition
def drawWhorl(pt):
    r1 = 0.3
    r2 = 1
    num = 30
    lines = []
    for i in range(num):
        vec1 = rg.Vector3d(r1, 0, 0)
        vec1.Rotate(math.pi*2*i/num + math.pi/3, rg.Vector3d.ZAxis)
        vec2 = rg.Vector3d(r2, 0, 0)
        vec2.Rotate(math.pi*2*i/num, rg.Vector3d.ZAxis)
        vec1 += pt
        vec2 += pt
        line = rs.AddLine(vec1, vec2)
        lines.append(line)
    return lines

# main
a = []
for pt in pts:
    lines = drawWhorl(pt)
    a.extend(lines) # add all lines
# ---------- end python_2 ----------
