# Grasshopper definition ss-03-02_Function.gh (Grasshopper 0.9.76)
# plug-ins: Python Interpreter

srf = Surface(reparameterize(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))
number_slider = Slider(20, range=0..50)
vdiv = Slider(25, range=0..50)
python = PythonScript(Surf=srf, Udiv=number_slider, Vdiv=vdiv)  # -> Out, A

# ---- group: Download
python_2 = PythonScript(surf=srf, udiv=number_slider, vdiv=vdiv)  # -> out, a; inputs surf: Surface, udiv: Int32, vdiv: Int32
# ---------- python_2: Python ----------
# this adds tubular surface on an input surface by a function
# input type: surf - Surface (Item Access)
import rhinoscriptsyntax as rs
import Rhino.Geometry as rg

def addTube(pt, normal, radius):
    circle1 = rs.AddCircle(rg.Plane(pt, normal), radius)
    pt2 = pt + normal * 0.1
    circle2 = rs.AddCircle(rg.Plane(pt2, normal), radius*0.5)
    pt3 = pt + normal * 0.5
    circle3 = rs.AddCircle(rg.Plane(pt3, normal), radius*0.2)
    loftResult = rs.AddLoftSrf([circle1, circle2, circle3])
    return loftResult # loftResult is a list

a = []
vshift = 0
for i in range(1, udiv):
    vshift += 0.01
    for j in range(vdiv):
        u = i/udiv
        v = j/vdiv + vshift
        if(v > 1.0): v = v%1.0
        pt = surf.PointAt(u,v)
        nml = surf.NormalAt(u,v)
        result = addTube(pt, nml, 0.6-u*0.5) 
        a.extend(result) # result is a list
# ---------- end python_2 ----------
