# Grasshopper definition ss-03-03_RecursionFractal.gh (Grasshopper 0.9.76)
# plug-ins: Python Interpreter

crv = Curve(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)
line = Line(crv)
python = PythonScript(line=line)  # -> out, a; inputs line: Line
# ---------- python: Python ----------
## recursive
## this creates fractal line by Recursive function
## input type: line-Line (Item Access)

import rhinoscriptsyntax as rs
import Rhino.Geometry as rg
import math

def recursiveLine(line, depth, resultList):
    pt1 = line.PointAt(0)
    pt2 = line.PointAt(0.15)
    pt3 = line.PointAt(0.65)
    pt4 = line.PointAt(0.65)
    pt5 = line.PointAt(1.0)
    
    dir = rg.Vector3d(pt5.X-pt1.X, pt5.Y-pt1.Y, pt5.X-pt1.Z)
    dir.Rotate(math.pi*0.5, rg.Vector3d.ZAxis)
    pt3 += dir*0.5
    line1 = rg.Line(pt1,pt2)
    line2 = rg.Line(pt2,pt3)
    line3 = rg.Line(pt3,pt4)
    line4 = rg.Line(pt4,pt5)
    
    resultList.append(line1)
    resultList.append(line4)
    
    if (depth > 0):
        recursiveLine(line2,depth-1,resultList)
        recursiveLine(line3,depth-1,resultList)
    else:
        resultList.append(line2)
        resultList.append(line3)

## main
a = []
recursiveLine(line, 10, a) ## max 12??
# ---------- end python ----------
python_2 = PythonScript(line=line)  # -> out, a; inputs line: Curve, div: Int32
# ---------- python_2: Python ----------
# this creates fractal lines by recursive function
# input type: line - Line (Item Access)
import rhinoscriptsyntax as rs
import Rhino.Geometry as rg
import math

def recursiveLine(line, depth, resultList):
    pt1 = line.PointAt(0)
    pt2 = line.PointAt(0.15)
    pt3 = line.PointAt(0.65)
    pt4 = line.PointAt(0.65)
    pt5 = line.PointAt(1.0)
    dir = rg.Vector3d(pt5.X-pt1.X, pt5.Y-pt1.Y, pt5.Z-pt5.Z)
    dir.Rotate(math.pi/2, rg.Vector3d.ZAxis)
    pt3 += dir * 0.5
    line1 = rg.Line(pt1, pt2)
    line2 = rg.Line(pt2, pt3)
    line3 = rg.Line(pt3, pt4)
    line4 = rg.Line(pt4, pt5)
    resultList.append(line1)
    resultList.append(line4)
    if(depth>0):
        recursiveLine(line2, depth-1, resultList) # recursion
        recursiveLine(line3, depth-1, resultList) # recursion
    else:
        resultList.append(line2)
        resultList.append(line3)

# main
a = []
recursiveLine(line, 9, a)
# ---------- end python_2 ----------
join = JoinCurves(Curves=python.a, Preserve=False)
join_2 = JoinCurves(Curves=python_2.a, Preserve=False)
