# Grasshopper definition ss-03-04_RecursionFractalTree.gh (Grasshopper 0.9.76)
# plug-ins: Python Interpreter

crv = Curve(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)
line = Line(crv)
python = PythonScript(line=line)  # -> out, a; inputs line: Line, div: Int32
# ---------- python: Python ----------
# this creates random branching lines with recursion
# input type: line - Line (Item Access)
import rhinoscriptsyntax as rs
import Rhino.Geometry as rg
import random

def recursiveLine(line, depth, resultList):
    pt1 = line.PointAt(0)
    pt2 = line.PointAt(1)
    dir1 = rg.Vector3d(pt2.X-pt1.X, pt2.Y-pt1.Y, pt2.Z-pt1.Z)
    dir2 = rg.Vector3d(dir1) # copy

    dir1.Rotate(random.random()*0.4+0.1, rg.Vector3d.ZAxis) # random angle
    dir2.Rotate(random.random()*-0.4-0.1, rg.Vector3d.ZAxis)
    dir1 *= random.random()*0.2 + 0.8; # random scale
    dir2 *= random.random()*0.2 + 0.8;
    line1 = rg.Line(pt2, pt2+dir1)
    line2 = rg.Line(pt2, pt2+dir2)
    resultList.append(line1)
    resultList.append(line2)
    if(depth>0):
        if(random.random()<0.9): # random omission
            recursiveLine(line1, depth-1, resultList)
        if(random.random()<0.8): # random omission
            recursiveLine(line2, depth-1, resultList)

a = []
recursiveLine(line, 10, a)
# ---------- end python ----------
python_2 = PythonScript(line=line)  # -> out, a; inputs line: Line
# ---------- python_2: Python ----------
## this create raddom branching lines with recursion
## input type: line - Line(Item Access)

import rhinoscriptsyntax as rs
import Rhino.Geometry as rg
import random

def recursiveLine(line, depth, resultList):
    pt1 = line.PointAt(0)
    pt2 = line.PointAt(1)
    
    dir1 = rg.Vector3d(pt2.X-pt1.X, pt2.Y-pt1.Y, pt2.Z-pt1.Z)
    dir2 = rg.Vector3d(dir1) ## copy
    
    ## random angle
    dir1.Rotate(random.random()*0.3 +0.1, rg.Vector3d.ZAxis)
    dir2.Rotate(random.random()*-0.3 -0.1, rg.Vector3d.ZAxis)
    
    ## random scale
    dir1 *= random.random()*0.1 +0.8;
    dir2 *= random.random()*0.1 +0.8;
    
    line1 = rg.Line(pt2, pt2+dir1)
    line2 = rg.Line(pt2, pt2+dir2)
    
    resultList.append(line1)
    resultList.append(line2)
    
    if(depth>0): ## random omission
        if(random.random()<0.9):
            recursiveLine(line1, depth-1, resultList)
        if(random.random()<0.8):
            recursiveLine(line2, depth-1, resultList)

a = []
recursiveLine(line,12,a)
# ---------- end python_2 ----------
