# Grasshopper definition ss-03-05_MeshRecursion.gh (Grasshopper 0.9.76)
# plug-ins: Python Interpreter

mesh = Mesh(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)
python = PythonScript(mesh=mesh)  # -> out, a; inputs mesh: Mesh
# ---------- python: Python ----------
## this subdicided mesh faces by recursive function
## input type: mesh

import rhinoscriptsyntax as rs
import Rhino.Geometry
import math
import random

def subdivide(pt1, pt2, pt3,depth, resultList):
    if(depth == 0 or random.random()<0.1):
        v1 = rg.Point3f(pt1.X,
# ---------- end python ----------
python_2 = PythonScript(mesh=mesh)  # -> out, a; inputs mesh: Mesh
# ---------- python_2: Python ----------
# this subdivided mesh faces by recursive function
# input type - Mesh (Item Access)
import rhinoscriptsyntax as rs
import Rhino.Geometry as rg
import random
import math

def subdivide(pt1, pt2, pt3, depth, resultList):
    if(depth == 0 or random.random()<0.1): # random omission
        v1 = rg.Point3f(pt1.X, pt1.Y, pt1.Z);
        v2 = rg.Point3f(pt2.X, pt2.Y, pt2.Z);
        v3 = rg.Point3f(pt3.X, pt3.Y, pt3.Z);
        resultList.append([v1,v2,v3])
    else:
        npt1 = (pt1+pt2)/2
        npt2 = (pt2+pt3)/2
        npt3 = (pt3+pt1)/2
        npt4 = (npt1+npt2+npt3)/3
        normal = normalVector(pt1,pt2,pt3)
        npt4 += normal*0.06*math.sqrt(depth)
        subdivide(npt1, pt1, npt3, depth-1, resultList)
        subdivide(npt2, pt2, npt1, depth-1, resultList)
        subdivide(npt3, pt3, npt2, depth-1, resultList)
        subdivide(npt1, npt2, npt4, depth-1, resultList)
        subdivide(npt2, npt3, npt4, depth-1, resultList)
        subdivide(npt3, npt1, npt4, depth-1, resultList)

def normalVector(pt1, pt2, pt3):
    vec1 = rg.Vector3d.Subtract(rg.Vector3d(pt2),rg.Vector3d(pt1))
    vec2 = rg.Vector3d.Subtract(rg.Vector3d(pt3),rg.Vector3d(pt1))
    return rg.Vector3d.CrossProduct(vec1, vec2)

# main
a = []
vertices = []
for face in mesh.Faces:
    pt1 = rg.Vector3d(mesh.Vertices[face.A])
    pt2 = rg.Vector3d(mesh.Vertices[face.B])
    pt3 = rg.Vector3d(mesh.Vertices[face.C])
    subdivide(pt1, pt2, pt3, 5, vertices)
    if(face.IsQuad):
        pt4 = rg.Vector3d(mesh.Vertices[face.D])
        subdivide(pt1, pt4, pt3, 5, vertices) # reverse order

mesh2 = rg.Mesh()
for vtx in vertices:
    idx = mesh2.Vertices.Count
    mesh2.Vertices.Add(vtx[0])
    mesh2.Vertices.Add(vtx[1])
    mesh2.Vertices.Add(vtx[2])
    mesh2.Faces.AddFace(idx, idx+1, idx+2)
a = mesh2
# ---------- end python_2 ----------
