# Grasshopper definition ss-04-01_BakeWithColorPoint.gh (Grasshopper 0.9.76)
# plug-ins: Python Interpreter

python = PythonScript(bake=Toggle(True))  # -> out, a; inputs bake: Boolean
# ---------- python: Python ----------
## bake color with type
## input type: bool (Item Access)

import scriptcontext as sc
import Rhino.DocObjects as rd
import Rhino.Geometry as rg
import System.Drawing as sd
import Rhino

sc.doc = Rhino.RhinoDoc.ActiveDoc
if bake:
    xnum = 100
    ynum = 100
    
    for i in range(xnum):
        for j in range(ynum):
            pt = rg.Point3d(i,j,0)
            attr = rd.ObjectAttributes()
            attr.ColorSource = rd.ObjectColorSource.ColorFromObject
            attr.ObjectColor = sd.Color.FromArgb(i/xnum*255, j/ynum*255, 0)
            sc.doc.Objects.AddPoint(pt, attr)
# ---------- end python ----------
python_2 = PythonScript(bake=Toggle(False))  # -> out
# ---------- python_2: Python ----------
# bake points with colors
# input type - bool (Item Access)
import scriptcontext as sc
import Rhino.DocObjects as rd
import Rhino.Geometry as rg
import System.Drawing as sd
import Rhino

sc.doc = Rhino.RhinoDoc.ActiveDoc
if bake:
    xnum = 100
    ynum = 100
    for i in range(xnum):
        for j in range(ynum):
            pt = rg.Point3d(i,j,0)
            attr = rd.ObjectAttributes()
            attr.ColorSource = rd.ObjectColorSource.ColorFromObject
            attr.ObjectColor = sd.Color.FromArgb(i/xnum*255, j/ynum*255, 0)
            sc.doc.Objects.AddPoint(pt, attr)
# ---------- end python_2 ----------
