# Grasshopper definition ss-04-02_BakeWithColorCurve.gh (Grasshopper 0.9.76)
# plug-ins: Python Interpreter

python = PythonScript(bake=Toggle(False))  # -> out, a; inputs bake: Boolean
# ---------- python: Python ----------
## bake curves with colors
## input type: bool (Item Access)

import scriptcontext as sc
import System.Drawing as sd
import Rhino.DocObjects as rd
import Rhino.Geometry as rg
import Rhino
import math

sc.doc = Rhino.RhinoDoc.ActiveDoc
if bake:
    num = 100
    for i in range(num):
        pt1 = rg.Point3d(i,0,math.sin(i*0.2)*2)
        pt2 = rg.Point3d(i,5,2)
        pt3 = rg.Point3d(i,10,math.cos(i*0.1)*2)
        
        curve = rg.NurbsCurve.Create(False, 2, [pt1,pt2,pt3])
        attr = rd.ObjectAttributes()
        attr.ColorSource = rd.ObjectColorSource.ColorFromObject
        attr.ObjectColor = sd.Color.FromArgb(i/num*255, (num-i)/num*255, 255)
        sc.doc.Objects.AddCurve(curve, attr)
# ---------- end python ----------
python_2 = PythonScript(bake=Toggle(False))  # -> out
# ---------- python_2: Python ----------
# bake curves with colors
# input type - bool (Item Access)
import scriptcontext as sc
import System.Drawing as sd
import Rhino.DocObjects as rd
import Rhino.Geometry as rg
import Rhino
import math

sc.doc = Rhino.RhinoDoc.ActiveDoc
if bake:
    num = 100
    for i in range(num):
        pt1 = rg.Point3d(i, 0, math.sin(i*0.2)*2)
        pt2 = rg.Point3d(i, 5, 2)
        pt3 = rg.Point3d(i, 10, math.cos(i*0.1)*2)
        curve = rg.NurbsCurve.Create(False, 2, [pt1, pt2, pt3])
        attr = rd.ObjectAttributes()
        attr.ColorSource = rd.ObjectColorSource.ColorFromObject
        attr.ObjectColor = sd.Color.FromArgb(i/num*255, (num-i)/num*255, 255)
        sc.doc.Objects.AddCurve(curve, attr)
# ---------- end python_2 ----------
