# Grasshopper definition ss-04-03_BakeWithMaterial.gh (Grasshopper 0.9.76)
# plug-ins: Python Interpreter

panel = Panel("ViewType: Rendering")
python = PythonScript(bake=Toggle(False))  # -> out
# ---------- python: Python ----------
# bake surfaces with simple materials
# input type - bool (Item Access)
import scriptcontext as sc
import System.Drawing as sd
import Rhino.DocObjects as rd
import Rhino.Geometry as rg
import Rhino

sc.doc = Rhino.RhinoDoc.ActiveDoc
if bake:
    xnum = 20
    ynum = 20
    for i in range(xnum):
        for j in range(ynum):
            pt1 = rg.Point3d(i, j, 0)
            pt2 = rg.Point3d(i+1, j, 0)
            pt3 = rg.Point3d(i+1, j+1, i*j/100)
            pt4 = rg.Point3d(i, j+1, 0)
            surface = rg.NurbsSurface.CreateFromCorners(pt1,pt2,pt3,pt4)
            materialIndex = sc.doc.Materials.Add()
            material = sc.doc.Materials[materialIndex]
            material.DiffuseColor = sd.Color.FromArgb(i/xnum*255, j/ynum*255, 255)
            material.CommitChanges()
            attr = rd.ObjectAttributes()
            attr.MaterialSource = rd.ObjectMaterialSource.MaterialFromObject
            attr.MaterialIndex = materialIndex
            sc.doc.Objects.AddSurface(surface, attr)
# ---------- end python ----------
python_2 = PythonScript(bake=Toggle(False))  # -> out, a
# ---------- python_2: Python ----------
## bake surfaces with simple materials
## input type: bool(Item Access)

import scriptcontext as sc
import System.Drawing as sd
import Rhino.DocObjects as rd
import Rhino.Geometry as rg
import Rhino

sc.doc = Rhino.RhinoDoc.ActiveDoc
if bake:
    xnum = 20
    ynum = 20
    
    for i in range(xnum):
        for j in range(ynum):
            pt1 = rg.Point3d(i,j,0)
            pt2 = rg.Point3d(i+1,j,0)
            pt3 = rg.Point3d(i+1,j+1,i*j/100)
            pt4 = rg.Point3d(i,j+1,0)
            
            surface = rg.NurbsSurface.CreateFromCorners(pt1,pt2,pt3,pt4)
            materialIndex = sc.doc.Materials.Add()
            material = sc.doc.Materials[materialIndex]
            material.DiffuseColor = sd.Color.FromArgb(i/xnum*255,j/ynum*255,255)
            material.CommitChanges()
            
            attr = rd.ObjectAttributes()
            attr.MaterialSource = rd.ObjectMaterialSource.MaterialFromObject
            attr.MaterialIndex = materialIndex
            sc.doc.Objects.AddSurface(surface, attr)
# ---------- end python_2 ----------
