# Grasshopper definition ss-04-04_BakeWithMaterial.gh (Grasshopper 0.9.76)
# plug-ins: Python Interpreter

panel = Panel("ViewType: Rendering")
python = PythonScript(bake=Toggle(False))  # -> out
# ---------- python: Python ----------
# bake breps with simple materials
# input type - bool (Item Access)
import scriptcontext as sc
import System.Drawing as sd
import Rhino.DocObjects as rd
import Rhino.Geometry as rg
import Rhino

sc.doc = Rhino.RhinoDoc.ActiveDoc
if bake:
    xnum = 10
    ynum = 10
    znum = 10
    for i in range(xnum):
        for j in range(ynum):
            for k in range(znum):
                size = (i/xnum+j/ynum+k/znum)/3
                box = rg.Box( rg.Plane.WorldXY, rg.Interval(i, i+size), rg.Interval(j,j+size), rg.Interval(k, k+size) )
                brep = rg.Brep.CreateFromBox(box)
                materialIndex = sc.doc.Materials.Add()
                material = sc.doc.Materials[materialIndex]
                material.DiffuseColor = sd.Color.FromArgb(i/xnum*255, j/ynum*255, k/znum*255)
                material.CommitChanges()
                attr = rd.ObjectAttributes()
                attr.MaterialSource = rd.ObjectMaterialSource.MaterialFromObject
                attr.MaterialIndex = materialIndex
                sc.doc.Objects.AddBrep(brep, attr)
# ---------- end python ----------
python_2 = PythonScript(bake=Toggle(False))  # -> out, a; inputs bake: Boolean
# ---------- python_2: Python ----------
## bake breps with shimple materials
## input type: bool (Item Access)

import scriptcontext as sc
import System.Drawing as sd
import Rhino.DocObjects as rd
import Rhino.Geometry as rg
import Rhino

sc.duc = Rhino.RhinoDoc.ActiveDoc

if bake:
    xnum = 10
    ynum = 10
    znum = 10
    
    for i in range (xnum):
        for j in range(ynum):
            for k in range(znum):
                size = (i/xnum+ j/ynum+ k/znum)/3
                box = rg.Box(rg.Plane.WorldXY, rg.Interval(i, i+size), rg.Interval(j,j+size), rg.Interval(k,k+size))
                brep = rg.Brep.CreateFromBox(box)
                
                materialIndex = sc.doc.Materials.Add()
                material = sc.doc.Materials[materialIndex]
                material.DiffuseColor =sd.Color.FromArgb(i/xnum*255, j/ynum*255, k/znum*255)
                ## sd.Color.FromArgb()
                ## FromArge(int r, intg, int b)
                ## return "Color"
                material.CommitChanges()
                attr = rd.ObjectAttributes()
                attr.MaterialSource = rd.ObjectMaterialSource.MaterialFromObject
                attr.MaterialIndex = materialIndex
                sc.doc.Objects.AddBrep(brep, attr)
# ---------- end python_2 ----------
