# Grasshopper definition ss-04-05_BakeWithMaterialLight.gh (Grasshopper 0.9.76)
# plug-ins: Python Interpreter

panel = Panel("View Type: Rendering")
python = PythonScript(bake=Toggle(False))  # -> out
# ---------- python: Python ----------
# material attributes
# input type - bool (Item Access)
import scriptcontext as sc
import System.Drawing as sd
import Rhino.DocObjects as rd
import Rhino.Geometry as rg
import Rhino

sc.doc = Rhino.RhinoDoc.ActiveDoc
if bake:
    xnum = 20
    ynum = 20
    for i in range(xnum):
        for j in range(ynum):
            pt = rg.Point3d(i, j, 0)
            sphere = rg.Sphere(pt, 0.4)
            surface = rg.NurbsSurface.CreateFromSphere(sphere)
            materialIndex = sc.doc.Materials.Add()
            material = sc.doc.Materials[materialIndex]
            material.AmbientColor = sd.Color.FromArgb(0, 0, 0)
            material.DiffuseColor = sd.Color.FromArgb(255, 0, 0)
            material.EmissionColor = sd.Color.FromArgb(0, j/ynum*255, 0)
            material.ReflectionColor = sd.Color.FromArgb(255, 255, 255)
            material.SpecularColor = sd.Color.FromArgb(255, 255, i/xnum*255)
            material.Transparency = i/xnum
            material.TransparentColor = sd.Color.FromArgb(0, 0, 255)
            material.Shine = 1
            material.CommitChanges()
            attr = rd.ObjectAttributes()
            attr.MaterialSource = rd.ObjectMaterialSource.MaterialFromObject
            attr.MaterialIndex = materialIndex
            sc.doc.Objects.AddSurface(surface, attr)
# ---------- end python ----------
python_2 = PythonScript(bake=Toggle(False))  # -> out, a; inputs bake: Boolean
# ---------- python_2: Python ----------
## material attributes
## input type: bool (Item Access)

import scriptcontext as sc
import System.Drawing as sd
import Rhino.DocObjects as rd
import Rhino.Geometry as rg
import Rhino

sc.doc = Rhino.RhinoDoc.ActiveDoc
if bake:
    xnum = 20
    ynum = 20
    
    for i in range(xnum):
        for j in range(ynum):
            
            pt = rg.Point3d(i,j,0)
            sphere = rg.Sphere(pt,0.4)
            surface = rg.NurbsSurface.CreateFromSphere(sphere)
            
            materialIndex = sc.doc.Materials.Add()
            material = sc.doc.Materials[materialIndex]
            material.AmbientColor = sd.Color.FromArgb(0,0,0)
            material.DiffuseColor = sd.Color.FromArgb(255,0,0)
            material.EmissionColor = sd.Color.FromArgb(0,j/ynum*255,0)
            material.ReflectionColor = sd.Color.FromArgb(255,255,255)
            material.SpecularColor = sd.Color.FromArgb(255,255,i/xnum*255)
            material.Transparency = i/xnum
            material.TransparentColor = sd.Color.FromArgb(0,0,255)
            material.Shine = 1
            material.CommitChanges()
            
            attr = rd.ObjectAttributes()
            attr.MaterialSource = rd.ObjectMaterialSource.MaterialFromObject
            attr.MaterialIndex = materialIndex
            sc.doc.Objects.AddSurface(surface, attr)
# ---------- end python_2 ----------
