# Grasshopper definition ss-04-06_SetMaterialNameXXX.gh (Grasshopper 0.9.76)
# plug-ins: Python Interpreter

# Bool: ture
# 
# Return: material not found: else
panel = Panel("Cherry")
python = PythonScript(materialName=panel, bake=Toggle(False))  # -> out
# ---------- python: Python ----------
# setting materials by name
# input type - materialName: str, bake: bool (Item Access)
import scriptcontext as sc
import System.Drawing as sd
import Rhino.DocObjects as rd
import Rhino.Geometry as rg
import Rhino

sc.doc = Rhino.RhinoDoc.ActiveDoc
if bake:
    xnum = 20
    ynum = 20
    for i in range(xnum):
        for j in range(ynum):
            pt = rg.Point3d(i, j, 0)
            sphere = rg.Sphere(pt, 0.4)
            surface = rg.NurbsSurface.CreateFromSphere(sphere)
            
            materialIndex = sc.doc.Materials.Find(materialName, True)
            attr = rd.ObjectAttributes()
            if materialIndex >= 0:
                attr.MaterialSource = rd.ObjectMaterialSource.MaterialFromObject
                attr.MaterialIndex = materialIndex
            else:
                print "material " + materialName + " not found"
            sc.doc.Objects.AddSurface(surface, attr)
# ---------- end python ----------
panel_2 = Panel(python)
