# Grasshopper definition ss-04-07_BakeIntoLayer.gh (Grasshopper 0.9.76)
# plug-ins: Python Interpreter

# Bake into Layer
# 
# Veiw Color is abel to set
# Layer Color in NOT able to set
# 
# Layer Color is Default(Black)
# Export AI File XXXX
toggle = BooleanToggle(False)
python = PythonScript(bake=toggle)  # -> out
# ---------- python: Python ----------
# baking into layers
# input type - bool (Item Access)
import scriptcontext as sc
import System.Drawing as sd
import Rhino.DocObjects as rd
import Rhino.Geometry as rg
import Rhino
import math

sc.doc = Rhino.RhinoDoc.ActiveDoc
if bake:
    num = 40
    for i in range(num):
        pt1 = rg.Point3d(-math.sin(i*0.2), -math.sin(i*0.2), i*0.2)
        pt2 = rg.Point3d(math.cos(i*0.2), -math.sin(i*0.2), i*0.2)
        pt3 = rg.Point3d(math.sin(i*0.2), math.cos(i*0.2), i*0.2)
        pt4 = rg.Point3d(-math.cos(i*0.2), math.sin(i*0.2), i*0.2)
        curve = rg.NurbsCurve.Create(True, 1, [pt1, pt2, pt3, pt4])
        attr = rd.ObjectAttributes()
        attr.ColorSource = rd.ObjectColorSource.ColorFromObject
        attr.ObjectColor = sd.Color.FromArgb((num-i)/num*255, 255, i/num*255)
        layerName = "layer_" + str(i)
        layerIndex = sc.doc.Layers.Find(layerName, True)
        if layerIndex < 0:
            layer = rd.Layer()
            layer.Name = layerName
            layerIndex = sc.doc.Layers.Add(layer)
        attr.LayerIndex = layerIndex
        sc.doc.Objects.AddCurve(curve, attr)
# ---------- end python ----------
python_2 = PythonScript(bake=Toggle(False))  # -> out, a; inputs bake: Boolean
# ---------- python_2: Python ----------
## baking into layers
## input type: bool (Item Access)

import scriptcontext as sc
import System.Drawing as sd
import Rhino.DocObjects as rd
import Rhino.Geometry as rg
import Rhino
import math

sc.doc = Rhino.RhinoDoc.ActiveDoc

if bake:
    num = 40
    for i in range(num):
        pt1 = rg.Point3d(-math.sin(i*0.2),-math.sin(i*0.2),i*0.2)
        pt2 = rg.Point3d(math.cos(i*0.2),-math.sin(i*0.2),i*0.2)
        pt3 = rg.Point3d(math.sin(i*0.2),math.cos(i*0.2),i*0.2)
        pt4 = rg.Point3d(-math.cos(i*0.2),math.sin(i*0.2),i*0.2)
        
        curve = rg.NurbsCurve.Create(True, 1, [pt1,pt2,pt3,pt4])
        
        attr = rd.ObjectAttributes()
        attr.ColorSource = rd.ObjectColorSource.ColorFromObject
        attr.ObjectColor = sd.Color.FromArgb((num-i)/num*255,255,i/num*255)
        
        layerName = "layer_" +str(i)
        layerIndex = sc.doc.Layers.Find(layerName, True)
        
        if layerIndex < 0:
            layer = rd.Layer()
            layer.Name = layerName
            layerIndex = sc.doc.Layers.Add(layer)
            
        attr.LayerIndex = layerIndex
        sc.doc.Objects.AddCurve(curve, attr)
# ---------- end python_2 ----------
