# Grasshopper definition ss-04-08_BakeOnject.gh (Grasshopper 0.9.76)
# plug-ins: Python Interpreter

cone = Cone(Base=PlaneXY(0, 0, 0), Radius=0.5, Length=1)  # -> Cone, Tip
col = Colour(RGB(230, 71, 71))
col_2 = Colour(RGB(230, 71, 71))
col_3 = Colour(RGB(176, 255, 215))
col_4 = Colour(RGB(230, 64, 64))
col_5 = Colour(RGB(13, 78, 84))
col_6 = Colour(RGB(99, 0, 105))
python = PythonScript(
    obj=cone.Cone,
    objName="my object1",
    layerName="layer1",
    displayColor=col,
    plotColor=col_2,
    plotWeight=Slider(0.2, range=0..1),
    ambientColor=col_3,
    diffuseColor=col_4,
    emissionColor=col_5,
    specularColor=col_6,
    transparency=Slider(0.5, range=0..1),
    shine=Slider(0.6, range=0..1),
    wireDensity=Slider(2, range=0..10),
    bake=Toggle(False))  # -> out; inputs obj: GeometryBase, displayColor: Color, plotColor: Color, ambientColor: Color, diffuseColor: Color, emissionColor: Color, specularColor: Color, wireDensity: Int32, bake: Int32
# ---------- python: Python ----------
# bake objects with attributes
# input type - obj: GeometryBase, 
#              objName: str,
#              layerName: str,
#              displayColor: Color,
#              plotColor: Color,
#              plotWeight: float,
#              ambientColor: color,
#              diffuseColor: Color,
#              emissionColor: Color,
#              specularColor: Color,
#              transparency: float,
#              shine: float,
#              wireDensity: int,
#              bake: bool (Item Access)

import scriptcontext as sc
import System.Drawing as sd
import Rhino.DocObjects as rd
import Rhino.Geometry as rg
import Rhino

sc.doc = Rhino.RhinoDoc.ActiveDoc
if bake and obj is not None:
    attr = rd.ObjectAttributes()
    
    if objName is not None: # setting object name
        attr.Name = objName
    
    if layerName is not None: # setting layer
        if rd.Layer.IsValidName(layerName):
            layerIndex = sc.doc.Layers.Find(layerName, True)
            if layerIndex < 0: # if the layer doesn't exist
                layer = rd.Layer()
                layer.Name = layerName
                layerIndex = sc.doc.Layers.Add(layer)
            attr.LayerIndex = layerIndex
     
    if displayColor is not None: # setting display color
        attr.ColorSource = rd.ObjectAttributes.ColorSource.PropertyType.ColorFromObject
        attr.ObjectColor = displayColor
    
    if plotColor is not None: # setting plot color
        attr.PlotColorSource = rd.ObjectAttributes.PlotColorSource.PropertyType.PlotColorFromObject
        attr.PlotColor = plotColor
    
    if plotWeight >= 0: # setting plot weight
        attr.PlotWeightSource = rd.ObjectAttributes.PlotWeightSource.PropertyType.PlotWeightFromObject
        attr.PlotWeight = plotWeight
    
    if ambientColor is not None or diffuseColor is not None or emissionColor is not None or specularColor is not None or transparency >= 0 or shine >=0: # setting material
        materialIndex = sc.doc.Materials.Add()
        material = sc.doc.Materials[materialIndex]
        if ambientColor is not None:
            material.AmbientColor = ambientColor
        if diffuseColor is not None:
            material.DiffuseColor = diffuseColor
        if emissionColor is not None:
            material.EmissionColor = emissionColor
        if specularColor is not None:
            material.SpecularColor = specularColor
        if transparency >= 0:
            material.Transparency = transparency
        if shine >= 0:
            material.Shine = shine
        material.CommitChanges()
        attr.MaterialSource = rd.ObjectMaterialSource.MaterialFromObject
        attr.MaterialIndex = materialIndex
    
    if wireDensity > 0 or wireDensity == -1: # setting wire density
        attr.WireDensity = wireDensity
    
    # bake by type
    type = obj.ObjectType
    if type == rd.ObjectType.Point:
        sc.doc.Objects.AddPoint(obj.Location, attr)
    elif type == rd.ObjectType.Curve:
        sc.doc.Objects.AddCurve(obj, attr)
    elif type == rd.ObjectType.Surface:
        sc.doc.Objects.AddSurface(obj, attr)
    elif type == rd.ObjectType.Brep:
        sc.doc.Objects.AddBrep(obj, attr)
    elif type == rd.ObjectType.Mesh:
        sc.doc.Objects.AddMesh(obj, attr)
    else:
        print "object type "+str(type)+ " is not baked"
# ---------- end python ----------

cone_2 = Cone(Base=PlaneXY(0, 0, 0), Radius=0.5, Length=1)  # -> Cone, Tip
col_7 = Colour(RGB(230, 71, 71))
col_8 = Colour(RGB(230, 71, 71))
col_9 = Colour(RGB(176, 255, 215))
col_10 = Colour(RGB(230, 64, 64))
col_11 = Colour(RGB(13, 78, 84))
col_12 = Colour(RGB(99, 0, 105))
python_2 = PythonScript(
    obj=cone_2.Cone,
    objName="my object1",
    layerName="layer1",
    displayColor=col_7,
    plotColor=col_8,
    plotWeight=Slider(0, range=0..1),
    ambientColor=col_9,
    diffuseColor=col_10,
    emissionColor=col_11,
    specularColor=col_12,
    transparency=Slider(0.5, range=0..1),
    shine=Slider(0.6, range=0..1),
    wireDensity=Slider(2, range=0..10),
    bake=Toggle(False))  # -> out; inputs obj: GeometryBase, displayColor: Color, plotColor: Color, ambientColor: Color, diffuseColor: Color, emissionColor: Color, specularColor: Color, wireDensity: Int32, bake: Int32
# ---------- python_2: Python ----------
# bake objects with attributes
# input type - obj: GeometryBase, objName: str, layerName: str, displayColor: Color, plotColor: Color, plotWeight: float, ambientColor: color, diffuseColor: Color, emissionColor: Color, specularColor: Color, transparency: float, shine: float, wireDensity: int, bake: bool (Item Access)
import scriptcontext as sc
import System.Drawing as sd
import Rhino.DocObjects as rd
import Rhino.Geometry as rg
import Rhino

sc.doc = Rhino.RhinoDoc.ActiveDoc
if bake and obj is not None:
    attr = rd.ObjectAttributes()
    
    if objName is not None: # setting object name
        attr.Name = objName
    
    if layerName is not None: # setting layer
        if rd.Layer.IsValidName(layerName):
            layerIndex = sc.doc.Layers.Find(layerName, True)
            if layerIndex < 0: # if the layer doesn't exist
                layer = rd.Layer()
                layer.Name = layerName
                layerIndex = sc.doc.Layers.Add(layer)
            attr.LayerIndex = layerIndex
     
    if displayColor is not None: # setting display color
        attr.ColorSource = rd.ObjectAttributes.ColorSource.PropertyType.ColorFromObject
        attr.ObjectColor = displayColor
    
    if plotColor is not None: # setting plot color
        attr.PlotColorSource = rd.ObjectAttributes.PlotColorSource.PropertyType.PlotColorFromObject
        attr.PlotColor = plotColor
    
    if plotWeight >= 0: # setting plot weight
        attr.PlotWeightSource = rd.ObjectAttributes.PlotWeightSource.PropertyType.PlotWeightFromObject
        attr.PlotWeight = plotWeight
    
    if ambientColor is not None or diffuseColor is not None or emissionColor is not None or specularColor is not None or transparency >= 0 or shine >=0: # setting material
        materialIndex = sc.doc.Materials.Add()
        material = sc.doc.Materials[materialIndex]
        if ambientColor is not None:
            material.AmbientColor = ambientColor
        if diffuseColor is not None:
            material.DiffuseColor = diffuseColor
        if emissionColor is not None:
            material.EmissionColor = emissionColor
        if specularColor is not None:
            material.SpecularColor = specularColor
        if transparency >= 0:
            material.Transparency = transparency
        if shine >= 0:
            material.Shine = shine
        material.CommitChanges()
        attr.MaterialSource = rd.ObjectMaterialSource.MaterialFromObject
        attr.MaterialIndex = materialIndex
    
    if wireDensity > 0 or wireDensity == -1: # setting wire density
        attr.WireDensity = wireDensity
    
    # bake by type
    type = obj.ObjectType
    if type == rd.ObjectType.Point:
        sc.doc.Objects.AddPoint(obj.Location, attr)
    elif type == rd.ObjectType.Curve:
        sc.doc.Objects.AddCurve(obj, attr)
    elif type == rd.ObjectType.Surface:
        sc.doc.Objects.AddSurface(obj, attr)
    elif type == rd.ObjectType.Brep:
        sc.doc.Objects.AddBrep(obj, attr)
    elif type == rd.ObjectType.Mesh:
        sc.doc.Objects.AddMesh(obj, attr)
    else:
        print "object type "+str(type)+ " is not baked"
# ---------- end python_2 ----------
