# Grasshopper definition ss-04-09_PanelizationWithMaterials.gh (Grasshopper 0.9.76)
# plug-ins: Python Interpreter

number_slider = Slider(4, range=0..100)
number_slider_2 = Slider(15, range=0..100)
panel = Panel("""View Type;
Rendering""")
srf = Surface(reparameterize(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))
panel_2 = Panel(srf)
python = PythonScript(surf=srf, unum=number_slider, vnum=number_slider_2, bake=Toggle(False))  # -> out, panels, a; inputs surf: Surface, unum: Int32, vnum: Int32, bake: Boolean
# ---------- python: Python ----------
# This makes surface panels by 3 points on an input surface
# input type: surf - Surface, unum - int, vnum - int
import scriptcontext as sc
import System.Drawing as sd
import Rhino.DocObjects as rd
import Rhino.Geometry as rg
import Rhino
import math

sc.doc = Rhino.RhinoDoc.ActiveDoc
panels = []
a = []

for i in range(unum):
    for j in range(vnum):
        u = i/unum
        v = j/vnum
        pt1 = surf.PointAt(u, v)
        pt2 = surf.PointAt(u + (2-u)/unum, v + 0.1/vnum)
        pt3 = surf.PointAt(u + (1.5+u)/unum, v + 1/vnum)
        pt4 = surf.PointAt(u + 0.3/unum, v + 1/vnum)
        n1 = surf.NormalAt(u, v)
        n2 = surf.NormalAt(u + (2.5-u)/unum, v + 0.1/vnum)
        n3 = surf.NormalAt(u + (1.5+u)/unum, v + 1/vnum)
        n4 = surf.NormalAt(u + 0.3/unum, v + 1/vnum)
        
        pt1 += n1*0.2
        pt2 += n2*1.2
        pt3 += n3*1.8
        pt4 += n4*0.3
        
        panel = rg.NurbsSurface.CreateFromCorners(pt1, pt2, pt3, pt4)
        panels.append(panel)
        a.append(pt1)
        
        if bake:
            materialIndex = sc.doc.Materials.Add()
            material = sc.doc.Materials[materialIndex]
            material.AmbientColor = sd.Color.FromArgb(0, 0, 0)
            material.DiffuseColor = sd.Color.FromArgb(255-u*255, u*255, math.fabs(1-2*v)*255)
            material.EmissionColor = sd.Color.FromArgb(0, u*30, 0)
            material.SpecularColor = sd.Color.FromArgb(u*255, 0, u*255)
            material.Transparency = u
            material.Shine = 1-u
            material.CommitChanges()
            attr = rd.ObjectAttributes()
            attr.MaterialSource = rd.ObjectMaterialSource.MaterialFromObject
            attr.MaterialIndex = materialIndex
            sc.doc.Objects.AddSurface(panel, attr)
# ---------- end python ----------
python_2 = PythonScript(surf=srf, unum=number_slider, vnum=number_slider_2, bake=Toggle(False))  # -> out, panels; inputs surf: Surface, unum: Int32, vnum: Int32, bake: Boolean
# ---------- python_2: Python ----------
## this makes surface panels by 3 points on an input surface

## input type; sur - Surface
##             unum,vunm - int

import scriptcontext as sc
import System.Drawing as sd
import Rhino.DocObjects as rd
import Rhino.Geometry as rg
import Rhino
import math

sc.doc = Rhino.RhinoDoc.ActiveDoc
panels =[]

for i in range(unum):
    for j in range(vnum):
        
        u = i/unum
        v = j/vnum
        
        pt1 = surf.PointAt(u,v)
        pt2 = surf.PointAt(u+ (2-u)/unum, v + 0.1/vnum)
        pt3 = surf.PointAt(u+ (1.5+u)/unum, v + 1/vnum)
        pt4 = surf.PointAt(u+ 0.3/unum, v+ 1/vnum)
        
        n1 = surf.NormalAt(u,v)
        n2 = surf.NormalAt(u+ (2.5-u)/unum, v+ 0.1/vnum)
        n3 = surf.NormalAt(u+ (1.5+u)/unum, v+ 1/vnum)
        n4 = surf.NormalAt(u+ 0.3/unum, v+1/vnum)
        
        pt1 += n1*0.2
        pt2 += n2*1.2
        pt3 += n3*1.8
        pt4 += n4*0.3
        
        panel = rg.NurbsSurface.CreateFromCorners(pt1,pt2,pt3,pt4)
        panels.append(panel)
        
        if bake:
            materialIndex = sc.doc.Materials.Add()
            material = sc.doc.Materials[materialIndex]
            material.AmbientColor = sd.Color.FromArgb(0,0,0)
            ## fabs = float abs?
            ## abs = Absolute value (ex: 1>1, -3.2>3.2)
            material.DiffuseColor = sd.Color.FromArgb(255-u*255, u*255, math.fabs(1-2*v)*255)
            material.EmissionColor = sd.Color.FromArgb(0,u*30,0)
            material.SpecularColor = sd.Color.FromArgb(u*255,0,u*255)
            material.Transparency = u
            material.Shine = 1-u
            material.CommitChanges()
            attr = rd.ObjectAttributes()
            attr.MaterialSource = rd.ObjectMaterialSource.MaterialFromObject
            attr.MaterialIndex = materialIndex
            sc.doc.Objects.AddSurface(panel, attr)
# ---------- end python_2 ----------
pt = Point(python.a)
