# Grasshopper definition ss-04-10_PanelizationWithMaterials.gh (Grasshopper 0.9.76)
# plug-ins: Python Interpreter

number_slider = Slider(15, range=0..100)
number_slider_2 = Slider(32, range=0..100)
srf = Surface(reparameterize(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))

# ---- group: download
python = PythonScript(surf=srf, unum=number_slider, vnum=number_slider_2, bake=Toggle(True))  # -> out, panels; inputs surf: Surface, unum: Int32, vnum: Int32, bake: Boolean
# ---------- python: Python ----------
# This makes surface panels by 3 points on an input surface
# input type: surf - Surface, unum - int, vnum - int
import scriptcontext as sc
import System.Drawing as sd
import Rhino.DocObjects as rd
import Rhino.Geometry as rg
import Rhino
import math

def stretchTriangle(pt1, pt2, pt3, nml, stretchRatio):
    pt4 = pt2 + (pt2-pt1)*stretchRatio + nml
    return rg.NurbsSurface.CreateFromPoints([pt1,pt2,pt4, pt3,pt2,pt4], 2, 3, 1, 2)

sc.doc = Rhino.RhinoDoc.ActiveDoc
panels = []
for i in range(unum):
    for j in range(vnum):
        if (i+j)%2 == 0:
            u = i/unum
            v = j/vnum
            pt1 = surf.PointAt(u, v)
            pt2 = surf.PointAt(u + 1/unum, v - 1/vnum)
            pt3 = surf.PointAt(u + 1/unum, v + 1/vnum)
            pt4 = surf.PointAt(u + 1/unum, v + 0.5/vnum)
            nml = surf.NormalAt(u, v)
            
            panel1 = stretchTriangle(pt1, pt2, pt3+nml*0.5, nml*2*u, 4*u+0.5)
            panels.append(panel1)
            panel2 = stretchTriangle(pt1, pt4, pt2, nml*u, 2*u+0.5)
            panels.append(panel2)
            
            if bake:
                materialIndex1 = sc.doc.Materials.Add()
                material1 = sc.doc.Materials[materialIndex1]
                if (i+j)%4 == 0:
                    material1.DiffuseColor = sd.Color.FromArgb(255-u*255, u*255, math.fabs(1-2*v)*255)
                    material1.EmissionColor = sd.Color.FromArgb(0, u*30, 0)
                    material1.SpecularColor = sd.Color.FromArgb(u*255, 0, u*255)
                    material1.Shine = 0.25
                else:
                    material1.DiffuseColor = sd.Color.FromArgb(0,0,128)
                material1.Transparency = 0.25
                material1.CommitChanges()
                attr1 = rd.ObjectAttributes()
                attr1.MaterialSource = rd.ObjectMaterialSource.MaterialFromObject
                attr1.MaterialIndex = materialIndex1
                sc.doc.Objects.AddSurface(panel1, attr1)
                
                materialIndex2 = sc.doc.Materials.Add()
                material2 = sc.doc.Materials[materialIndex2]
                material2.DiffuseColor = sd.Color.FromArgb(math.fabs(1-2*v)*255, (1-math.fabs(1-2*v))*128, 0)
                material2.CommitChanges()
                attr2 = rd.ObjectAttributes()
                attr2.MaterialSource = rd.ObjectMaterialSource.MaterialFromObject
                attr2.MaterialIndex = materialIndex2
                sc.doc.Objects.AddSurface(panel2, attr2)
# ---------- end python ----------

# ----
python_2 = PythonScript(surf=srf, unum=number_slider, vnum=number_slider_2, bake=Toggle(False))  # -> out, panels; inputs surf: Surface, unum: Int32, vnum: Int32, bake: Boolean
# ---------- python_2: Python ----------
## this makes surface palnels by 3 points on an input surface
## input type: surf-Surface
##             unum,vnum-int

import scriptcontext as sc
import System.Drawing as sd
import Rhino.DocObjects as rd
import Rhino.Geometry as rg
import Rhino
import math

def stretchTriangle(pt1,pt2,pt3,nm1,stretchRatio):
    pt4 = pt2 + (pt2-pt1)*stretchRatio + nml
    return rg.NurbsSurface.CreateFromPoints([pt1,pt2,pt4,pt3,pt2,pt4],2,3,1,2)

sc.doc = Rhino.RhinoDoc.ActiveDoc
panels = []
for i in range(unum):
    for j in range(vnum):
        
        if(i+j)%2 ==0:
            u = i/unum
            v = j/vnum
            
            pt1 = surf.PointAt(u,v)
            pt2 = surf.PointAt(u+1/unum,v-1/vnum)
            pt3 = surf.PointAt(u+1/unum,v+1/vnum)
            pt4 = surf.PointAt(u+1/unum,v+0.5/vnum)
            
            nml = surf.NormalAt(u,v)
            
            panel1 = stretchTriangle(pt1,pt2,pt3+nml*0.5,nml*2*u,4*u+0.5)
            panels.append(panel1)
            panel2 = stretchTriangle(pt1,pt4,pt2,nml*u,2*u+0.5)
            panels.append(panel2)
            
            if bake:
                materialIndex1 = sc.doc.Materials.Add()
                material1 = sc.doc.Materials[materialIndex1]
                
                if (i+j)%4 == 0:
                    material1.DiffuseColor = sd.Color.FromArgb(255-u*255,u*255,math.fabs(1-2*v)*255)
                    material1.EmissionColor = sd.Color.FromArgb(0,u*30,0)
                    material1.SpecularColor = sd.Color.FromArgb(u*255,0,u*255)
                    material1.Shine = 0.25
                else:
                    material1.DiffuseColor = sd.Color.FromArgb(0,0,128)
                material1.Transparency = 0.25
                material1.CommitChanges()
                attr1 = rd.ObjectAttributes()
                attr1.MaterialSource = rd.ObjectMaterialSource.MaterialFromObject
                attr1.MaterialIndex = materialIndex1
                sc.doc.Objects.AddSurface(panel1,attr1)
                
                materialIndex2 = sc.doc.Materials.Add()
                material2 = sc.doc.Materials[materialIndex2]
                material2.DiffuseColor = sd.Color.FromArgb(math.fabs(1-2*v)*255,(1-math.fabs(1-2*v))*128,0)
                material2.CommitChanges()
                attr2 = rd.ObjectAttributes()
                attr2.MaterialSource = rd.ObjectMaterialSource.MaterialFromObject
                attr2.MaterialIndex = materialIndex2
                sc.doc.Objects.AddSurface(panel2,attr2)
# ---------- end python_2 ----------
