# Grasshopper definition ss-05-01_DefineClass.gh (Grasshopper 0.9.76)
# plug-ins: Python Interpreter

pt = Point(Point(-0.0521072434, 0.01302681085, 0))
python = PythonScript(pts=pt)  # -> out, a; inputs pts: Point3d
# ---------- python: Python ----------
## defining a custom class
## input type: Point3d(List Access)

class Class1:
    ## __init__ is a special method to initialize a class instance
    def __init__ (self,pt):
        self.center = pt

for pt in pts:
    obj = Class1(pt)
# ---------- end python ----------

# ---- group: download
python_2 = PythonScript(pts=pt)  # -> out, a; inputs pts: list of Point3d
# ---------- python_2: Python ----------
# defining a custom class
# input type - Point3d (List Access)

class Class1:
    # __init__ is a special method to initialize a class instance (constructor)
    def __init__(self, pt):
        self.center = pt

for pt in pts:
    obj = Class1(pt)
# ---------- end python_2 ----------

# ----
panel = Panel(pt)
panel_2 = Panel(python_2.out)
panel_3 = Panel(python_2.a)
