# Grasshopper definition ss-05-04_AddMoreMethod.gh (Grasshopper 0.9.76)
# plug-ins: Python Interpreter

pop2d = Populate2D(Region={Plane=PlaneXY(0, 0, 0), Size=Domain2(u=0..20, v=0..10)}, Count=100, Seed=1)
python = PythonScript(pts=pop2d)  # -> out, a; inputs pts: list of Point3d
# ---------- python: Python ----------
## definig a custom class
## input type: Point3d (list Access)

import rhinoscriptsyntax as rs
import Rhino.Geometry as rg

class Class1:
    def __init__(self, pt):
        self.center = pt
        self.radius = 0.5
        
    def getCircle(self):
        return rs.AddCircle(self.center, self.radius)
        
    def getSquare(self):
        plane = rg.Plane(self.center +rg.Point3d(-self.radius,-self.radius,0),rg.Vector3d.ZAxis)
        return rs.AddRectangle(plane,self.radius*2,self.radius*2)
        ## plane is left Bottom Corner
        
a = []

for pt in pts:
    obj = Class1(pt)
    a.append(obj.getCircle())
    a.append(obj.getSquare())
# ---------- end python ----------

# ---- group: download
python_2 = PythonScript(pts=pop2d)  # -> out, a; inputs pts: list of Point3d
# ---------- python_2: Python ----------
# defining a custom class
# input type - Point3d (List Access)
import rhinoscriptsyntax as rs
import Rhino.Geometry as rg

class Class1:
    def __init__(self, pt):
        self.center = pt
        self.radius = 0.5

    def getCircle(self):
        return rs.AddCircle(self.center, self.radius)

    def getSquare(self):
        plane = rg.Plane(self.center + rg.Point3d(-self.radius,-self.radius,0),rg.Vector3d.ZAxis)
        return rs.AddRectangle(plane, self.radius*2, self.radius*2)

a = []

for pt in pts:
    obj = Class1(pt)
    a.append( obj.getCircle() )
    a.append( obj.getSquare() )
# ---------- end python_2 ----------
