# Grasshopper definition ss-05-05_GeometricModule.gh (Grasshopper 0.9.76)
# plug-ins: Python Interpreter

pop2d = Populate2D(Region={Plane=PlaneXY(0, 0, 0), Size=Domain2(u=0..20, v=0..10)}, Count=100, Seed=1)
python = PythonScript(pts=pop2d)  # -> out, a; inputs pts: list of Point3d
# ---------- python: Python ----------
## definig a custom class
## input type: Point3d (List Acccess)

import rhinoscriptsyntax as rs
import Rhino.Geometry as rg

class CircleSequence:
    def __init__(self,pt,dir):
        self.center = pt
        self.dir = dir
        self.radius = 0.2
        
    def generate(self):
        for i in range(10):
            circle = rs.AddCircle(self.center,self.radius)
            self.dir *= 0.9
            self.radius *= 0.8
            self.dir.Rotate(0.2,rg.Vector3d.ZAxis)
            self.center += self.dir
            a.append(circle)

a = []

for pt in pts:
    obj = CircleSequence(pt, rg.Vector3d(0,0.2,0))
    obj.generate()
# ---------- end python ----------

# ---- group: download
python_2 = PythonScript(pts=pop2d)  # -> out, a; inputs pts: list of Point3d
# ---------- python_2: Python ----------
# defining a custom class
# input type - Point3d (List Access)
import rhinoscriptsyntax as rs
import Rhino.Geometry as rg

class CircleSequence:
    def __init__(self, pt, dir):
        self.center = pt
        self.dir = dir
        self.radius = 0.2

    def generate(self):
        for i in range(10):
            circle = rs.AddCircle(self.center, self.radius)
            self.dir *= 0.9
            self.radius *= 0.8
            self.dir.Rotate(0.2, rg.Vector3d.ZAxis)
            self.center += self.dir
            a.append(circle)

a = []
for pt in pts:
    obj = CircleSequence(pt, rg.Vector3d(0,0.2,0))
    obj.generate()
# ---------- end python_2 ----------
