# Grasshopper definition ss-05-06_GeometricModule.gh (Grasshopper 0.9.76)
# plug-ins: Python Interpreter

pop2d = Populate2D(Region={Plane=PlaneXY(0, 0, 0), Size=Domain2(u=0..20, v=0..10)}, Count=Slider(50, range=0..100), Seed=1)

# ---- group: download
python = PythonScript(pts=pop2d)  # -> out, a; inputs pts: list of Point3d
# ---------- python: Python ----------
# defining a custom class
# input type - Point3d (List Access)
import rhinoscriptsyntax as rs
import Rhino.Geometry as rg
import random
import math

class CircleSequence:
    def __init__(self, pt, dir):
        self.center = pt
        self.dir = dir
        self.radius = 0.2

    def generate(self):
        for i in range(10):
            circle = rs.AddCircle(self.center, self.radius)
            self.dir *= 0.9
            self.radius *= 0.8
            self.dir.Rotate(0.2, rg.Vector3d.ZAxis)
            self.center += self.dir
            a.append(circle)

class SpiralCircles:
    def __init__(self, pt, size, count):
        self.center = pt
        dir = rg.Vector3d(0,size,0)
        self.arms = []
        for i in range(count):
            arm = CircleSequence(pt, rg.Vector3d(dir))
            self.arms.append(arm)
            dir.Rotate(math.pi*2/count, rg.Vector3d.ZAxis)
    
    def generate(self):
        for arm in self.arms:
            arm.generate() 

a = []
for pt in pts:
    size = random.random()*0.3 + 0.1
    count = int(random.random()*10)+2
    obj = SpiralCircles(pt, size, count)
    obj.generate()
# ---------- end python ----------

# ----
python_2 = PythonScript(pts=pop2d)  # -> out, a; inputs pts: list of Point3d
# ---------- python_2: Python ----------
## defining a custom class
## input type: Point3d (List Access)

import rhinoscriptsyntax as rs
import Rhino.Geometry as rg
import random
import math

class CircleSequence:
    def __init__(self, pt, dir):
        self.center = pt
        self.dir = dir
        self.radius = 0.2
        
    def generate(self):
        for i in range(10):
            circle = rs.AddCircle(self.center,self.radius)
            self.dir *= 0.9
            self.radius *= 0.8
            self.dir.Rotate(0.2, rg.Vector3d.ZAxis)
            self.center += self.dir
            a.append(circle)

class SpiralCircles:
    def __init__(self,pt,size,count):
        self.center = pt
        dir = rg.Vector3d(0,size,0)
        self.arms = []
        
        for i in range(count):
            arm = CircleSequence(pt,rg.Vector3d(dir))
            self.arms.append(arm)
            dir.Rotate(math.pi*2/count, rg.Vector3d.ZAxis)
            
    def generate(self):
        for arm in self.arms:
            arm.generate


a=[]
for pt in pts:
    size = random.random()*0.3 + 0.1
    count = int(random.random()*10)+2
    obj = SpiralCircles(pt,size,count)
    obj.generate()
# ---------- end python_2 ----------
python_3 = PythonScript()  # -> out, a
# ---------- python_3: Python ----------
import math

print(math.pi)
# ---------- end python_3 ----------
panel = Panel(python.a)
panel_2 = Panel(python_3.out)
