# Grasshopper definition ss-05-07_GeometricModule.gh (Grasshopper 0.9.76)
# plug-ins: Python Interpreter

pop2d = Populate2D(Region={Plane=PlaneXY(0, 0, 0), Size=Domain2(u=0..20, v=0..10)}, Count=100, Seed=1)

# ---- group: download
python = PythonScript(pts=pop2d)  # -> out, a; inputs pts: list of Point3d
# ---------- python: Python ----------
# defining a custom class
# input type - Point3d (List Access)
import rhinoscriptsyntax as rs
import Rhino.Geometry as rg
import random

class HierarchyBoxes:
    def __init__(self, pt, size, level):
        self.pt = pt
        self.size = size
        self.child = CornerBoxes(pt, size, size/2, level-1)
    def generate(self):
        box = rg.Box(rg.Plane.WorldXY, [self.pt, rg.Point3d(pt)+rg.Point3d(self.size,self.size,self.size)])
        a.append(box)
        self.child.generate()

class CornerBoxes:
    def __init__(self, pt, size1, size2, level):
        self.pt = pt
        self.size1 = size1
        self.size2 = size2
        self.children = []
        if(level>1):
            child1 = CornerBoxes(rg.Point3d(pt)+rg.Point3d(-size2,-size2,-size2), size2, size2/2, level-1)
            child2 = CornerBoxes(rg.Point3d(pt)+rg.Point3d(size1,-size2,-size2),  size2, size2/2, level-1)
            child3 = CornerBoxes(rg.Point3d(pt)+rg.Point3d(-size2,size1,-size2),  size2, size2/2, level-1)
            self.children.append(child1)
            self.children.append(child2)
            self.children.append(child3)
    
    def makeBox(self, corner):
        box = rg.Box(rg.Plane.WorldXY, [corner, rg.Point3d(corner)+rg.Point3d(-self.size2,-self.size2,-self.size2)])
        a.append(box)

    def generate(self):
        self.makeBox(self.pt)
        self.makeBox(rg.Point3d(self.pt) + rg.Point3d(self.size1+self.size2, 0, 0))
        self.makeBox(rg.Point3d(self.pt) + rg.Point3d(0, self.size1+self.size2, 0))
        for c in self.children:
            c.generate()

a = []
for pt in pts:
    level = int(random.random()*5)+1
    obj = HierarchyBoxes(pt, 0.5, level)
    obj.generate()
# ---------- end python ----------

# ----
python_2 = PythonScript(pts=pop2d)  # -> out, a; inputs pts: list of Point3d
# ---------- python_2: Python ----------
## defining a custom class
## input type: Point3d (List Access)

import rhinoscriptsyntax as rs
import Rhino.Geometry as rg
import random

class HierarchyBoxes:
    def __init__(self,pt,size,level):
        self.pt = pt
        self.size = size
        self.child = CornerBoxes(pt,size,size/2,level-1)
        
    def generate(self):
        box = rg.Box(rg.Plane.WorldXY, [self.pt,rg.Point3d(pt)+rg.Point3d(self.size,self.size,self.size)])
        a.append(box)
        self.child.generate()

class CornerBoxes:
    def __init__(self,pt,size1,size2,level):
        self.pt = pt
        self.size1 = size1
        self.size2 = size2
        self.children = []
        
        if (level>1):
            child1 = CornerBoxes(rg.Point3d(pt)+rg.Point3d(-size2,-size2,-size2),size2,size2/2,level-1)
            child2 = CornerBoxes(rg.Point3d(pt)+rg.Point3d(size1,-size2,-size2),size2,size2/2,level-1)
            child3 = CornerBoxes(rg.Point3d(pt)+rg.Point3d(-size2,size1,-size2),size2,size2/2,level-1)
            
            self.children.append(child1)
            self.children.append(child2)
            self.children.append(child3)
    
    def makeBox(self,corner):
        box = rg.Box(rg.Plane.WorldXY,[corner,rg.Point3d(corner)+rg.Point3d(-self.size2,-self.size2,-self.size2)])
        a.append(box)
    
    def generate(self):
        self.makeBox(self.pt)
        self.makeBox(rg.Point3d(self.pt)+rg.Point3d(self.size1+self.size2,0,0))
        self.makeBox(rg.Point3d(self.pt)+rg.Point3d(0,self.size1+self.size2,0))
        for c in self.children:
            c.generate()

a=[]
for pt in pts:
    level = int(random.random()*5)+1
    obj = HierarchyBoxes(pt,0.5,level)
    obj.generate()
# ---------- end python_2 ----------
viewer = ParamViewer(python.a)
viewer_2 = ParamViewer(python_2.a)
