# Grasshopper definition ss-05-08_GeometricModule.gh (Grasshopper 0.9.76)
# plug-ins: Python Interpreter

pt = Point(Point(0, 0, 0))

# ---- group: download
python = PythonScript(pts=pt)  # -> out, a; inputs pts: list of Point3d
# ---------- python: Python ----------
# defining a custom class
# input type - Point3d (List Access)
import rhinoscriptsyntax as rs
import Rhino.Geometry as rg
import random

class AngleSequence:
    def __init__(self, pt, dir, width, count):
        self.pt = pt
        self.width = width
        self.dir = dir
        self.count = count

    def generate(self):
        ndir = rg.Vector3d.CrossProduct(self.dir, rg.Vector3d.ZAxis)
        wdir = rg.Vector3d.CrossProduct(self.dir, ndir)
        wdir.Unitize()
        wdir *= self.width/2
        pt1 = rg.Point3d(self.pt)-wdir
        pt2 = rg.Point3d(self.pt)
        pt3 = rg.Point3d(self.pt)+wdir
        plines = []
        for i in range(self.count):
            pline = rg.PolylineCurve([pt1,pt2,pt3])
            plines.append(pline)
            a.append(pline)
            pt1 += self.dir
            pt2 += self.dir*1.5
            pt3 += self.dir
        return plines

class TiltedExtrusion:
    def __init__(self, pt, dir, width, count):
        self.angles = AngleSequence(pt,dir,width,count)
        self.dir = rg.Vector3d(dir)
        
    def loft(self, pline, dir):
        pline2 = pline.Duplicate()
        pline2.Translate(dir.X, dir.Y, dir.Z)
        brep = rg.Brep.CreateFromLoft([pline,pline2], rg.Point3d.Unset, rg.Point3d.Unset, rg.LoftType.Straight, False)
        a.extend(brep)
        
    def generate(self):
        plines = self.angles.generate()
        for pl in plines:
            self.loft(pl, self.dir)
            self.dir.Rotate(0.1, rg.Vector3d.ZAxis)
            self.dir *= 0.95

class SpiralAggregation:
    def __init__(self, pt, count):
        self.children = []
        dir = rg.Vector3d(0.2, 0, 0.01)
        for i in range(count):
            len = int(random.random()*5)+10
            width = random.random()*1.5+1.0
            extrusion = TiltedExtrusion(rg.Point3d(pt), rg.Vector3d(dir)+rg.Vector3d(0,0,0.08), width, len)
            self.children.append(extrusion)
            dir.Rotate(0.5, rg.Vector3d.ZAxis)
            pt += dir*len
        
    def generate(self):
        for c in self.children:
            c.generate()

a = []
for pt in pts:
    obj = SpiralAggregation(pt, 100)
    obj.generate()
# ---------- end python ----------

# ----
python_2 = PythonScript(pts=pt)  # -> out, a; inputs pts: list of Point3d
# ---------- python_2: Python ----------
## defining a custom class
## input type: Point3d (List Access)

import rhinoscriptsyntax as rs
import Rhino.Geometry as rg
import random

class AngleSequence:
    def __init__(self,pt,dir,width,count):
        self.pt = pt
        self.width = width
        self.dir = dir
        self.count = count
        
    def generate(self):
        ndir = rg.Vector3d.CrossProduct(self.dir, rg.Vector3d.ZAxis)
        wdir = rg.Vector3d.CrossProduct(self.dir,ndir)
        wdir.Unitize()
        wdir *= self.width/2
        pt1 = rg.Point3d(self.pt)-wdir
        pt2 = rg.Point3d(self.pt)
        pt3 = rg.Point3d(self.pt)+wdir
        
        plines =[]
        
        for i in range(self.count):
            pline = rg.PolylineCurve([pt1,pt2,pt3])
            plines.append(pline)
            
            pt1 += self.dir
            pt2 += self.dir*1.5
            pt3 += self.dir
        return plines

class TiltedExtrusion:
    def __init__ (self,pt,dir,width,count):
        self.angles = AngleSequence(pt,dir,width,count)
        self.dir = rg.Vector3d(dir)
        
    def loft(self,pline,dir):
        pline2 = pline.Duplicate()
        pline2.Translate(dir.X,dir.Y,dir.Z)
        
        brep = rg.Brep.CreateFromLoft([pline,pline2],rg.Point3d.Unset,rg.Point3d.Unset,rg.LoftType.Straight,False)
        a.extend(brep)
    
    def generate(self):
        plines = self.angles.generate()
        
        for p1 in plines:
            self.loft(p1,self.dir)
            self.dir.Rotate(0.1,rg.Vector3d.ZAxis)
            self.dir *= 0.95

class SpiralAggregation:
    def __init__(self, pt, count):
        self.children = []
        dir = rg.Vector3d(0.2, 0, 0.01)
        
        for i in range(count):
            len = int(random.random()*5)+10
            width = random.random()*1.5+1.0
            extrusion = TiltedExtrusion(rg.Point3d(pt), rg.Vector3d(dir)+rg.Vector3d(0,0,0.08), width, len)
            self.children.append(extrusion)
            dir.Rotate(0.5, rg.Vector3d.ZAxis)
            pt += dir*len
            
    def generate(self):
        for c in self.children:
            c.generate()

a = []
for pt in pts:
    obj = SpiralAggregation(pt,100)
    obj.generate()
# ---------- end python_2 ----------
panel = Panel(pt)
panel_2 = Panel(python.a)
