# Grasshopper definition ss-06-01_ConnectByDistance_NetworkStructure.gh (Grasshopper 0.9.76)
# plug-ins: Python Interpreter

number_slider = Slider(2.7, range=0..10)
box = Box2Pt(PointA="0,0,0", PointB="10,10,10", Plane=PlaneXY(0, 0, 0))
pop3d = Populate3D(Region=box, Count=Slider(75, range=0..100), Seed=1)

# ---- group: download
python = PythonScript(pts=pop3d, threshold=number_slider)  # -> out, lines; inputs pts: list of Point3d
# ---------- python: Python ----------
# defining a connective module
# input type - pts : Point3d (List Access), threshold : float (Item Access)
import rhinoscriptsyntax as rs

class Module1:
    def __init__(self, pt):
        self.pt = pt
        self.links = []
    
    def connect(self, modules):
        for m in modules:
            if m is not self:
                dist = m.pt.DistanceTo(self.pt)
                if dist < threshold:
                    self.links.append(m)
    
    def generate(self):
        for m in self.links:
            line = rs.AddLine(self.pt, m.pt)
            lines.append(line)

lines = []
modules = []
# create modules
for pt in pts: 
    m = Module1(pt)
    modules.append(m)
# connect modules
for m in modules:
    m.connect(modules)
# generate geometries
for m in modules:
    m.generate()
# ---------- end python ----------

# ----
python_2 = PythonScript(pts=pop3d, threshold=number_slider)  # -> out, lines; inputs pts: list of Point3d
# ---------- python_2: Python ----------
## defining a connective module
## input type: pts- Point3d (List Access)
##             threshold- float(Item Access)

import rhinoscriptsyntax as rs

class Module1:
    def __init__(self,pt):
        self.pt = pt
        self.links = []
    
    def connect(self,modules):
        for m in modules:
            
            if m is not self:
                dist = m.pt.DistanceTo(self.pt)
                
                if dist < threshold:
                    self.links.append(m)
    
    def generate(self):
        for m in self.links:
            line = rs.AddLine(self.pt,m.pt)
            lines.append(line)


lines = []
modules = []

## create modules
for pt in pts:
    m = Module1(pt)
    modules.append(m)

## connect modules
for m in modules:
    m.connect(modules)

## generate geometry
for m in modules:
    m.generate()
# ---------- end python_2 ----------
viewer = ParamViewer(python_2.lines)
number_slider_2 = Slider(0.1, range=0..1)
crv = Curve(python.lines)
viewer_2 = ParamViewer(crv)
panel = Panel(crv)
pipe = Pipe(Curve=python.lines, Radius=number_slider_2, Caps=0)  # disabled
pipe_2 = Pipe(Curve=python_2.lines, Radius=number_slider_2, Caps=0)  # disabled
viewer_3 = ParamViewer(pipe)
