# Grasshopper definition ss-06-02_SortLink.gh (Grasshopper 0.9.76)
# plug-ins: Python Interpreter

box = Box2Pt(PointA="0,0,0", PointB="10,10,10", Plane=PlaneXY(0, 0, 0))
pop3d = Populate3D(Region=box, Count=100, Seed=Slider(36, range=0..100))
pop3d_2 = Populate3D(Region=box, Count=Slider(85, range=50..150), Seed=Slider(79, range=0..100))

# ---- group: download
python = PythonScript(pts=pop3d, threshold=Slider(2.8, range=0..10), maxLink=Slider(3, range=0..10))  # -> out, lines; inputs pts: list of Point3d, maxLink: Int32
# ---------- python: Python ----------
# defining a connective module
# input type - pts : Point3d (List Access), threshold : float (Item Access), maxLink : int (Item Access)
import rhinoscriptsyntax as rs

class Module1:
    def __init__(self, pt):
        self.pt = pt
        self.links = []
    
    def connect(self, modules):
        #sort list by distance
        sorted(modules, key=lambda m: m.pt.DistanceTo(self.pt))
        for m in modules:
            if len(self.links) >= maxLink:
                break # finish loop
            if m is not self and m not in self.links:
                dist = m.pt.DistanceTo(self.pt)
                if dist < threshold and len(m.links) < maxLink:
                    self.links.append(m)
                    m.links.append(self)
    
    def generate(self):
        for m in self.links:
            line = rs.AddLine(self.pt, m.pt)
            lines.append(line)

lines = []
modules = []
for pt in pts: 
    m = Module1(pt)
    modules.append(m)
for m in modules:
    m.connect(modules)
for m in modules:
    m.generate()
# ---------- end python ----------

# ----
python_2 = PythonScript(pts=pop3d_2, threshold=Slider(2.8, range=0..10), maxLink=Slider(3, range=0..10))  # -> out, lines; inputs pts: list of Point3d, maxLink: Int32
# ---------- python_2: Python ----------
## difining a connective module
## input type: pts - Point3d (list Access)
##             threshold - float (Item Access)
##             maxLink - int (Item Access)

import rhinoscriptsyntax as rs

class Module:
    def __init__(self,pt):
        self.pt = pt
        self.links = []
        
    def connect(self,modules):
        
        ## sort list by distance
        sorted(modules, key=lambda m:m.pt.DistanceTo(self.pt))
        
        for m in modules:
            if len(self.links) >= maxLink:
                break ## finish loop
            
            if m is not self and m not in self.links:
                dist = m.pt.DistanceTo(self.pt)
                
                if dist < threshold and len(m.links) < maxLink:
                    self.links.append(m)
                    m.links.append(self)
    
    def generate(self):
        for m in self.links:
            line = rs.AddLine(self.pt,m.pt)
            lines.append(line)

lines = []
modules = []

for pt in pts:
    m = Module(pt)
    modules.append(m)

for m in modules:
    m.connect(modules)

for m in modules:
    m.generate()
# ---------- end python_2 ----------
pipe = Pipe(Curve=python.lines, Radius=Slider(0.1, range=0..1), Caps=0)
