# Grasshopper definition ss-06-03_TreeOutput_Network.gh (Grasshopper 0.9.76)
# plug-ins: Python Interpreter

box = Box2Pt(PointA="0,0,0", PointB="10,10,10", Plane=PlaneXY(0, 0, 0))
pop3d = Populate3D(Region=box, Count=100, Seed=Slider(0, range=0..100))
pop3d_2 = Populate3D(Region=box, Count=100, Seed=Slider(79, range=0..100))
number_slider = Slider(0.19, range=0..1)

# ---- group: download
python = PythonScript(pts=pop3d, threshold=Slider(4.6, range=0..10), maxLink=Slider(4, range=0..10))  # -> out, center, arm; inputs pts: list of Point3d, maxLink: Int32
# ---------- python: Python ----------
# defining a connective module
# input type - pts : Point3d (List Access), threshold : float (Item Access), maxLink : int (Item Access)
# importing grasshopper tree classes
import Rhino.Geometry as rg
import clr
clr.AddReference("Grasshopper")
from Grasshopper.Kernel.Data import GH_Path
from Grasshopper import DataTree

class Module1:
    def __init__(self, pt):
        self.pt = pt
        self.links = []
    
    def connect(self, modules):
        #sort list by distance
        sorted(modules, key=lambda m: m.pt.DistanceTo(self.pt))
        for m in modules:
            if len(self.links) >= maxLink:
                break # finish loop
            if m is not self and m not in self.links:
                dist = m.pt.DistanceTo(self.pt)
                if dist < threshold and len(m.links) < maxLink:
                    self.links.append(m)
                    m.links.append(self)
    
    def generate(self):
        id = center.BranchCount
        center.Add(self.pt, GH_Path(id))
        linkNum = len(self.links)
        armPts = []
        for i in range(linkNum):
            pt2 = (self.pt + self.links[i].pt)/2 # mid point
            armPts.append(pt2)
        arm.AddRange(armPts, GH_Path(id))

# initialize output points in tree structure
center = DataTree[rg.Point3d]()
arm = DataTree[rg.Point3d]()
modules = []
for pt in pts: 
    m = Module1(pt)
    modules.append(m)
for m in modules:
    m.connect(modules)
for m in modules:
    m.generate()
# ---------- end python ----------

# ----
python_2 = PythonScript(pts=pop3d_2, threshold=Slider(5.5, range=0..10), maxLink=Slider(4, range=0..10))  # -> out, center, arm; inputs pts: list of Point3d, maxLink: Int32
# ---------- python_2: Python ----------
## defining a connective module
## input type: pts - Point3d (List Access)
##             threshold - float (Item Access)
##             maxLink - int (Item Access)

## importing grasshopper tree classes

import Rhino.Geometry as rg

import clr
clr.AddReference("Grasshopper")
from Grasshopper.Kernel.Data import GH_Path
from Grasshopper import DataTree

class Module1:
    def __init__(self,pt):
        self.pt = pt
        self.links = []
    
    def connect(self,modules):
        ## sort list by distance
        sorted(modules, key=lambda m: m.pt.DistanceTo(self.pt))
        
        for m in modules:
            if len(self.links) >= maxLink:
                break ## finish loop
            if m is not self and m not in self.links:
                dist = m.pt.DistanceTo(self.pt)
                
                if dist < threshold and len(m.links) < maxLink:
                    self.links.append(m)
                    m.links.append(self)
                    
    def generate(self):
        id = center.BranchCount
        center.Add(self.pt,GH_Path(id))
        linkNum = len(self.links)
        armPts = []
        
        for i in range(linkNum):
            pt2 = (self.pt + self.links[i].pt)/2 ## mid point
            armPts.append(pt2)
        arm.AddRange(armPts,GH_Path(id))

## initialize output points in tree structure
center = DataTree[rg.Point3d]()
arm = DataTree[rg.Point3d]()
modules = []

for pt in pts:
    m = Module1(pt)
    modules.append(m)

for m in modules:
    m.connect(modules)

for m in modules:
    m.generate()
# ---------- end python_2 ----------
viewer = ParamViewer(python_2.center)
viewer_2 = ParamViewer(python.center)
dist = Distance(PointA=python.center, PointB=python.arm)
vec2pt = Vector2Pt(PointA=python.center, PointB=python.arm, Unitize=False)  # -> Vector, Length
dist_2 = Distance(PointA=python_2.center, PointB=python_2.arm)
vec2pt_2 = Vector2Pt(PointA=python_2.center, PointB=python_2.arm, Unitize=False)  # -> Vector, Length
pl = PlaneNormal(Origin=python.center, ZAxis=vec2pt.Vector)
cone = Cone(Base=python.center, Radius=number_slider, Length=dist)  # -> Cone, Tip
xy = XYPlane(Origin=python.center)
pl_2 = PlaneNormal(Origin=python_2.center, ZAxis=vec2pt_2.Vector)
cone_2 = Cone(Base=python_2.center, Radius=number_slider, Length=dist_2)  # -> Cone, Tip
xy_2 = XYPlane(Origin=python_2.center)
viewer_3 = ParamViewer(python_2.arm)
viewer_4 = ParamViewer(python.arm)
orient = Orient(Geometry=cone.Cone, Source=xy, Target=pl)  # -> Geometry, Transform
orient_2 = Orient(Geometry=cone_2.Cone, Source=xy_2, Target=pl_2)  # -> Geometry, Transform
cap = CapHoles(Brep=orient.Geometry)
cap_2 = CapHoles(Brep=orient_2.Geometry)
sph = Sphere(Base=python.center, Radius=number_slider)
sph_2 = Sphere(Base=python_2.center, Radius=number_slider)
