# Grasshopper definition ss-06-04_3PointOutput.gh (Grasshopper 0.9.76)
# plug-ins: Python Interpreter

box = Box2Pt(PointA="0,0,0", PointB="10,10,10", Plane=PlaneXY(0, 0, 0))
number_slider = Slider(3.7, range=0..10)
number_slider_2 = Slider(4, range=0..10)
pop3d = Populate3D(Region=box, Count=100, Seed=Slider(0, range=0..100))
pop3d_2 = Populate3D(Region=box, Count=100, Seed=Slider(69, range=0..100))
python = PythonScript(pts=pop3d_2, threshold=number_slider, maxLink=number_slider_2)  # -> out, center, arm3Pts; inputs pts: list of Point3d, maxLink: Int32
# ---------- python: Python ----------
## defining a connective module
## input type - pts : Point3d (List Access)
##              thershold : float (Item Access)
##              maxLinks : int(Item Access)
## importing grasshopper tree classes

import Rhino.Geometry as rg

import clr
clr.AddReference("Grasshopper")
from Grasshopper.Kernel.Data import GH_Path
from Grasshopper import DataTree

class Module1:
    def __init__(self,pt):
        self.pt = pt
        self.links = []
        
    def connect(self,modules):
        ## sort list by distance
        sorted(modules, key=lambda m:m.pt.DistanceTo(self.pt))
        
        for m in modules:
            if len(self.links) >= maxLink:
                break ## finish loop
                
            if m is not self and m not in self.links:
                dist = m.pt.DistanceTo(self.pt)
                
                if dist < threshold and len(m.links) < maxLink:
                    self.links.append(m)
                    m.links.append(self)
                    
    def generate(self):
        id = center.BranchCount
        center.Add(self.pt,GH_Path(id))
        linkNum = len(self.links)
        
        for i in range(linkNum):
            pt2 = (self.pt + self.links[i].pt)/2 ## mid point
            
            for j in range(i+1,linkNum):
                pt3 = (self.pt + self.links[j].pt)/2 ## mid point
                arm3Pts.AddRange([pt2,self.pt,pt3],GH_Path(id,i,j))

## initialize output points in tree structure
center = DataTree[rg.Point3d]()
arm3Pts = DataTree[rg.Point3d]()
modules = []

for pt in pts:
    m = Module1(pt)
    modules.append(m)

for m in modules:
    m.connect(modules)

for m in modules:
    m.generate()
# ---------- end python ----------

# ---- group: download
python_2 = PythonScript(pts=pop3d, threshold=number_slider, maxLink=number_slider_2)  # -> out, center, arm3Pts; inputs pts: list of Point3d, maxLink: Int32
# ---------- python_2: Python ----------
# defining a connective module
# input type - pts : Point3d (List Access), threshold : float (Item Access), maxLink : int (Item Access)
# importing grasshopper tree classes
import Rhino.Geometry as rg
import clr
clr.AddReference("Grasshopper")
from Grasshopper.Kernel.Data import GH_Path
from Grasshopper import DataTree

class Module1:
    def __init__(self, pt):
        self.pt = pt
        self.links = []
    
    def connect(self, modules):
        #sort list by distance
        sorted(modules, key=lambda m: m.pt.DistanceTo(self.pt))
        for m in modules:
            if len(self.links) >= maxLink:
                break # finish loop
            if m is not self and m not in self.links:
                dist = m.pt.DistanceTo(self.pt)
                if dist < threshold and len(m.links) < maxLink:
                    self.links.append(m)
                    m.links.append(self)
    
    def generate(self):
        id = center.BranchCount
        center.Add(self.pt, GH_Path(id))
        linkNum = len(self.links)
        for i in range(linkNum):
            pt2 = (self.pt + self.links[i].pt)/2 # mid point
            for j in range(i+1, linkNum):
                pt3 = (self.pt + self.links[j].pt)/2 # mid point
                arm3Pts.AddRange([pt2, self.pt, pt3], GH_Path(id,i,j)) # add 2 arm and center

# initialize output points in tree structure
center = DataTree[rg.Point3d]()
arm3Pts = DataTree[rg.Point3d]()
modules = []
for pt in pts: 
    m = Module1(pt)
    modules.append(m)
for m in modules:
    m.connect(modules)
for m in modules:
    m.generate()
# ---------- end python_2 ----------

# ----
nurbs = NurbsCurve(Vertices=python_2.arm3Pts, Degree="2", Periodic=False)  # -> Curve, Length, Domain
nurbs_2 = NurbsCurve(Vertices=python.arm3Pts, Degree="2", Periodic=False)  # -> Curve, Length, Domain
Z = UnitZ(Factor=Slider(0.2, range=0..1))
extr = Extrude(Base=nurbs.Curve, Direction=Z)
extr_2 = Extrude(Base=nurbs_2.Curve, Direction=Z)
