# Grasshopper definition ss-06-05_FacePointOutput.gh (Grasshopper 0.9.76)
# plug-ins: Python Interpreter

box = Box2Pt(PointA="0,0,0", PointB="10,10,10", Plane=PlaneXY(0, 0, 0))
number_slider = Slider(3.2, range=0..10)
number_slider_2 = Slider(3, range=0..10)
pop3d = Populate3D(Region=box, Count=100, Seed=Slider(32, range=0..100))
pop3d_2 = Populate3D(Region=box, Count=100, Seed=Slider(0, range=0..100))

# ---- group: download
python = PythonScript(pts=pop3d_2, threshold=number_slider, maxLink=number_slider_2)  # -> out, center, armFacePts; inputs pts: list of Point3d, maxLink: Int32
# ---------- python: Python ----------
# defining a connective module
# input type - pts : Point3d (List Access), threshold : float (Item Access), maxLink : int (Item Access)
import Rhino.Geometry as rg
import clr
clr.AddReference("Grasshopper")
from Grasshopper.Kernel.Data import GH_Path
from Grasshopper import DataTree

class Module1:
    def __init__(self, pt):
        self.pt = pt
        self.links = []
    
    def connect(self, modules):
        #sort list by distance
        sorted(modules, key=lambda m: m.pt.DistanceTo(self.pt))
        for m in modules:
            if len(self.links) >= maxLink:
                break # finish loop
            if m is not self and m not in self.links:
                dist = m.pt.DistanceTo(self.pt)
                if dist < threshold and len(m.links) < maxLink:
                    self.links.append(m)
                    m.links.append(self)
    
    def generate(self):
        id = center.BranchCount
        center.Add(self.pt, GH_Path(id))
        linkNum = len(self.links)
        for i in range(linkNum):
            pt2 = (self.pt + self.links[i].pt)/2 # mid point
            for j in range(i+1, linkNum):
                pt3 = (self.pt + self.links[j].pt)/2 # mid point
                for k in range(j+1, linkNum):
                    pt4 = (self.pt + self.links[k].pt)/2
                    armFacePts.AddRange([pt2, pt3, pt4], GH_Path(id,i,j,k)) # add 3 face pts

# initialize output points in tree structure
center = DataTree[rg.Point3d]()
armFacePts = DataTree[rg.Point3d]()
modules = []
for pt in pts: 
    m = Module1(pt)
    modules.append(m)
for m in modules:
    m.connect(modules)
for m in modules:
    m.generate()
# ---------- end python ----------

# ----
python_2 = PythonScript(pts=pop3d, threshold=number_slider, maxLink=number_slider_2)  # -> out, center, armFacePts; inputs pts: list of Point3d, maxLink: Int32
# ---------- python_2: Python ----------
## defining a connective module
## input type - pts: Point3d (List Access)
##              threshold: float (Item Access)
##              maxLink: int (Item Access)

import Rhino.Geometry as rg

import clr
clr.AddReference("Grasshopper")
from Grasshopper.Kernel.Data import GH_Path
from Grasshopper import DataTree

class Module1:
    def __init__(self,pt):
        self.pt = pt
        self.links = []
    
    def connect(self,modules):
        ## sort list by distance
        sorted(modules,key=lambda m:m.pt.DistanceTo(self.pt))
        
        for m in modules:
            if len(self.links) >= maxLink:
                break ## finish loop
            if m is not self and m not in self.links:
                dist = m.pt.DistanceTo(self.pt)
                
                if dist < threshold and len(m.links) < maxLink:
                    self.links.append(m)
                    m.links.append(self)
    
    def generate(self):
        id = center.BranchCount
        center.Add(self.pt,GH_Path(id))
        linkNum = len(self.links)
        
        for i in range(linkNum):
            pt2 = (self.pt + self.links[i].pt)/2 ## mid point
            
            for j in range(i+1,linkNum):
                pt3 = (self.pt + self.links[j].pt)/2 ## mid point
                
                for k in range(j+1,linkNum):
                    pt4 = (self.pt + self.links[k].pt)/2
                    armFacePts.AddRange([pt2,pt3,pt4],GH_Path(id,i,j,k)) ## add 3 face pts

## initialize output points in tree structure
center = DataTree[rg.Point3d]()
armFacePts = DataTree[rg.Point3d]()
modules = []

for pt in pts:
    m = Module1(pt)
    modules.append(m)

for m in modules:
    m.connect(modules)

for m in modules:
    m.generate()
# ---------- end python_2 ----------
item = ListItem(List=python_2.armFacePts, Index="1", Wrap=True)
item_2 = ListItem(List=python_2.armFacePts, Index="2", Wrap=True)
item_3 = ListItem(List=python.armFacePts, Index="1", Wrap=True)
item_4 = ListItem(List=python.armFacePts, Index="2", Wrap=True)
item_5 = ListItem(List=python_2.armFacePts, Index="0", Wrap=True)
item_6 = ListItem(List=python.armFacePts, Index="0", Wrap=True)
srf4pt = _4PointSurface(CornerA=item_5, CornerB=item, CornerC=item_2)
srf4pt_2 = _4PointSurface(CornerA=item_6, CornerB=item_3, CornerC=item_4)
