# Grasshopper definition ss-06-06_PointsOutput_cf_LambdaSample.gh (Grasshopper 0.9.76)
# plug-ins: Python Interpreter

number_slider = Slider(3.5, range=0..10)
number_slider_2 = Slider(3, range=0..10)
number_slider_3 = Slider(0.2, range=0..1)
number_slider_4 = Slider(0.9, range=0..1)
box = Box2Pt(PointA="0,0,0", PointB="10,10,10", Plane=PlaneXY(0, 0, 0))

# ---- group: lambda
python = PythonScript()  # -> out, a
# ---------- python: Python ----------
myfunc1 = lambda x:x**2

print(myfunc1(5))
print(myfunc1(6))


## same function

def myfunc2(x):
    return x**2

print(myfunc2(7))
# ---------- end python ----------

# ---- group: lambda / map lambda sample
python_2 = PythonScript()  # -> out, a
# ---------- python_2: Python ----------
list1 = [2,3,5,6,7,8,9,10]

list2 = map(lambda x:x**2, list1)

print(list2)
# ---------- end python_2 ----------

# ---- group: lambda / sorted lambda sample
python_3 = PythonScript()  # -> out, a
# ---------- python_3: Python ----------
list1 = [(7,2),(3,4),(5,5),(10,3)]

list2 = sorted(list1,key=lambda x:x[0])
list3 = sorted(list1,key=lambda x:x[1])

print(list2)
print(list3)
# ---------- end python_3 ----------

# ---- group: lambda
# map() is fx for list
panel = Panel("lambda sample")
panel_2 = Panel("sorted() is sort list")
panel_3 = Panel(python.out)
panel_4 = Panel(python_3.out)
panel_5 = Panel(python_2.out)

# ----
pop3d = Populate3D(Region=box, Count=100, Seed=Slider(0, range=0..100))
pop3d_2 = Populate3D(Region=box, Count=100, Seed=Slider(0, range=0..100))

# ---- group: download
python_4 = PythonScript(pts=pop3d, threshold=number_slider, maxLink=number_slider_2, depthRatio=number_slider_3, shrinkRatio=number_slider_4)  # -> out, spiralPts; inputs pts: list of Point3d, maxLink: Int32
# ---------- python_4: Python ----------
# defining a connective module
# input type - pts : Point3d (List Access), threshold : float (Item Access), 
##             maxLink : int (Item Access), depthRatio : float (Item Access), shrinkRatio : float (Item Access)

import Rhino.Geometry as rg
import clr
clr.AddReference("Grasshopper")
from Grasshopper.Kernel.Data import GH_Path
from Grasshopper import DataTree

class Module1:
    def __init__(self, pt):
        self.pt = pt
        self.links = []
    
    def connect(self, modules):
        #sort list by distance
        sorted(modules, key=lambda m: m.pt.DistanceTo(self.pt))
        for m in modules:
            if len(self.links) >= maxLink:
                break # finish loop
            if m is not self and m not in self.links:
                dist = m.pt.DistanceTo(self.pt)
                if dist < threshold and len(m.links) < maxLink:
                    self.links.append(m)
                    m.links.append(self)
    
    def generate(self):
        linkNum = len(self.links)
        if linkNum != 3:
            return # do nothing if less than 3 links
        self.armLength = 0
        for m in self.links:
            self.armLength += m.pt.DistanceTo(self.pt)
        tricenter = (self.links[0].pt+self.links[1].pt+self.links[2].pt)/3
        normal = rg.Vector3d.CrossProduct(self.links[1].pt-self.links[0].pt, self.links[2].pt-self.links[0].pt) 
        normal.Unitize()
        normal *= self.armLength * depthRatio
        for i in range(linkNum):
            spts = []
            spts.append( (self.links[i].pt + self.pt)/2 )
            sp = self.links[i].pt * 0.4 + self.pt * 0.6
            spts.append(sp)
            for j in range(30): # spiral points
                vec = sp - self.pt 
                vec.Rotate(0.5, normal)
                sp = vec*shrinkRatio + self.pt + normal/30
                spts.append(sp)
            spiralPts.AddRange(spts, GH_Path(self.id, i))

# initialize output points in tree structure
spiralPts = DataTree[rg.Point3d]()
modules = []
for pt in pts: 
    m = Module1(pt)
    m.id = len(modules) # setting id number
    modules.append(m)
for m in modules:
    m.connect(modules)
for m in modules:
    m.generate()
# ---------- end python_4 ----------

# ----
viewer = ParamViewer(python_4.spiralPts)
python_5 = PythonScript(pts=pop3d_2, threshold=number_slider, maxLink=number_slider_2, depthRatio=number_slider_3, shrinkRatio=number_slider_4)  # -> out, spiralPts; inputs pts: list of Point3d, maxLink: Int32
# ---------- python_5: Python ----------
## defining a connective module
## input type - pts: Point3d (List Access)
##              threshold: float (Item Access)
##              maxLink: int (Item Access)
##              depthRatio: float(Item Access)
##              shrinkRatio: flaot (Item Access)

import Rhino.Geometry as rg

import clr
clr.AddReference("Grasshopper")
from Grasshopper.Kernel.Data import GH_Path
from Grasshopper import DataTree

class Module1:
    def __init__(self,pt):
        self.pt = pt
        self.links = []
    
    def connect(self,modeles):
        ## sort list by distance
        sorted(modules, key=lambda m:m.pt.DistanceTo(self.pt))
        
        for m in modules:
            if len(self.links) >= maxLink:
                break ## finish loop
            
            if m is not self and m not in self.links:
                dist = m.pt.DistanceTo(self.pt)
                
                if dist < threshold and len(m.links) < maxLink:
                    self.links.append(m)
                    m.links.append(self)
    
    def generate(self):
        linkNum = len(self.links)
        
        if linkNum != 3:
            return ## do nothing if less than 3 links
        self.armLength = 0
        
        for m in self.links:
            self.armLength += m.pt.DistanceTo(self.pt)
        
        tricenter = (self.links[0].pt + self.links[1].pt + self.links[2].pt)/3
        normal = rg.Vector3d.CrossProduct(self.links[1].pt - self.links[0].pt,  self.links[2].pt-self.links[0].pt)
        normal.Unitize()
        normal *= self.armLength*depthRatio
        
        for i in range(linkNum):
            spts = []
            spts.append((self.links[i].pt + self.pt)/2)
            sp = self.links[i].pt*0.4 + self.pt*0.6
            spts.append(sp)
            
            for j in range(30):
                vec = sp-self.pt
                vec.Rotate(0.5,normal)
                sp = vec*shrinkRatio + self.pt + normal/30
                spts.append(sp)
            spiralPts.AddRange(spts,GH_Path(self.id,i))

## initialize output points in tree structure
spiralPts = DataTree[rg.Point3d]()
modules =[]

for pt in pts:
    m = Module1(pt)
    m.id = len(modules) ## setting id number
    modules.append(m)

for m in modules:
    m.connect(modules)

for m in modules:
    m.generate()
# ---------- end python_5 ----------
number_slider_5 = Slider(1, range=0..1)
number_slider_6 = Slider(0, range=0..1)
number_slider_7 = Slider(0.03, range=0..0.1)
number_slider_8 = Slider(0, range=0..0.1)
viewer_2 = ParamViewer(python_4.spiralPts)
nurbs = NurbsCurve(Vertices=python_4.spiralPts, Degree=3, Periodic=False)  # -> reparameterize(Curve), Length, Domain
nurbs_2 = NurbsCurve(Vertices=python_5.spiralPts, Degree=3, Periodic=False)  # -> reparameterize(Curve), Length, Domain
vpipe = PipeVariable(Curve=nurbs.Curve, Parameters=[number_slider_6, number_slider_5], Radii=[number_slider_7, number_slider_8], Caps=0)
vpipe_2 = PipeVariable(Curve=nurbs_2.Curve, Parameters=[number_slider_6, number_slider_5], Radii=[number_slider_7, number_slider_8], Caps=0)  # disabled
flatten = FlattenTree(Tree=vpipe, Path="{0}")
flatten_2 = FlattenTree(Tree=nurbs_2.Curve, Path="{0}")
viewer_3 = ParamViewer(flatten)
viewer_4 = ParamViewer(flatten_2)
