# Grasshopper definition ss-06-07_DifferentType.gh (Grasshopper 0.9.76)
# plug-ins: Python Interpreter

number_slider = Slider(4, range=0..10)
number_slider_2 = Slider(3, range=0..10)
box = Box2Pt(PointA="0,0,0", PointB="10,10,10", Plane=PlaneXY(0, 0, 0))
pop3d = Populate3D(Region=box, Count=100, Seed=Slider(12, range=0..100))
pop3d_2 = Populate3D(Region=box, Count=100, Seed=Slider(15, range=0..100))
python = PythonScript(pts=pop3d, threshold=number_slider, maxLink=number_slider_2)  # -> out, center1, arm1_1, arm1_2, center2, arm2_1, arm2_2; inputs pts: list of Point3d, maxLink: Int32
# ---------- python: Python ----------
# defining a connective module
# input type - pts : Point3d (List Access), threshold : float (Item Access),
##             maxLink : int (Item Access), depthRatio : float (Item Access), shrinkRatio : float (Item Access)
import Rhino.Geometry as rg
import random
import clr
clr.AddReference("Grasshopper")
from Grasshopper.Kernel.Data import GH_Path
from Grasshopper import DataTree

class Module1:
    def __init__(self, pt):
        self.pt = pt
        self.links = []
        if random.random()<0.5:
            self.type = 1
        else:
            self.type = 2
    
    def connect(self, modules):
        #sort list by distance
        sorted(modules, key=lambda m: m.pt.DistanceTo(self.pt))
        for m in modules:
            if len(self.links) >= maxLink:
                break # finish loop
            if m is not self and m not in self.links:
                dist = m.pt.DistanceTo(self.pt)
                if dist < threshold and len(m.links) < maxLink:
                    self.links.append(m)
                    m.links.append(self)
    
    def generate(self):
        linkNum = len(self.links)
        if self.type == 1:
            center1.Add(self.pt, GH_Path(self.id))
        else:
            center2.Add(self.pt, GH_Path(self.id))
        for i in range(linkNum):
            mpt = (self.pt + self.links[i].pt)/2
            if self.type == 1 and self.links[i].type == 1: # link 1-1
                arm1_1.AddRange([mpt, self.pt], GH_Path(self.id, i))
            elif self.type == 1 and self.links[i].type == 2: #link 1-2
                arm1_2.AddRange([mpt, self.pt], GH_Path(self.id, i))
            elif self.type == 2 and self.links[i].type == 1: #link 2-1
                arm2_1.AddRange([mpt, self.pt], GH_Path(self.id, i))
            elif self.type == 2 and self.links[i].type == 2: #link 2-2
                arm2_2.AddRange([mpt, self.pt], GH_Path(self.id, i))

# initialize output points in tree structure
center1 = DataTree[rg.Point3d]()
center2 = DataTree[rg.Point3d]()
arm1_1 = DataTree[rg.Point3d]()
arm1_2 = DataTree[rg.Point3d]()
arm2_1 = DataTree[rg.Point3d]()
arm2_2 = DataTree[rg.Point3d]()

modules = []
for pt in pts: 
    m = Module1(pt)
    m.id = len(modules) # setting id number
    modules.append(m)
for m in modules:
    m.connect(modules)
for m in modules:
    m.generate()
# ---------- end python ----------
python_2 = PythonScript(pts=pop3d_2, threshold=number_slider, maxLink=number_slider_2)  # -> out, center1, arm1_1, arm1_2, center2, arm2_1, arm2_2; inputs pts: list of Point3d, maxLink: Int32
# ---------- python_2: Python ----------
## defining a connestive module
## input type- pts: Point3d (List Access)
##             threshold: float (Item Access)
##             maxLink: int (Item Access)
##             depthRatio: float (Item Access)
##             shrinkRatio: float (Item Access)

import Rhino.Geometry as rg
import random

import clr
clr.AddReference("Grasshopper")
from Grasshopper.Kernel.Data import GH_Path
from Grasshopper import DataTree

class Module1:
    def __init__(self,pt):
        self.pt = pt
        self.links = []
        
        if random.random()<0.5:
            self.type = 1
        else:
            self.type = 2
    def connect(self, modules):
        ## sort list by distance
        sorted(modules,key=lambda m:m.pt.DistanceTo(self.pt))
        
        for m in modules:
            if len(self.links)>= maxLink:
                break ## finish
            if m is not self and m not in self.links:
                dist = m.pt.DistanceTo(self.pt)
                
                if dist<threshold and len(m.links)<maxLink:
                    self.links.append(m)
                    m.links.append(self)
    
    def generate(self):
        linkNum = len(self.links)
        
        if self.type == 1:
            center1.Add(self.pt,GH_Path(self.id))
        else:
            center2.Add(self.pt,GH_Path(self.id))
        
        for i in range(linkNum):
            mpt = (self.pt + self.links[i].pt)/2
            
            if self.type == 1 and self.links[i].type == 1: ## link 1-1
                arm1_1.AddRange([mpt,self.pt],GH_Path(self.id,i))
            elif self.type == 1 and self.links[i].type == 2: ## link 1-2
                arm1_2.AddRange([mpt,self.pt],GH_Path(self.id,i))
            elif self.type == 2 and self.links[i].type == 1: ## link 2-1
                arm2_1.AddRange([mpt,self.pt],GH_Path(self.id,i))
            elif self.type == 2 and self.links[i].type == 2: ## link 2-2
                arm2_2.AddRange([mpt,self.pt],GH_Path(self.id,i))

## initialize output points in tree structure
center1 = DataTree[rg.Point3d]()
center2 = DataTree[rg.Point3d]()

arm1_1 = DataTree[rg.Point3d]()
arm1_2 = DataTree[rg.Point3d]()
arm2_1 = DataTree[rg.Point3d]()
arm2_2 = DataTree[rg.Point3d]()

modules = []

for pt in pts:
    m = Module1(pt)
    m.id = len(modules) ## setting id number
    modules.append(m)

for m in modules:
    m.connect(modules)

for m in modules:
    m.generate()
# ---------- end python_2 ----------
item = ListItem(List=[python.arm2_1, python.arm1_2], Index="0", Wrap=True)
item_2 = ListItem(List=[python.arm2_1, python.arm1_2], Index="1", Wrap=True)
item_3 = ListItem(List=[python_2.arm2_1, python_2.arm1_2], Index="0", Wrap=True)
item_4 = ListItem(List=[python_2.arm2_1, python_2.arm1_2], Index="1", Wrap=True)
Z = UnitZ(Factor=Slider(0.3, range=0..1))
Z_2 = UnitZ(Factor=Slider(0.3, range=0..1))
Z_3 = UnitZ(Factor=1)
Z_4 = UnitZ(Factor=1)
vec2pt = Vector2Pt(PointA=item, PointB=item_2, Unitize=False)  # -> Vector, Length
vec2pt_2 = Vector2Pt(PointA=item_3, PointB=item_4, Unitize=False)  # -> Vector, Length
addition = Addition(A=python.arm2_2, B=Z)
addition_2 = Addition(A=python_2.arm2_2, B=Z_2)
pl = ConstructPlane(Origin=item, XAxis=Z_3, YAxis=vec2pt.Vector)
xz = XZPlane(Origin=Point(0, 0, 0))
xy = XYPlane(Origin=Point(0, 0, 0))
pl_2 = ConstructPlane(Origin=item_3, XAxis=Z_4, YAxis=vec2pt_2.Vector)
xz_2 = XZPlane(Origin=Point(0, 0, 0))
xy_2 = XYPlane(Origin=Point(0, 0, 0))
number_slider_3 = Slider(0.3, range=0..1)
number_slider_4 = Slider(0.3, range=0..1)
orient = Orient(Geometry=xz, Source=xy, Target=pl)  # -> Geometry, Transform
orient_2 = Orient(Geometry=xz_2, Source=xy_2, Target=pl_2)  # -> Geometry, Transform
polygon = Polygon(Plane=orient.Geometry, Radius=Slider(0.2, range=0..1), Segments=Slider(3, range=0..10), FilletRadius=0)  # -> Polygon, Length
polygon_2 = Polygon(Plane=orient_2.Geometry, Radius=Slider(0.2, range=0..1), Segments=Slider(3, range=0..10), FilletRadius=0)  # -> Polygon, Length
pline = PolyLine(Vertices=python.arm1_1, Closed=False)
pline_2 = PolyLine(Vertices=python.arm2_2, Closed=False)
pline_3 = PolyLine(Vertices=addition, Closed=False)
pline_4 = PolyLine(Vertices=python_2.arm1_1, Closed=False)
pline_5 = PolyLine(Vertices=python_2.arm2_2, Closed=False)
pline_6 = PolyLine(Vertices=addition_2, Closed=False)
cyl = Cylinder(Base=python.center2, Radius=number_slider_3, Length=number_slider_3)
cyl_2 = Cylinder(Base=python_2.center2, Radius=number_slider_4, Length=number_slider_4)
cap = CapHoles(Brep=cyl)
cap_2 = CapHoles(Brep=cyl_2)
sph = Sphere(Base=python.center1, Radius=Slider(0.25, range=0..1))
pipe = Pipe(Curve=pline, Radius=Slider(0.1, range=0..0.1), Caps=0)
extr = ExtrudePoint(Base=polygon.Polygon, Point=item_2)
loft = Loft(
    Curves=[pline_3, pline_2],
    Options={Adjust=False, Closed=False, LoftEnds=0, LoftSimp=0, LoftType=0, Rebuild=10, Refit=0.01})
sph_2 = Sphere(Base=python_2.center1, Radius=Slider(0.25, range=0..1))
pipe_2 = Pipe(Curve=pline_4, Radius=Slider(0.1, range=0..0.1), Caps=0)
extr_2 = ExtrudePoint(Base=polygon_2.Polygon, Point=item_4)
loft_2 = Loft(
    Curves=[pline_6, pline_5],
    Options={Adjust=False, Closed=False, LoftEnds=0, LoftSimp=0, LoftType=0, Rebuild=10, Refit=0.01})
