# Grasshopper definition ss-07-01_OffsetPoint.gh (Grasshopper 0.9.76)
# plug-ins: Python Interpreter

mplane = MeshPlane(Boundary={Plane=PlaneXY(0, 0, 0), Size=Domain2(u=-10..10, v=-10..10)}, WidthCount=10, HeightCount=10)  # -> Mesh, Area
depth = Slider(2.1, range=0..10)
depth_2 = Slider(4.7, range=0..10)
python = PythonScript(mesh1=mplane.Mesh, depth=depth_2)  # -> out, a; inputs mesh1: Mesh
# ---------- python: Python ----------
## input type- mesh1: mesh
##             depth: float

import Rhino.Geometry as rg
import random

def offsetVertex(mesh):
    mesh2 = rg.Mesh() ## Create a new mesh
    
    vtx = mesh.Vertices.ToPoint3dArray() ## get all vertices in a list
    
    for i in range(len(vtx)):
        vtx2 = vtx[i] + rg.Vector3d(mesh.Normals[i])*depth*random.random()
        mesh2.Vertices.Add(vtx2)
    
    mesh2.Faces.AddFaces(mesh.Faces) ## add all face at once
    mesh2.Normals.ComputeNormals()
    return mesh2

a = offsetVertex(mesh1)
# ---------- end python ----------

# ---- group: download
py_offsetvertex = PythonScript(mesh=mplane.Mesh, depth=depth)  # -> out, a; inputs mesh: Mesh
# ---------- py_offsetvertex: Python ----------
import Rhino.Geometry as rg
import random

def offsetVertex(mesh):
    mesh2 = rg.Mesh() # create a new mesh
    
    vtx = mesh.Vertices.ToPoint3dArray() # get all vertices in a list
    for i in range(len(vtx)):
        vtx2 = vtx[i] + rg.Vector3d(mesh.Normals[i]) * depth * random.random() # offset randomly
        mesh2.Vertices.Add(vtx2)
    
    mesh2.Faces.AddFaces(mesh.Faces) # add all faces at once
    mesh2.Normals.ComputeNormals()
    return mesh2

a = offsetVertex(mesh)
# ---------- end py_offsetvertex ----------
