# Grasshopper definition ss-07-02_Randomaize.gh (Grasshopper 0.9.76)
# plug-ins: Python Interpreter

mplane = MeshPlane(Boundary={Plane=PlaneXY(0, 0, 0), Size=Domain2(u=-10..10, v=-10..10)}, WidthCount=10, HeightCount=10)  # -> Mesh, Area
depth = Slider(1.255, range=0..10)
depth_2 = Slider(2.175, range=0..10)
python = PythonScript(mesh1=mplane.Mesh, depth=depth_2)  # -> out, a; inputs mesh1: Mesh
# ---------- python: Python ----------
import Rhino.Geometry as rg
import random

def randomizeVertex(mesh):
    mesh2 = rg.Mesh() ## create a new mesh
    
    vtx = mesh.Vertices.ToPoint3dArray() ## get all vertices in a list
    
    for i in range(len(vtx)):
        vtx2 = vtx[i] + rg.Vector3d(random.uniform(-1,1)*depth,random.uniform(-1,1)*depth,random.uniform(-1,1)*depth)
        ## random xyz move
        mesh2.Vertices.Add(vtx2)
        
    mesh2.Faces.AddFaces(mesh.Faces)
    mesh2.Normals.ComputeNormals()
    return mesh2

a = randomizeVertex(mesh1)
# ---------- end python ----------

# ---- group: download
py_randomvertex = PythonScript(mesh=mplane.Mesh, depth=depth)  # -> out, a; inputs mesh: Mesh
# ---------- py_randomvertex: Python ----------
import Rhino.Geometry as rg
import random

def randomizeVertex(mesh):
    mesh2 = rg.Mesh() # create a new mesh
    
    vtx = mesh.Vertices.ToPoint3dArray() # get all vertices in a list
    for i in range(len(vtx)):
        vtx2 = vtx[i] + rg.Vector3d(random.uniform(-1,1)*depth, random.uniform(-1,1)*depth, random.uniform(-1,1)*depth) #random xyz move
        mesh2.Vertices.Add(vtx2)
    
    mesh2.Faces.AddFaces(mesh.Faces)
    mesh2.Normals.ComputeNormals()
    return mesh2

a = randomizeVertex(mesh)
# ---------- end py_randomvertex ----------
