# Grasshopper definition ss-07-03_MoveByAttract.gh (Grasshopper 0.9.76)
# plug-ins: Python Interpreter

number_slider = Slider(50, range=0..100)
mplane = MeshPlane(
    Boundary={Plane=PlaneXY(0, 0, 0), Size=Domain2(u=-10..10, v=-10..10)},
    WidthCount=number_slider,
    HeightCount=number_slider)  # -> Mesh, Area
depth = Slider(2.098, range=0..10)
pt = Point([Point(-4.014378246, 5.88595195, -2.005936165), Point(-4.87301364, -4.656010331, 1.100829424), Point(5.352411475, -3.637595632, -1.26347365), Point(5.669133946, 5.252507009, 0.5764070329)])
depth_2 = Slider(2.098, range=0..10)
pt_2 = Point([Point(-7.501121293, 5.88595195, -2.005936165), Point(-4.87301364, -3.296709042, 1.100829424), Point(5.352411475, -6.805146533, -1.26347365), Point(-0.09583730024, 3.680123816, 0.5764070329)])
number_slider_2 = Slider(5, range=0..100)
number_slider_3 = Slider(5, range=0..100)
python = PythonScript(mesh1=mplane.Mesh, depth=depth, attractors=pt_2, threshold=number_slider_2)  # -> out, a; inputs mesh1: Mesh, attractors: list of Point3d
# ---------- python: Python ----------
## input type - attractors: Point3d(List Access)

import rhinoscriptsyntax as rs
import Rhino.Geometry as rg

def moveVertexByAttractor(mesh):
    mesh2 = rg.Mesh()
    vtx = mesh.Vertices.ToPoint3dArray()
    
    for i in range(len(vtx)):
        vtx2 = vtx[i] + attractorVector(vtx[i]) * depth #add attractor vector
        mesh2.Vertices.Add(vtx2)
        
    mesh2.Faces.AddFaces(mesh.Faces)
    mesh2.Normals.ComputeNormals()
    return mesh2

def attractorVector(pos):
    minDist = -1
    for attr in attractors: #find closest attractor
        dist = rs.Distance(pos,attr)
        
        if( minDist < 0 or dist < minDist ):
            minDist = dist
            closest = attr
    if(minDist < threshold):
        vec = pos - closest
        vec.Unitize()
        vec *= (threshold - minDist)/(threshold) #length from 0 to 1
        return vec
    return rg.Vector3d(0,0,0) #return zero vector if out of threshold

a = moveVertexByAttractor(mesh1)
# ---------- end python ----------

# ---- group: download
py_movevertexbyattr = PythonScript(mesh=mplane.Mesh, depth=depth, attractors=pt, threshold=number_slider_2)  # -> out, a; inputs mesh: Mesh, attractors: list of Point3d
# ---------- py_movevertexbyattr: Python ----------
import rhinoscriptsyntax as rs
import Rhino.Geometry as rg

def moveVertexByAttractor(mesh):
    mesh2 = rg.Mesh()
    vtx = mesh.Vertices.ToPoint3dArray()
    for i in range(len(vtx)):
        vtx2 = vtx[i] + attractorVector(vtx[i]) * depth #add attractor vector
        mesh2.Vertices.Add(vtx2)
    
    mesh2.Faces.AddFaces(mesh.Faces)
    mesh2.Normals.ComputeNormals()
    return mesh2

def attractorVector(pos):
    minDist = -1
    for attr in attractors: #find closest attractor
        dist = rs.Distance(pos, attr)
        if( minDist < 0 or dist < minDist ):
            minDist = dist
            closest = attr
    if(minDist < threshold):
        vec = pos - closest
        vec.Unitize()
        vec *= (threshold - minDist)/(threshold) #length from 0 to 1
        return vec
    return rg.Vector3d(0,0,0) #return zero vector if out of threshold

a = moveVertexByAttractor(mesh)
# ---------- end py_movevertexbyattr ----------
