# Grasshopper definition ss-07-07_QuadSubdivision.gh (Grasshopper 0.9.76)
# plug-ins: Python Interpreter

count = Slider(5, range=0..10)
panel = Panel("not recursion")
mplane = MeshPlane(Boundary={Plane=PlaneXY(0, 0, 0), Size=Domain2(u=-10..10, v=-10..10)}, WidthCount=count, HeightCount=count)  # -> Mesh, Area
recursionlevel = Slider(0, range=0..10)
offsetdepth1 = Slider(0.152, range=0..10)
offsetdepth2 = Slider(4.392, range=0..10)

# ---- group: download
py_quadcentersubd = PythonScript(
    mesh=mplane.Mesh,
    recursionLevel=Slider(0, range=0..10),
    offsetDepth1=Slider(4.352, range=0..10),
    offsetDepth2=Slider(8.192, range=0..10))  # -> out, a; inputs mesh: Mesh, recursionLevel: Int32
# ---------- py_quadcentersubd: Python ----------
import Rhino.Geometry as rg

def subdivide(mesh, recursion, offset1, offset2):
    mesh2 = rg.Mesh()
    
    vtx = mesh.Vertices.ToPoint3dArray()
    for i in range(len(vtx)):
        vtx2 = vtx[i] + rg.Vector3d(mesh.Normals[i]) * offset1 #offset vertex
        mesh2.Vertices.Add(vtx2)
    
    for i in range(mesh.Faces.Count):
        if(mesh.Faces[i].IsQuad): # quad face
            vidx1 = mesh.Faces[i].A
            vidx2 = mesh.Faces[i].B
            vidx3 = mesh.Faces[i].C
            vidx4 = mesh.Faces[i].D
            
            v1 = vtx[vidx1]
            v2 = vtx[vidx2]
            v3 = vtx[vidx3]
            v4 = vtx[vidx4]
            v5 = interpolateQuad(v1,v2,v3,v4,0.7,0.9) # point inside quad
            v5 += rg.Vector3d(mesh.FaceNormals[i]) * offset2 #offset new vertex
            
            vidx5 = mesh2.Vertices.Add(v5) #add new vertex and get index number
            mesh2.Faces.AddFace(vidx1,vidx2,vidx5) #subdivided triangle
            mesh2.Faces.AddFace(vidx2,vidx3,vidx5) #subdivided triangle
            mesh2.Faces.AddFace(vidx3,vidx4,vidx5) #subdivided triangle
            mesh2.Faces.AddFace(vidx4,vidx1,vidx5) #subdivided triangle
        else: # triangular face
            mesh2.Faces.AddFace(mesh.Faces[i]) #put original face
    
    mesh2.Normals.ComputeNormals()
    if(recursion>1):
        return subdivide(mesh2, recursion-1, offset1/2, offset2/2)
    return mesh2

def interpolateQuad(v1, v2, v3, v4, ratio1, ratio2): # 0<ratio1<1, 0<ratio2<1 to be inside quad
    return (v1*(1-ratio1)+v2*ratio1)*(1-ratio2) + (v4*(1-ratio1)+v3*ratio1)*ratio2

a = subdivide(mesh, recursionLevel, offsetDepth1, offsetDepth2)
# ---------- end py_quadcentersubd ----------

# ----
python = PythonScript(mesh1=mplane.Mesh, recursionLevel=recursionlevel, offsetDepth1=offsetdepth1, offsetDepth2=offsetdepth2)  # -> out, a; inputs mesh1: Mesh
# ---------- python: Python ----------
import Rhino.Geometry as rg

def subdivide(mesh,recursion,offset1,offset2):
    mesh2 = rg.Mesh()
    
    vtx = mesh.Vertices.ToPoint3dArray()
    
    for i in range(len(vtx)):
        vtx2 = vtx[i] + rg.Vector3d(mesh.Normals[i])*offset1 ## offset vertex
        mesh2.Vertices.Add(vtx2)
    
    for i in range(mesh.Faces.Count):
        
        if(mesh.Faces[i].IsQuad): ## quad face
            vidx1 = mesh.Faces[i].A
            vidx2 = mesh.Faces[i].B
            vidx3 = mesh.Faces[i].C
            vidx4 = mesh.Faces[i].D
            
            v1 = vtx[vidx1]
            v2 = vtx[vidx2]
            v3 = vtx[vidx3]
            v4 = vtx[vidx4]
            
            v5 = interpolateQuad(v1,v2,v3,v4,0.7,0.9) ## point inside quad
            v5 += rg.Vector3d(mesh.FaceNormals[i])*offset2 ## offset new vertex
            
            vidx5 = mesh2.Vertices.Add(v5) ## add new vertex and get index number
            
            mesh2.Faces.AddFace(vidx1,vidx2,vidx5) ## subdivided triangle
            mesh2.Faces.AddFace(vidx2,vidx3,vidx5) ## subdivided triangle
            mesh2.Faces.AddFace(vidx3,vidx4,vidx5) ## subdivided triangle
            mesh2.Faces.AddFace(vidx4,vidx1,vidx5) ## subdivided triangle
        
        else: ## traianglar face
            mesh2.Faces.AddFace(mesh.Faces[i]) ## face original face
    
    mesh2.Normals.ComputeNormals()
    
    if(recursion>1):
        return subdivide(mesh2,recursion-1,offset1/2,offset2/2)
    
    return mesh2

def interpolateQuad(v1,v2,v3,v4,ratio1,ratio2):
    return (v1*(1-ratio1)+v2*ratio1)*(1-ratio2) + (v4*(1-ratio1)+v3*ratio1)*ratio2

a = subdivide(mesh1,recursionLevel,offsetDepth1,offsetDepth2)
# ---------- end python ----------
