# Grasshopper definition ss-07-08_1D_Fractal.gh (Grasshopper 0.9.76)
# plug-ins: Python Interpreter

mplane = MeshPlane(
    Boundary={Plane=PlaneXY(0, 0, 0), Size=Domain2(u=-10..10, v=-10..10)},
    WidthCount=Slider(1, range=0..1),
    HeightCount=Slider(10, range=0..100))  # -> Mesh, Area
panel = Panel(mplane.Mesh)

# ---- group: download
py_quadsubd1d = PythonScript(
    mesh=mplane.Mesh,
    recursionLevel=Slider(6, range=0..10),
    offsetDepth1=Slider(0, range=0..10),
    offsetDepth2=Slider(1.2, range=-10..10))  # -> out, a; inputs mesh: Mesh, recursionLevel: Int32
# ---------- py_quadsubd1d: Python ----------
import Rhino.Geometry as rg

def subdivide(mesh, recursion, offset1, offset2):
    mesh2 = rg.Mesh()
    vtx = mesh.Vertices.ToPoint3dArray()
    for i in range(len(vtx)):
        vtx2 = vtx[i] + rg.Vector3d(mesh.Normals[i]) * offset1
        mesh2.Vertices.Add(vtx2)
    
    for i in range(mesh.Faces.Count):
        if mesh.Faces[i].IsQuad : # quad face
            vidx1 = mesh.Faces[i].A
            vidx2 = mesh.Faces[i].B
            vidx3 = mesh.Faces[i].C
            vidx4 = mesh.Faces[i].D
            v1 = vtx[vidx1]
            v2 = vtx[vidx2]
            v3 = vtx[vidx3]
            v4 = vtx[vidx4]
            n = rg.Vector3d(mesh.FaceNormals[i]) * offset2
            
            w1 = interpolateLine(v1,v2,0.2) # interpolation on edge
            w2 = interpolateLine(v1,v2,0.4) + n # interpolate on edge and offset
            w3 = interpolateLine(v1,v2,0.6) + n # interpolate on edge and offset
            w4 = interpolateLine(v1,v2,0.8) # interpolation on edge
            w5 = interpolateLine(v4,v3,0.2) # interpolation on edge
            w6 = interpolateLine(v4,v3,0.4) + n # interpolate on edge and offset
            w7 = interpolateLine(v4,v3,0.6) + n # interpolate on edge and offset
            w8 = interpolateLine(v4,v3,0.8) # interpolation on edge
            
            widx1 = mesh2.Vertices.Add(w1)
            widx2 = mesh2.Vertices.Add(w2)
            widx3 = mesh2.Vertices.Add(w3)
            widx4 = mesh2.Vertices.Add(w4)
            widx5 = mesh2.Vertices.Add(w5)
            widx6 = mesh2.Vertices.Add(w6)
            widx7 = mesh2.Vertices.Add(w7)
            widx8 = mesh2.Vertices.Add(w8)
            mesh2.Faces.AddFace(vidx1,widx1,widx5,vidx4)
            mesh2.Faces.AddFace(widx1,widx2,widx6,widx5)
            mesh2.Faces.AddFace(widx2,widx3,widx7,widx6)
            mesh2.Faces.AddFace(widx3,widx4,widx8,widx7)
            mesh2.Faces.AddFace(widx4,vidx2,vidx3,widx8)
        else: # triangular face
            mesh2.Faces.AddFace(mesh.Faces[i])
    
    mesh2.Normals.ComputeNormals()
    mesh2.Weld(180)
    
    if(recursion>1):
        return subdivide(mesh2, recursion-1, offset1/2, offset2/2)
    return mesh2

def interpolateLine(v1, v2, ratio):
    return v1*(1-ratio) + v2*ratio

a = subdivide(mesh, recursionLevel, offsetDepth1, offsetDepth2)
# ---------- end py_quadsubd1d ----------

# ----
python = PythonScript(
    mesh=mplane.Mesh,
    recursionLevel=Slider(6, range=0..6),
    offsetDepth1=Slider(1.2, range=0..10),
    offsetDepth2=Slider(1.4, range=-10..10))  # -> out, a; inputs mesh: Mesh, recursionLevel: Int32
# ---------- python: Python ----------
import Rhino.Geometry as rg

def subdivide(mesh,recursion,offset1,offset2):
    mesh2 = rg.Mesh()
    vtx = mesh.Vertices.ToPoint3dArray()
    
    for i in range(len(vtx)):
        vtx2 = vtx[i] + rg.Vector3d(mesh.Normals[i])*offset1
        mesh2.Vertices.Add(vtx2)
    
    for i in range(mesh.Faces.Count):
        
        if mesh.Faces[i].IsQuad: ## Quad face
            vidx1 = mesh.Faces[i].A
            vidx2 = mesh.Faces[i].B
            vidx3 = mesh.Faces[i].C
            vidx4 = mesh.Faces[i].D
            
            v1 = vtx[vidx1]
            v2 = vtx[vidx2]
            v3 = vtx[vidx3]
            v4 = vtx[vidx4]
            
            n = rg.Vector3d(mesh.FaceNormals[i])*offset2
            
            w1 = interpolateLine(v1,v2,0.2) ## interpolation on edge
            w2 = interpolateLine(v1,v2,0.4)+n ## interpolation on edge and offset
            w3 = interpolateLine(v1,v2,0.6)+n ## interpolation on edge and offset
            w4 = interpolateLine(v1,v2,0.8) ## interpolation on edge
            
            w5 = interpolateLine(v4,v3,0.2) ## interpolation on edge
            w6 = interpolateLine(v4,v3,0.4)+n ## interpolation on edge and offset
            w7 = interpolateLine(v4,v3,0.6)+n ## interpolation on edge and offset
            w8 = interpolateLine(v4,v3,0.8) ## interpolaiton on edge
            
            widx1 = mesh2.Vertices.Add(w1)
            widx2 = mesh2.Vertices.Add(w2)
            widx3 = mesh2.Vertices.Add(w3)
            widx4 = mesh2.Vertices.Add(w4)
            
            widx5 = mesh2.Vertices.Add(w5)
            widx6 = mesh2.Vertices.Add(w6)
            widx7 = mesh2.Vertices.Add(w7)
            widx8 = mesh2.Vertices.Add(w8)
            
            mesh2.Faces.AddFace(vidx1,widx1,widx5,vidx4)
            mesh2.Faces.AddFace(widx1,widx2,widx6,widx5)
            mesh2.Faces.AddFace(widx2,widx3,widx7,widx6)
            mesh2.Faces.AddFace(widx3,widx4,widx8,widx7)
            mesh2.Faces.AddFace(widx4,vidx2,vidx3,widx8)
        
        else: ## triangle face
            mesh2.Faces.AddFace(mesh.Face[i])
    
    mesh2.Normals.ComputeNormals()
    mesh2.Weld(180)
    
    if (recursion>1):
        return subdivide(mesh2,recursion-1,offset1/2,offset2/2)
    return mesh2

def interpolateLine(v1,v2,ratio):
    return v1*(1-ratio) + v2*ratio

a = subdivide(mesh,recursionLevel,offsetDepth1,offsetDepth2)
# ---------- end python ----------
