# Grasshopper definition ss-07-09_ProbabilisticSubdivision_RandomReduce.gh (Grasshopper 0.9.76)
# plug-ins: Python Interpreter

number_slider = Slider(2, range=0..10)
mplane = MeshPlane(
    Boundary={Plane=PlaneXY(0, 0, 0), Size=Domain2(u=-10..10, v=-10..10)},
    WidthCount=number_slider,
    HeightCount=number_slider)  # -> Mesh, Area
tri = Triangulate(Mesh=mplane.Mesh)  # -> Mesh, Count
recureionlevel = Slider(9, range=0..10)
recursionprobability = Slider(99, range=0..100)
offsetdepth1 = Slider(0, range=-10..10)
offsetdepth2 = Slider(8, range=0..10)
recureionlevel_2 = Slider(6, range=0..10)
recursionprobability_2 = Slider(100, range=0..100)
offsetdepth1_2 = Slider(0, range=-10..10)
offsetdepth2_2 = Slider(4, range=0..10)
python = PythonScript(
    mesh=tri.Mesh,
    recursionLevel=recureionlevel_2,
    recursionProbability=recursionprobability_2,
    offsetDepth1=offsetdepth1_2,
    offsetDepth2=offsetdepth2_2)  # -> out, a; inputs mesh: Mesh, recursionLevel: Int32
# ---------- python: Python ----------
import Rhino.Geometry as rg
import random

def subdivide(mesh,recursion,offset1,offset2):
    mesh2 = rg.Mesh() ## create new mesh
    
    vtx = mesh.Vertices.ToPoint3dArray()
    
    for i in range(len(vtx)):
        vtx2 = vtx[i] + rg.Vector3d(mesh.Normals[i])*offset1 ## offset vertex
        mesh2.Vertices.Add(vtx2)
    
    for i in range(mesh.Faces.Count):
        if (mesh.Faces[i].IsQuad): ## quad mesh
            mesh2.Faces.AddFace(mesh.Faces[i]) ## put original face
        
        else: ## triangle
            if random.random()*100 < recursionProbability: ## subdivided probabilisitically
                vidx1 = mesh.Faces[i].A
                vidx2 = mesh.Faces[i].B
                vidx3 = mesh.Faces[i].C
                
                v1 = vtx[vidx1]
                v2 = vtx[vidx2]
                v3 = vtx[vidx3]
                v4 = (v1+v2+v3)/3 ## calculator center point
                v4 += rg.Vector3d(mesh.FaceNormals[i])*offset2 ## offset new vector
                
                vidx4 = mesh2.Vertices.Add(v4) ## add new vertex and get index number
                
                mesh2.Faces.AddFace(vidx1,vidx2,vidx4) ## subdivided triangle
                mesh2.Faces.AddFace(vidx2,vidx3,vidx4) ## subdivided triangle
                mesh2.Faces.AddFace(vidx3,vidx1,vidx4) ## subdivided triangle
            
            else:
                mesh2.Faces.AddFace(mesh.Faces[i]) ## put original face
    
    mesh2.Normals.ComputeNormals()
    
    if (recursion>1):
        return subdivide(mesh2,recursion-1,offset1/2,offset2/2)
    return mesh2


a = subdivide(mesh,recursionLevel,offsetDepth1,offsetDepth2)
# ---------- end python ----------

# ---- group: download
py_trianglecentersubd = PythonScript(
    mesh=tri.Mesh,
    recursionLevel=recureionlevel,
    recursionProbability=recursionprobability,
    offsetDepth1=offsetdepth1,
    offsetDepth2=offsetdepth2)  # -> out, a; inputs mesh: Mesh, recursionLevel: Int32
# ---------- py_trianglecentersubd: Python ----------
import Rhino.Geometry as rg
import random

def subdivide(mesh, recursion, offset1, offset2):
    mesh2 = rg.Mesh() #create new mesh
    
    vtx = mesh.Vertices.ToPoint3dArray()
    for i in range(len(vtx)):
        vtx2 = vtx[i] + rg.Vector3d(mesh.Normals[i]) * offset1 #offset vertex
        mesh2.Vertices.Add(vtx2)
    
    for i in range(mesh.Faces.Count):
        if(mesh.Faces[i].IsQuad): #quad mesh
            mesh2.Faces.AddFace(mesh.Faces[i]) #put original face
        else: #triangular mesh
            if random.random()*100 < recursionProbability: # subdivided probabilistically
                vidx1 = mesh.Faces[i].A
                vidx2 = mesh.Faces[i].B
                vidx3 = mesh.Faces[i].C
                
                v1 = vtx[vidx1]
                v2 = vtx[vidx2]
                v3 = vtx[vidx3]
                v4 = (v1 + v2 + v3)/3 #center point
                v4 += rg.Vector3d(mesh.FaceNormals[i]) * offset2 #offset new vertex
                
                vidx4 = mesh2.Vertices.Add(v4) #add new vertex and get index number
                mesh2.Faces.AddFace(vidx1,vidx2,vidx4) #subdivided trianle
                mesh2.Faces.AddFace(vidx2,vidx3,vidx4) #subdivided trianle
                mesh2.Faces.AddFace(vidx3,vidx1,vidx4) #subdivided trianle
            else: 
                mesh2.Faces.AddFace(mesh.Faces[i]) #put original face
    
    mesh2.Normals.ComputeNormals()
    if(recursion>1):
        return subdivide(mesh2, recursion-1, offset1/2, offset2/2)
    return mesh2

a = subdivide(mesh,recursionLevel,offsetDepth1,offsetDepth2)
# ---------- end py_trianglecentersubd ----------

# ----
medges = MeshEdges(Mesh=py_trianglecentersubd.a)  # -> NakedEdges, InteriorEdges, NonManifoldEdges
medges_2 = MeshEdges(Mesh=python.a)  # -> NakedEdges, InteriorEdges, NonManifoldEdges
