# Grasshopper definition ss-07-10_FrameSubdivision.gh (Grasshopper 0.9.76)
# plug-ins: Python Interpreter

number_slider = Slider(2, range=0..10)
mplane = MeshPlane(
    Boundary={Plane=PlaneXY(0, 0, 0), Size=Domain2(u=-10..10, v=-10..10)},
    WidthCount=number_slider,
    HeightCount=number_slider)  # -> Mesh, Area
recursiondepth = Slider(5, range=0..10)
offsetdepth1 = Slider(0, range=-10..10)
offsetdepth2 = Slider(1, range=-10..10)
recursiondepth_2 = Slider(5, range=0..10)
offsetdepth1_2 = Slider(0, range=-10..10)
offsetdepth2_2 = Slider(1, range=-10..10)

# ---- group: download
py_framesubd = PythonScript(mesh=mplane.Mesh, recursionLevel=recursiondepth, offsetDepth1=offsetdepth1, offsetDepth2=offsetdepth2)  # -> out, a; inputs mesh: Mesh, recursionLevel: Int32
# ---------- py_framesubd: Python ----------
import Rhino.Geometry as rg
import random

def subdivide(mesh, recursion, offset1, offset2):
    mesh2 = rg.Mesh()
    vtx = mesh.Vertices.ToPoint3dArray()
    for i in range(len(vtx)):
        vtx2 = vtx[i] + rg.Vector3d(mesh.Normals[i]) * offset1 #offset vertex
        mesh2.Vertices.Add(vtx2)
    
    for i in range(mesh.Faces.Count):
        vidx1 = mesh.Faces[i].A
        vidx2 = mesh.Faces[i].B
        vidx3 = mesh.Faces[i].C
        v1 = vtx[vidx1]
        v2 = vtx[vidx2]
        v3 = vtx[vidx3]
        n = rg.Vector3d(mesh.FaceNormals[i]) * offset2 * random.random() #random normal vector
        
        if(mesh.Faces[i].IsTriangle): # triangle face
            w1 = v1*0.6 + v2*0.2 + v3*0.2 + n #new vertex
            w2 = v1*0.2 + v2*0.6 + v3*0.2 + n #new vertex
            w3 = v1*0.2 + v2*0.2 + v3*0.6 + n #new vertex
            
            widx1 = mesh2.Vertices.Add(w1) #add new vertex and get index
            widx2 = mesh2.Vertices.Add(w2) #add new vertex and get index
            widx3 = mesh2.Vertices.Add(w3) #add new vertex and get index
            mesh2.Faces.AddFace(vidx1,vidx2,widx2,widx1) #subdivided face
            mesh2.Faces.AddFace(vidx2,vidx3,widx3,widx2) #subdivided face
            mesh2.Faces.AddFace(vidx3,vidx1,widx1,widx3) #subdivided face
            
        else: # quad face
            vidx4 = mesh.Faces[i].D
            v4 = vtx[vidx4]
            
            w1 = v1*0.4 + v2*0.2 + v3*0.2 + v4*0.2 + n #new vertex
            w2 = v1*0.2 + v2*0.4 + v3*0.2 + v4*0.2 + n #new vertex
            w3 = v1*0.2 + v2*0.2 + v3*0.4 + v4*0.2 + n #new vertex
            w4 = v1*0.2 + v2*0.2 + v3*0.2 + v4*0.4 + n #new vertex
            
            widx1 = mesh2.Vertices.Add(w1) #add new vertex and get index
            widx2 = mesh2.Vertices.Add(w2) #add new vertex and get index
            widx3 = mesh2.Vertices.Add(w3) #add new vertex and get index
            widx4 = mesh2.Vertices.Add(w4) #add new vertex and get index
            mesh2.Faces.AddFace(vidx1,vidx2,widx2,widx1) #subdivided face
            mesh2.Faces.AddFace(vidx2,vidx3,widx3,widx2) #subdivided face
            mesh2.Faces.AddFace(vidx3,vidx4,widx4,widx3) #subdivided face
            mesh2.Faces.AddFace(vidx4,vidx1,widx1,widx4) #subdivided face
    
    mesh2.Normals.ComputeNormals()
    if(recursion>1):
        return subdivide(mesh2, recursion-1, offset1/2, offset2/2)
    return mesh2

a = subdivide(mesh, recursionLevel, offsetDepth1, offsetDepth2)
# ---------- end py_framesubd ----------

# ----
python = PythonScript(mesh=mplane.Mesh, recursionLevel=recursiondepth_2, offsetDepth1=offsetdepth1_2, offsetDepth2=offsetdepth2_2)  # -> out, a; inputs mesh: Mesh, recursionLevel: Int32
# ---------- python: Python ----------
import Rhino.Geometry as rg
import random

def subdivide(mesh,recursion,offset1,offset2):
    mesh2 = rg.Mesh()
    vtx = mesh.Vertices.ToPoint3dArray()
    
    for i in range(len(vtx)):
        vtx2 = vtx[i] + rg.Vector3d(mesh.Normals[i])*offset1 ## offset vertex
        mesh2.Vertices.Add(vtx2)
    
    for i in range(mesh.Faces.Count):
        vidx1 = mesh.Faces[i].A
        vidx2 = mesh.Faces[i].B
        vidx3 = mesh.Faces[i].C
        
        v1 = vtx[vidx1]
        v2 = vtx[vidx2]
        v3 = vtx[vidx3]
        
        n = rg.Vector3d(mesh.FaceNormals[i])*offset2*random.random() ## random normal vector
        
        if (mesh.Faces[i].IsTriangle): ## triangle face
            w1 = v1*0.6+v2*0.2+v3*0.2+n ## new vertex
            w2 = v1*0.2+v2*0.6+v3*0.2+n ## new vertex
            w3 = v1*0.2+v2*0.2+v3*0.6+n ## new vertex
            
            widx1 = mesh2.Vertices.Add(w1) ## add new vertex and get index
            widx2 = mesh2.Vertices.Add(w2) ## add new vertex and get index
            widx3 = mesh2.Vertices.Add(w3) ## add new vertex and get index
            
            mesh2.Faces.AddFace(vidx1,vidx2,widx2,widx1) ## subdivided face
            mesh2.Faces.AddFace(vidx2,vidx3,widx3,widx2) ## subdivided face
            mesh2.Faces.AddFace(vidx3,vidx1,widx1,widx3) ## subdivided face
            
        else: ## quad
            vidx4 = mesh.Faces[i].D
            v4 = vtx[vidx4]
            
            w1 = v1*0.4+v2*0.2+v3*0.2+v4*0.2+n ## new vertex
            w2 = v1*0.2+v2*0.4+v3*0.2+v4*0.2+n ## new vertex
            w3 = v1*0.2+v2*0.2+v3*0.4+v4*0.2+n ## new vertex
            w4 = v1*0.2+v2*0.2+v3*0.2+v4*0.4+n ## new vertex
            
            widx1 = mesh2.Vertices.Add(w1) ## add new vertex and get index
            widx2 = mesh2.Vertices.Add(w2) ## add new vertex and get index
            widx3 = mesh2.Vertices.Add(w3) ## add new vertex and get index
            widx4 = mesh2.Vertices.Add(w4) ## add new vertex and get index
            
            mesh2.Faces.AddFace(vidx1,vidx2,widx2,widx1) ## subdivided index
            mesh2.Faces.AddFace(vidx2,vidx3,widx3,widx2) ## subdivided index
            mesh2.Faces.AddFace(vidx3,vidx4,widx4,widx3) ## subdivided index
            mesh2.Faces.AddFace(vidx4,vidx1,widx1,widx4) ## subdivided index
    
    mesh2.Normals.ComputeNormals()
    if (recursion>1):
        return subdivide(mesh2,recursion-1,offset1/2,offset2/2)
    return mesh2

a = subdivide(mesh,recursionLevel,offsetDepth1,offsetDepth2)
# ---------- end python ----------
medges = MeshEdges(Mesh=py_framesubd.a)  # -> NakedEdges, InteriorEdges, NonManifoldEdges
medges_2 = MeshEdges(Mesh=python.a)  # -> NakedEdges, InteriorEdges, NonManifoldEdges
