# Grasshopper definition ss-07-12_QuadSubdivision.gh (Grasshopper 0.9.76)
# plug-ins: Python Interpreter

number_slider = Slider(2, range=0..10)
mplane = MeshPlane(
    Boundary={Plane=PlaneXY(0, 0, 0), Size=Domain2(u=-10..10, v=-10..10)},
    WidthCount=number_slider,
    HeightCount=number_slider)  # -> Mesh, Area
recursionlevel = Slider(8, range=0..8)
offsetdepth1 = Slider(2.5, range=-10..10)
offsetdepth2 = Slider(-2.5, range=-10..10)
recursionlevel_2 = Slider(6, range=0..8)
offsetdepth1_2 = Slider(2.5, range=-10..10)
offsetdepth2_2 = Slider(-2.5, range=-10..10)

# ---- group: download
py_quadsubd = PythonScript(mesh=mplane.Mesh, recursionLevel=recursionlevel, offsetDepth1=offsetdepth1, offsetDepth2=offsetdepth2)  # -> out, a; inputs mesh: Mesh, recursionLevel: Int32
# ---------- py_quadsubd: Python ----------
import Rhino.Geometry as rg

def subdivide(mesh, recursion, offset1, offset2):
    mesh2 = rg.Mesh()
    
    vtx = mesh.Vertices.ToPoint3dArray()
    for i in range(len(vtx)):
        vtx2 = vtx[i] + rg.Vector3d(mesh.Normals[i]) * offset1 # offset vertex
        mesh2.Vertices.Add(vtx2)
    
    for i in range(mesh.Faces.Count):
        if(mesh.Faces[i].IsQuad): # quad face
            vidx1 = mesh.Faces[i].A
            vidx2 = mesh.Faces[i].B
            vidx3 = mesh.Faces[i].C
            vidx4 = mesh.Faces[i].D
            
            v1 = vtx[vidx1]
            v2 = vtx[vidx2]
            v3 = vtx[vidx3]
            v4 = vtx[vidx4]
            
            w1 = (v1+v2)/2 # mid point
            w2 = (v2+v3)/2 # mid point
            w3 = (v3+v4)/2 # mid point
            w4 = (v4+v1)/2 # mid point
            w5 = (v1+v2+v3+v4)/4 # center
            w5 += rg.Vector3d(mesh.FaceNormals[i]) * offset2 #offset new vertex
            
            widx1 = mesh2.Vertices.Add(w1)
            widx2 = mesh2.Vertices.Add(w2)
            widx3 = mesh2.Vertices.Add(w3)
            widx4 = mesh2.Vertices.Add(w4)
            widx5 = mesh2.Vertices.Add(w5)
            mesh2.Faces.AddFace(vidx1,widx1,widx5,widx4)
            mesh2.Faces.AddFace(vidx2,widx2,widx5,widx1)
            mesh2.Faces.AddFace(vidx3,widx3,widx5,widx2)
            mesh2.Faces.AddFace(vidx4,widx4,widx5,widx3)
            
        else: # triangular face
            mesh2.Faces.AddFace(mesh.Faces[i])
    
    mesh2.Normals.ComputeNormals()
    mesh2.Weld(180) #weld vertices
    if(recursion>1):
        return subdivide(mesh2, recursion-1, offset1/2, offset2/2)
    return mesh2

a = subdivide(mesh, recursionLevel, offsetDepth1, offsetDepth2)
# ---------- end py_quadsubd ----------

# ----
python = PythonScript(mesh=mplane.Mesh, recursionLevel=recursionlevel_2, offsetDepth1=offsetdepth1_2, offsetDepth2=offsetdepth2_2)  # -> out, a; inputs mesh: Mesh, recursionLevel: Int32
# ---------- python: Python ----------
import Rhino.Geometry as rg

def subdivide(mesh,recursion,offset1,offset2):
    mesh2 = rg.Mesh()
    
    vtx = mesh.Vertices.ToPoint3dArray()
    
    for i in range(len(vtx)):
        vtx2 = vtx[i]+rg.Vector3d(mesh.Normals[i])*offset1 ## offset vertex
        mesh2.Vertices.Add(vtx2)
    
    for i in range(mesh.Faces.Count):
        
        if(mesh.Faces[i].IsQuad): ## quad face
            vidx1 = mesh.Faces[i].A
            vidx2 = mesh.Faces[i].B
            vidx3 = mesh.Faces[i].C
            vidx4 = mesh.Faces[i].D
            
            v1 = vtx[vidx1]
            v2 = vtx[vidx2]
            v3 = vtx[vidx3]
            v4 = vtx[vidx4]
            
            w1 = (v1+v2)/2 ## mid point
            w2 = (v2+v3)/2 ## mid point
            w3 = (v3+v4)/2 ## mid point
            w4 = (v4+v1)/2 ## mid point
            w5 = (v1+v2+v3+v4)/4 ## center point
            w5 += rg.Vector3d(mesh.FaceNormals[i])*offset2 ## offset new vertex
            
            widx1 = mesh2.Vertices.Add(w1)
            widx2 = mesh2.Vertices.Add(w2)
            widx3 = mesh2.Vertices.Add(w3)
            widx4 = mesh2.Vertices.Add(w4)
            widx5 = mesh2.Vertices.Add(w5)
            
            mesh2.Faces.AddFace(vidx1,widx1,widx5,widx4)
            mesh2.Faces.AddFace(vidx2,widx2,widx5,widx1)
            mesh2.Faces.AddFace(vidx3,widx3,widx5,widx2)
            mesh2.Faces.AddFace(vidx4,widx4,widx5,widx3)
        
        else:
            mesh2.Faces.AddFace(mesh.Faces[i])
    
    mesh2.Normals.ComputeNormals()
    mesh2.Weld(180) ## weld vertices
    
    if (recursion>1):
        return subdivide(mesh2,recursion-1,offset1/2,offset2/2)
    return mesh2

a = subdivide(mesh,recursionLevel,offsetDepth1,offsetDepth2)
# ---------- end python ----------
medges = MeshEdges(Mesh=py_quadsubd.a)  # -> NakedEdges, InteriorEdges, NonManifoldEdges
medges_2 = MeshEdges(Mesh=python.a)  # -> NakedEdges, InteriorEdges, NonManifoldEdges
