# Grasshopper definition ss-07-13_TriangularSubdivision.gh (Grasshopper 0.9.76)
# plug-ins: Python Interpreter

number_slider = Slider(6, range=0..10)
mplane = MeshPlane(
    Boundary={Plane=PlaneXY(0, 0, 0), Size=Domain2(u=-10..10, v=-10..10)},
    WidthCount=number_slider,
    HeightCount=number_slider)  # -> Mesh, Area
panel = Panel("not recursion")
tri = Triangulate(Mesh=mplane.Mesh)  # -> Mesh, Count
recursiondepth = Slider(0, range=0..10)
offsetdepth1 = Slider(1, range=-10..10)
offsetdepth2 = Slider(0, range=-10..10)
recursiondepth_2 = Slider(0, range=0..10)
offsetdepth1_2 = Slider(2, range=-10..10)
offsetdepth2_2 = Slider(1, range=-10..10)

# ---- group: download
py_triangularsubd = PythonScript(mesh=tri.Mesh, recursionLevel=recursiondepth, offsetDepth1=offsetdepth1, offsetDepth2=offsetdepth2)  # -> out, a; inputs mesh: Mesh, recursionLevel: Int32
# ---------- py_triangularsubd: Python ----------
import Rhino.Geometry as rg

def subdivide(mesh, recursion, offset1, offset2):
    mesh2 = rg.Mesh()
    vtx = mesh.Vertices.ToPoint3dArray()
    for i in range(len(vtx)):
        vtx2 = vtx[i] + rg.Vector3d(mesh.Normals[i]) * offset1 #offset vertex
        mesh2.Vertices.Add(vtx2)
    
    for i in range(mesh.Faces.Count): # triangular face
        if(mesh.Faces[i].IsTriangle):
            vidx1 = mesh.Faces[i].A
            vidx2 = mesh.Faces[i].B
            vidx3 = mesh.Faces[i].C
            v1 = vtx[vidx1]
            v2 = vtx[vidx2]
            v3 = vtx[vidx3]
            
            w1 = (v1+v2)/2 # mid point
            w2 = (v2+v3)/2 # mid point
            w3 = (v3+v1)/2 # mid point
            w4 = (v1+v2+v3)/3 # center
            w4 += rg.Vector3d(mesh.FaceNormals[i]) * offset2 # offset new vertex
            
            widx1 = mesh2.Vertices.Add(w1) # add new vertex and get index
            widx2 = mesh2.Vertices.Add(w2) # add new vertex and get index
            widx3 = mesh2.Vertices.Add(w3) # add new vertex and get index
            widx4 = mesh2.Vertices.Add(w4) # add new vertex and get index
            mesh2.Faces.AddFace(vidx1,widx1,widx4,widx3) # subdivided face
            mesh2.Faces.AddFace(vidx2,widx2,widx4,widx1) # subdivided face
            mesh2.Faces.AddFace(vidx3,widx3,widx4,widx2) # subdivided face
        else: # quad face
            mesh2.Faces.AddFace(mesh.Faces[i]) # put original face
            
    mesh2.Weld(180)
    mesh2.Normals.ComputeNormals()
    if(recursion>1):
        return subdivide(mesh2, recursion-1, offset1/2, offset2/2)
    return mesh2

a = subdivide(mesh, recursionLevel, offsetDepth1, offsetDepth2)
# ---------- end py_triangularsubd ----------

# ----
python = PythonScript(mesh=tri.Mesh, recursionLevel=recursiondepth_2, offsetDepth1=offsetdepth1_2, offsetDepth2=offsetdepth2_2)  # -> out, a; inputs mesh: Mesh, offsetDepth1: Int32, offsetDepth2: Int32
# ---------- python: Python ----------
import Rhino.Geometry as rg

def subdivide(mesh,recursion,offset1,offset2):
    mesh2 = rg.Mesh()
    vtx = mesh.Vertices.ToPoint3dArray()
    
    for i in range(len(vtx)):
        vtx2 = vtx[i]+rg.Vector3d(mesh.Normals[i])*offset1 ## offset vertex
        mesh2.Vertices.Add(vtx2)
    
    for i in range(mesh.Faces.Count): ## triangle
        if(mesh.Faces[i].IsTriangle):
            vidx1 = mesh.Faces[i].A
            vidx2 = mesh.Faces[i].B
            vidx3 = mesh.Faces[i].C
            
            v1 = vtx[vidx1]
            v2 = vtx[vidx2]
            v3 = vtx[vidx3]
            
            w1 = (v1+v2)/2 ## mid point
            w2 = (v2+v3)/2 ## mid point
            w3 = (v3+v1)/2 ## mid point
            w4 = (v1+v2+v3)/3 ## center point
            w4 += rg.Vector3d(mesh.FaceNormals[i])*offset2 ## offset new vertex
            
            widx1 = mesh2.Vertices.Add(w1) ## add new vertex and get index
            widx2 = mesh2.Vertices.Add(w2) ## add new Vertex and get index
            widx3 = mesh2.Vertices.Add(w3) ## add new vertex and get index
            widx4 = mesh2.Vertices.Add(w4) ## add new vertex and get index
            
            mesh2.Faces.AddFace(vidx1,widx1,widx4,widx3) ## subdivided face
            mesh2.Faces.AddFace(vidx2,widx2,widx4,widx1) ## subdivided face
            mesh2.Faces.AddFace(vidx3,widx3,widx4,widx2) ## subdivided face
        
        else: ## quad face
            mesh.Faces.AddFace(mesh.Faces[i]) ## put original face
            
    mesh2.Weld(180)
    mesh2.Normals.ComputeNormals()
    
    if(recursion>1):
        return subdivide(mesh2,recursion-1,offset1/2,offset2/2)
    return mesh2

a = subdivide(mesh,recursionLevel,offsetDepth1,offsetDepth2)
# ---------- end python ----------
medges = MeshEdges(Mesh=py_triangularsubd.a)  # -> NakedEdges, InteriorEdges, NonManifoldEdges
medges_2 = MeshEdges(Mesh=python.a)  # -> NakedEdges, InteriorEdges, NonManifoldEdges
