# Grasshopper definition ss-07-16_QuadSubdivDepthByBitmap.gh (Grasshopper 0.9.76)
# plug-ins: Python Interpreter

number_slider = Slider(2, range=0..10)
number_slider_2 = Slider(100, range=0..100)
srf = Surface(reparameterize(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))
mplane = MeshPlane(
    Boundary={Plane=PlaneXY(0, 0, 0), Size=Domain2(u=-10..10, v=-10..10)},
    WidthCount=number_slider,
    HeightCount=number_slider)  # -> Mesh, Area
sdivide = DivideSurface(Surface=srf, UCount=number_slider_2, VCount=number_slider_2)  # -> Points, Normals, Parameters
image = ImageSampler(
    sdivide.Parameters,
    FilePath="C:\Users\yoshioca\Desktop\image-sampler\gray.jpg",
    Filter="Colour",
    Interpolate=False,
    Umax=1,
    Umin=0,
    Vmax=1,
    Vmin=0,
    Wrap=1)
offsetdepth1 = Slider(4, range=0..10)
offsetdepth1_2 = Slider(4, range=0..10)
recursionlevel = Slider(5, range=0..7)
offsetdepth2 = Slider(0, range=0..10)
recursionlevel_2 = Slider(5, range=0..7)
offsetdepth2_2 = Slider(0, range=0..10)

# ---- group: download
py_quadsubdattr = PythonScript(
    mesh=mplane.Mesh,
    recursionLevel=recursionlevel,
    offsetDepth1=offsetdepth1,
    offsetDepth2=offsetdepth2,
    imageProjectionSurface=srf,
    imagePixelValue=image)  # -> out, a; inputs mesh: Mesh, recursionLevel: Int32, imageProjectionSurface: Surface, imagePixelValue: tree
# ---------- py_quadsubdattr: Python ----------
import rhinoscriptsyntax as rs
import Rhino.Geometry as rg

def subdivide(mesh, recursion, offset1, offset2):
    mesh2 = rg.Mesh()
    vtx = mesh.Vertices.ToPoint3dArray()
    for i in range(len(vtx)):
        vtx2 = vtx[i] + rg.Vector3d(mesh.Normals[i]) * offset1 * pixelValue(vtx[i]) # offset vertex
        mesh2.Vertices.Add(vtx2)
    
    for i in range(mesh.Faces.Count):
        if(mesh.Faces[i].IsQuad): # quad face
            vidx1 = mesh.Faces[i].A
            vidx2 = mesh.Faces[i].B
            vidx3 = mesh.Faces[i].C
            vidx4 = mesh.Faces[i].D
            v1 = vtx[vidx1]
            v2 = vtx[vidx2]
            v3 = vtx[vidx3]
            v4 = vtx[vidx4]
            
            w1 = (v1+v2)/2 # mid point
            w2 = (v2+v3)/2 # mid point
            w3 = (v3+v4)/2 # mid point
            w4 = (v4+v1)/2 # mid point
            w5 = (v1+v2+v3+v4)/4 # center point
            w5 += rg.Vector3d(mesh.FaceNormals[i]) * offset2 * pixelValue(w5) # offset new vertex
            
            widx1 = mesh2.Vertices.Add(w1)
            widx2 = mesh2.Vertices.Add(w2)
            widx3 = mesh2.Vertices.Add(w3)
            widx4 = mesh2.Vertices.Add(w4)
            widx5 = mesh2.Vertices.Add(w5)
            mesh2.Faces.AddFace(vidx1,widx1,widx5,widx4)
            mesh2.Faces.AddFace(vidx2,widx2,widx5,widx1)
            mesh2.Faces.AddFace(vidx3,widx3,widx5,widx2)
            mesh2.Faces.AddFace(vidx4,widx4,widx5,widx3)
        else: # triangular face
            vidx1 = mesh.Faces[i].A
            vidx2 = mesh.Faces[i].B
            vidx3 = mesh.Faces[i].C
            v1 = vtx[vidx1]
            v2 = vtx[vidx2]
            v3 = vtx[vidx3]
            
            w1 = (v1+v2)/2 # mid point
            w2 = (v2+v3)/2 # mid point
            w3 = (v3+v1)/2 # mid point
            w4 = (v1+v2+v3)/3 # center point
            w4 += rg.Vector3d(mesh.FaceNormals[i]) * offset2 * pixelValue(w4) # offset new vertex
            
            widx1 = mesh2.Vertices.Add(w1)
            widx2 = mesh2.Vertices.Add(w2)
            widx3 = mesh2.Vertices.Add(w3)
            widx4 = mesh2.Vertices.Add(w4)
            mesh2.Faces.AddFace(vidx1,widx1,widx4,widx3)
            mesh2.Faces.AddFace(vidx2,widx2,widx4,widx1)
            mesh2.Faces.AddFace(vidx3,widx3,widx4,widx2)
    
    mesh2.Normals.ComputeNormals()
    mesh2.Weld(180) # weld vertices
    if(recursion>1):
        return subdivide(mesh2, recursion-1, offset1/2, offset2/2)
    return mesh2

def pixelValue(pos):
    [result, u, v] = imageProjectionSurface.ClosestPoint(pos) # find closest point on surface
    if not result : # if it fails, return 0
        return 0
    # pick a pixel value on the tree branch matrix
    branch = imagePixelValue.Branches[int((imagePixelValue.BranchCount-1)*u)] 
    return branch[int((len(branch)-1)*v)]

a = subdivide(mesh, recursionLevel, offsetDepth1, offsetDepth2)
# ---------- end py_quadsubdattr ----------

# ----
python = PythonScript(
    mesh1=mplane.Mesh,
    recursionLevel=recursionlevel_2,
    offsetDepth1=offsetdepth1_2,
    offsetDepth2=offsetdepth2_2,
    imageProjectionSurface=srf,
    imagePixelValue=image)  # -> out, a; inputs mesh1: Mesh, recursionLevel: Int32, imageProjectionSurface: Surface, imagePixelValue: tree
# ---------- python: Python ----------
import rhinoscriptsyntax as rs
import Rhino.Geometry as rg

def subdivide(mesh,recursion,offset1,offset2):
    mesh2 = rg.Mesh()
    vtx = mesh.Vertices.ToPoint3dArray()
    
    for i in range(len(vtx)):
        vtx2 = vtx[i] + rg.Vector3d(mesh.Normals[i])*offset1*pixelValue(vtx[i]) ## offset vertex
        mesh2.Vertices.Add(vtx2)
    
    for i in range(mesh.Faces.Count):
        
        if(mesh.Faces[i].IsQuad): ## quad face
            vidx1 = mesh.Faces[i].A
            vidx2 = mesh.Faces[i].B
            vidx3 = mesh.Faces[i].C
            vidx4 = mesh.Faces[i].D
            
            v1 = vtx[vidx1]
            v2 = vtx[vidx2]
            v3 = vtx[vidx3]
            v4 = vtx[vidx4]
            
            w1 = (v1+v2)/2 ## mid point
            w2 = (v2+v3)/2 ## mid point
            w3 = (v3+v4)/2 ## mid point
            w4 = (v4+v1)/2 ## mid point
            w5 = (v1+v2+v3+v4)/4 ## center point
            w5 += rg.Vector3d(mesh.FaceNormals[i])*offset2*pixelValue(w5) ## offset new vertex
            
            widx1 = mesh2.Vertices.Add(w1)
            widx2 = mesh2.Vertices.Add(w2)
            widx3 = mesh2.Vertices.Add(w3)
            widx4 = mesh2.Vertices.Add(w4)
            widx5 = mesh2.Vertices.Add(w5)
            
            mesh2.Faces.AddFace(vidx1,widx1,widx5,widx4)
            mesh2.Faces.AddFace(vidx2,widx2,widx5,widx1)
            mesh2.Faces.AddFace(vidx3,widx3,widx5,widx2)
            mesh2.Faces.AddFace(vidx4,widx4,widx5,widx3)
        
        else: ## triangular face
            vidx1 = mesh.Faces[i].A
            vidx2 = mesh.Faces[i].B
            vidx3 = mesh.Faces[i].C
            
            v1 = vtx[vidx1]
            v2 = vtx[vidx2]
            v3 = vtx[vidx3]
            
            w1 = (v1+v2)/2 ## mid point
            w2 = (v2+v3)/2 ## mid point
            w3 = (v3+v1)/2 ## mid point
            
            w4 = (v1+v2+v3)/3 ## center point
            w4 += rg.Vector3d(mesh.FaceNormals[i])*offset3*pixelValue(w4) ## offset new vertex
            
            widx1 = mesh2.Vertices.Add(w1)
            widx2 = mesh2.Vertices.Add(w2)
            widx3 = mesh2.Vertices.Add(w3)
            widx4 = mesh2.Vertices.Add(w4)
            
            mesh.Faces.AddFace(vidx1,widx1,widx4,widx3)
            mesh.Faces.AddFace(vidx2,widx2,widx4,widx1)
            mesh.Faces.AddFace(vidx3,widx3,widx4,widx2)
    
    mesh2.Normals.ComputeNormals()
    mesh2.Weld(180) ## weld vertices
    
    if (recursion-1):
        return subdivide(mesh2,recursion-1,offset1/2,offset2/2)
    return mesh2

def pixelValue(pos):
    [result,u,v] = imageProjectionSurface.ClosestPoint(pos) ## find closest point on surface
    
    if not result: ## if it fails,rerurn 0
        return 0
    
    ## pick a pixel value on the tree branch matrix
    branch = imagePixelValue.Branches[int((imagePixelValue.BranchCount-1)*u)]
    return branch[int((len(branch)-1)*v)]

a = subdivide(mesh1,recursionLevel,offsetDepth1,offsetDepth2)
# ---------- end python ----------
medges = MeshEdges(Mesh=py_quadsubdattr.a)  # -> NakedEdges, InteriorEdges, NonManifoldEdges
medges_2 = MeshEdges(Mesh=python.a)  # -> NakedEdges, InteriorEdges, NonManifoldEdges
