# Grasshopper definition ss-07-17_QuadSubdivRecursionByBitmap.gh (Grasshopper 0.9.76)
# plug-ins: Python Interpreter

number_slider = Slider(5, range=0..10)
number_slider_2 = Slider(100, range=0..100)
srf = Surface(reparameterize(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))
mplane = MeshPlane(
    Boundary={Plane=PlaneXY(0, 0, 0), Size=Domain2(u=-10..10, v=-10..10)},
    WidthCount=number_slider,
    HeightCount=number_slider)  # -> Mesh, Area
sdivide = DivideSurface(Surface=srf, UCount=number_slider_2, VCount=number_slider_2)  # -> Points, Normals, Parameters
recursiondepth = Slider(6, range=0..10)
offsetdepth1 = Slider(-1, range=-10..10)
offsetdepth2 = Slider(2, range=-10..10)
holeratio = Slider(0.7, range=0..1)
recursiondepth_2 = Slider(6, range=0..10)
offsetdepth1_2 = Slider(-1, range=-10..10)
offsetdepth2_2 = Slider(2, range=-10..10)
holeratio_2 = Slider(0.7, range=0..1)
image = ImageSampler(
    sdivide.Parameters,
    FilePath="C:\Users\yoshioca\Desktop\image-sampler\gray.jpg",
    Filter="Value",
    Interpolate=False,
    Umax=1,
    Umin=0,
    Vmax=1,
    Vmin=0,
    Wrap=1)
py_framesubd = PythonScript(
    mesh=mplane.Mesh,
    recursionLevel=recursiondepth,
    offsetDepth1=offsetdepth1,
    offsetDepth2=offsetdepth2,
    holeRatio=holeratio,
    imageProjectionSurface=srf,
    imagePixelValue=image)  # -> out, a; inputs mesh: Mesh, recursionLevel: Int32, imageProjectionSurface: Surface, imagePixelValue: tree
# ---------- py_framesubd: Python ----------
import Rhino.Geometry as rg
import random

def subdivide(mesh, recursion, offset1, offset2):
    mesh2 = rg.Mesh()
    vtx = mesh.Vertices.ToPoint3dArray()
    for i in range(len(vtx)):
        vtx2 = vtx[i] + rg.Vector3d(mesh.Normals[i]) * offset1 #offset vertex
        mesh2.Vertices.Add(vtx2)
    
    for i in range(mesh.Faces.Count):
        vidx1 = mesh.Faces[i].A
        vidx2 = mesh.Faces[i].B
        vidx3 = mesh.Faces[i].C
        v1 = vtx[vidx1]
        v2 = vtx[vidx2]
        v3 = vtx[vidx3]
        n = rg.Vector3d(mesh.FaceNormals[i]) * offset2 * random.random() #random normal vector
        
        if mesh.Faces[i].IsTriangle: # triangle face
            if random.random() < pixelValue((v1+v2+v3)/3) :
                w1 = interpolateTriangle(v1,v2,v3, holeRatio/3,holeRatio/3) + n #new vertex
                w2 = interpolateTriangle(v1,v2,v3, 1-holeRatio*2/3,holeRatio/3) + n #new vertex
                w3 = interpolateTriangle(v1,v2,v3, holeRatio/3,1-holeRatio*2/3) + n #new vertex
                widx1 = mesh2.Vertices.Add(w1) #add new vertex and get index
                widx2 = mesh2.Vertices.Add(w2) #add new vertex and get index
                widx3 = mesh2.Vertices.Add(w3) #add new vertex and get index
                mesh2.Faces.AddFace(vidx1,vidx2,widx2,widx1) #subdivided face
                mesh2.Faces.AddFace(vidx2,vidx3,widx3,widx2) #subdivided face
                mesh2.Faces.AddFace(vidx3,vidx1,widx1,widx3) #subdivided face
            else:
                mesh2.Faces.AddFace(mesh.Faces[i])
        else: # quad face
            vidx4 = mesh.Faces[i].D
            v4 = vtx[vidx4]
            if random.random() < pixelValue((v1+v2+v3+v4)/4) :
                w1 = interpolateQuad(v1,v2,v3,v4,holeRatio/2,holeRatio/2) + n # new vertex
                w2 = interpolateQuad(v1,v2,v3,v4,1-holeRatio/2,holeRatio/2) + n # new vertex
                w3 = interpolateQuad(v1,v2,v3,v4,1-holeRatio/2,1-holeRatio/2) + n # new vertex
                w4 = interpolateQuad(v1,v2,v3,v4,holeRatio/2,1-holeRatio/2) + n # new vertex
                widx1 = mesh2.Vertices.Add(w1) #add new vertex and get index
                widx2 = mesh2.Vertices.Add(w2) #add new vertex and get index
                widx3 = mesh2.Vertices.Add(w3) #add new vertex and get index
                widx4 = mesh2.Vertices.Add(w4) #add new vertex and get index
                mesh2.Faces.AddFace(vidx1,vidx2,widx2,widx1) #subdivided face
                mesh2.Faces.AddFace(vidx2,vidx3,widx3,widx2) #subdivided face
                mesh2.Faces.AddFace(vidx3,vidx4,widx4,widx3) #subdivided face
                mesh2.Faces.AddFace(vidx4,vidx1,widx1,widx4) #subdivided face
            else:
                mesh2.Faces.AddFace(mesh.Faces[i])
    
    mesh2.Normals.ComputeNormals()
    if(recursion>1):
        return subdivide(mesh2, recursion-1, offset1/2, offset2/2)
    return mesh2

def interpolateQuad(v1, v2, v3, v4, ratio1, ratio2): # 0 < ratio1 < 1, 0 < ratio2 < 1 to be inside quad
    return (v1*(1-ratio1)+v2*ratio1)*(1-ratio2) + (v4*(1-ratio1)+v3*ratio1)*ratio2

def interpolateTriangle(v1, v2, v3, ratio1, ratio2): # ratio1 > 0, ratio2 > 0, ratio1+ratio2 < 1 to be inside triangle
    return (v2-v1)*ratio1+(v3-v1)*ratio2+v1

def pixelValue(pos):
    [result, u, v] = imageProjectionSurface.ClosestPoint(pos) # find closest point on surface
    if not result : # if it fails, return 0
        return 0
    # pick a pixel value on the tree branch matrix
    branch = imagePixelValue.Branches[int((imagePixelValue.BranchCount-1)*u)] 
    return branch[int((len(branch)-1)*v)]

a = subdivide(mesh, recursionLevel, offsetDepth1, offsetDepth2)
# ---------- end py_framesubd ----------
python = PythonScript(
    mesh1=mplane.Mesh,
    recursionLevel=recursiondepth_2,
    offsetDepth1=offsetdepth1_2,
    offsetDepth2=offsetdepth2_2,
    holeRatio=holeratio_2,
    imageProjectionSurface=srf,
    imagePixelValue=image)  # -> out, a; inputs mesh1: Mesh, recursionLevel: Int32, imageProjectionSurface: Surface, imagePixelValue: tree
# ---------- python: Python ----------
import Rhino.Geometry as rg
import random

def subdivide(mesh,recursion,offset1,offset2):
    mesh2 = rg.Mesh()
    vtx = mesh.Vertices.ToPoint3dArray()
    
    for i in range(len(vtx)):
        vtx2 = vtx[i]+rg.Vector3d(mesh.Normals[i])*offset1 ## offset vertex
        mesh2.Vertices.Add(vtx2)
    
    for i in range(mesh.Faces.Count):
        vidx1 = mesh.Faces[i].A
        vidx2 = mesh.Faces[i].B
        vidx3 = mesh.Faces[i].C
        
        v1 = vtx[vidx1]
        v2 = vtx[vidx2]
        v3 = vtx[vidx3]
        
        n = rg.Vector3d(mesh.FaceNormals[i])*offset2*random.random() ## random normal vector
        
        if mesh.Faces[i].IsTriangle: ## triangle face
            
            if random.random()<pixelValue((v1+v2+v3)/3):
                
                w1 = interpolateTriangle(v1,v2,v3,holeRatio/3,holeRaio/3)+n ## new vertex
                w2 = interpolateTriangle(v1,v2,v3,1-holeRatio*2/3,holeRatio/3)+n ## new vertex
                w3 = interpolateTriangle(v1,v2,v3,holeRatio/3,1-holeRatio*2/3)+n ## new vertex
                
                widx1 = mesh2.Vertices.Add(w1) ## add new vertex and get index
                widx2 = mesh2.Vertices.Add(w2) ## add new vertex and get index
                widx3 = mesh2.Vertices.Add(w3) ## add new vertex and get index
                
                mesh2.Faces.AddFace(vidx1,vidx2,widx2,widx1) ## subdivide face
                mesh2.Faces.AddFace(vidx2,vidx3,widx3,widx2) ## subdivide face
                mesh2.Faces.AddFace(vidx3,vidx1,widx1,widx3) ## subdivide face
            
            else:
                mesh2.Faces.AddFace(mesh.Faces[i])
                
        else: ## quad face
            vidx4 = mesh.Faces[i].D
            v4 = vtx[vidx4]
            
            if random.random()<pixelValue((v1+v2+v3+v4)/4):
                w1 = interpolateQuad(v1,v2,v3,v4,holeRatio/2,holeRatio/2)+n ## new vertex
                w2 = interpolateQuad(v1,v2,v3,v4,1-holeRatio/2,holeRatio/2)+n ## new vertex
                w3 = interpolateQuad(v1,v2,v3,v4,1-holeRatio/2,1-holeRatio/2)+n ## new vertex
                w4 = interpolateQuad(v1,v2,v3,v4,holeRatio/2,1-holeRatio/2)+n ## new vertex
                
                widx1 = mesh2.Vertices.Add(w1) ## add new vertex and get index
                widx2 = mesh2.Vertices.Add(w2) ## add new vertex and get index
                widx3 = mesh2.Vertices.Add(w3) ## add new vertex and get index
                widx4 = mesh2.Vertices.Add(w4) ## add new vertex and get index
                
                mesh2.Faces.AddFace(vidx1,vidx2,widx2,widx1) ## subdivide face
                mesh2.Faces.AddFace(vidx2,vidx3,widx3,widx2) ## subdivide face
                mesh2.Faces.AddFace(vidx3,vidx4,widx4,widx3) ## subdivide face
                mesh2.Faces.AddFace(vidx4,vidx1,widx1,widx4) ## subdivide face
            
            else:
                mesh2.Faces.AddFace(mesh.Faces[i])
    
    mesh2.Normals.ComputeNormals()
    
    if (recursion>1):
        return subdivide(mesh2,recursion-1,offset1/2,offset2/2)
    return mesh2

def interpolateQuad(v1,v2,v3,v4,ratio1,ratio2): ## 0<ratio1<1,0<ratio2<1 to be inside quad
    return (v1*(1-ratio1)+v2*ratio1)*(1-ratio2)+(v4*(1-ratio1)+v3*ratio1)*ratio2

def interpolateTriangle(v1,v2,v3,ratio1,ratio2): ## 0<ratio1,0<ratio2,ratio1+ratio2<1 to be inside triangle
    return (v2-v1)*ratio1+(v3-v1)*ratio2+v1

def pixelValue(pos):
    [result,u,v] = imageProjectionSurface.ClosestPoint(pos) ## find closest point on surface
    
    if not result: ## if it fails,return 0
        return 0
    
    ## pick a pixel value on the tree branch matrix
    branch = imagePixelValue.Branches[int((imagePixelValue.BranchCount-1)*u)]
    return branch[int((len(branch)-1)*v)]

a = subdivide(mesh1,recursionLevel,offsetDepth1,offsetDepth2)
# ---------- end python ----------
medges = MeshEdges(Mesh=py_framesubd.a)  # -> NakedEdges, InteriorEdges, NonManifoldEdges
medges_2 = MeshEdges(Mesh=python.a)  # -> NakedEdges, InteriorEdges, NonManifoldEdges
