# Grasshopper definition ss-07-18_QuadSubdivDepthByArea .gh (Grasshopper 0.9.76)
# plug-ins: Python Interpreter

number_slider = Slider(1, range=0..10)
mplane = MeshPlane(
    Boundary={Plane=PlaneXY(0, 0, 0), Size=Domain2(u=-10..10, v=-10..10)},
    WidthCount=number_slider,
    HeightCount=number_slider)  # -> Mesh, Area
recursionprobability = Slider(100, range=0..100)
recursionprobability_2 = Slider(100, range=0..100)

# ---- group: download
py_customquadsubd2 = PythonScript(
    mesh=mplane.Mesh,
    recursionLevel=Slider(4, range=0..10),
    recursionProbability=recursionprobability,
    offsetDepth1=Slider(0, range=0..10),
    offsetDepth2=Slider(3.9, range=0..10))  # -> out, a; inputs mesh: Mesh, recursionLevel: Int32
# ---------- py_customquadsubd2: Python ----------
import Rhino.Geometry as rg
import random

def subdivide(mesh, recursion, offset1, offset2):
    mesh2 = rg.Mesh()
    vtx = mesh.Vertices.ToPoint3dArray()
    for i in range(len(vtx)):
        vtx2 = vtx[i] + rg.Vector3d(mesh.Normals[i]) * offset1
        mesh2.Vertices.Add(vtx2)
    
    for i in range(mesh.Faces.Count):
        if(mesh.Faces[i].IsQuad): # quad face
            if(random.random()*100 < recursionProbability):
                vidx1 = mesh.Faces[i].A
                vidx2 = mesh.Faces[i].B
                vidx3 = mesh.Faces[i].C
                vidx4 = mesh.Faces[i].D
                v1 = vtx[vidx1]
                v2 = vtx[vidx2]
                v3 = vtx[vidx3]
                v4 = vtx[vidx4]
                
                area = quadArea(v1,v2,v3,v4)
                n = rg.Vector3d(mesh.FaceNormals[i]) * offset2 * area / 100
                
                w1 = v1*0.5+v2*0.2+v3*0.1+v4*0.2
                w2 = v1*0.2+v2*0.5+v3*0.2+v4*0.1
                w3 = w1+n
                w4 = w2+n
                
                widx1 = mesh2.Vertices.Add(w1)
                widx2 = mesh2.Vertices.Add(w2)
                widx3 = mesh2.Vertices.Add(w3)
                widx4 = mesh2.Vertices.Add(w4)
                mesh2.Faces.AddFace(vidx1,vidx2,widx2,widx1)
                mesh2.Faces.AddFace(vidx3,vidx4,widx3,widx4)
                mesh2.Faces.AddFace(widx1,widx2,widx4,widx3)
                mesh2.Faces.AddFace(vidx2,vidx3,widx4,widx2)
                mesh2.Faces.AddFace(vidx4,vidx1,widx1,widx3)
            else:
                mesh2.Faces.AddFace(mesh.Faces[i])
        else: # triangular face
            mesh2.Faces.AddFace(mesh.Faces[i])
            
    mesh2.Normals.ComputeNormals()
    if(recursion>1):
        return subdivide(mesh2, recursion-1, offset1*0.8, offset2*0.8)
    return mesh2

def triangleArea(v1, v2, v3):
    crossVec = rg.Vector3d.CrossProduct(v2-v1, v3-v1)
    return crossVec.Length/2

def quadArea(v1, v2, v3, v4):
    return triangleArea(v1,v2,v3) + triangleArea(v3,v4,v1)

a = subdivide(mesh, recursionLevel, offsetDepth1, offsetDepth2)
# ---------- end py_customquadsubd2 ----------

# ----
python = PythonScript(
    mesh1=mplane.Mesh,
    recursionLevel=Slider(4, range=0..10),
    recursionProbability=recursionprobability_2,
    offsetDepth1=Slider(0, range=0..10),
    offsetDepth2=Slider(4.3, range=0..10))  # -> out, a; inputs mesh1: Mesh, recursionLevel: Int32
# ---------- python: Python ----------
import Rhino.Geometry as rg
import random

def subdivide(mesh,recursion,offset1,offset2):
    mesh2 = rg.Mesh()
    vtx = mesh.Vertices.ToPoint3dArray()
    
    for i in range(len(vtx)):
        vtx2 = vtx[i]+rg.Vector3d(mesh.Normals[i])*offset1
        mesh2.Vertices.Add(vtx2)
    
    for i in range(mesh.Faces.Count):
        if (mesh.Faces[i].IsQuad): ## quad face
            if (random.random()*100 < recursionProbability):
                vidx1 = mesh.Faces[i].A
                vidx2 = mesh.Faces[i].B
                vidx3 = mesh.Faces[i].C
                vidx4 = mesh.Faces[i].D
                
                v1 = vtx[vidx1]
                v2 = vtx[vidx2]
                v3 = vtx[vidx3]
                v4 = vtx[vidx4]
                
                area = quadArea(v1,v2,v3,v4)
                n = rg.Vector3d(mesh.FaceNormals[i])*offset2*area/100
                
                w1 = v1*0.5 + v2*0.2 + v3*0.1 + v4*0.2
                w2 = v1*0.2 + v2*0.5 + v3*0.2 + v4*0.1
                w3 = w1+n
                w4 = w2+n
                
                widx1 = mesh2.Vertices.Add(w1)
                widx2 = mesh2.Vertices.Add(w2)
                widx3 = mesh2.Vertices.Add(w3)
                widx4 = mesh2.Vertices.Add(w4)
                
                mesh2.Faces.AddFace(vidx1,vidx2,widx2,widx1)
                mesh2.Faces.AddFace(vidx3,vidx4,widx3,widx4)
                mesh2.Faces.AddFace(widx1,widx2,widx4,widx3)
                mesh2.Faces.AddFace(vidx2,vidx3,widx4,widx2)
                mesh2.Faces.AddFace(vidx4,vidx1,widx1,widx3)
                
            else:
                mesh2.Faces.AddFace(mesh.Faces[i])
        
        else: ## triangular face
            mesh2.Faces.AddFace(mesh.Faces[i])
            
    mesh2.Normals.ComputeNormals()
    
    if (recursion>1):
        return subdivide(mesh2,recursion-1,offset1*0.8,offset2*0.8)
    return mesh2

def triangleArea(v1,v2,v3):
    crossVec = rg.Vector3d.CrossProduct(v2-v1,v3-v1)
    return crossVec.Length/2

def quadArea(v1,v2,v3,v4):
    return triangleArea(v1,v2,v3) + triangleArea(v3,v4,v1)

a = subdivide(mesh1,recursionLevel,offsetDepth1,offsetDepth2)
# ---------- end python ----------
medges = MeshEdges(Mesh=py_customquadsubd2.a)  # -> NakedEdges, InteriorEdges, NonManifoldEdges
medges_2 = MeshEdges(Mesh=python.a)  # -> NakedEdges, InteriorEdges, NonManifoldEdges
