# Grasshopper definition ss-07-19_LinearSubdivision.gh (Grasshopper 0.9.76)
# plug-ins: Python Interpreter

msphereex = MeshSphereEx(Base=PlaneXY(0, 0, 0), Radius=10, Count=Slider(3, range=1..10))
recursionprobability = Slider(100, range=0..100)
scale = Slider(0.7, range=0..1)
bend = Slider(0.04, range=0..1)
recursionprobability_2 = Slider(100, range=0..100)
scale_2 = Slider(0.7, range=0..1)
bend_2 = Slider(0.04, range=0..1)

# ---- group: download
py_linearsubd = PythonScript(
    mesh=msphereex,
    recursionLevel=Slider(30, range=0..30),
    recursionProbability=recursionprobability,
    offsetDepth1=Slider(0, range=0..10),
    offsetDepth2=Slider(1, range=0..1),
    scale=scale,
    bend=bend)  # -> out, a; inputs mesh: Mesh, recursionLevel: Int32
# ---------- py_linearsubd: Python ----------
import Rhino.Geometry as rg
import random

a = []

def subdivide(mesh, recursion, offset1, offset2):
    mesh2 = rg.Mesh() # new mesh
    mesh3 = rg.Mesh() # another new mesh
    vtx = mesh.Vertices.ToPoint3dArray()
    for i in range(len(vtx)):
        vtx2 = vtx[i] + rg.Vector3d(mesh.Normals[i]) * offset1
        mesh2.Vertices.Add(vtx2)
    
    for i in range(mesh.Faces.Count):
        if mesh.Faces[i].IsQuad : # quad face
            vidx1 = mesh.Faces[i].A
            vidx2 = mesh.Faces[i].B
            vidx3 = mesh.Faces[i].C
            vidx4 = mesh.Faces[i].D
            if random.random()*100 < recursionProbability :
                v1 = vtx[vidx1]
                v2 = vtx[vidx2]
                v3 = vtx[vidx3]
                v4 = vtx[vidx4]
                
                n = rg.Vector3d(mesh.FaceNormals[i]) * offset2
                w1 = interpolateQuad(v1,v2,v3,v4, (1-scale)/4, (1-scale)/2) + n * (1+bend)
                w2 = interpolateQuad(v1,v2,v3,v4, (1+scale)/2, (3-3*scale)/8) + n * (1+bend)
                w3 = interpolateQuad(v1,v2,v3,v4, (3+scale)/4, (1+scale)/2) + n * (1-bend)
                w4 = interpolateQuad(v1,v2,v3,v4, (1-scale)/2, (5+3*scale)/8) + n * (1-bend)
                
                widx1 = mesh2.Vertices.Add(w1)
                widx2 = mesh2.Vertices.Add(w2)
                widx3 = mesh2.Vertices.Add(w3)
                widx4 = mesh2.Vertices.Add(w4)
                mesh2.Faces.AddFace(vidx1,vidx2,widx2,widx1) # tubular side face
                mesh2.Faces.AddFace(vidx2,vidx3,widx3,widx2) # tubular side face
                mesh2.Faces.AddFace(vidx3,vidx4,widx4,widx3) # tubular side face
                mesh2.Faces.AddFace(vidx4,vidx1,widx1,widx4) # tubular side face
                
                widx1 = mesh3.Vertices.Add(w1)
                widx2 = mesh3.Vertices.Add(w2)
                widx3 = mesh3.Vertices.Add(w3)
                widx4 = mesh3.Vertices.Add(w4)
                mesh3.Faces.AddFace(widx1,widx2,widx3,widx4) # offset face
            else:
                mesh2.Faces.AddFace(vidx1,vidx2,vidx3,vidx4) # original face
            
        else: # triangular face
            vidx1 = mesh.Faces[i].A
            vidx2 = mesh.Faces[i].B
            vidx3 = mesh.Faces[i].C
            if random.random()*100 < recursionProbability :
                v1 = vtx[vidx1]
                v2 = vtx[vidx2]
                v3 = vtx[vidx3]
                
                n = rg.Vector3d(mesh.FaceNormals[i]) * offset2
                w1 = interpolateTriangle(v1,v2,v3, (1-scale)/2, (1-scale)/6) + n
                w2 = interpolateTriangle(v1,v2,v3, (1+scale)/2, (3-3*scale)/8) + n*(1+bend)
                w3 = interpolateTriangle(v1,v2,v3, (1-scale)/8, (1+scale)/2) + n*(1-bend)
                
                widx1 = mesh2.Vertices.Add(w1)
                widx2 = mesh2.Vertices.Add(w2)
                widx3 = mesh2.Vertices.Add(w3)
                mesh2.Faces.AddFace(vidx1,vidx2,widx2,widx1) # tubular side face
                mesh2.Faces.AddFace(vidx2,vidx3,widx3,widx2) # tubular side face
                mesh2.Faces.AddFace(vidx3,vidx1,widx1,widx3) # tubular side face
                
                widx1 = mesh3.Vertices.Add(w1)
                widx2 = mesh3.Vertices.Add(w2)
                widx3 = mesh3.Vertices.Add(w3)
                mesh3.Faces.AddFace(widx1,widx2,widx3) # offset face
            else:
                mesh2.Faces.AddFace(vidx1,vidx2,vidx3) # original face
    
    mesh2.Normals.ComputeNormals()
    mesh3.Normals.ComputeNormals()
    a.append(mesh2) # tubular side mesh
    
    if(recursion>1):
        return subdivide(mesh3, recursion-1, offset1, offset2) # subdivide offset mesh
    return mesh3 # return offset mesh

def interpolateQuad(v1, v2, v3, v4, ratio1, ratio2): # 0 < ratio1 < 1, 0 < ratio2 < 1 to be inside quad
    return (v1*(1-ratio1)+v2*ratio1)*(1-ratio2) + (v4*(1-ratio1)+v3*ratio1)*ratio2

def interpolateTriangle(v1, v2, v3, ratio1, ratio2): # ratio1 > 0, ratio2 > 0, ratio1+ratio2 < 1 to be inside triangle
    return (v2-v1)*ratio1+(v3-v1)*ratio2+v1

a.append( subdivide(mesh, recursionLevel, offsetDepth1, offsetDepth2) )
# ---------- end py_linearsubd ----------

# ----
python = PythonScript(
    mesh1=msphereex,
    recursionLevel=Slider(30, range=0..30),
    recursionProbability=recursionprobability_2,
    offsetDepth1=Slider(0, range=0..10),
    offsetDepth2=Slider(1, range=0..1),
    scale=scale_2,
    bend=bend_2)  # -> out, a; inputs mesh1: Mesh, recursionLevel: Int32
# ---------- python: Python ----------
import Rhino.Geometry as rg
import random

a = []

def subdivide(mesh,recursion,offset1,offset2):
    mesh2 = rg.Mesh()
    mesh3 = rg.Mesh()
    
    vtx = mesh.Vertices.ToPoint3dArray()
    
    for i in range(len(vtx)):
        vtx2 = vtx[i] + rg.Vector3d(mesh.Normals[i])*offset1
        mesh2.Vertices.Add(vtx2)
    
    for i in range(mesh.Faces.Count):
        if mesh.Faces[i].IsQuad: ## quad face
            vidx1 = mesh.Faces[i].A
            vidx2 = mesh.Faces[i].B
            vidx3 = mesh.Faces[i].C
            vidx4 = mesh.Faces[i].D
            
            if random.random()*100 < recursionProbability:
                v1 = vtx[vidx1]
                v2 = vtx[vidx2]
                v3 = vtx[vidx3]
                v4 = vtx[vidx4]
                
                n = rg.Vector3d(mesh.FaceNormals[i])*offset2
                
                w1 = interpolateQuad(v1,v2,v3,v4,(1-scale)/4,(1-scale)/2) + n*(1+bend)
                w2 = interpolateQuad(v1,v2,v3,v4,(1+scale)/2,(3-3*scale)/8) + n*(1+bend)
                w3 = interpolateQuad(v1,v2,v3,v4,(3+scale)/4,(1+scale)/2) + n*(1-bend)
                w4 = interpolateQuad(v1,v2,v3,v4,(1-scale)/2,(5+3*scale)/8) + n*(1-bend)
                
                widx1 = mesh2.Vertices.Add(w1)
                widx2 = mesh2.Vertices.Add(w2)
                widx3 = mesh2.Vertices.Add(w3)
                widx4 = mesh2.Vertices.Add(w4)
                
                mesh2.Faces.AddFace(vidx1,vidx2,widx2,widx1) ## tubular side face
                mesh2.Faces.AddFace(vidx2,vidx3,widx3,widx2) ## tubular side face
                mesh2.Faces.AddFace(vidx3,vidx4,widx4,widx3) ## tubular side face
                mesh2.Faces.AddFace(vidx4,vidx1,widx1,widx4) ## tubular side face
                
                widx1 = mesh3.Vertices.Add(w1)
                widx2 = mesh3.Vertices.Add(w2)
                widx3 = mesh3.Vertices.Add(w3)
                widx4 = mesh3.Vertices.Add(w4)
                
                mesh3.Faces.AddFace(widx1,widx2,widx3,widx4) ## offset face
                
            else:
                mesh2.Faces.AddFace(vidx1,vidx2,vidx3,vidx4) ## original face
            
        else: ## triangular face
            vidx1 = mesh.Faces[i].A
            vidx2 = mesh.Faces[i].B
            vidx3 = mesh.Faces[i].C
            
            if random.random()*100 <recursionProbability:
                v1 = vtx[vidx1]
                v2 = vtx[vidx2]
                v3 = vtx[vidx3]
                
                n = rg.Vector3d(mesh.FaceNormals[i])*offset2
                
                w1 = interpolateTriangle(v1,v2,v3,(1-scale)/2,(1-scale)/6) + n
                w2 = interpolateTriangle(v1,v2,v3,(1+scale)/2,(3-3*scale)/8) + n*(1+bend)
                w3 = interpolateTriangle(v1,v2,v3,(1-scale)/8,(1+scale)/2) + n*(1-bend)
                
                widx1 = mesh2.Vertices.Add(w1)
                widx2 = mesh2.Vertices.Add(w2)
                widx3 = mesh2.Vertices.Add(w3)
                
                mesh2.Faces.AddFace(vidx1,vidx2,widx2,widx1) ## tubular side face
                mesh2.Faces.AddFace(vidx2,vidx3,widx3,widx2) ## tubular side face
                mesh2.Faces.AddFace(vidx3,vidx1,widx1,widx3) ## tubular side face
                
                widx1 = mesh3.Vertices.Add(w1)
                widx2 = mesh3.Vertices.Add(w2)
                widx3 = mesh3.Vertices.Add(w3)
                
                mesh3.Faces.AddFace(widx1,widx2,widx3) ## offset face
                
            else:
                meshs.Faces.AddFace(vidx1,vidx2,vidx3) ## offset face
    
    mesh2.Normals.ComputeNormals()
    mesh3.Normals.ComputeNormals()
    
    a.append(mesh2) ## tubular face
    
    if (recursion>1):
        return subdivide(mesh3,recursion-1,offset1,offset2) ## subdivide offset mesh
    return mesh3 ## return offset mesh


def interpolateQuad(v1,v2,v3,v4,ratio1,ratio2): ## 0<ratio1<1,0<ratio2<1 to be inside quad
    return (v1*(1-ratio1) + v2*ratio1)*(1-ratio2) + (v4*(1-ratio1)+v3*ratio1)*ratio2


def interpolateTriangle(v1,v2,v3,ratio1,ratio2): ## 0<ratio1,0<ratio2,ratio1+ratio2<1 to be inside triangle
    return (v2-v1)*ratio1 + (v3-v1)+ratio2 + v1


a.append(subdivide(mesh1,recursionLevel,offsetDepth1,offsetDepth2))
# ---------- end python ----------
mjoin = MeshJoin(Meshes=py_linearsubd.a)
mjoin_2 = MeshJoin(Meshes=python.a)
weld = WeldMesh(Mesh=mjoin, Angle=3.141592654)
weld_2 = WeldMesh(Mesh=mjoin_2, Angle=3.141592654)
medges = MeshEdges(Mesh=weld)  # -> NakedEdges, InteriorEdges, NonManifoldEdges
