# Grasshopper definition ss-07-21_TubularSubdivisionWithTab.gh (Grasshopper 0.9.76)
# plug-ins: Python Interpreter

number_slider = Slider(3, range=0..10)
mplane = MeshPlane(
    Boundary={Plane=PlaneXY(0, 0, 0), Size=Domain2(u=-10..10, v=-10..10)},
    WidthCount=number_slider,
    HeightCount=number_slider)  # -> Mesh, Area
recursionprobability = Slider(75, range=0..100)
recursionprobability_2 = Slider(75, range=0..100)

# ---- group: download
py_tubularoffset = PythonScript(
    mesh=mplane.Mesh,
    recursionLevel=Slider(3, range=1..7),
    recursionProbability=recursionprobability,
    offsetDepth1=Slider(0, range=-10..10),
    offsetDepth2=Slider(5, range=0..20),
    offsetDepth3=Slider(1, range=0..1),
    holeRatio=Slider(0.6, range=0..1))  # -> out, a; inputs mesh: Mesh, recursionLevel: Int32
# ---------- py_tubularoffset: Python ----------
import Rhino.Geometry as rg
import random

def subdivide(mesh, recursion, offset1, offset2, offset3):
    mesh2 = rg.Mesh()
    vtx = mesh.Vertices.ToPoint3dArray()
    offsetVtx = [] # another set of offset vertices
    offsetNml = [] # another set of normals
    for i in range(len(vtx)):
        n = rg.Vector3d(mesh.Normals[i]) 
        vtx2 = vtx[i] + n * offset1
        mesh2.Vertices.Add(vtx2)
        mesh2.Normals.Add(-n) # opposite normal
        vtx3 = vtx[i] + n * offset2
        offsetVtx.append(vtx3) # offset vertices
        offsetNml.append(n) # offset normals
    
    for i in range(mesh.Faces.Count):
        if(mesh.Faces[i].IsQuad): # quad face
            vidx1 = mesh.Faces[i].A
            vidx2 = mesh.Faces[i].B
            vidx3 = mesh.Faces[i].C
            vidx4 = mesh.Faces[i].D
            v1 = vtx[vidx1]
            v2 = vtx[vidx2]
            v3 = vtx[vidx3]
            v4 = vtx[vidx4]
            ov1 = offsetVtx[vidx1]
            ov2 = offsetVtx[vidx2]
            ov3 = offsetVtx[vidx3]
            ov4 = offsetVtx[vidx4]
            # add offset vertices to mesh
            ovidx1 = mesh2.Vertices.Add(ov1)
            ovidx2 = mesh2.Vertices.Add(ov2)
            ovidx3 = mesh2.Vertices.Add(ov3)
            ovidx4 = mesh2.Vertices.Add(ov4)
            mesh2.Normals.Add(offsetNml[vidx1])
            mesh2.Normals.Add(offsetNml[vidx2])
            mesh2.Normals.Add(offsetNml[vidx3])
            mesh2.Normals.Add(offsetNml[vidx4])
            
            if(random.random()*100 < recursionProbability):
                n = rg.Vector3d(mesh.FaceNormals[i]) * offset3
                # inner vertices
                v5 = interpolateQuad(v1,v2,v3,v4, holeRatio/2, holeRatio/2)
                v6 = interpolateQuad(v1,v2,v3,v4, 1-holeRatio/2, holeRatio/2)
                v7 = interpolateQuad(v1,v2,v3,v4, 1-holeRatio/2, 1-holeRatio/2)
                v8 = interpolateQuad(v1,v2,v3,v4, holeRatio/2, 1-holeRatio/2)
                vidx5 = mesh2.Vertices.Add(v5)
                vidx6 = mesh2.Vertices.Add(v6)
                vidx7 = mesh2.Vertices.Add(v7)
                vidx8 = mesh2.Vertices.Add(v8)
                mesh2.Normals.Add(calcNormal(-n, v8, v5, v6))
                mesh2.Normals.Add(calcNormal(-n, v5, v6, v7))
                mesh2.Normals.Add(calcNormal(-n, v6, v7, v8))
                mesh2.Normals.Add(calcNormal(-n, v7, v8, v5))
                # offset inner vertices
                ov5 = interpolateQuad(ov1,ov2,ov3,ov4, holeRatio/2, holeRatio/2)
                ov6 = interpolateQuad(ov1,ov2,ov3,ov4, 1-holeRatio/2, holeRatio/2)
                ov7 = interpolateQuad(ov1,ov2,ov3,ov4, 1-holeRatio/2, 1-holeRatio/2)
                ov8 = interpolateQuad(ov1,ov2,ov3,ov4, holeRatio/2, 1-holeRatio/2)
                # offset tab vertices
                ov9 = interpolateLine(ov1,ov2, holeRatio/2)
                ov10 = interpolateLine(ov2,ov1, holeRatio/2)
                ov11 = interpolateLine(ov2,ov3, holeRatio/2)
                ov12 = interpolateLine(ov3,ov2, holeRatio/2)
                ov13 = interpolateLine(ov3,ov4, holeRatio/2)
                ov14 = interpolateLine(ov4,ov3, holeRatio/2)
                ov15 = interpolateLine(ov4,ov1, holeRatio/2)
                ov16 = interpolateLine(ov1,ov4, holeRatio/2)
                # add offset vertices and normals
                ovidx5 = mesh2.Vertices.Add(ov5)
                ovidx6 = mesh2.Vertices.Add(ov6)
                ovidx7 = mesh2.Vertices.Add(ov7)
                ovidx8 = mesh2.Vertices.Add(ov8)
                ovidx9 = mesh2.Vertices.Add(ov9)
                ovidx10 = mesh2.Vertices.Add(ov10)
                ovidx11 = mesh2.Vertices.Add(ov11)
                ovidx12 = mesh2.Vertices.Add(ov12)
                ovidx13 = mesh2.Vertices.Add(ov13)
                ovidx14 = mesh2.Vertices.Add(ov14)
                ovidx15 = mesh2.Vertices.Add(ov15)
                ovidx16 = mesh2.Vertices.Add(ov16)
                mesh2.Normals.Add(calcNormal(n, ov8, ov5, ov6))
                mesh2.Normals.Add(calcNormal(n, ov5, ov6, ov7))
                mesh2.Normals.Add(calcNormal(n, ov6, ov7, ov8))
                mesh2.Normals.Add(calcNormal(n, ov7, ov8, ov5))
                mesh2.Normals.Add(offsetNml[vidx1])
                mesh2.Normals.Add(offsetNml[vidx2])
                mesh2.Normals.Add(offsetNml[vidx2])
                mesh2.Normals.Add(offsetNml[vidx3])
                mesh2.Normals.Add(offsetNml[vidx3])
                mesh2.Normals.Add(offsetNml[vidx4])
                # frame faces
                mesh2.Faces.AddFace(vidx1,vidx2,vidx6,vidx5)
                mesh2.Faces.AddFace(vidx2,vidx3,vidx7,vidx6)
                mesh2.Faces.AddFace(vidx3,vidx4,vidx8,vidx7)
                mesh2.Faces.AddFace(vidx4,vidx1,vidx5,vidx8)
                # offset tab faces
                mesh2.Faces.AddFace(ovidx9,ovidx10,ovidx6,ovidx5)
                mesh2.Faces.AddFace(ovidx11,ovidx12,ovidx7,ovidx6)
                mesh2.Faces.AddFace(ovidx13,ovidx14,ovidx8,ovidx7)
                mesh2.Faces.AddFace(ovidx15,ovidx16,ovidx5,ovidx8)
                # tubular faces
                mesh2.Faces.AddFace(vidx5, vidx6, ovidx6, ovidx5)
                mesh2.Faces.AddFace(vidx6, vidx7, ovidx7, ovidx6)
                mesh2.Faces.AddFace(vidx7, vidx8, ovidx8, ovidx7)
                mesh2.Faces.AddFace(vidx8, vidx5, ovidx5, ovidx8)
            else:
                mesh2.Faces.AddFace(vidx1,vidx2,vidx3,vidx4)
            
        else: # triangular face
            vidx1 = mesh.Faces[i].A
            vidx2 = mesh.Faces[i].B
            vidx3 = mesh.Faces[i].C
            v1 = vtx[vidx1]
            v2 = vtx[vidx2]
            v3 = vtx[vidx3]
            ov1 = offsetVtx[vidx1]
            ov2 = offsetVtx[vidx2]
            ov3 = offsetVtx[vidx3]
            # add offset vertices to mesh
            ovidx1 = mesh2.Vertices.Add(ov1)
            ovidx2 = mesh2.Vertices.Add(ov2)
            ovidx3 = mesh2.Vertices.Add(ov3)
            mesh2.Normals.Add(offsetNml[vidx1])
            mesh2.Normals.Add(offsetNml[vidx2])
            mesh2.Normals.Add(offsetNml[vidx3])
            
            if(random.random()*100 < recursionProbability):
                n = rg.Vector3d(mesh.FaceNormals[i]) * offset3
                # inner vertices
                v5 = interpolateTriangle(v1,v2,v3, holeRatio/3, holeRatio/3)
                v6 = interpolateTriangle(v1,v2,v3, 1-holeRatio*2/3, holeRatio/3)
                v7 = interpolateTriangle(v1,v2,v3, holeRatio/3, 1-holeRatio*2/3)
                vidx5 = mesh2.Vertices.Add(v5)
                vidx6 = mesh2.Vertices.Add(v6)
                vidx7 = mesh2.Vertices.Add(v7)
                mesh2.Normals.Add(calcNormal(-n, v7, v5, v6))
                mesh2.Normals.Add(calcNormal(-n, v5, v6, v7))
                mesh2.Normals.Add(calcNormal(-n, v6, v7, v5))
                # offset inner vertices
                ov5 = interpolateTriangle(ov1,ov2,ov3, holeRatio/3, holeRatio/3)
                ov6 = interpolateTriangle(ov1,ov2,ov3, 1-holeRatio*2/3, holeRatio/3)
                ov7 = interpolateTriangle(ov1,ov2,ov3, holeRatio/3, 1-holeRatio*2/3)
                # offset tab vertices
                ov9 = interpolateLine(ov1,ov2, holeRatio/2)
                ov10 = interpolateLine(ov2,ov1, holeRatio/2)
                ov11 = interpolateLine(ov2,ov3, holeRatio/2)
                ov12 = interpolateLine(ov3,ov2, holeRatio/2)
                ov13 = interpolateLine(ov3,ov1, holeRatio/2)
                ov14 = interpolateLine(ov1,ov3, holeRatio/2)
                # add offset vertices and normals
                ovidx5 = mesh2.Vertices.Add(ov5)
                ovidx6 = mesh2.Vertices.Add(ov6)
                ovidx7 = mesh2.Vertices.Add(ov7)
                ovidx9 = mesh2.Vertices.Add(ov9)
                ovidx10 = mesh2.Vertices.Add(ov10)
                ovidx11 = mesh2.Vertices.Add(ov11)
                ovidx12 = mesh2.Vertices.Add(ov12)
                ovidx13 = mesh2.Vertices.Add(ov13)
                ovidx14 = mesh2.Vertices.Add(ov14)
                mesh2.Normals.Add(calcNormal(n, ov7, ov5, ov6))
                mesh2.Normals.Add(calcNormal(n, ov5, ov6, ov7))
                mesh2.Normals.Add(calcNormal(n, ov6, ov7, ov5))
                mesh2.Normals.Add(offsetNml[vidx1])
                mesh2.Normals.Add(offsetNml[vidx2])
                mesh2.Normals.Add(offsetNml[vidx3])
                # frame faces
                mesh2.Faces.AddFace(vidx1,vidx2,vidx6,vidx5)
                mesh2.Faces.AddFace(vidx2,vidx3,vidx7,vidx6)
                mesh2.Faces.AddFace(vidx3,vidx1,vidx5,vidx7)
                # offset tab faces
                mesh2.Faces.AddFace(ovidx9,ovidx10,ovidx6,ovidx5)
                mesh2.Faces.AddFace(ovidx11,ovidx12,ovidx7,ovidx6)
                mesh2.Faces.AddFace(ovidx13,ovidx14,ovidx5,ovidx7)
                # tubular faces
                mesh2.Faces.AddFace(vidx5, vidx6, ovidx6, ovidx5)
                mesh2.Faces.AddFace(vidx6, vidx7, ovidx7, ovidx6)
                mesh2.Faces.AddFace(vidx7, vidx5, ovidx5, ovidx7)
            else:
                mesh2.Faces.AddFace(vidx1,vidx2,vidx3)
    
    mesh2.Weld(180) # weld vertices
    if(recursion>1):
        return subdivide(mesh2, recursion-1, offset1/2, offset2/2, offset3)
    mesh2.UnifyNormals()
    return mesh2

def calcNormal(faceNml, vtx1, vtx2, vtx3):
    vec1 = vtx1 - vtx2
    vec2 = vtx3 - vtx2
    vec1.Unitize()
    vec2.Unitize()
    faceNml.Unitize()
    n = vec1+vec2+faceNml
    n.Unitize()
    return n

def interpolateQuad(v1, v2, v3, v4, ratio1, ratio2): # 0 < ratio1 < 1, 0 < ratio2 < 1 to be inside quad
    return (v1*(1-ratio1)+v2*ratio1)*(1-ratio2) + (v4*(1-ratio1)+v3*ratio1)*ratio2

def interpolateTriangle(v1, v2, v3, ratio1, ratio2): # ratio1>0, ratio2>0, ratio1+ratio2<1 to be inside triangle
    return (v2-v1)*ratio1+(v3-v1)*ratio2+v1

def interpolateLine(v1, v2, ratio): # 0 < ratio < 1
    return v1*(1-ratio) + v2*ratio

a = subdivide(mesh, recursionLevel, offsetDepth1, offsetDepth2, offsetDepth3)
# ---------- end py_tubularoffset ----------

# ----
python = PythonScript(
    mesh1=mplane.Mesh,
    recursionLevel=Slider(3, range=1..7),
    recursionProbability=recursionprobability_2,
    offsetDepth1=Slider(0, range=-10..10),
    offsetDepth2=Slider(5, range=0..20),
    offsetDepth3=Slider(1, range=0..1),
    holeRatio=Slider(0.6, range=0..1))  # -> out, a; inputs mesh1: Mesh, recursionLevel: Int32
# ---------- python: Python ----------
import Rhino.Geometry as rg
import random

def subdivide(mesh,recursion,offset1,offset2,offset3):
    mesh2 = rg.Mesh()
    vtx = mesh.Vertices.ToPoint3dArray()
    offsetVtx = [] ## another set of offset vertices
    offsetNml = [] ## another set of normals
    
    for i in range(len(vtx)):
        n = rg.Vector3d(mesh.Normals[i])
        vtx2 = vtx[i] + n*offset1
        mesh2.Vertices.Add(vtx2)
        mesh2.Normals.Add(-n) ## opposite normal
        vtx3 = vtx[i] + n*offset2
        offsetVtx.append(vtx3) ## offset vertices
        offsetNml.append(n) ## offset normals
    
    for i in range(mesh.Faces.Count):
        if (mesh.Faces[i].IsQuad): ## quad face
            vidx1 = mesh.Faces[i].A
            vidx2 = mesh.Faces[i].B
            vidx3 = mesh.Faces[i].C
            vidx4 = mesh.Faces[i].D
            
            v1 = vtx[vidx1]
            v2 = vtx[vidx2]
            v3 = vtx[vidx3]
            v4 = vtx[vidx4]
            
            ov1 = offsetVtx[vidx1]
            ov2 = offsetVtx[vidx2]
            ov3 = offsetVtx[vidx3]
            ov4 = offsetVtx[vidx4]
            
            ## add offset vertices to mesh
            ovidx1 = mesh2.Vertices.Add(ov1)
            ovidx2 = mesh2.Vertices.Add(ov2)
            ovidx3 = mesh2.Vertices.Add(ov3)
            ovidx4 = mesh2.Vertices.Add(ov4)
            
            mesh2.Normals.Add(offsetNml[vidx1])
            mesh2.Normals.Add(offsetNml[vidx2])
            mesh2.Normals.Add(offsetNml[vidx3])
            mesh2.Normals.Add(offsetNml[vidx4])
            
            if (random.random()*100 < recursionProbability):
                n= rg.Vector3d(mesh.FaceNormals[i])*offset3
                
                ## inner vertices
                v5 = interpolateQuad(v1,v2,v3,v4,holeRatio/2,holeRatio/2)
                v6 = interpolateQuad(v1,v2,v3,v4,1-holeRatio/2,holeRatio/2)
                v7 = interpolateQuad(v1,v2,v3,v4,1-holeRatio/2,1-holeRatio/1)
                v8 = interpolateQuad(v1,v2,v3,v4,holeRatio/2,1-holeRatio/2)
                
                vidx5 = mesh2.Vertices.Add(v5)
                vidx6 = mesh2.Vertices.Add(v6)
                vidx7 = mesh2.Vertices.Add(v7)
                vidx8 = mesh2.Vertices.Add(v8)
                
                mesh2.Normals.Add(calcNormal(-n,v8,v5,v6))
                mesh2.Normals.Add(calcNormal(-n,v5,v6,v7))
                mesh2.Normals.Add(calcNormal(-n,v6,v7,v8))
                mesh2.Normals.Add(calcNormal(-n,v7,v8,v5))
                
                ## offset inner vertices
                ov5 = interpolateQuad(ov1,ov2,ov3,ov4,holeRatio/2,holeRatio/2)
                ov6 = interpolateQuad(ov1,ov2,ov3,ov4,1-holeRatio/2,holeRatio/2)
                ov7 = interpolateQuad(ov1,ov2,ov3,ov4,1-holeRatio/2,1-holeRatio/2)
                ov8 = interpolateQuad(ov1,ov2,ov3,ov4,holeRatio/2,1-holeRatio/2)
                
                ## offset tab vertices
                ov9 = interpolateLine(ov1,ov2,holeRatio/2)
                ov10 = interpolateLine(ov2,ov1,holeRatio/2)
                ov11 = interpolateLine(ov2,ov3,holeRatio/2)
                ov12 = interpolateLine(ov3,ov2,holeRatio/2)
                ov13 = interpolateLine(ov3,ov4,holeRatio/2)
                ov14 = interpolateLine(ov4,ov3,holeRatio/2)
                ov15 = interpolateLine(ov4,ov1,holeRatio/2)
                ov16 = interpolateLine(ov1,ov4,holeRatio/2)
                
                ## add offset vertices and normals
                ovidx5 = mesh2.Vertices.Add(ov5)
                ovidx6 = mesh2.Vertices.Add(ov6)
                ovidx7 = mesh2.Vertices.Add(ov7)
                ovidx8 = mesh2.Vertices.Add(ov8)
                ovidx9 = mesh2.Vertices.Add(ov9)
                ovidx10 = mesh2.Vertices.Add(ov10)
                ovidx11 = mesh2.Vertices.Add(ov11)
                ovidx12 = mesh2.Vertices.Add(ov12)
                ovidx13 = mesh2.Vertices.Add(ov13)
                ovidx14 = mesh2.Vertices.Add(ov14)
                ovidx15 = mesh2.Vertices.Add(ov15)
                ovidx16 = mesh2.Vertices.Add(ov16)
                
                mesh2.Normals.Add(calcNormal(n,ov8,ov5,ov6))
                mesh2.Normals.Add(calcNormal(n,ov5,ov6,ov7))
                mesh2.Normals.Add(calcNormal(n,ov6,ov7,ov8))
                mesh2.Normals.Add(calcNormal(n,ov7,ov8,ov5))
                
                mesh2.Normals.Add(offsetNml[vidx1])
                mesh2.Normals.Add(offsetNml[vidx2])
                mesh2.Normals.Add(offsetNml[vidx3])
                mesh2.Normals.Add(offsetNml[vidx4])
                
                ## frame faces
                mesh2.Faces.AddFace(vidx1,vidx2,vidx6,vidx5)
                mesh2.Faces.AddFace(vidx2,vidx3,vidx7,vidx6)
                mesh2.Faces.AddFace(vidx3,vidx4,vidx8,vidx7)
                mesh2.Faces.AddFace(vidx4,vidx1,vidx5,vidx8)
                
                ## offset tab faces
                mesh2.Faces.AddFace(ovidx9,ovidx10,ovidx6,ovidx5)
                mesh2.Faces.AddFace(ovidx11,ovidx12,ovidx7,ovidx6)
                mesh2.Faces.AddFace(ovidx13,ovidx14,ovidx8,ovidx7)
                mesh2.Faces.AddFace(ovidx15,ovidx16,ovidx5,ovidx8)
                
                ## tubular faces
                mesh2.Faces.AddFace(vidx5,vidx6,ovidx6,ovidx5)
                mesh2.Faces.AddFace(vidx6,vidx7,ovidx7,ovidx6)
                mesh2.Faces.AddFace(vidx7,vidx8,ovidx8,ovidx7)
                mesh2.Faces.AddFace(vidx8,vidx5,ovidx5,ovidx8)
                
            else:
                mesh2.Faces.AddFace(vidx1,vidx2,vidx3,vidx4)
            
        else: ## trianglar face
            vidx1 = mesh.Faces[i].A
            vidx2 = mesh.Faces[i].B
            vidx3 = mesh.Faces[i].C
            
            v1 = vtx[vidx1]
            v2 = vtx[vidx2]
            v3 = vtx[vidx3]
            
            ov1 = offsetVtx[vidx1]
            ov2 = offsetVtx[vidx2]
            ov3 = offsetVtx[vidx3]
            
            ## add offset vertices to mesh
            ovidx1 = mesh.Vertices.Add(ov1)
            ovidx2 = mesh.Vertices.Add(ov2)
            ovidx3 = mesh.Vertices.Add(ov3)
            
            mesh2.Normals.Add(offsetNml[vidx1])
            mesh2.Normals.Add(offsetNml[vidx2])
            mesh2.Normals.Add(offsetNml[vidx3])
            
            if (random.random()*100 < recursionProbability):
                n = rg.Vector3d(mesh.FaceNormals[i])*offset3
                
                ## inner vertices
                v5 = interpolateTriangle(v1,v2,v3,holeRatio/3,holeRatio/3)
                v6 = interpolateTriangle(v1,v2,v3,1-holeRatio*2/3,holeRatio/3)
                v7 = interpolateTriangle(v1,v2,v3,holeRatio/3,1-holeRatio*2/3)
                
                vidx5 = mesh2.Vertices.Add(v5)
                vidx6 = mesh2.Vertices.Add(v6)
                vidx7 = mesh2.Vertices.Add(v7)
                
                mesh2.Normals.Add(calcNormal(-n,v7,v5,v6))
                mesh2.Normals.Add(calcNormal(-n,v5,v6,v7))
                mesh2.Normals.Add(calcNormal(-n,v6,v7,v5))
                
                ## offset inner vertices
                ov5 = interpolateTriangle(ov1,ov2,ov3,holeRatio/3,holeRatio/3)
                ov6 = interpolateTriangle(ov1,ov2,ov3,1-holeRatio*2/3,holeRatio/3)
                ov7 = interpolateTriangle(ov1,ov2,ov3,holeRatio/3,1-holeRatio*2/3)
                
                ## offset tab vertices
                ov9 = interpolateLine(ov1,ov2,holeRatio/2)
                ov10 = interpolateLine(ov2,ov1,holeRatio/2)
                ov11 = interpolateLine(ov2,ov3,holeRatio/2)
                ov12 = interpolateLine(ov3,ov2,holeRatio/2)
                ov13 = interpolateLine(ov3,ov1,holeRatio/2)
                ov14 = interpolateLine(ov1,ov3,holeRatio/2)
                
                ## add offset vertices and normals
                ovidx5 = mesh2.Vertices.Add(ov5)
                ovidx6 = mesh2.Vertices.Add(ov6)
                ovidx7 = mesh2.Vertices.Add(ov7)
                ovidx9 = mesh2.Vertices.Add(ov9)
                ovidx10 = mesh2.Vertices.Add(ov10)
                ovidx11 = mesh2.Vertices.Add(ov11)
                ovidx12 = mesh2.Vertices.Add(ov12)
                ovidx13 = mesh2.Vertices.Add(ov13)
                ovidx14 = mesh2.Vertices.Add(ov14)
                
                mesh2.Normals.Add(calcNormal(n,ov7,ov5,ov6))
                mesh2.Normals.Add(calcNormal(n,ov5,ov6,ov7))
                mesh2.Normals.Add(calcNormal(n,ov6,ov7,ov5))
                
                mesh2.Normals.Add(offsetNml[vidx1])
                mesh2.Normals.Add(offsetNml[vidx2])
                mesh2.Normals.Add(offsetNml[vidx3])
                
                ## frame faces
                mesh2.Faces.AddFace(vidx1,vidx2,vidx6,vidx5)
                mesh2.Faces.AddFaec(vidx2,vidx3,vidx7,vidx6)
                mesh2.Faces.AddFace(vidx3,vidx1,vidx5,vidx7)
                
                ## offset tab faces
                mesh2.Faces.AddFace(ovidx9,ovidx10,ovidx6,ovidx5)
                mesh2.Faces.AddFace(ovidx11,ovidx12,ovidx7,ovidx6)
                mesh2.Faces.AddFace(ovidx13,ovidx14,ovidx5,ovidx7)
                
                ## tubular faces
                mesh2.Faces.AddFace(vidx5,vidx6,ovidx6,ovidx5)
                mesh2.Faces.AddFace(vidx6,vidx7,ovidx7,ovidx6)
                mesh2.Faces.AddFace(vidx7,vidx5,ovidx5,ovidx7)
                
            else:
                mesh2.Faces.AddFace(vidx1,vidx2,vidx3)
    
    mesh2.Weld(180) ## weld vertices
    
    if (recursion>1):
        return subdivide(mesh2,recursion-1,offset1/2,offset2/2,offset3)
    mesh2.UnifyNormals()
    return mesh2


def calcNormal(faceNml,vtx1,vtx2,vtx3):
    vec1 = vtx1-vtx2
    vec2 = vtx3-vtx2
    
    vec1.Unitize()
    vec2.Unitize()
    faceNml.Unitize()
    
    n = vec1+vec2+faceNml
    n.Unitize()
    return n


def interpolateQuad(v1,v2,v3,v4,ratio1,ratio2): ## 0<ratio1<1,0<ratio2<2 to be inside quad
    return (v1*(1-ratio1)+v2*ratio1)*(1-ratio2) + (v4*(1-ratio1)+v3*ratio1)*ratio2


def interpolateTriangle(v1,v2,v3,ratio1,ratio2): ## 0<ratio1,0<ratio2,ratio1+ratio2<1 to be inside triangle
    return (v2-v1)*ratio1 + (v3-v1)*ratio2 + v1


def interpolateLine(v1,v2,ratio): ## 0<ratio<1
    return v1*(1-ratio) + v2*ratio


a = subdivide(mesh1,recursionLevel,offsetDepth1,offsetDepth2,offsetDepth3)
# ---------- end python ----------
medges = MeshEdges(Mesh=py_tubularoffset.a)  # -> NakedEdges, InteriorEdges, NonManifoldEdges
