# Grasshopper definition ss-07-22_LongEdgeSubdivision.gh (Grasshopper 0.9.76)
# plug-ins: Python Interpreter

mesh = Mesh(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)
number_slider = Slider(1.032, range=0..10)
number_slider_2 = Slider(4, range=1..6)

# ---- group: download
py_longedgesubd = PythonScript(mesh=mesh, recursionLevel=number_slider_2, maxEdgeLength=number_slider)  # -> out, a; inputs mesh: Mesh, recursionLevel: Int32
# ---------- py_longedgesubd: Python ----------
import Rhino.Geometry as rg

def subdivide(mesh, recursion, threshold):
    mesh2 = rg.Mesh()
    vtx = mesh.Vertices.ToPoint3dArray()
    mesh2.Vertices.AddVertices(vtx)
    for i in range(mesh.Faces.Count):
        if(mesh.Faces[i].IsQuad): # quad face
            vidx1 = mesh.Faces[i].A
            vidx2 = mesh.Faces[i].B
            vidx3 = mesh.Faces[i].C
            vidx4 = mesh.Faces[i].D
            v1 = vtx[vidx1]
            v2 = vtx[vidx2]
            v3 = vtx[vidx3]
            v4 = vtx[vidx4]
            widx1 = mesh2.Vertices.Add((v1+v2)/2) # mid point
            widx2 = mesh2.Vertices.Add((v2+v3)/2) # mid point
            widx3 = mesh2.Vertices.Add((v3+v4)/2) # mid point
            widx4 = mesh2.Vertices.Add((v4+v1)/2) # mid point
            widx5 = mesh2.Vertices.Add((v1+v2+v3+v4)/4) # center point
            dist12 = v1.DistanceTo(v2)
            dist23 = v2.DistanceTo(v3)
            dist34 = v3.DistanceTo(v4)
            dist41 = v4.DistanceTo(v1)
            if(dist12 > threshold and dist23>threshold and dist34 > threshold and dist41>threshold): # quad subdiv
                mesh2.Faces.AddFace(vidx1,widx1,widx5,widx4)
                mesh2.Faces.AddFace(vidx2,widx2,widx5,widx1)
                mesh2.Faces.AddFace(vidx3,widx3,widx5,widx2)
                mesh2.Faces.AddFace(vidx4,widx4,widx5,widx3)
            elif(dist12 > threshold and dist23 > threshold and dist34 > threshold): # 1 quad, 3 triangles
                mesh2.Faces.AddFace(vidx1,widx1,widx3,vidx4)
                mesh2.Faces.AddFace(widx1,vidx2,widx2)
                mesh2.Faces.AddFace(widx2,vidx3,widx3)
                mesh2.Faces.AddFace(widx1,widx2,widx3)
            elif(dist23 > threshold and dist34 > threshold and dist41 > threshold): # 1 quad, 3 triangles
                mesh2.Faces.AddFace(vidx2,widx2,widx4,vidx1)
                mesh2.Faces.AddFace(widx2,vidx3,widx3)
                mesh2.Faces.AddFace(widx3,vidx4,widx4)
                mesh2.Faces.AddFace(widx2,widx3,widx4)
            elif(dist34 > threshold and dist41 > threshold and dist12 > threshold): # 1 quad, 3 triangles
                mesh2.Faces.AddFace(vidx3,widx3,widx1,vidx2)
                mesh2.Faces.AddFace(widx3,vidx4,widx4)
                mesh2.Faces.AddFace(widx4,vidx1,widx1)
                mesh2.Faces.AddFace(widx3,widx4,widx1)
            elif(dist41 > threshold and dist12 > threshold and dist23 > threshold): # 1 quad, 3 triangles
                mesh2.Faces.AddFace(vidx4,widx4,widx2,vidx3)
                mesh2.Faces.AddFace(widx4,vidx1,widx1)
                mesh2.Faces.AddFace(widx1,vidx2,widx2)
                mesh2.Faces.AddFace(widx4,widx1,widx2)
            elif(dist12 > threshold and dist34 > threshold ): # 2 quads
                mesh2.Faces.AddFace(vidx1,widx1,widx3,vidx4)
                mesh2.Faces.AddFace(widx1,vidx2,vidx3,widx3)
            elif(dist23 > threshold and dist41 > threshold ): # 2 quads
                mesh2.Faces.AddFace(vidx1,vidx2,widx2,widx4)
                mesh2.Faces.AddFace(widx4,widx2,vidx3,vidx4)
            elif(dist12 > threshold and dist23 > threshold ): # 1 quad, 2 triangles
                mesh2.Faces.AddFace(vidx2,widx2,widx1)
                mesh2.Faces.AddFace(widx2,vidx3,vidx1,widx1)
                mesh2.Faces.AddFace(vidx3,vidx4,vidx1)
            elif(dist23 > threshold and dist34 > threshold ): # 1 quad, 2 triangles
                mesh2.Faces.AddFace(vidx3,widx3,widx2)
                mesh2.Faces.AddFace(widx3,vidx4,vidx2,widx2)
                mesh2.Faces.AddFace(vidx4,vidx1,vidx2)
            elif(dist34 > threshold and dist41 > threshold ): # 1 quad, 2 triangles
                mesh2.Faces.AddFace(vidx4,widx4,widx3)
                mesh2.Faces.AddFace(widx4,vidx1,vidx3,widx3)
                mesh2.Faces.AddFace(vidx1,vidx2,vidx3)
            elif(dist41 > threshold and dist12 > threshold ): # 1 quad, 2 triangles
                mesh2.Faces.AddFace(vidx1,widx1,widx4)
                mesh2.Faces.AddFace(widx1,vidx2,vidx4,widx4)
                mesh2.Faces.AddFace(vidx2,vidx3,vidx4)
            elif(dist12 > threshold): # 1 quad, 1 triangle
                mesh2.Faces.AddFace(vidx1,widx1,vidx3, vidx4)
                mesh2.Faces.AddFace(widx1,vidx2,vidx3)
            elif(dist23 > threshold): # 1 quad, 1 triangle
                mesh2.Faces.AddFace(vidx2,widx2,vidx4, vidx1)
                mesh2.Faces.AddFace(widx2,vidx3,vidx4)
            elif(dist34 > threshold): # 1 quad, 1 triangle
                mesh2.Faces.AddFace(vidx3,widx3,vidx1, vidx2)
                mesh2.Faces.AddFace(widx3,vidx4,vidx1)
            elif(dist41 > threshold): # 1 quad, 1 triangle
                mesh2.Faces.AddFace(vidx4,widx4,vidx2, vidx3)
                mesh2.Faces.AddFace(widx4,vidx1,vidx2)
            else:
                mesh2.Faces.AddFace(vidx1,vidx2,vidx3,vidx4)
            
        else: # triangular face
            vidx1 = mesh.Faces[i].A
            vidx2 = mesh.Faces[i].B
            vidx3 = mesh.Faces[i].C
            v1 = vtx[vidx1]
            v2 = vtx[vidx2]
            v3 = vtx[vidx3]
            widx1 = mesh2.Vertices.Add((v1+v2)/2) # mid point
            widx2 = mesh2.Vertices.Add((v2+v3)/2) # mid point
            widx3 = mesh2.Vertices.Add((v3+v1)/2) # mid point
            widx4 = mesh2.Vertices.Add((v1+v2+v3)/3) # center point
            dist12 = v1.DistanceTo(v2)
            dist23 = v2.DistanceTo(v3)
            dist31 = v3.DistanceTo(v1)
            if(dist12 > threshold and dist23>threshold and dist31 > threshold): # 3 quads 
                mesh2.Faces.AddFace(vidx1,widx1,widx4,widx3)
                mesh2.Faces.AddFace(vidx2,widx2,widx4,widx1)
                mesh2.Faces.AddFace(vidx3,widx3,widx4,widx2)
            elif(dist12 > threshold and dist23 > threshold): # 1 triangle, 1 quad
                mesh2.Faces.AddFace(vidx2,widx2,widx1)
                mesh2.Faces.AddFace(widx2,vidx3,vidx1,widx1)
            elif(dist23 > threshold and dist31 > threshold): # 1 triangle, 1 quad
                mesh2.Faces.AddFace(vidx3,widx3,widx2)
                mesh2.Faces.AddFace(widx3,vidx1,vidx2,widx2)
            elif(dist31 > threshold and dist12 > threshold): # 1 triangle, 1 quad
                mesh2.Faces.AddFace(vidx1,widx1,widx3)
                mesh2.Faces.AddFace(widx1,vidx2,vidx3,widx3)
                
            elif(dist12 > threshold): # 2 triangles 
                mesh2.Faces.AddFace(vidx1,widx1,vidx3)
                mesh2.Faces.AddFace(widx1,vidx2,vidx3)
                
            elif(dist23 > threshold): # 2 triangles 
                mesh2.Faces.AddFace(vidx2,widx2,vidx1)
                mesh2.Faces.AddFace(widx2,vidx3,vidx1)
                
            elif(dist31 > threshold): # 2 triangles 
                mesh2.Faces.AddFace(vidx3,widx3,vidx2)
                mesh2.Faces.AddFace(widx3,vidx1,vidx2)
            else:
                mesh2.Faces.AddFace(vidx1,vidx2,vidx3)
            
    mesh2.Normals.ComputeNormals()
    mesh2.Weld(180)
    if(recursion>1):
        return subdivide(mesh2, recursion-1, threshold)
    return mesh2

a = subdivide(mesh,recursionLevel,maxEdgeLength)
# ---------- end py_longedgesubd ----------

# ----
panel = Panel(py_longedgesubd.a)
python = PythonScript(mesh1=mesh, recursionLevel=number_slider_2, maxEdgeLength=number_slider)  # -> out, a; inputs mesh1: Mesh, recursionLevel: Int32
# ---------- python: Python ----------
import Rhino.Geometry as rg

def subdivide(mesh,recursion,threshold):
    mesh2 = rg.Mesh()
    vtx = mesh.Vertices.ToPoint3dArray()
    mesh2.Vertices.AddVertices(vtx)
    
    for i in range(mesh.Faces.Count):
        if(mesh.Faces[i].IsQuad): ## quad face
            vidx1 = mesh.Faces[i].A
            vidx2 = mesh.Faces[i].B
            vidx3 = mesh.Faces[i].C
            vidx4 = mesh.Faces[i].D
            
            v1 = vtx[vidx1]
            v2 = vtx[vidx2]
            v3 = vtx[vidx3]
            v4 = vtx[vidx4]
            
            widx1 = mesh2.Vertices.Add((v1+v2)/2) ## mid point
            widx2 = mesh2.Vertices.Add((v2+v3)/2) ## mid point
            widx3 = mesh2.Vertices.Add((v3+v4)/2) ## mid point
            widx4 = mesh2.Vertices.Add((v4+v1)/2) ## mid point
            widx5 = mesh2.Vertices.Add((v1+v2+v3+v4)/4) ## center point
            
            dist12 = v1.DistanceTo(v2)
            dist23 = v2.DistanceTo(v3)
            dist34 = v3.DistanceTo(v4)
            dist41 = v4.DistanceTo(v1)
            
            if ((dist12>threshold)and(dist23>threshold)and(dist34>threshold)and(dist41>threshold)): ## quad sbdivide
                mesh2.Faces.AddFace(vidx1,widx1,widx5,widx4)
                mesh2.Faces.AddFace(vidx2,widx2,widx5,widx1)
                mesh2.Faces.AddFace(vidx3,widx3,widx5,widx2)
                mesh2.Faces.AddFace(vidx4,widx4,widx5,widx3)
                
            elif((dist12>threshold)and(dist23>threshold)and(dist34>threshold)): ## 1 quad, 3 triangle
                mesh2.Faces.AddFace(vidx1,widx1,widx3,vidx4)
                mesh2.Faces.AddFace(widx1,vidx2,widx2)
                mesh2.Faces.AddFace(widx2,vidx3,widx3)
                mesh2.Faces.AddFace(widx1,widx2,widx3)
                
            elif((dist23>threshold)and(dist34>threshold)and(dist41>threshold)): ## 1 quad, 3 triangle
                mesh2.Faces.AddFace(vidx2,widx2,widx4,vidx1)
                mesh2.Faces.AddFace(widx2,vidx3,widx3)
                mesh2.Faces.AddFace(widx3,vidx4,widx4)
                mesh2.Faces.AddFace(widx2,widx3,widx4)
                
            elif((dist34>threshold)and(dist41>threshold)and(dist12>threshold)): ## 1 quad, 3 triangle
                mesh2.Faces.AddFace(vidx3,widx3,widx1,vidx2)
                mesh2.Faces.AddFace(widx3,vidx4,widx4)
                mesh2.Faces.AddFace(widx4,vidx1,widx1)
                mesh2.Faces.AddFace(widx3,widx4,widx1)
                
            elif((dist41>threshold)and(dist12>threshold)and(dist23>threshold)): ## 1 quad, 3triangle
                mesh2.Faces.AddFace(vidx4,widx4,widx2,vidx3)
                mesh2.Faces.AddFace(widx4,vidx1,widx1)
                mesh2.Faces.AddFace(widx1,vidx2,widx2)
                mesh2.Faces.AddFace(widx4,widx1,widx2)
                
            elif((dist12>threshold)and(dist34>threshold)): ## 2 quad
                mesh2.Faces.AddFace(vidx1,widx1,widx3,vidx4)
                mesh2.Faces.AddFace(widx1,vidx2,vidx3,widx3)
                
            elif((dist23>threshold)and(dist41>threshold)): ## 2 quad
                mesh2.Faces.AddFace(vidx1,vidx2,widx2,widx4)
                mesh2.Faces.AddFace(widx4,widx2,vidx3,vidx4)
                
            elif((dist12>threshold)and(dist23>threshold)): ## 1 quad, 2 triangle
                mesh2.Faces.AddFace(vidx2,widx2,widx1)
                mesh2.Faces.AddFace(widx2,vidx3,vidx1,widx1)
                mesh2.Faces.AddFace(vidx3,vidx4,vidx1)
                
            elif((dist23>threshold)and(dist34>threshold)): ## 1 quad, 2 triangle
                mesh2.Faces.AddFace(vidx3,widx3,widx2)
                mesh2.Faces.AddFace(widx3,vidx4,vidx2,widx2)
                mesh2.Faces.AddFace(vidx4,vidx1,vidx2)
                
            elif((dist34>threshold)and(dist41>threshold)): ## 1 quad, 2 triangle
                mesh2.Faces.AddFace(vidx4,widx4,widx3)
                mesh2.Faces.AddFace(widx4,vidx1,vidx3,widx3)
                mesh2.Faces.AddFace(vidx1,vidx2,vidx3)
                
            elif((dist41>threshold)and(dist12>threshold)): ## 1 quad, 2 triangle
                mesh2.Faces.AddFace(vidx1,widx1,widx4)
                mesh2.Faces.AddFace(widx1,vidx2,vidx4,widx4)
                mesh2.Faces.AddFace(vidx2,vidx3,vidx4)
                
            elif(dist12>threshold): ## 1 quad, 1 triangle
                mesh2.Faces.AddFace(vidx1,widx1,vidx3,vidx4)
                mesh2.Faces.AddFace(widx1,vidx2,vidx3)
                
            elif(dist23>threshold): ## 1 quad, 1 triangle
                mesh2.Faces.AddFace(vidx2,widx2,vidx4,vidx1)
                mesh2.Faces.AddFace(widx2,vidx3,vidx4)
                
            elif(dist34>threshold): ## 1 quad, 1 triangle
                mesh2.Faces.AddFace(vidx3,widx3,vidx1,vidx2)
                mesh2.Faces.AddFace(widx3,vidx4,vidx1)
                
            elif(dist41>threshold): ## 1 quad, 1 triangle
                mesh2.Faces.AddFace(vidx4,widx4,vidx2,vidx3)
                mesh2.Faces.AddFace(widx4,vidx1,vidx2)
                
            else:
                mesh2.Faces.AddFace(vidx1,vidx2,vidx3,vidx4)
                
        
        else: ## triangular face
            vidx1 = mesh.Faces[i].A
            vidx2 = mesh.Faces[i].B
            vidx3 = mesh.Faces[i].C
            
            v1 = vtx[vidx1]
            v2 = vtx[vidx2]
            v3 = vtx[vidx3]
            
            widx1 = mesh2.Vertices.Add((v1+v2)/2) ## mid point
            widx2 = mesh2.Vertices.Add((v2+v3)/2) ## mid point
            widx3 = mesh2.Vertices.Add((v3+v1)/2) ## mid point
            widx4 = mesh2.Vertices.Add((v1+v2+v3)/3) ## center point
            
            dist12 = v1.DistanceTo(v2)
            dist23 = v2.DistanceTo(v3)
            dist31 = v3.DistanceTo(v1)
            
            if((dist12>threshold)and(dist23>threshold)and(dist31>threshold)): ## 3 quad
                mesh2.Faces.AddFace(vidx1,widx1,widx4,widx3)
                mesh2.Faces.AddFace(vidx2,widx2,widx4,widx1)
                mesh2.Faces.AddFace(vidx3,widx3,widx4,widx2)
                
            elif((dist12>threshold)and(dist23>threshold)): ## 1 triangle, 1 quad
                mesh2.Faces.AddFace(vidx2,widx2,widx1)
                mesh2.Faces.AddFace(widx2,vidx3,vidx1,widx1)
                
            elif((dist23>threshold)and(dist31>threshold)): ## 1 triangle, 1 quad
                mesh2.Faces.AddFace(vidx3,widx3,widx2)
                mesh2.Faces.AddFace(widx3,vidx1,vidx2,widx2)
                
            elif((dist31>threshold)and(dist12>threshold)): ## 1 triangle, 1 quad
                mesh2.Faces.AddFace(vidx1,widx1,widx3)
                mesh2.Faces.AddFace(widx1,vidx2,vidx3,widx3)
                
            elif(dist12>threshold): ## 2 triangles
                mesh2.Faces.AddFace(vidx1,widx1,vidx3)
                mesh2.Faces.AddFace(widx1,vidx2,vidx3)
                
            elif(dist23>threshold): ## 2 triangles
                mesh2.Faces.AddFace(vidx2,widx2,vidx1)
                mesh2.Faces.AddFace(widx2,vidx3,vidx1)
                
            elif(dist31>threshold): ## 2 triangles
                mesh2.Faces.AddFace(vidx3,widx3,vidx2)
                mesh2.Faces.AddFace(widx3,vidx1,vidx2)
                
            else:
                mesh2.Faces.AddFace(vidx1,vidx2,vidx3)
            
            
    mesh2.Normals.ComputeNormals()
    mesh2.Weld(180)
    
    if (recursion>1):
        return subdivide(mesh2,recursion-1,threshold)
    return mesh2

a = subdivide(mesh1,recursionLevel,maxEdgeLength)
# ---------- end python ----------
panel_2 = Panel(python.a)
medges = MeshEdges(Mesh=py_longedgesubd.a)  # -> NakedEdges, InteriorEdges, NonManifoldEdges
