# Grasshopper definition ss-07-23_DispatchFacesRandomly  .gh (Grasshopper 0.9.76)
# plug-ins: Python Interpreter

number_slider = Slider(20, range=0..20)
mplane = MeshPlane(
    Boundary={Plane=PlaneXY(0, 0, 0), Size=Domain2(u=-10..10, v=-10..10)},
    WidthCount=number_slider,
    HeightCount=number_slider)  # -> Mesh, Area
tri = Triangulate(Mesh=mplane.Mesh)  # -> Mesh, Count
number_slider_2 = Slider(90, range=0..100)

# ---- group: download
py_randomfacedispatch = PythonScript(mesh=tri.Mesh, probability=number_slider_2)  # -> out, a, b; inputs mesh: Mesh
# ---------- py_randomfacedispatch: Python ----------
import Rhino.Geometry as rg
import random

def dispatch(mesh):
    mesh2 = rg.Mesh() # new mesh 
    mesh3 = rg.Mesh() # another new mesh
    
    vtx = mesh.Vertices.ToPoint3dArray()
    mesh2.Vertices.AddVertices(vtx)
    mesh3.Vertices.AddVertices(vtx)
    
    for i in range(mesh.Faces.Count):
        if random.random()*100 < probability:
            mesh2.Faces.AddFace(mesh.Faces[i])
        else:
            mesh3.Faces.AddFace(mesh.Faces[i])
    
    mesh2.Normals.ComputeNormals()
    mesh3.Normals.ComputeNormals()
    return [mesh2, mesh3]

[a, b] = dispatch(mesh)
# ---------- end py_randomfacedispatch ----------

# ----
python = PythonScript(mesh1=tri.Mesh, probability=number_slider_2)  # -> out, a, b; inputs mesh1: Mesh
# ---------- python: Python ----------
import Rhino.Geometry as rg
import random

def dispatch(mesh):
    mesh2 = rg.Mesh() ## new mesh
    mesh3 = rg.Mesh() ## another new mesh
    
    vtx = mesh.Vertices.ToPoint3dArray()
    
    mesh2.Vertices.AddVertices(vtx)
    mesh3.Vertices.AddVertices(vtx)
    
    for i in range(mesh.Faces.Count):
        
        if random.random()*100 < probability:
            mesh2.Faces.AddFace(mesh.Faces[i])
            
        else:
            mesh3.Faces.AddFace(mesh.Faces[i])
    
    mesh2.Normals.ComputeNormals()
    mesh3.Normals.ComputeNormals()
    return [mesh2,mesh3]

[a,b] = dispatch(mesh1)
# ---------- end python ----------
mesh = Mesh(py_randomfacedispatch.a)
mesh_2 = Mesh(py_randomfacedispatch.b)
mesh_3 = Mesh(python.a)
mesh_4 = Mesh(python.b)
preview = CustomPreview(Geometry=mesh_2, Shader="255,126,0,100")
preview_2 = CustomPreview(Geometry=mesh_4, Shader="255,255,0,100")
