# Grasshopper definition ss-07-24_DispatchFaceByAtract.gh (Grasshopper 0.9.76)
# plug-ins: Python Interpreter

number_slider = Slider(20, range=0..20)
mplane = MeshPlane(
    Boundary={Plane=PlaneXY(0, 0, 0), Size=Domain2(u=-10..10, v=-10..10)},
    WidthCount=number_slider,
    HeightCount=number_slider)  # -> Mesh, Area
tri = Triangulate(Mesh=mplane.Mesh)  # -> Mesh, Count
number_slider_2 = Slider(8, range=0..10)
pt = Point([Point(-7, -9, 0), Point(-4, 8, 0), Point(12, -1, 0)])
pt_2 = Point([Point(-7, -9, 0), Point(-4, 8, 0), Point(12, -1, 0)])

# ---- group: download
py_randomfacedispatch = PythonScript(mesh=tri.Mesh, attractors=pt, attractorRange=number_slider_2)  # -> out, a, b; inputs mesh: Mesh, attractors: list of Point3d
# ---------- py_randomfacedispatch: Python ----------
import rhinoscriptsyntax as rs
import Rhino.Geometry as rg

def dispatch(mesh):
    mesh2 = rg.Mesh() # new mesh 
    mesh3 = rg.Mesh() # another new mesh
    vtx = mesh.Vertices.ToPoint3dArray()
    mesh2.Vertices.AddVertices(vtx) # add all vertices
    mesh3.Vertices.AddVertices(vtx) # add all vertices
    
    for i in range(mesh.Faces.Count):
        if isAttractorInRange(faceCenter(mesh, mesh.Faces[i])):
            mesh2.Faces.AddFace(mesh.Faces[i])
        else:
            mesh3.Faces.AddFace(mesh.Faces[i])
    
    mesh2.Normals.ComputeNormals()
    mesh3.Normals.ComputeNormals()
    return [mesh2, mesh3]

def faceCenter(mesh, face):
    vtx = mesh.Vertices.ToPoint3dArray()
    if face.IsTriangle:
        return (vtx[face.A] + vtx[face.B] + vtx[face.C])/3 # center of 3 vertices
    return (vtx[face.A] + vtx[face.B] + vtx[face.C] + vtx[face.D])/4 # center of 4 vertices

def isAttractorInRange(pos): # check if any attractor is in range
    for attr in attractors: 
        dist = rs.Distance(pos, attr)
        if dist < attractorRange :
            return True
    return False # when out of range

[a, b] = dispatch(mesh)
# ---------- end py_randomfacedispatch ----------

# ----
python = PythonScript(mesh1=tri.Mesh, attractors=pt_2, attractorRange=number_slider_2)  # -> out, a, b; inputs mesh1: Mesh, attractors: list of Point3d
# ---------- python: Python ----------
import rhinoscriptsyntax as rs
import Rhino.Geometry as rg

def dispatch(mesh):
    mesh2 = rg.Mesh() ## new mesh
    mesh3 = rg.Mesh() ## another new mesh
    
    vtx = mesh.Vertices.ToPoint3dArray()
    
    mesh2.Vertices.AddVertices(vtx) ## add all vertices
    mesh3.Vertices.AddVertices(vtx) ## add allvvertices
    
    for i in range(mesh.Faces.Count):
        if isAttractorInRange(faceCenter(mesh,mesh.Faces[i])):
            mesh2.Faces.AddFace(mesh.Faces[i])
            
        else:
            mesh3.Faces.AddFace(mesh.Faces[i])
    
    mesh2.Normals.ComputeNormals()
    mesh3.Normals.ComputeNormals()
    
    return [mesh2,mesh3]

def faceCenter(mesh,face): ## calculate center point
    vtx = mesh.Vertices.ToPoint3dArray()
    
    if face.IsTriangle:
        return (vtx[face.A]+vtx[face.B]+vtx[face.C])/3 ## center of 3 vertices
        
    return (vtx[face.A]+vtx[face.B]+vtx[face.C]+vtx[face.D])/4 ## center of 4 vertices


def isAttractorInRange(pos): ## cheak if any attractor is in range
    for attr in attractors:
        dist = rs.Distance(pos,attr)
        
        if dist<attractorRange:
            return True
    
    return False ## when out of range


[a,b] = dispatch(mesh1)
# ---------- end python ----------
mesh = Mesh(py_randomfacedispatch.a)
mesh_2 = Mesh(py_randomfacedispatch.b)
mesh_3 = Mesh(python.a)
mesh_4 = Mesh(python.b)
preview = CustomPreview(Geometry=mesh, Shader="255,126,0,100")
preview_2 = CustomPreview(Geometry=mesh_2, Shader="255,255,0,100")
preview_3 = CustomPreview(Geometry=mesh_3, Shader="0,0,255,100")
preview_4 = CustomPreview(Geometry=mesh_4, Shader="0,255,0,100")
