# Grasshopper definition cs-HelloWorld.ghx (Grasshopper 0.9.76)

c_script = CSharpScript()  # -> out, A
# ---------- c_script: C# ----------
    string hello = "Hello World.\nHello cs.";
    A = hello;
# ---------- end c_script ----------
panel = Panel(c_script.A)
