# Grasshopper definition cpy-Boolean.ghx (Grasshopper 0.9.76)
# plug-ins: GH_CPython

gh_cpython = GH_CPython(input=Toggle(False))  # -> output; inputs input: list
# ---------- gh_cpython: Python ----------
# -*- coding: utf-8 -*-
""" 
Python Script
Created on  Thursday September 2018 10:00:35 
@author:  yoshioca 

[desc]
Description of the plugin Here
Write here any thing... 
[/desc]

ARGUMENTS:
----------
<inp> 
    _input :[required] - [type = int] - [default = None] 
    Descripe your input here 
        * bullet point.
        * bullet point
</inp>
<inp>
    Other inputs go here ...
</inp>

RETURN:
----------
    <out>
        output_ : indicate your output description here. \n refers to a new line.
    </out>

"""

if _input == True:
    output_ = "Hello True"

else:
    output_ = "Hello False"
# ---------- end gh_cpython ----------
panel = Panel(gh_cpython)
