# Grasshopper definition cpy-Hello.ghx (Grasshopper 0.9.76)
# plug-ins: GH_CPython

gh_cpython = GH_CPython()  # -> output
# ---------- gh_cpython: Python ----------
# -*- coding: utf-8 -*-
""" 
Python Script
Created on  Monday September 2018 03:34:16 
@author:  yoshioca 

[desc]
Description of the plugin Here
Write here any thing... 
[/desc]

ARGUMENTS:
----------
<inp> 
    _input :[required] - [type = int] - [default = None] 
    Descripe your input here 
        * bullet point.
        * bullet point
</inp>
<inp>
    Other inputs go here ...
</inp>

RETURN:
----------
    <out>
        output_ : indicate your output description here. \n refers to a new line.
    </out>

"""


output_ = "Hello World\nHello CPython"
# ---------- end gh_cpython ----------
panel = Panel(gh_cpython)
