# Grasshopper definition cpy-len.ghx (Grasshopper 0.9.76)
# plug-ins: GH_CPython

series = Series(Start=0, Step=1, Count=Slider(100, range=1..100))
gh_cpython = GH_CPython(input=series)  # -> output; inputs input: list
#   port input: [required] - [type = int] - [default = None] Descripe your input here * bullet point. * bullet point
#   port output: indicate your output description here. refers to a new line.
# ---------- gh_cpython: Python ----------
# -*- coding: utf-8 -*-

output_ = len(_input)
# ---------- end gh_cpython ----------
panel = Panel(gh_cpython)
