# Grasshopper definition use_my_packege.ghx (Grasshopper 1.0.7)

python = GhPythonScript()  # -> out, a
# ---------- python: Python ----------
from rhino_py_package import preset_color as pclr


print dir(pclr)

a = pclr.red()
# ---------- end python ----------
panel = Panel(python.a)
