# Grasshopper definition BoxMorph-01.ghx (Grasshopper 0.9.76)

number_slider = Slider(5, range=0..10)
srf = Surface(reparameterize(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))
geo = Geometry(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)
area = Area(Geometry=geo)  # -> Area, Centroid
divide = DivideDomain²(Domain=srf, UCount=number_slider, VCount=number_slider)
scale = Scale(Geometry=geo, Center=area.Centroid, Factor=Slider(3, range=0..10))  # -> Geometry, Transform
sbox = SurfaceBox(Surface=srf, Domain=divide, Height=Slider(30, range=0..30))
subsrf = Isotrim(Surface=srf, Domain=divide)
brep = Brep(sbox)
panel = Panel(subsrf)
morph = BoxMorph(Geometry=geo, Reference=geo, Target=sbox)
panel_2 = Panel(brep)
