# Grasshopper definition FabCafe-classB-1.ghx (Grasshopper 0.9.76)

# ---- group: 2_points
pt = Point([Point(27.76822183, 11.11479852, 0), Point(146.8259868, 132.7722309, 0)])

# ---- group: curve
crv = Curve(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)

# ----
pop2d = Populate2D(Region=crv, Count=100, Seed=1)
viewer = ParamViewer(pop2d)
voronoi = Voronoi(Points=pop2d, Boundary=crv, BruteForceOverride=False)
graft = GraftTree(Tree=pt, IncludeEmptyLists=True, IncludeNullItems=True)
boundary = BoundarySurfaces(Edges=voronoi)
dist = Distance(PointA=graft, PointB=pop2d)
min = Minimum(A=dist, B=Slider(89, range=0..100))
flip = FlipMatrix(Data=min)
ma = MassAddition(Input=flip)  # -> flatten(Result), PartialResults
viewer_2 = ParamViewer(ma.Result)
dom = ConstructDomain(DomainStart=Slider(100, range=0..100), DomainEnd=Slider(7, range=0..100))
bnd = Bounds(Numbers=ma.Result)
remap = RemapNumbers(Value=ma.Result, Source=bnd, Target=dom)  # -> Mapped, Clipped
Z = UnitZ(Factor=remap.Mapped)
dom_2 = ConstructDomain(DomainStart=Slider(1, range=0..1), DomainEnd=Slider(0, range=0..100))
extr = Extrude(Base=boundary, Direction=Z)
remap_2 = RemapNumbers(Value=ma.Result, Source=bnd, Target=dom_2)  # -> Mapped, Clipped
hsl = ColourHSL(Alpha=1, Hue=remap_2.Mapped, Saturation=1, Luminance=0.5)
preview = CustomPreview(Geometry=extr, Shader=hsl)
