# Grasshopper definition FabCafe-classB-2.ghx (Grasshopper 0.9.76)

number_slider = Slider(50, range=0..100)

# ---- group: multie-points
pt = Point([Point(155.6721876, 44.12779195, 0), Point(36.87629841, 32.26174224, 26.86064676), Point(42.76462436, 161, 0), Point(189, 219, 0)])

# ----
sqgrid = Square(Plane=PlaneXY(0, 0, 0), Size=Slider(5, range=0..10), ExtentX=number_slider, ExtentY=number_slider)  # -> Cells, Points
graft = GraftTree(Tree=pt, IncludeEmptyLists=True, IncludeNullItems=True)
addition = Addition(A=number_slider, B=Slider(1, range=0..1))
pt_2 = Point(sqgrid.Points)
flatten = FlattenTree(Tree=pt_2, Path="{0}")
dist = Distance(PointA=graft, PointB=flatten)
min = Minimum(A=dist, B=Slider(81, range=0..100))
flip = FlipMatrix(Data=min)
ma = MassAddition(Input=flip)  # -> flatten(Result), PartialResults
dom = ConstructDomain(DomainStart=Slider(57, range=0..100), DomainEnd=Slider(0, range=0..100))
bnd = Bounds(Numbers=ma.Result)
remap = RemapNumbers(Value=ma.Result, Source=bnd, Target=dom)  # -> Mapped, Clipped
dom_2 = ConstructDomain(DomainStart=Slider(1, range=0..1), DomainEnd=Slider(0, range=0..100))
Z = UnitZ(Factor=remap.Mapped)
remap_2 = RemapNumbers(Value=remap.Mapped, Source=dom, Target=dom_2)  # -> Mapped, Clipped
move = Move(Geometry=flatten, Motion=Z)  # -> Geometry, Transform
srfgrid = SurfaceFromPoints(Points=move.Geometry, UCount=addition, Interpolate=False)
hsl = ColourHSL(Alpha=1, Hue=remap_2.Mapped, Saturation=1, Luminance=0.5)
preview = CustomPreview(Geometry=move.Geometry, Shader=hsl)
