# Grasshopper definition FabCafe-classC-1.ghx (Grasshopper 0.9.76)
# plug-ins: MeshEdit Components

Y = UnitY(Factor=1)
pt = ConstructPoint(XCoordinate=0, YCoordinate=0, ZCoordinate=0)
line = LineSDL(Start=pt, Direction=Y, Length=Slider(200, range=0..200))
number_slider = Slider(20, range=0..20)
divide = DivideCurve(Curve=line, Count=Slider(49, range=1..100), Kinks=False)  # -> Points, Tangents, Parameters
lng = ListLength(List=divide.Points)
rad = Radians(Degrees=Slider(22, range=0..100))
series = Series(Start=0, Step=Slider(10, range=0..10), Count=number_slider)
series_2 = Series(Start=0, Step=rad, Count=lng)
graft = GraftTree(Tree=series, IncludeEmptyLists=True, IncludeNullItems=True)
sin = Sine(Value=series_2)
X = UnitX(Factor=graft)
multiplication = Multiplication(A=sin, B=Slider(18, range=0..100))
move = Move(Geometry=divide.Points, Motion=X)  # -> Geometry, Transform
rad_2 = Radians(Degrees=Slider(41, range=0..100))
lng_2 = ListLength(List=move.Geometry)
Z = UnitZ(Factor=multiplication)
move_2 = Move(Geometry=divide.Points, Motion=Z)  # -> Geometry, Transform
series_3 = Series(Start=0, Step=Slider(30, range=0..100), Count=number_slider)
graft_2 = GraftTree(Tree=series_3, IncludeEmptyLists=True, IncludeNullItems=True)
nurbs = NurbsCurve(Vertices=move_2.Geometry, Degree=Slider(3, range=0..10), Periodic=False)  # -> Curve, Length, Domain
series_4 = Series(Start=graft_2, Step=rad_2, Count=lng_2)
sin_2 = Sine(Value=series_4)
multiplication_2 = Multiplication(A=sin_2, B=Slider(23, range=1..100))
Z_2 = UnitZ(Factor=multiplication_2)
move_3 = Move(Geometry=move.Geometry, Motion=Z_2)  # -> Geometry, Transform
nurbs_2 = NurbsCurve(Vertices=move_3.Geometry, Degree=Slider(3, range=0..10), Periodic=False)  # -> Curve, Length, Domain
loft_opt = LoftOptions(Closed=False, Adjust=False, Rebuild=0, Refit=0, Type=Slider(2, range=0..5))
flatten = FlattenTree(Tree=nurbs_2.Curve, Path="{0}")
number_slider_2 = Slider(29, range=0..100)
loft = Loft(Curves=flatten, Options=loft_opt)
addition = Addition(A=number_slider_2, B=Slider(1, range=0..1))
sdivide = DivideSurface(Surface=loft, UCount=number_slider_2, VCount=number_slider_2)  # -> Points, Normals, Parameters
flatten_2 = FlattenTree(Tree=sdivide.Points, Path="{0}")
pdecon = Deconstruct(Point=flatten_2)  # -> XComponent, YComponent, ZComponent
panel = Panel(pdecon.ZComponent)
bnd = Bounds(Numbers=pdecon.XComponent)
bnd_2 = Bounds(Numbers=pdecon.YComponent)
bnd_3 = Bounds(Numbers=pdecon.ZComponent)
dom = ConstructDomain(DomainStart=Slider(0, range=0..100), DomainEnd=Slider(255, range=0..1000))
remap = RemapNumbers(Value=pdecon.XComponent, Source=bnd, Target=dom)  # -> Mapped, Clipped
remap_2 = RemapNumbers(Value=pdecon.YComponent, Source=bnd_2, Target=dom)  # -> Mapped, Clipped
remap_3 = RemapNumbers(Value=pdecon.ZComponent, Source=bnd_3, Target=dom)  # -> Mapped, Clipped
rgb = ColourRGB(Alpha=255, Red=remap.Mapped, Green=remap_2.Mapped, Blue=remap_3.Mapped)
frompoints = MeshFromPoints(Points=flatten_2, UDirection=addition, VDirection=addition, Colour=rgb)
