# Grasshopper definition FabCafe-classE-1.ghx (Grasshopper 0.9.76)
# plug-ins: Python Interpreter

panel = Panel("""Math
Basic""")
panel_2 = Panel("""Loap

Serise""")
panel_3 = Panel("If")
python = PythonScript(Number1=Slider(3, range=0..10), Number2=Slider(5, range=0..10))  # -> out, Result; inputs Number1: Int32, Number2: Int32
# ---------- python: Python ----------
Result=Number1 / Number2
# ---------- end python ----------
python_2 = PythonScript(x=Slider(10, range=0..10), y=Slider(50, range=0..100))  # -> out, a; inputs x: Int32, y: Int32
# ---------- python_2: Python ----------
myList=[]

for i in range(x):
    myList.append(i*y)
    
    a = myList
# ---------- end python_2 ----------
python_3 = PythonScript(x=Slider(5, range=0..10), y=Slider(6, range=0..10))  # -> out, a; inputs x: Int32, y: Int32
# ---------- python_3: Python ----------
if (x>y):
    a=True

## if (x<=y):
##    a=False

else:
    a=False
# ---------- end python_3 ----------
panel_4 = Panel(python_2.out)
panel_5 = Panel(python.out)
panel_6 = Panel(python_3.a)
panel_7 = Panel(python_3.out)
panel_8 = Panel(python_2.a)
panel_9 = Panel(python.Result)
