# Grasshopper definition Font-Wave.ghx (Grasshopper 0.9.76)

crv = Curve([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])
crv_2 = Curve([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])
crv_3 = Curve([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])
crv_4 = Curve([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])
number_slider = Slider(8, range=1..50)
number_slider_2 = Slider(5, range=1..10)
crv_5 = Curve([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])
number_slider_3 = Slider(6, range=1..10)
crv_6 = Curve([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])
len = Length(Curve=crv_5)
len_2 = Length(Curve=crv_6)
divlength = DivideLength(Curve=crv_2, Length=number_slider)  # -> Points, Tangents, Parameters
divlength_2 = DivideLength(Curve=crv_4, Length=number_slider)  # -> Points, Tangents, Parameters
divlength_3 = DivideLength(Curve=crv_3, Length=number_slider)  # -> Points, Tangents, Parameters
seed = Slider(100, range=0..100)
divlength_4 = DivideLength(Curve=crv, Length=number_slider)  # -> Points, Tangents, Parameters
number_slider_4 = Slider(62, range=1..100)
seed_2 = Slider(100, range=0..100)
number_slider_5 = Slider(2.1, range=0..4)
integer_division = IntegerDivision(A=len, B=Slider(7, range=1..30))
lng = ListLength(List=divlength.Points)
lng_2 = ListLength(List=divlength_4.Points)
lng_3 = ListLength(List=divlength_3.Points)
lng_4 = ListLength(List=divlength_2.Points)
integer_division_2 = IntegerDivision(A=len_2, B=Slider(5, range=1..30))
divide = DivideCurve(Curve=crv_2, Count=lng, Kinks=False)  # -> Points, Tangents, Parameters
divide_2 = DivideCurve(Curve=crv, Count=lng_2, Kinks=False)  # -> Points, Tangents, Parameters
divide_3 = DivideCurve(Curve=crv_3, Count=lng_3, Kinks=False)  # -> Points, Tangents, Parameters
divide_4 = DivideCurve(Curve=crv_4, Count=lng_4, Kinks=False)  # -> Points, Tangents, Parameters
neg = Negative(Value=number_slider_5)
divide_5 = DivideCurve(Curve=crv_5, Count=integer_division, Kinks=False)  # -> Points, Tangents, Parameters
neg_2 = Negative(Value=number_slider_2)
divide_6 = DivideCurve(Curve=crv_6, Count=integer_division_2, Kinks=False)  # -> Points, Tangents, Parameters
neg_3 = Negative(Value=number_slider_3)
dom = ConstructDomain(DomainStart=neg, DomainEnd=number_slider_5)
dom_2 = ConstructDomain(DomainStart=neg_2, DomainEnd=number_slider_2)
dom_3 = ConstructDomain(DomainStart=neg_3, DomainEnd=number_slider_3)
panel = Panel(divide_5.Points)
int = Integer(47)
panel_2 = Panel(divide_6.Points)
pdecon = Deconstruct(Point=divide.Points)  # -> XComponent, YComponent, ZComponent
pdecon_2 = Deconstruct(Point=divide_2.Points)  # -> XComponent, YComponent, ZComponent
pdecon_3 = Deconstruct(Point=divide_3.Points)  # -> XComponent, YComponent, ZComponent
pdecon_4 = Deconstruct(Point=divide_4.Points)  # -> XComponent, YComponent, ZComponent
lng_5 = ListLength(List=divide_5.Points)  # -> flatten(Length)
addition = Addition(A=seed, B=int)
random = Random(Range=dom, Number=lng, Seed=number_slider_4)
pdecon_5 = Deconstruct(Point=divide_5.Points)  # -> XComponent, YComponent, ZComponent
lng_6 = ListLength(List=divide_6.Points)  # -> flatten(Length)
random_2 = Random(Range=dom, Number=lng_2, Seed=number_slider_4)
random_3 = Random(Range=dom, Number=lng_3, Seed=number_slider_4)
random_4 = Random(Range=dom, Number=lng_4, Seed=number_slider_4)
group = Group(Objects=crv_5)
pdecon_6 = Deconstruct(Point=divide_6.Points)  # -> XComponent, YComponent, ZComponent
addition_2 = Addition(A=number_slider_4, B=Slider(8, range=0..10))
random_5 = Random(Range=dom, Number=lng, Seed=addition_2)
random_6 = Random(Range=dom, Number=lng_2, Seed=addition_2)
random_7 = Random(Range=dom, Number=lng_4, Seed=addition_2)
random_8 = Random(Range=dom, Number=lng_3, Seed=addition_2)
addition_3 = Addition(A=pdecon.XComponent, B=random)
addition_4 = Addition(A=pdecon.YComponent, B=random_5)
addition_5 = Addition(A=pdecon_2.XComponent, B=random_2)
addition_6 = Addition(A=pdecon_3.XComponent, B=random_3)
addition_7 = Addition(A=pdecon_2.YComponent, B=random_6)
addition_8 = Addition(A=pdecon_3.YComponent, B=random_8)
addition_9 = Addition(A=pdecon_4.XComponent, B=random_4)
addition_10 = Addition(A=pdecon_4.YComponent, B=random_7)
pt = ConstructPoint(XCoordinate=addition_3, YCoordinate=addition_4, ZCoordinate=pdecon.ZComponent)
pt_2 = ConstructPoint(XCoordinate=addition_5, YCoordinate=addition_7, ZCoordinate=pdecon_2.ZComponent)
random_9 = Random(Range=dom_2, Number=lng_5, Seed=seed)
random_10 = Random(Range=dom_2, Number=lng_5, Seed=addition)
pt_3 = ConstructPoint(XCoordinate=addition_6, YCoordinate=addition_8, ZCoordinate=pdecon_3.ZComponent)
pt_4 = ConstructPoint(XCoordinate=addition_9, YCoordinate=addition_10, ZCoordinate=pdecon_4.ZComponent)
random_11 = Random(Range=dom_3, Number=lng_6, Seed=seed_2)
panel_3 = Panel(random_10)
panel_4 = Panel(random_9)
panel_5 = Panel(random_11)
addition_11 = Addition(A=pdecon_5.XComponent, B=random_9)
addition_12 = Addition(A=pdecon_5.YComponent, B=random_10)
addition_13 = Addition(A=pdecon_6.XComponent, B=random_11)
addition_14 = Addition(A=pdecon_6.YComponent, B=random_11)
intcrv = Interpolate(Vertices=pt, Degree=3, Periodic=Toggle(True), KnotStyle=1)  # -> Curve, Length, Domain
intcrv_2 = Interpolate(Vertices=pt_3, Degree=3, Periodic=Toggle(False), KnotStyle=1)  # -> Curve, Length, Domain
pline = PolyLine(Vertices=pt_4, Closed=Toggle(True))
pline_2 = PolyLine(Vertices=pt_2, Closed=Toggle(False))
group_2 = Group(Objects=flatten(intcrv.Curve))
group_3 = Group(Objects=flatten(intcrv_2.Curve))
group_4 = Group(Objects=flatten(pline))
group_5 = Group(Objects=flatten(pline_2))
pt_5 = ConstructPoint(XCoordinate=addition_11, YCoordinate=addition_12, ZCoordinate=pdecon_5.ZComponent)
pt_6 = ConstructPoint(XCoordinate=addition_13, YCoordinate=addition_14, ZCoordinate=pdecon_6.ZComponent)
pline_3 = PolyLine(Vertices=pt_5, Closed=Toggle(True))
pline_4 = PolyLine(Vertices=pt_6, Closed=Toggle(True))
group_6 = Group(Objects=flatten(pline_3))
group_7 = Group(Objects=flatten(pline_4))
merge = Merge(Data1=group_6, Data2=group_7)
group_8 = Group(Objects=flatten(merge))
merge_2 = Merge(Data1=group, Data2=group_6, Data3=group_7, Data4=group_8, Data5=group_2, Data6=group_3, Data7=group_4, Data8=group_5)
lng_7 = ListLength(List=merge_2)
series = Series(Start=0, Step=Slider(80, range=0..100), Count=lng_7)
Y = UnitY(Factor=series)
move = Move(Geometry=merge_2, Motion=Y)  # -> Geometry, Transform
