# Grasshopper definition GH-vs-Python-vs-Cs-01.ghx (Grasshopper 0.9.76)
# plug-ins: Python Interpreter

number_slider = Slider(30, range=1..100)
series = Series(Start=0, Step=1, Count=number_slider)
Y = UnitY(Factor=series)
pt = ConstructPoint(XCoordinate=series, YCoordinate=0, ZCoordinate=0)  # -> graft(Point)
move = Move(Geometry=pt, Motion=Y)  # -> graft(Geometry), Transform
Z = UnitZ(Factor=series)
move_2 = Move(Geometry=move.Geometry, Motion=Z)  # -> flatten(Geometry), Transform
python = PythonScript(x=number_slider)  # -> out, a; inputs x: Int32
# ---------- python: Python ----------
import rhinoscriptsyntax as rs

a = []

for i in range(x):
    for j in range(x):
        for k in range(x):
            point = rs.AddPoint(i,j,k)
            a.append(point)
# ---------- end python ----------
c_script = CSharpScript(x=number_slider)  # -> out, A; inputs x: Int32
# ---------- c_script: C# ----------
    List<Point3d> pts = new List<Point3d>();

    for (int i = 0; i < x; i++){
      for (int j = 0; j < x; j++){
        for (int k = 0; k < x; k++){
          Point3d tempPt = new Point3d(i, j, k);
          pts.Add(tempPt);
        }
      }
    }
    
    A = pts;
# ---------- end c_script ----------
viewer = ParamViewer(move_2.Geometry)
viewer_2 = ParamViewer(python.a)
viewer_3 = ParamViewer(c_script.A)
panel = Panel(c_script.A)
