# Grasshopper definition Line-to-Bricks.ghx (Grasshopper 0.9.76)

pt = ConstructPoint(XCoordinate=0, YCoordinate=0, ZCoordinate=0)
number_slider = Slider(18, range=0..100)
_210 = Integer(210)
_30 = Integer(39)
series = Series(Start=0, Step=_30, Count=number_slider)
series_2 = Series(Start=0, Step=_210, Count=number_slider)
rad = Radians(Degrees=series)
X = UnitX(Factor=series_2)
sin = Sine(Value=rad)
move = Move(Geometry=pt, Motion=X)  # -> Geometry, Transform
multiplication = Multiplication(A=sin, B=Slider(300, range=0..1000))
Y = UnitY(Factor=multiplication)
move_2 = Move(Geometry=move.Geometry, Motion=Y)  # -> Geometry, Transform
intcrv = Interpolate(Vertices=move_2.Geometry, Degree=3, Periodic=False, KnotStyle=1)  # -> Curve, Length, Domain
_105 = Integer(105)
divlength = DivideLength(Curve=intcrv.Curve, Length=_105)  # -> Points, Tangents, Parameters
subtraction = Subtraction(A=_105, B=Slider(10, range=1..20))
pl = ConstructPlane(Origin=divlength.Points, XAxis=divlength.Tangents, YAxis=Vector(0, 1, 0))
_35 = Integer(35)
neg = Negative(Value=subtraction)
neg_2 = Negative(Value=_35)
dom = ConstructDomain(DomainStart=subtraction, DomainEnd=neg)
dom_2 = ConstructDomain(DomainStart=_35, DomainEnd=neg_2)
rectangle = Rectangle(Plane=pl, XSize=dom, YSize=dom_2, Radius=0)  # -> Rectangle, Length
dispatch = Dispatch(List=rectangle.Rectangle, DispatchPattern=[True, False])  # -> ListA, ListB
_50 = Integer(50)
_2 = Integer(2)
multiplication_2 = Multiplication(A=_50, B=_2)
series_3 = Series(Start=_50, Step=multiplication_2, Count=10)
series_4 = Series(Start=0, Step=multiplication_2, Count=10)
Z = UnitZ(Factor=series_3)
Z_2 = UnitZ(Factor=series_4)
graft = GraftTree(Tree=Z, IncludeEmptyLists=True, IncludeNullItems=True)
graft_2 = GraftTree(Tree=Z_2, IncludeEmptyLists=True, IncludeNullItems=True)
Z_3 = UnitZ(Factor=_50)
move_3 = Move(Geometry=dispatch.ListA, Motion=graft_2)  # -> Geometry, Transform
move_4 = Move(Geometry=dispatch.ListB, Motion=graft)  # -> Geometry, Transform
boundary = BoundarySurfaces(Edges=move_3.Geometry)
boundary_2 = BoundarySurfaces(Edges=move_4.Geometry)
extr = Extrude(Base=boundary, Direction=Z_3)
extr_2 = Extrude(Base=boundary_2, Direction=Z_3)
