# Grasshopper definition Mesh-Reconstruction.ghx (Grasshopper 0.9.76)
# plug-ins: MeshEdit Components

mesh = Mesh(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)
explode = MeshExplode(Mesh=mesh, Interpolate=False)
area = Area(Geometry=explode)  # -> Area, Centroid
sort = SortList(Keys=area.Area, ValuesA=explode)  # -> Keys, ValuesA
split = SplitList(List=sort.ValuesA, Index=Slider(400, range=0..1000))  # -> ListA, ListB
mesh_2 = Mesh(split.ListB)
area_2 = Area(Geometry=mesh_2)  # -> Area, Centroid
pdecon = Deconstruct(Point=area_2.Centroid)  # -> XComponent, YComponent, ZComponent
smaller = SmallerThan(FirstNumber=pdecon.YComponent, SecondNumber=Slider(0, range=0..100))  # -> SmallerThan, OrEqualTo
dispatch = Dispatch(List=mesh_2, DispatchPattern=smaller.SmallerThan)  # -> ListA, ListB
panel = Panel(smaller.SmallerThan)
mesh_3 = Mesh(dispatch.ListA)
mesh_4 = Mesh(dispatch.ListB)
facen = FaceNormals(Mesh=mesh_3)  # -> Centers, Normals
demesh = DeconstructMesh(Mesh=mesh_3)  # -> Vertices, Faces, Colours, Normals
facen_2 = FaceNormals(Mesh=mesh_4)  # -> Centers, Normals
demesh_2 = DeconstructMesh(Mesh=mesh_4)  # -> Vertices, Faces, Colours, Normals
unit = UnitVector(Vector=facen.Normals)
unit_2 = UnitVector(Vector=facen_2.Normals)
amp = Amplitude(Vector=unit, Amplitude=Slider(0.9, range=-8..8))
amp_2 = Amplitude(Vector=unit_2, Amplitude=Slider(-0.7, range=-8..8))
item = ListItem(List=demesh.Vertices, Index="0", Wrap=True)
item_2 = ListItem(List=demesh.Vertices, Index="1", Wrap=True)
item_3 = ListItem(List=demesh.Vertices, Index="2", Wrap=True)
item_4 = ListItem(List=demesh_2.Vertices, Index="0", Wrap=True)
item_5 = ListItem(List=demesh_2.Vertices, Index="1", Wrap=True)
item_6 = ListItem(List=demesh_2.Vertices, Index="2", Wrap=True)
move = Move(Geometry=facen.Centers, Motion=amp)  # -> Geometry, Transform
move_2 = Move(Geometry=facen_2.Centers, Motion=amp_2)  # -> Geometry, Transform
pt = Point(move.Geometry)
pt_2 = Point(move_2.Geometry)
merge = Merge(Data1=item, Data2=item_2, Data3=pt)
merge_2 = Merge(Data1=item_2, Data2=item_3, Data3=pt)
merge_3 = Merge(Data1=item_4, Data2=item_5, Data3=pt_2)
merge_4 = Merge(Data1=item_3, Data2=item, Data3=pt)
merge_5 = Merge(Data1=item_5, Data2=item_6, Data3=pt_2)
merge_6 = Merge(Data1=item_6, Data2=item_4, Data3=pt_2)
conmesh = ConstructMesh(Vertices=merge, Faces=demesh.Faces)
conmesh_2 = ConstructMesh(Vertices=merge_2, Faces=demesh.Faces)
conmesh_3 = ConstructMesh(Vertices=merge_4, Faces=demesh.Faces)
conmesh_4 = ConstructMesh(Vertices=merge_3, Faces=demesh_2.Faces)
conmesh_5 = ConstructMesh(Vertices=merge_5, Faces=demesh_2.Faces)
conmesh_6 = ConstructMesh(Vertices=merge_6, Faces=demesh_2.Faces)
mesh_5 = Mesh([conmesh, conmesh_2, conmesh_3])
mesh_6 = Mesh([conmesh_4, conmesh_5, conmesh_6])
merge_7 = Merge(Data1=split.ListA, Data2=mesh_5, Data3=mesh_6)
flatten = FlattenTree(Tree=merge_7, Path="{0}")
mjoin = MeshJoin(Meshes=flatten)
medges = MeshEdges(Mesh=mjoin)  # -> NakedEdges, InteriorEdges, NonManifoldEdges
