# Grasshopper definition Pattern-Ellipse-01.ghx (Grasshopper 0.9.76)

number_slider = Slider(22, range=2..70)
pi = Pi(Factor=1)
division = Division(A=pi, B=number_slider)
ellipse = Ellipse(Plane=PlaneXY(0, 0, 0), Radius1=Slider(1.7, range=0.1..3), Radius2=Slider(10, range=0..10))  # -> Ellipse, Focus1, Focus2
series = Series(Start=0, Step=division, Count=number_slider)
rotate = Rotate(Geometry=ellipse.Ellipse, Angle=series, Plane=PlaneXY(0, 0, 0))  # -> Geometry, Transform
crv = Curve(rotate.Geometry)
bbox = BoundingBox(Content=crv, Plane=PlaneXY(0, 0, 0), UnionBox=True)  # -> Box, Box_2
debox = DeconstructBox(Box=bbox.Box_2)  # -> Plane, X, Y, Z
dedomain = DeconstructDomain(Domain=debox.X)  # -> Start, End
subtraction = Subtraction(A=dedomain.Start, B=dedomain.End)
abs = Absolute(Value=subtraction)
multiplication = Multiplication(A=abs, B=Slider(0.91, range=0.75..1.25))
num = Number(multiplication)
series_2 = Series(Start=0, Step=num, Count=Slider(10, range=0..10))
X = UnitX(Factor=num)  # -> graft(UnitVector)
X_2 = UnitX(Factor=series_2)  # -> graft(UnitVector)
move = Move(Geometry=crv, Motion=X)  # -> Geometry, Transform
rotate_2 = Rotate(Geometry=move.Geometry, Angle="(1/3)*pi", Plane=PlaneXY(0, 0, 0))  # -> Geometry, Transform
move_2 = Move(Geometry=crv, Motion=X_2)  # -> graft(Geometry), Transform
move_3 = Move(Geometry=rotate_2.Geometry, Motion=X_2)  # -> graft(Geometry), Transform
