# Grasshopper definition Pattern-Honeycomb-01.ghx (Grasshopper 0.9.76)

# ---- group: UV Count
number_slider = Slider(9, range=0..10)
number_slider_2 = Slider(18, range=0..18)

# ---- group: その他-密度
number_slider_3 = Slider(0.954, range=0.949..1.1)
number_slider_4 = Slider(0.015, range=0.004..0.015)

# ---- group: 重心間-距離
number_slider_5 = Slider(1.1, range=1..3)

# ----
pi = Pi(Factor=1)
division = Division(A=pi, B="3")
series = Series(Start=0, Step=1, Count="6")
multiplication = Multiplication(A=division, B=series)
sin = Sine(Value=multiplication)
cos = Cosine(Value=multiplication)
pt = ConstructPoint(XCoordinate=cos, YCoordinate=sin, ZCoordinate=0)
rotate = Rotate(Geometry=pt, Angle=1.570796327, Plane=PlaneXY(0, 0, 0))  # -> Geometry, Transform
_5 = Integer(5)
_3 = Integer(3)
item = ListItem(List=rotate.Geometry, Index=_3, Wrap=True)
item_2 = ListItem(List=rotate.Geometry, Index=_5, Wrap=True)
vec2pt = Vector2Pt(PointA=item, PointB=item_2, Unitize=False)  # -> Vector, Length
pline = PolyLine(Vertices=rotate.Geometry, Closed=Toggle(True))
multiplication_2 = Multiplication(A=number_slider_5, B=vec2pt.Vector)
move = Move(Geometry=pline, Motion=multiplication_2)  # -> Geometry, Transform
area = Area(Geometry=pline)  # -> Area, Centroid
area_2 = Area(Geometry=move.Geometry)  # -> Area, Centroid
series_2 = Series(Start=0, Step=multiplication_2, Count=number_slider_2)
vec2pt_2 = Vector2Pt(PointA=area.Centroid, PointB=area_2.Centroid, Unitize=False)  # -> Vector, Length
X = UnitX(Factor=series_2)
merge = Merge(Data1=pline, Data2=move.Geometry)
devec = DeconstructVector(Vector=vec2pt_2.Vector)  # -> XComponent, YComponent, ZComponent
graft = GraftTree(Tree=X, IncludeEmptyLists=True, IncludeNullItems=True)
series_3 = Series(Start=number_slider_3, Step=number_slider_4, Count=number_slider_2)
move_2 = Move(Geometry=merge, Motion=graft)  # -> Geometry, Transform
graft_2 = GraftTree(Tree=series_3, IncludeEmptyLists=True, IncludeNullItems=True)
_2 = Integer(2)
area_3 = Area(Geometry=move_2.Geometry)  # -> Area, Centroid
multiplication_3 = Multiplication(A=devec.YComponent, B=_2)
series_4 = Series(Start=0, Step=multiplication_3, Count=number_slider)
scale = Scale(Geometry=move_2.Geometry, Center=area_3.Centroid, Factor=graft_2)  # -> Geometry, Transform
Y = UnitY(Factor=series_4)
flatten = FlattenTree(Tree=scale.Geometry, Path="{0}")
graft_3 = GraftTree(Tree=Y, IncludeEmptyLists=True, IncludeNullItems=True)
move_3 = Move(Geometry=flatten, Motion=graft_3)  # -> Geometry, Transform
