# Grasshopper definition Perlin-Slimplex-Noise.ghx (Grasshopper 0.9.76)
# plug-ins: MeshEdit Components, Python Interpreter, Noise 4D

number_slider = Slider(30, range=0..100)
series = Series(Start=0, Step=1, Count=number_slider)
Y = UnitY(Factor=series)  # -> graft(UnitVector)
pt = ConstructPoint(XCoordinate=series, YCoordinate=0, ZCoordinate=0)
python = PythonScript(x=number_slider, y=number_slider, scaleX=Slider(0.14, range=0..1), scaleY=Slider(0.23, range=0..1))  # -> out, a; inputs x: Int32, y: Int32
# ---------- python: Python ----------
import rhinoscriptsyntax as rs
import perlin

sn = perlin.SimplexNoise()

pList = []

for i in range(x):
    for j in range(y):
        
        perVal = sn.noise2(i*scaleX,j*scaleY)*2
        point = rs.AddPoint(i,j,perVal)
        pList.append(point)

a = pList
# ---------- end python ----------
move = Move(Geometry=pt, Motion=Y)  # -> flatten(Geometry), Transform
pdecon = Deconstruct(Point=python.a)  # -> XComponent, YComponent, ZComponent
gradient = Gradient(
    LowerLimit=0,
    UpperLimit=1,
    Parameter=pdecon.ZComponent,
    stops=[0: RGB(234, 38, 0), 0.25: RGB(234, 126, 0), 0.5: RGB(254, 244, 84), 0.75: RGB(173, 203, 249), 1: RGB(75, 107, 169)])
simplex = SimplexNoise(Values=move.Geometry, Time=Slider(1.22, range=0..3), Scale=Slider(1, range=0..10))
pdecon_2 = Deconstruct(Point=move.Geometry)  # -> XComponent, YComponent, ZComponent
pt_2 = ConstructPoint(XCoordinate=pdecon_2.XComponent, YCoordinate=pdecon_2.YComponent, ZCoordinate=simplex)
gradient_2 = Gradient(
    LowerLimit=0,
    UpperLimit=1,
    Parameter=simplex,
    stops=[0: RGB(234, 38, 0), 0.25: RGB(234, 126, 0), 0.5: RGB(254, 244, 84), 0.75: RGB(173, 203, 249), 1: RGB(75, 107, 169)])
frompoints = MeshFromPoints(Points=python.a, UDirection=number_slider, VDirection=number_slider, Colour=gradient)
srfgrid = SurfaceFromPoints(Points=pt_2, UCount=number_slider, Interpolate=number_slider)
frompoints_2 = MeshFromPoints(Points=pt_2, UDirection=number_slider, VDirection=number_slider, Colour=gradient_2)
bbox = BoundingBox(Content=srfgrid, Plane=PlaneXY(0, 0, 0))  # -> Box, Box_2
debrep = DeconstructBrep(Brep=bbox.Box)  # -> Faces, Edges, Vertices
pdecon_3 = Deconstruct(Point=debrep.Vertices)  # -> XComponent, YComponent, ZComponent
sort = SortList(Keys=pdecon_3.ZComponent, ValuesA=debrep.Vertices)  # -> Keys, ValuesA
item = ListItem(List=sort.ValuesA, Index=0, Wrap=True)
contour = Contour(Shape=srfgrid, Point=item, Direction=Vector(0, 0, 1), Distance=Slider(0.5, range=0..1))
