# Grasshopper definition Timer.ghx (Grasshopper 0.9.76)

# ---- group: toggle
timer = Timer(TimerInterval=20, Target=rec)  # disabled

# ----
rec = DataRecorder("0", DataLimit=-10, RecordData=True)
panel = Panel("""listlength

start 1""")
lng = ListLength(List=rec)
panel_2 = Panel(lng)
