# Grasshopper definition ghPython-Array-01.ghx (Grasshopper 0.9.76)
# plug-ins: Python Interpreter

number_slider = Slider(9, range=0..10)
number_slider_2 = Slider(4, range=0..10)
series = Series(Start=number_slider, Step="0", Count=number_slider_2)
random = Random(Range="0 to 10", Number="1", Seed=2)
random_2 = Random(Range="0 to 10", Number=Slider(6, range=1..20), Seed=2)
series_2 = Series(Start=number_slider, Step=1, Count=number_slider_2)
int = Integer(series)
lng = ListLength(List=random_2)
bnd = Bounds(Numbers=random)
bnd_2 = Bounds(Numbers=random_2)
random_3 = Random(Range="0 to 10", Number=int, Seed=series_2)
bnd_3 = Bounds(Numbers=flatten(random_3))
panel = Panel(bnd)
panel_2 = Panel(bnd_2)
python = PythonScript(x=random_2, y=lng)  # -> out, a; inputs x: list
# ---------- python: Python ----------
a = []

for i in range(y):
    
    if 0<=x[i] and x[i]<1:
        x[i] = 0

    elif 1<=x[i] and x[i]<2:
        x[i] = 1

    elif 2<=x[i] and x[i]<3:
        x[i] = 2

    elif 3<=x[i] and x[i]<4:
        x[i] = 3

    elif 4<=x[i] and x[i]<5:
        x[i] = 4

    elif 5<=x[i] and x[i]<6:
        x[i] = 5

    elif 6<=x[i] and x[i]<7:
        x[i] = 6

    elif 7<=x[i] and x[i]<8:
        x[i] = 7

    elif 8<=x[i] and x[i]<9:
        x[i] = 8

    elif 9<=x[i] and x[i]<=10:
        x[i] = 9

    a.append(x[i])
# ---------- end python ----------
python_2 = PythonScript(x=random)  # -> out, a
# ---------- python_2: Python ----------
a =[]

if 0<=x and x<1:
    x = 0

elif 1<=x and x<2:
    x = 1

elif 2<=x and x<3:
    x = 2

elif 3<=x and x<4:
    x = 3

elif 4<=x and x<5:
    x = 4

elif 5<=x and x<6:
    x = 5

elif 6<=x and x<7:
    x = 6

elif 7<=x and x<8:
    x = 7

elif 8<=x and x<9:
    x = 8

elif 9<=x and x<=10:
    x = 9

a.append(x)
# ---------- end python_2 ----------
panel_3 = Panel(random_2)
panel_4 = Panel(random)
lng_2 = ListLength(List=random_3)  # -> flatten(Length)
panel_5 = Panel(bnd_3)
item = ListItem(List=lng_2, Index=0, Wrap=True)
panel_6 = Panel(python_2.a)
panel_7 = Panel(python.a)
python_3 = PythonScript(x=random_3, y=item)  # -> out, a; inputs x: list; same code as python
panel_8 = Panel(random_3)
panel_9 = Panel(python_3.a)
