# Grasshopper definition imageSampler-03.ghx (Grasshopper 0.9.76)
# plug-ins: MeshEdit Components

number_slider = Slider(60, range=0..1000)
pt = ConstructPoint(XCoordinate=0, YCoordinate=0, ZCoordinate=0)
series = Series(Start=0, Step=Slider(10, range=0..1000), Count=number_slider)
Y = UnitY(Factor=series)
X = UnitX(Factor=series)
move = Move(Geometry=pt, Motion=X)  # -> Geometry, Transform
graft = GraftTree(Tree=move.Geometry, IncludeEmptyLists=True, IncludeNullItems=True)
move_2 = Move(Geometry=graft, Motion=Y)  # -> Geometry, Transform
flatten = FlattenTree(Tree=move_2.Geometry, Path="{0}")
pdecon = Deconstruct(Point=flatten)  # -> XComponent, YComponent, ZComponent
bnd = Bounds(Numbers=pdecon.XComponent)
bnd_2 = Bounds(Numbers=pdecon.YComponent)
remap = RemapNumbers(Value=pdecon.YComponent, Source=bnd_2, Target="0 to 1")  # -> Mapped, Clipped
remap_2 = RemapNumbers(Value=pdecon.XComponent, Source=bnd, Target="0 to 1")  # -> Mapped, Clipped
pt_2 = ConstructPoint(XCoordinate=remap_2.Mapped, YCoordinate=remap.Mapped, ZCoordinate=0)
image = ImageSampler(
    pt_2,
    FilePath="C:\Users\yoshioca\Documents\image-sampler\gray.jpg",
    Filter="Value",
    Interpolate=False,
    Umax=1,
    Umin=0,
    Vmax=1,
    Vmin=0,
    Wrap=1)
number_slider_2 = Slider(144, range=100..200)
multiplication = Multiplication(A=image, B=number_slider_2)
addition = Addition(A=number_slider_2, B=Slider(10, range=0..10))
Z = UnitZ(Factor=multiplication)
neg = Negative(Value=Z)
neg_2 = Negative(Value=addition)
pt_3 = ConstructPoint(XCoordinate=0, YCoordinate=0, ZCoordinate=neg_2)
move_3 = Move(Geometry=flatten, Motion=neg)  # -> Geometry, Transform
xy = XYPlane(Origin=pt_3)
addition_2 = Addition(A=addition, B=Slider(10, range=0..10))
srfgrid = SurfaceFromPoints(Points=move_3.Geometry, UCount=number_slider, Interpolate=False)
rectangle = Rectangle(Plane=xy, XSize=bnd, YSize=bnd_2, Radius=0)  # -> Rectangle, Length
boundary = BoundarySurfaces(Edges=rectangle.Rectangle)
Z_2 = UnitZ(Factor=addition_2)
extr = Extrude(Base=boundary, Direction=Z_2)
split = SplitBrep(Brep=extr, Cutter=srfgrid)
dispatch = Dispatch(List=split, DispatchPattern=[True, False])  # -> ListA, ListB
join = BrepJoin(Breps=[dispatch.ListA, srfgrid])  # -> Breps, Closed
number_slider_3 = Slider(30, range=0..100)
brep = Brep(join.Breps)
Y_2 = UnitY(Factor=1)
X_2 = UnitX(Factor=1)
number_slider_4 = Slider(10, range=0..10)
contour = Contour(Shape=brep, Point=pt_3, Direction=X_2, Distance=number_slider_3)
contour_2 = Contour(Shape=brep, Point=pt_3, Direction=Y_2, Distance=number_slider_3)
Z_3 = UnitZ(Factor=1)
pdecon_2 = Deconstruct(Point=move_3.Geometry)  # -> XComponent, YComponent, ZComponent
bnd_3 = Bounds(Numbers=pdecon_2.ZComponent)
number_slider_5 = Slider(7, range=0..10)
contour_3 = Contour(Shape=brep, Point=pt_3, Direction=Z_3, Distance=number_slider_4)
flatten_2 = FlattenTree(Tree=contour, Path="{0}")
flatten_3 = FlattenTree(Tree=contour_2, Path="{0}")
remap_3 = RemapNumbers(Value=pdecon_2.ZComponent, Source=bnd_3, Target="0 to 1")  # -> Mapped, Clipped
boundary_2 = BoundarySurfaces(Edges=flatten_2)
boundary_3 = BoundarySurfaces(Edges=flatten_3)
flatten_4 = FlattenTree(Tree=contour_3, Path="{0}")
Z_4 = UnitZ(Factor=number_slider_4)
gradient = Gradient(
    LowerLimit=0,
    UpperLimit=1,
    Parameter=remap_3.Mapped,
    stops=[0: RGB(0, 128, 0), 0.5: RGB(255, 255, 0), 1: RGB(255, 0, 0)])
boundary_4 = BoundarySurfaces(Edges=flatten_4)
X_3 = UnitX(Factor=number_slider_5)
Y_3 = UnitY(Factor=number_slider_5)
extr_2 = Extrude(Base=boundary_3, Direction=Y_3)
extr_3 = Extrude(Base=boundary_2, Direction=X_3)
extr_4 = Extrude(Base=boundary_4, Direction=Z_4)
merge = Merge(Data1=extr_3, Data2=extr_2)
frompoints = MeshFromPoints(Points=move_3.Geometry, UDirection=number_slider, VDirection=number_slider, Colour=gradient)

# ---- group: z
brep_2 = Brep(extr_4)

# ----
move_4 = Move(Geometry=frompoints, Motion="0,600,0")  # -> Geometry, Transform

# ---- group: xy
brep_3 = Brep(merge)
